# Grasshopper definition CellularAutomata.gh (Grasshopper 1.0.7)

number_slider = Slider(10, range=0..10)
number_slider_2 = Slider(1, range=0..1)
recgrid = Rectangular(Plane=PlaneXY(0, 0, 0), SizeX=number_slider_2, SizeY=number_slider_2, ExtentX=number_slider, ExtentY=number_slider)  # -> Cells, Points
area = Area(Geometry=recgrid.Cells, UseTasks=False)  # -> Area, Centroid
c_script = CSharpScript(ISize=area.Centroid)  # -> Out, CellularAutomata
