# Grasshopper definition ExportRevit.gh (Grasshopper 1.0.7)
# plug-ins: RhinoInside.Revit

crv = Curve([<curve referenced from the Rhino model> x69])
crv_2 = Curve([<curve referenced from the Rhino model> x371])
crv_3 = Curve([<curve referenced from the Rhino model> x477])
crv_4 = Curve([<curve referenced from the Rhino model> x474])
crv_5 = Curve([<curve referenced from the Rhino model> x1489])
crv_6 = Curve([<curve referenced from the Rhino model> x65])
bycurve = AddWallByCurve(Curve=crv_6)
bygeometry = AddDirectShapeByGeometry(Name="Tags", Geometry=crv_5)
