# Grasshopper definition FloorPlanGH.gh (Grasshopper 1.0.7)
# Copyright: All rights reserved
# plug-ins: CORE.GH, MeshEdit Components, treesloth01, SyntacticGHPlugIn, PTComponentLibrary, SpaceSyntaxDesign_GH

boolean_toggle = BooleanToggle(False)
read_excel_sheet = ReadExcelSheet(Run=boolean_toggle, Worksheet="1", Listen=boolean_toggle)  # -> UserMessages, Columns, Rows
text = Text(Tree({1}: ["Área de control vehicular - Vigilancia", "1", "1.5", "1.5", "1"], {2}: ["Parqueaderos vehicular (5,00 x 2,50 mts)", "5", "12.5", "62.5", "1"], {3}: ["Parqueaderos discapacitados (5,00 x 3,70 mts)", "1", "18.5", "18.5", "1"], {4}: ["Parqueaderos bicicletas/motos", "5", "1.2", "6", "1"], {5}: ["Zona de Parqueo ambulancias", "1", "11", "11", "1"], {6}: ["*", "*", "*", "*", ""]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))
panel = Panel("""0
1""")
panel_2 = Panel("""25
8
9
10""")
panel_3 = Panel("""6
25
3""")
panel_4 = Panel("""24
11
19
22""")
panel_5 = Panel("""17
18
19
24
23""")
panel_6 = Panel("""7
11
25""")
panel_7 = Panel("""8
9""")
partitiontreeatchar = CSharpScript(data=text, erase="*")  # -> A; inputs data: tree of String, erase: String
# ---------- partitiontreeatchar: C# ----------
    var treeOut = new DataTree<string>();
    int path = 0;

    for( int i = 0; i < data.BranchCount; ++i )
      for( int j = 0; j < data.Branch(i).Count; ++j )
      {

        if( data.Branch(i)[j] != erase )
        {

          treeOut.Add(data.Branch(i)[j], new GH_Path(path));
          //path++;

        }
        
        else
        {
        
          path++;
        
        }

      }

    A = treeOut;
# ---------- end partitiontreeatchar ----------
panel_8 = Panel("""25
10""")
panel_9 = Panel("""17
18
21
25
22""")
panel_10 = Panel("""12
13""")
panel_11 = Panel("""14
25""")
panel_12 = Panel("""23
24""")
panel_13 = Panel("""19
20
23
24""")
panel_14 = Panel("""17
18""")
panel_15 = Panel("""24
4
25""")
panel_16 = Panel("""25
20""")
panel_17 = Panel("""24
25
21""")
cleantreefromempty = CSharpScript(data=partitiontreeatchar)  # -> A; inputs data: tree of String
# ---------- cleantreefromempty: C# ----------
    var treeOut = new DataTree<string>();

    foreach( var path in data.Paths )
    {
    
      var branch = data.Branch(path);
      
      foreach( var item in branch )
      {
      
        if( !String.IsNullOrEmpty(item) )
        treeOut.Add( item, path );
      
      }
    
    }

    A = treeOut;
# ---------- end cleantreefromempty ----------
renumber_paths = RenumberPaths(Data=cleantreefromempty)
panel_18 = Panel(renumber_paths)
cullbranchesfromindex = CSharpScript(branches=renumber_paths, cullFrom=Slider(4, range=0..10))  # -> out, treeOut; inputs branches: tree of String, cullFrom: Int32
# ---------- cullbranchesfromindex: C# ----------
    var newTree = new DataTree<string>();

    for( int i = 0; i < branches.BranchCount; ++i )
    {

      var path = branches.Path(i);

      if( path.Indices[0] >= cullFrom )

        newTree.AddRange(branches.Branch(i), path);

    }

    treeOut = newTree;
# ---------- end cullbranchesfromindex ----------
panel_19 = Panel(cullbranchesfromindex.treeOut)
renumber_paths_2 = RenumberPaths(Data=cullbranchesfromindex.treeOut)
partition_list = PartitionList(List=renumber_paths_2, Size=Slider(5, range=0..10))
text_2 = Text(partition_list)

# ---- group: lables
list_item = ListItem(List=text_2, Index=Slider(0, range=0..3), Wrap=True)
panel_20 = Panel("""Cirugía
Unidades Niños
Circulación""")
path_mapper = PathMapper(list_item, source="{A;B}", target="{A}")
flatten = FlattenTree(Tree=path_mapper, Path="{0}")
merge = Merge(Data1=flatten, Data2=panel_20)
panel_21 = Panel(merge)

# ----
panel_22 = Panel(text_2)

# ---- group: points
point = Point([<point referenced from the Rhino model> x23])
pt = Point([<point referenced from the Rhino model> x3])
point_2 = Point(flatten(point))
merge_2 = Merge(Data1=point_2, Data2=pt)
text_tag = TextTag(Location=merge_2, Text=flatten(merge))

# ----
pt_2 = Point(merge_2)
item = ListItem(List=pt_2, Index=panel, Wrap=True)
item_2 = ListItem(List=pt_2, Index=panel_2, Wrap=True)
item_3 = ListItem(List=pt_2, Index="2", Wrap=True)
item_4 = ListItem(List=pt_2, Index=panel_3, Wrap=True)
item_5 = ListItem(List=pt_2, Index="3", Wrap=True)
item_6 = ListItem(List=pt_2, Index="22", Wrap=True)
item_7 = ListItem(List=pt_2, Index="4", Wrap=True)
item_8 = ListItem(List=pt_2, Index=panel_4, Wrap=True)
item_9 = ListItem(List=pt_2, Index="5", Wrap=True)
item_10 = ListItem(List=pt_2, Index=panel_5, Wrap=True)
item_11 = ListItem(List=pt_2, Index="6", Wrap=True)
item_12 = ListItem(List=pt_2, Index=panel_6, Wrap=True)
item_13 = ListItem(List=pt_2, Index="7", Wrap=True)
item_14 = ListItem(List=pt_2, Index="11", Wrap=True)
item_15 = ListItem(List=pt_2, Index=panel_7, Wrap=True)
item_16 = ListItem(List=pt_2, Index=panel_8, Wrap=True)
item_17 = ListItem(List=pt_2, Index="10", Wrap=True)
item_18 = ListItem(List=pt_2, Index="11", Wrap=True)
item_19 = ListItem(List=pt_2, Index="25", Wrap=True)
item_20 = ListItem(List=pt_2, Index=panel_9, Wrap=True)
item_21 = ListItem(List=pt_2, Index=panel_10, Wrap=True)
item_22 = ListItem(List=pt_2, Index=panel_11, Wrap=True)
item_23 = ListItem(List=pt_2, Index="14", Wrap=True)
item_24 = ListItem(List=pt_2, Index="20", Wrap=True)
item_25 = ListItem(List=pt_2, Index="25", Wrap=True)
item_26 = ListItem(List=pt_2, Index=panel_12, Wrap=True)
item_27 = ListItem(List=pt_2, Index="21", Wrap=True)
item_28 = ListItem(List=pt_2, Index="25", Wrap=True)
item_29 = ListItem(List=pt_2, Index="15", Wrap=True)
item_30 = ListItem(List=pt_2, Index="16", Wrap=True)
item_31 = ListItem(List=pt_2, Index="25", Wrap=True)
item_32 = ListItem(List=pt_2, Index=panel_13, Wrap=True)
item_33 = ListItem(List=pt_2, Index="22", Wrap=True)
item_34 = ListItem(List=pt_2, Index=panel_15, Wrap=True)
item_35 = ListItem(List=pt_2, Index="23", Wrap=True)
item_36 = ListItem(List=pt_2, Index="19", Wrap=True)
item_37 = ListItem(List=pt_2, Index="25", Wrap=True)
item_38 = ListItem(List=pt_2, Index=panel_16, Wrap=True)
item_39 = ListItem(List=pt_2, Index=panel_14, Wrap=True)
item_40 = ListItem(List=pt_2, Index=panel_17, Wrap=True)
item_41 = ListItem(List=pt_2, Index="24", Wrap=True)
item_42 = ListItem(List=pt_2, Index="25", Wrap=True)
ln = Line(StartPoint=item, EndPoint=item_2)
ln_2 = Line(StartPoint=item_3, EndPoint=item_4)
ln_3 = Line(StartPoint=item_5, EndPoint=item_6)
ln_4 = Line(StartPoint=item_7, EndPoint=item_8)
ln_5 = Line(StartPoint=item_9, EndPoint=item_10)
ln_6 = Line(StartPoint=item_11, EndPoint=item_12)
ln_7 = Line(StartPoint=item_13, EndPoint=item_14)
ln_8 = Line(StartPoint=item_15, EndPoint=item_16)
ln_9 = Line(StartPoint=item_17, EndPoint=item_19)
ln_10 = Line(StartPoint=item_18, EndPoint=item_20)
ln_11 = Line(StartPoint=item_21, EndPoint=item_22)
ln_12 = Line(StartPoint=item_23, EndPoint=item_25)
ln_13 = Line(StartPoint=item_24, EndPoint=item_26)
ln_14 = Line(StartPoint=item_27, EndPoint=item_28)
ln_15 = Line(StartPoint=item_29, EndPoint=item_31)
ln_16 = Line(StartPoint=item_30, EndPoint=item_32)
ln_17 = Line(StartPoint=item_33, EndPoint=item_34)
ln_18 = Line(StartPoint=item_35, EndPoint=item_37)
ln_19 = Line(StartPoint=item_36, EndPoint=item_38)
ln_20 = Line(StartPoint=item_39, EndPoint=item_40)
ln_21 = Line(StartPoint=item_41, EndPoint=item_42)
panel_23 = Panel(ln)
panel_24 = Panel(ln_2)
panel_25 = Panel(ln_3)
panel_26 = Panel(ln_4)
panel_27 = Panel(ln_5)
panel_28 = Panel(ln_6)
panel_29 = Panel(ln_7)
panel_30 = Panel(ln_8)
panel_31 = Panel(ln_9)
panel_32 = Panel(ln_10)
panel_33 = Panel(ln_11)
panel_34 = Panel(ln_12)
panel_35 = Panel(ln_13)
panel_36 = Panel(ln_14)
panel_37 = Panel(ln_15)
panel_38 = Panel(ln_16)
panel_39 = Panel(ln_17)
panel_40 = Panel(ln_19)
panel_41 = Panel(ln_20)
panel_42 = Panel(ln_18)
panel_43 = Panel(ln_21)
merge_3 = Merge(
    Data1=ln,
    Data2=ln_2,
    Data3=ln_3,
    Data4=ln_4,
    Data5=ln_5,
    Data6=ln_6,
    Data7=ln_7,
    Data8=ln_8,
    Data9=ln_9,
    Data10=ln_10,
    Data11=ln_11,
    Data12=ln_12,
    Data13=ln_15,
    Data14=ln_16,
    Data15=ln_20,
    Data16=ln_19,
    Data17=ln_13,
    Data18=ln_14,
    Data19=ln_17,
    Data20=ln_18,
    Data21=ln_21)
geo = Geometry(merge_3)
points = PointList(Points=merge_2, Size=Slider(1.73, range=0..10))
list_item_2 = ListItem(List=text_2, Index=Slider(2, range=0..3), Wrap=True)
list_item_3 = ListItem(List=text_2, Index=Slider(3, range=0..3), Wrap=True)
path_mapper_2 = PathMapper(list_item_3, source="{A;B}", target="{A}")
list_item_4 = ListItem(List=text_2, Index=Slider(1, range=0..1), Wrap=True)
point_3 = Point([<point referenced from the Rhino model> x8])  # disabled
point_4 = Point([<point referenced from the Rhino model> x3])  # disabled
point_5 = Point([<point referenced from the Rhino model> x2])  # disabled
point_6 = Point([<point referenced from the Rhino model> x2])  # disabled
point_7 = Point([<point referenced from the Rhino model> x7])  # disabled
flatten_tree = FlattenTree(Tree=list_item_3, Path="{0}")
path_mapper_3 = PathMapper(list_item_2, source="{A;B}", target="{A}")
mass_addition = MassAddition(Input=flatten(path_mapper_2))  # -> Result, PartialResults
graphfromnodes_links = GraphFromNodesLinks(Points=merge_2, Links=geo, Labels=flatten(merge), Areas=flatten(path_mapper_2), TotalArea=mass_addition.Result)  # -> Graph, GraphVertices, Attributes
rectangle = Rectangle({Plane=PlaneXY(13.57608417, 19.21431116, 0), Size=Domain2(u=-9.933782594..9.933782594, v=-10.67616492..10.67616492)})
c_script = CSharpScript(x=point_5, y=point_6, z=point_3, u=point_7, v=point_4)  # -> A; inputs x: list of Point3d, y: list of Point3d, z: list of Point3d, u: list of Point3d, v: list of Point3d; disabled
# ---------- c_script: C# ----------
    var dataTree = new DataTree<Point3d>();

    dataTree.AddRange(x, new GH_Path(4));
    dataTree.AddRange(y, new GH_Path(5));
    dataTree.AddRange(z, new GH_Path(6));
    dataTree.AddRange(u, new GH_Path(7));
    dataTree.AddRange(v, new GH_Path(8));

    A = dataTree;
# ---------- end c_script ----------
mass_addition_2 = MassAddition(Input=flatten_tree)  # -> Result, PartialResults
multiplication = Multiplication(A=path_mapper_3, B=0.5)
path_mapper_4 = PathMapper(list_item_4, source="{A;B}", target="{A}")
planar_grid = PlanarGrid(
    BasePoint=Point(0, 0, 0),
    IDir=Vector(1, 0, 0),
    JDir=Vector(0, 1, 0),
    IDistance=1,
    JDistance=1.5,
    INumber=Slider(7, range=0..10),
    JNumber=Slider(5, range=0..10))
populate_2d = Populate2D(Region={Plane=PlaneXY(0, 0, 0), Size=Domain2(u=0..20, v=0..10)}, Count=Slider(22, range=0..100), Seed=1)
rectangle_2 = Rectangle(Plane=PlaneXY(0, 0, 0), XSize=Domain(-1, 1), YSize=Domain(-2, 2), Radius=0)  # -> Rectangle, Length
number_slider = Slider(0.24, range=0..1)
square_grid = SquareGrid(Grid=populate_2d)  # -> Grid, RowNumber, ColumnNumber
square_root = SquareRoot(Value=mass_addition_2.Result)
random_attraction = RandomAttraction(Grid=planar_grid, Magnitude=Slider(0.6929, range=0..1))  # -> Grid, Weights
gene_pool = GenePool(
    Decimals=2,
    Maximum=1,
    Minimum=0,
    Value=[0.5878188622, 0.2367880937, 0.382258393, 0.9419500939, 0.4284249462, 0.2649959234, 0.1646871102, 0.3171454148, 0.1894171462, 0.1202720367, 0.35679831, 0.6054385764, 0.9458294362, 0.3391076356, 0.3315119717, 0.3514538777, 0.05791166008, 0.496464716, 0.318861575, 0.8718206644, 0.4285088863, 0.8905659103, 0.6926039293])
gene_pool_2 = GenePool(
    Decimals=2,
    Maximum=1,
    Minimum=0,
    Value=[0.02730343306, 0.8153460216, 0.2798694336, 0.08380946661, 0.5245274685, 0.6769896251, 0.1536655152, 0.8170668282, 0.5288605837, 0.8659769375, 0.4738685738, 0.05786544134, 0.2961652536, 0.9137421865, 0.9814048242, 0.6231701763, 0.7174155846, 0.7152661996, 0.5312196606, 0.483716225, 0.07093745986, 0.8352242489, 0.6905273728])
mass_addition_3 = MassAddition(Input=path_mapper_4)  # -> Result, PartialResults
branchcount = CSharpScript(x=path_mapper_4)  # -> A; inputs x: tree of String
# ---------- branchcount: C# ----------
    A = x.BranchCount;
# ---------- end branchcount ----------
multiplication_2 = Multiplication(A=square_root, B=0.5)
curve = Curve(<curve referenced from the Rhino model>)
surface = Surface(curve)
morph_2d = Morph2D(Grid=random_attraction.Grid, PatternCurves=rectangle_2.Rectangle, Shift_i=1, Shift_j=1)
multiplication_3 = Multiplication(A=number_slider, B=Slider(1.5, range=0..10))
construct_domain = ConstructDomain(DomainStart=expr("-x", multiplication), DomainEnd=multiplication)
populate_geometry = PopulateGeometry(Geometry=surface, Count=Slider(23, range=0..100), Seed=Slider(54885, range=0..100000))
number_slider_2 = Slider(1, range=0..1)
number_slider_3 = Slider(10000, range=0..10000)
number_slider_4 = Slider(0, range=0..100)
crv = Curve(<curve referenced from the Rhino model>)
forcedirecteddrawing = ForceDirectedDrawing(
    Graph=graphfromnodes_links.Graph,
    Vertices=graphfromnodes_links.GraphVertices,
    Attributes=graphfromnodes_links.Attributes,
    AttractionStrength=number_slider,
    RepulsionStrength=multiplication_3,
    ConvergenceTolearnce=0.001,
    MaximumIterations=4000,
    Active=Toggle(True))  # -> NewGraphVertices, IterationCount
panel_45 = Panel("""2
5
6
7
5""")
multiplication_4 = Multiplication(A=multiplication_2, B=Slider(1.9389, range=0..10))
random = Random(Range=Domain(0, 10000), Number=branchcount, Seed=Slider(3374, range=0..10000))  # -> graft(Random)
construct_point = ConstructPoint(XCoordinate=gene_pool_2, YCoordinate=gene_pool, ZCoordinate=0)
surface_2 = Surface(reparameterize(curve))
point_8 = Point([<point referenced from the Rhino model> x22])
voronoi = Voronoi(Points=populate_2d, Boundary=rectangle, BruteForceOverride=False)
scale = Slider(1.6, range=0..10)
crv_2 = Curve(<curve referenced from the Rhino model>)
prgm = Programme(Attributes=graphfromnodes_links.Attributes)  # -> Tags, Areas, Colors, Legends
discontinuity = Discontinuity(Curve=curve, Level=1)  # -> Points, Parameters
construct_domain_2 = ConstructDomain(DomainStart=expr("-x", multiplication_4), DomainEnd=multiplication_4)
populate_2d_2 = Populate2D(Region=crv_2, Count=mass_addition_3.Result, Seed=random)  # -> simplify(Population)
panel_46 = Panel(construct_domain)
panel_47 = Panel(prgm.Areas)
populate_2d_3 = Populate2D(Region=surface, Count=100, Seed=1)
evaluate_surface = EvaluateSurface(Surface=surface_2, Point=construct_point)  # -> Point, Normal, UDirection, VDirection, Frame
area = Area(Geometry=flatten(crv_2))  # -> Area, Centroid
ghpython_script = GhPythonScript(params=[Slider(1, range=0..10), Slider(5, range=0..10), Slider(1, range=0..10), Slider(2, range=0..10)])  # -> out, a; inputs params: list
# ---------- ghpython_script: Python ----------
__author__ = "Paula"
__version__ = "2019.04.22"

import Rhino.Geometry as rh
import ghpythonlib.components as ghcomp
def divide(plane, inputCurve, params):
    if len(params) <= 0:
        return []
    
    param = params.pop(0)
    
    curves = []
    lines = ghcomp.Explode(inputCurve)[0]
    pts = [ ghcomp.DivideCurve(line,2)[0] for line in lines ]
    
    if param == 1:
        curves.append(rh.Rectangle3d(plane, pts[0][0], pts[2][1]))
        curves.append(rh.Rectangle3d(plane, pts[0][1], pts[2][0]))
        print curves
        return curves + divide(plane, curves[0], params) + divide(plane, curves[1], params)
    elif param == 2:
        curves.append(rh.Rectangle3d(plane, pts[1][0], pts[3][1]))
        curves.append(rh.Rectangle3d(plane, pts[1][1], pts[3][0]))
        print curves
        return curves + divide(plane, curves[0], params) + divide(plane, curves[1], params)
    else:
        return []
pl = rh.Plane(rh.Point3d(0,0,0), rh.Vector3d(0,0,1))
rect = rh.Rectangle3d(pl, 10, 10)
a = [rect] + divide(pl, rect, params)
# ---------- end ghpython_script ----------
cull_index = CullIndex(List=forcedirecteddrawing.NewGraphVertices, Indices=number_slider_4, Wrap=True)
explode = Explode(Curve=voronoi, Recursive=True)  # -> Segments, Vertices
list_item_5 = ListItem(List=forcedirecteddrawing.NewGraphVertices, Index=number_slider_4, Wrap=True)
point_list = PointList()
xy = XYPlane(Origin=Point(0, 0, 0))
att_tor = Att_toR(B=scale, att=graphfromnodes_links.Attributes)  # -> R, M
square = Square(Plane=forcedirecteddrawing.NewGraphVertices, Size=att_tor.R, ExtentX=number_slider_2, ExtentY=number_slider_2)  # -> Cells, Points
multiplication_5 = Multiplication(A=scale, B=prgm.Areas)
number_slider_5 = Slider(0, range=0..100)
rectangle_3 = Rectangle(Plane=PlaneXY(0, 0, 0), XSize=construct_domain_2, YSize=construct_domain_2, Radius=0)  # -> Rectangle, Length
closest_point = ClosestPoint(Point=list_item_5, Cloud=cull_index)  # -> ClosestPoint, CPIndex, Distance
rectangle_4 = Rectangle(Plane=populate_2d_2, XSize=construct_domain, YSize=construct_domain, Radius=0)  # -> Rectangle, Length
data = Data(flatten(construct_domain))
point_9 = Point(evaluate_surface.Point)
qt = QuadTree(Points=flatten(populate_2d_2), Plane=PlaneXY(0, 0, 0), Square=True, Group=Slider(1, range=0..10))  # -> Quads, Points
sort_list = SortList(Keys=flatten(explode.Segments), ValuesValuesA=flatten(explode.Segments))  # -> Keys, ValuesValuesA
voronoi_2 = Voronoi(Points=forcedirecteddrawing.NewGraphVertices, BruteForceOverride=False)
number_slider_6 = Slider(100, range=0..100)
voronoi_3 = CSharpScript(points=cull_index, locus=list_item_5)  # -> VoronoiOut; inputs points: list of Point3d, locus: Point3d
# ---------- voronoi_3: C# ----------
    var kVPair = new List<KeyValuePair<double, Point3d>>();
    var pointsOut = new List<Point3d>();
    var circles = new List<Circle>();

    for( int i = 0; i < points.Count; ++i )
    {

      kVPair.Add(new KeyValuePair<double, Point3d>(locus.DistanceTo(points[i]), points[i]));

    }

    kVPair.Sort(Compare);

    for( int i = 0; i < points.Count; ++i )
    {

      pointsOut.Add(kVPair[i].Value);
      circles.Add(new Circle(pointsOut[i], kVPair[i].Key));

    }

    VoronoiOut = pointsOut;
# ---------- voronoi_3: C# additional code ----------
  static int Compare(KeyValuePair<double, Point3d> a, KeyValuePair<double, Point3d> b)
  {

    return a.Key.CompareTo(b.Key);

  }
# ---------- end voronoi_3 ----------
panel_48 = Panel(voronoi_3)
list_length = ListLength(List=att_tor.R)
xy_2 = XYPlane(Origin=Point(0, 0, 0))
w_voronoi = WeightedVoronoi(BasePlane=xy_2, Points=forcedirecteddrawing.NewGraphVertices, Radii=att_tor.R)  # -> AdjacencyGraph, VoronoiCells
flatten_2 = FlattenTree(Tree=populate_2d_2, Path="{0}")
point_list_2 = PointList(Points=forcedirecteddrawing.NewGraphVertices)
voronoi_4 = Voronoi(Points=point_9, BruteForceOverride=False)
area_2 = Area(Geometry=w_voronoi.VoronoiCells)  # -> Area, Centroid
list_length_2 = ListLength(List=flatten(rectangle_4.Rectangle))
delaunay_mesh = DelaunayMesh(Points=forcedirecteddrawing.NewGraphVertices, Plane=PlaneXY(0, 0, 0))
srf = Surface(w_voronoi.VoronoiCells)
preview = CustomPreview(Geometry=srf, Shader=att_tor.M)
text_tag_2 = TextTag(Location=flatten_2, Text=flatten(path_mapper))
cull_index_2 = CullIndex(List=flatten(sort_list.Keys), Indices=number_slider_5, Wrap=True)  # -> simplify(flatten(List))
panel_49 = Panel(list_length)
area_3 = Area(Geometry=flatten(rectangle_4.Rectangle))  # -> Area, Centroid
point_list_3 = PointList(Points=voronoi_3)
text_tag_3 = TextTag(Location=forcedirecteddrawing.NewGraphVertices, Text=flatten(path_mapper))
mesh_edges = MeshEdges(Mesh=delaunay_mesh)  # -> NakedEdges, InteriorEdges, NonManifoldEdges
c_script_2 = CSharpScript(x=Slider(578, range=0..10000))  # -> out, A; inputs x: Int32
# ---------- c_script_2: C# ----------
    A = tailAddition(x);
# ---------- c_script_2: C# additional code ----------
  private long addRecursive(int number)
  {

    if( number == 0 )

      return number;

    return number + addRecursive(number - 1);

  }
  
  private long tailAddition(int number)
  {
  
    return tailAdd( number, 1 );
  
  }
  
  private long tailAdd(int number, int a)
  {
  
    if( number == 0 )
      
      return a;
    
    return tailAdd( number - 1, number + a );
  
  }

  private long factorial(int number)
  {

    if( number == 0 )

      return 1;

    return number * factorial(number - 1);

  }

  private long tailFactorial(int number)
  {

    return tailFact(number, 1);

  }

  private long tailFact(int number, int a)
  {

    if( number == 0 )

      return a;

    return tailFact(number - 1, number * a);

  }
# ---------- end c_script_2 ----------
random_2 = Random(Range=Domain(0, 1), Number=branchcount, Seed=Slider(465, range=0..1000))
crv_3 = Curve(<curve referenced from the Rhino model>)
substrate = Substrate(Border=crv_3, Count=list_length_2, Angles=0, Deviation=Slider(0, range=0..1), Seed=Slider(5627, range=0..10000))
random_3 = Random(Range=Domain(0, 1), Number=branchcount, Seed=Slider(460, range=0..1000))
random_4 = Random(Range=Domain(0, 1), Number=branchcount, Seed=Slider(342, range=0..1000))
region_intersection = RegionIntersection(CurvesA=voronoi_4, CurvesB=curve)
text_tag_4 = TextTag(Location=forcedirecteddrawing.NewGraphVertices, Text=flatten(path_mapper))
surface_3 = Surface(rectangle_4.Rectangle)
list_item_6 = ListItem(List=voronoi_3, Index=Slider(0, range=0..10), Wrap=True)
ma = MassAddition(Input=area_3.Area)  # -> Result, PartialResults
expression = Expression(Expression="Format(\"{0}, {1}\", x, y)")
panel_50 = Panel(c_script_2.A)
srf_2 = Surface(crv_3)
equality = Equality(FirstNumber=sort_list.Keys, SecondNumber=cull_index_2)  # -> Equality, Inequality
number_slider_7 = Slider(2.531, range=0..10)
taxicab = CSharpScript(points=cull_index, locus=list_item_5)  # -> out, A; inputs points: list of Point3d, locus: Point3d
# ---------- taxicab: C# ----------
    //double minDistance = double.MaxValue;
    var kVPair = new List<KeyValuePair<double, Point3d>>();
    var pointsOut = new List<Point3d>();
    
    /*
    for( int i = 0; i < points.Count - 1; ++i )
    {
    
      // Manhattan distance.
      double maxDistance = TaxiCab(points[i], points[i + 1]);
      // Euclidean distance.
      //double maxDistance = locus.DistanceTo( points[i] );
      
      minDistance = Math.Min( minDistance, maxDistance );
    
    }
    */
    
    for( int i = 0; i < points.Count; ++i )
    {

      kVPair.Add(new KeyValuePair<double, Point3d>(TaxiCab(locus, points[i]), points[i]));

    }

    kVPair.Sort(Compare);

    for( int i = 0; i < points.Count; ++i )
    {

      pointsOut.Add(kVPair[i].Value);
      //circles.Add(new Circle(pointsOut[i], kVPair[i].Key));

    }
    
    A = pointsOut;
# ---------- taxicab: C# additional code ----------
  public double TaxiCab(Point3d pointA, Point3d pointB)
  {
  
    return Math.Abs(pointA.X - pointB.X) + Math.Abs(pointA.Y - pointB.Y);   
  
  }
  
  static int Compare(KeyValuePair<double, Point3d> a, KeyValuePair<double, Point3d> b)
  {

    return a.Key.CompareTo(b.Key);

  }
# ---------- end taxicab ----------
mesh_explode = MeshExplode(Mesh=delaunay_mesh, Interpolate=False)
srfsplit = SurfaceSplit(Surface=srf_2, Curves=substrate)
colour_rgb_f = ColourRGBF(Alpha=1, Red=random_2, Green=random_3, Blue=random_4)  # -> simplify(graft(Colour))
point_list_4 = PointList(Points=taxicab.A)
area_4 = Area(Geometry=mesh_explode)  # -> Area, Centroid
discontinuity_2 = Discontinuity(Curve=region_intersection, Level=1)  # -> Points, Parameters
dispatch = Dispatch(List=sort_list.ValuesValuesA, DispatchPattern=equality.Equality)  # -> ListA, ListB
area_5 = Area(Geometry=srfsplit)  # -> Area, Centroid
voronoi_5 = Voronoi(BruteForceOverride=False)
rectangle_5 = Rectangle({Plane=PlaneXY(14.29914154, 18.32366587, 0), Size=Domain2(u=-8.171893392..8.171893392, v=-7.045785178..7.045785178)})
ghpython_script_2 = GhPythonScript(r=number_slider_7, P=forcedirecteddrawing.NewGraphVertices)  # -> out, PL; inputs P: list of Point3d
# ---------- ghpython_script_2: Python ----------
__author__ = "Paula"
__version__ = "2019.04.23"

import rhinoscriptsyntax as rs
from Rhino.Geometry import Point3d as P3
from Rhino.Geometry import Polyline as PLine

def taxicab_midnormal ( Point_1 = P3(0,0,0), Point_2 = P3(0,0,0) , leng = 10000):
    dx = abs(Point_1.X - Point_2.X)
    dy = abs(Point_1.Y - Point_2.Y)
    
    C = P3 ( ( Point_1.X + Point_2.X ) / 2, ( Point_1.Y + Point_2.Y ) / 2, ( Point_1.Z + Point_2.Z ) / 2)
    
    """ MPQN, in which M is on the lengeft(X-) or bottom(Y-) """
    P = P3 (0,0,C.Z)
    Q = P3 (0,0,C.Z)
    M = P3 (0,0,C.Z)
    N = P3 (0,0,C.Z)
    
    if dx > dy:
        P.Y = C.Y + dy / 2
        Q.Y = C.Y - dy / 2
        M.Y = P.Y + leng
        N.Y = Q.Y - leng
        if bool(Point_1.Y > Point_2.Y) ^ bool(Point_1.X > Point_2.X):
            P.X = C.X + dy / 2
            Q.X = C.X - dy / 2
        else:
            P.X = C.X - dy / 2
            Q.X = C.X + dy / 2
        M.X = P.X
        N.X = Q.X
    else:
        if dx < dy:
            P.X = C.X + dx / 2
            Q.X = C.X - dx / 2
            M.X = P.X + leng
            N.X = Q.X - leng
            if bool(Point_1.Y > Point_2.Y) ^ bool(Point_1.X > Point_2.X):
                P.Y = C.Y + dx / 2
                Q.Y = C.Y - dx / 2
            else:
                P.Y = C.Y - dx / 2
                Q.Y = C.Y + dx / 2
            M.Y = P.Y
            N.Y = Q.Y
        else:
            if bool(Point_1.Y > Point_2.Y) ^ bool(Point_1.X > Point_2.X):
                P.Y = C.Y - dx / 2
                Q.Y = C.Y + dx / 2
                P.X = C.X - dy / 2
                Q.X = C.X + dy / 2
                M.Y = P.Y - leng
                M.X = P.X - leng
                N.Y = Q.Y + leng
                N.X = Q.X + leng
            else:
                P.Y = C.Y - dx / 2
                Q.Y = C.Y + dx / 2
                P.X = C.X + dy / 2
                Q.X = C.X - dy / 2
                M.Y = P.Y - leng
                M.X = P.X + leng
                N.Y = Q.Y + leng
                N.X = Q.X - leng

    return rs.AddPolyline( [M , P , Q , N] )

def taxicab_circle ( point = P3(0,0,0), r = 1 ):
    A = P3( point.X + r, point.Y, point.Z )
    B = P3( point.X, point.Y + r, point.Z )
    C = P3( point.X - r, point.Y, point.Z )
    D = P3( point.X, point.Y - r, point.Z )
    return rs.AddPolyline( [A, B, C, D, A] )

l = 2 * r

PL = taxicab_midnormal ( P[0], P[1], r )
# ---------- end ghpython_script_2 ----------
ghpython_script_3 = GhPythonScript(r=number_slider_7, P=forcedirecteddrawing.NewGraphVertices)  # -> out, PL; inputs P: list of Point3d
# ---------- ghpython_script_3: Python ----------
__author__ = "Paula"
__version__ = "2019.04.23"

import rhinoscriptsyntax as rs
from Rhino.Geometry import Point3d as P3
from Rhino.Geometry import Polyline as PLine

def taxicab_midnormal ( Point_1 = P3(0,0,0), Point_2 = P3(0,0,0) , leng = 10000):
    dx = abs(Point_1.X - Point_2.X)
    dy = abs(Point_1.Y - Point_2.Y)
    
    C = P3 ( ( Point_1.X + Point_2.X ) / 2, ( Point_1.Y + Point_2.Y ) / 2, ( Point_1.Z + Point_2.Z ) / 2)
    
    """ MPQN, in which M is on the lengeft(X-) or bottom(Y-) """
    P = P3 (0,0,C.Z)
    Q = P3 (0,0,C.Z)
    M = P3 (0,0,C.Z)
    N = P3 (0,0,C.Z)
    
    if dx > dy:
        P.Y = C.Y + dy / 2
        Q.Y = C.Y - dy / 2
        M.Y = P.Y + leng
        N.Y = Q.Y - leng
        if bool(Point_1.Y > Point_2.Y) ^ bool(Point_1.X > Point_2.X):
            P.X = C.X + dy / 2
            Q.X = C.X - dy / 2
        else:
            P.X = C.X - dy / 2
            Q.X = C.X + dy / 2
        M.X = P.X
        N.X = Q.X
    else:
        if dx < dy:
            P.X = C.X + dx / 2
            Q.X = C.X - dx / 2
            M.X = P.X + leng
            N.X = Q.X - leng
            if bool(Point_1.Y > Point_2.Y) ^ bool(Point_1.X > Point_2.X):
                P.Y = C.Y + dx / 2
                Q.Y = C.Y - dx / 2
            else:
                P.Y = C.Y - dx / 2
                Q.Y = C.Y + dx / 2
            M.Y = P.Y
            N.Y = Q.Y
        else:
            if bool(Point_1.Y > Point_2.Y) ^ bool(Point_1.X > Point_2.X):
                P.Y = C.Y - dx / 2
                Q.Y = C.Y + dx / 2
                P.X = C.X - dy / 2
                Q.X = C.X + dy / 2
                M.Y = P.Y - leng
                M.X = P.X - leng
                N.Y = Q.Y + leng
                N.X = Q.X + leng
            else:
                P.Y = C.Y - dx / 2
                Q.Y = C.Y + dx / 2
                P.X = C.X + dy / 2
                Q.X = C.X - dy / 2
                M.Y = P.Y - leng
                M.X = P.X + leng
                N.Y = Q.Y + leng
                N.X = Q.X - leng

    return rs.AddPolyline( [M , P , Q , N] )

def taxicab_circle ( point = P3(0,0,0), r = 1 ):
    A = P3( point.X + r, point.Y, point.Z )
    B = P3( point.X, point.Y + r, point.Z )
    C = P3( point.X - r, point.Y, point.Z )
    D = P3( point.X, point.Y - r, point.Z )
    return rs.AddPolyline( [A, B, C, D, A] )

l = 2 * r

""" PL = taxicab_midnormal ( A, B, r ) """

pts = P

polylines = []
for i in range( len( P ) ):
    polylines.append(taxicab_circle( P[i], l ))

for i in range(len(polylines)):
    for j in range(i):
        if i == j:
            continue
        if rs.CurveBooleanUnion( [ polylines[i], polylines[j] ] ):
            MN = taxicab_midnormal( pts[i], pts[j], l )
            
            ccx = rs.CurveCurveIntersection( polylines[i], MN )
            if ccx is None:
                continue
            if ccx[0][0] == 2:
                continue
            para_a = [ ccx[0][5], ccx[1][5] ]
            para_b = [ ccx[0][7], ccx[1][7] ]
            
            if para_b[0] > para_b[1]:
                para_b = [ para_b[1], para_b[0] ]
            
            probable_dash = rs.SplitCurve(polylines[i], para_a)
            edge = rs.TrimCurve(MN, para_b, False )
            edgepts = rs.CurvePoints(edge)
            
            for crv in probable_dash:
                crvpts = rs.CurvePoints(crv)
                if rs.PointCompare( crvpts[0], edgepts[0] ):
                    crvpts.reverse()
                newpl = rs.AddPolyline( edgepts + crvpts )
                if rs.PointInPlanarClosedCurve( pts[i], newpl ):
                    polylines[i] = newpl
                    break
            
            
            ccx = rs.CurveCurveIntersection( polylines[j], MN )
            if ccx is None:
                continue
            para_a = [ ccx[0][5], ccx[1][5] ]
            para_b = [ ccx[0][7], ccx[1][7] ]
            
            if para_b[0] > para_b[1]:
                para_b = [ para_b[1], para_b[0] ]
            
            probable_dash = rs.SplitCurve(polylines[j], para_a)
            edge = rs.TrimCurve(MN, para_b, False )
            edgepts = rs.CurvePoints(edge)
            
            for crv in probable_dash:
                crvpts = rs.CurvePoints(crv)
                if rs.PointCompare( crvpts[0], edgepts[0] ):
                    crvpts.reverse()
                newpl = rs.AddPolyline( edgepts + crvpts )
                if rs.PointInPlanarClosedCurve( pts[j], newpl ):
                    polylines[j] = newpl
                    break
    

PL = polylines
# ---------- end ghpython_script_3 ----------
panel_51 = Panel(area_5.Area)
custom_preview = CustomPreview(Geometry=surface_3, Material=colour_rgb_f)
surface_4 = Surface(rectangle_5)
circle_fit = CircleFit(Points=discontinuity_2.Points)  # -> Circle, Radius, Deviation
srf_3 = Surface(ghpython_script_2.PL)
srf_4 = Surface(ghpython_script_3.PL)
preview_2 = CustomPreview(Geometry=srf_3, Shader=att_tor.M)
preview_3 = CustomPreview(Geometry=srf_4, Shader=att_tor.M)
explode_tree = ExplodeTree(Data=colour_rgb_f)  # -> Branch0, Branch1, Branch2, Branch3, Branch4
explode_tree_2 = ExplodeTree(Data=rectangle_4.Rectangle)  # -> Branch0, Branch1, Branch2, Branch3, Branch4
number_slider_8 = Slider(0.8, range=0..1)
curve_curve = CurveCurve(CurveA=rectangle_5, CurveB=ghpython_script_2.PL)  # -> Points, ParamsA, ParamsB
cull_index_3 = CullIndex(List=reverse(dispatch.ListA), Indices=number_slider_5, Wrap=True)
multiplication_6 = Multiplication(A=circle_fit.Radius, B=Slider(0.5, range=0..1))
construct_domain_3 = ConstructDomain(DomainStart=expr("-x", multiplication_6), DomainEnd=multiplication_6)  # -> flatten(Domain)
curve_2 = Curve(flatten(cull_index_3))
subtraction = Subtraction(A=Slider(1, range=0..1), B=number_slider_8)
end_points = EndPoints(Curve=curve_2)  # -> Start, End
ghpython_script_4 = GhPythonScript(r=number_slider_7, P=forcedirecteddrawing.NewGraphVertices)  # -> out, PL; inputs P: list of Point3d
# ---------- ghpython_script_4: Python ----------
__author__ = "Paula"
__version__ = "2019.04.23"

import rhinoscriptsyntax as rs
from Rhino.Geometry import Point3d as P3
from Rhino.Geometry import Polyline as PLine

def taxicab_midnormal ( Point_1 = P3(0,0,0), Point_2 = P3(0,0,0) , leng = 10000):
    dx = abs(Point_1.X - Point_2.X)
    dy = abs(Point_1.Y - Point_2.Y)
    
    C = P3 ( ( Point_1.X + Point_2.X ) / 2, ( Point_1.Y + Point_2.Y ) / 2, ( Point_1.Z + Point_2.Z ) / 2)
    
    """ MPQN, in which M is on the lengeft(X-) or bottom(Y-) """
    P = P3 (0,0,C.Z)
    Q = P3 (0,0,C.Z)
    M = P3 (0,0,C.Z)
    N = P3 (0,0,C.Z)
    
    if dx > dy:
        P.Y = C.Y + dy / 2
        Q.Y = C.Y - dy / 2
        M.Y = P.Y + leng
        N.Y = Q.Y - leng
        if bool(Point_1.Y > Point_2.Y) ^ bool(Point_1.X > Point_2.X):
            P.X = C.X + dy / 2
            Q.X = C.X - dy / 2
        else:
            P.X = C.X - dy / 2
            Q.X = C.X + dy / 2
        M.X = P.X
        N.X = Q.X
    else:
        if dx < dy:
            P.X = C.X + dx / 2
            Q.X = C.X - dx / 2
            M.X = P.X + leng
            N.X = Q.X - leng
            if bool(Point_1.Y > Point_2.Y) ^ bool(Point_1.X > Point_2.X):
                P.Y = C.Y + dx / 2
                Q.Y = C.Y - dx / 2
            else:
                P.Y = C.Y - dx / 2
                Q.Y = C.Y + dx / 2
            M.Y = P.Y
            N.Y = Q.Y
        else:
            if bool(Point_1.Y > Point_2.Y) ^ bool(Point_1.X > Point_2.X):
                P.Y = C.Y - dx / 2
                Q.Y = C.Y + dx / 2
                P.X = C.X - dy / 2
                Q.X = C.X + dy / 2
                M.Y = P.Y - leng
                M.X = P.X - leng
                N.Y = Q.Y + leng
                N.X = Q.X + leng
            else:
                P.Y = C.Y - dx / 2
                Q.Y = C.Y + dx / 2
                P.X = C.X + dy / 2
                Q.X = C.X - dy / 2
                M.Y = P.Y - leng
                M.X = P.X + leng
                N.Y = Q.Y + leng
                N.X = Q.X - leng

    return rs.AddPolyline( [M , P , Q , N] )

def taxicab_circle ( point = P3(0,0,0), r = 1 ):
    A = P3( point.X + r, point.Y, point.Z )
    B = P3( point.X, point.Y + r, point.Z )
    C = P3( point.X - r, point.Y, point.Z )
    D = P3( point.X, point.Y - r, point.Z )
    return rs.AddPolyline( [A, B, C, D, A] )

l = 2 * r

""" PL = taxicab_midnormal ( A, B, r ) """

pts = P

polylines = []
for i in range( len( P ) ):
    polylines.append(taxicab_circle( P[i], l ))

PL = polylines
# ---------- end ghpython_script_4 ----------
geometry = Geometry([explode_tree_2.Branch0, explode_tree_2.Branch1, explode_tree_2.Branch2, explode_tree_2.Branch3, explode_tree_2.Branch4])
evaluate_curve = EvaluateCurve(Curve=reparameterize(curve_2), Parameter=subtraction)  # -> Point, Tangent, Angle
evaluate_curve_2 = EvaluateCurve(Curve=reparameterize(curve_2), Parameter=number_slider_8)  # -> Point, Tangent, Angle
number = Number(curve_2)
rectangle_6 = Rectangle(Plane=point_9, XSize=construct_domain_3, YSize=construct_domain_3, Radius=0)  # -> Rectangle, Length
plane = Plane(evaluate_curve_2.Point)
point_10 = Point(simplify(graft(end_points.Start)))
point_11 = Point(simplify(graft(end_points.End)))
diskographdrawing = DiskoGraphDrawing(
    Plane=xy_2,
    Graph=graphfromnodes_links.Graph,
    Vertices=forcedirecteddrawing.NewGraphVertices,
    Attributes=graphfromnodes_links.Attributes,
    Thickness=1)
point_12 = Point(simplify(graft(evaluate_curve.Point)))
point_13 = Point(simplify(graft(evaluate_curve_2.Point)))
geometry_2 = Geometry(geometry)
surface_5 = Surface(geometry)
multiplication_7 = Multiplication(A=Slider(0.1, range=0..0.1), B=number)
curve_3 = Curve(rectangle_6.Rectangle)
region_intersection_2 = RegionIntersection(CurvesA=rectangle_6.Rectangle, CurvesB=curve)
collision_many_many = CollisionManyMany(Colliders=curve_3)  # -> Collision, Indices
radians = Radians(Degrees=Slider(90, range=0..100))
rotate = Rotate(Vector=evaluate_curve_2.Tangent, Axis=plane, Angle=radians)
custom_preview_2 = CustomPreview(Geometry=geometry_2, Material=explode_tree.Branch0)
amplitude = Amplitude(Vector=rotate, Amplitude=multiplication_7)
area_6 = Area(Geometry=geometry_2, UseTasks=False)  # -> Area, Centroid
sort_list_2 = SortList(Keys=area_6.Area, ValuesValuesA=area_6.Centroid)  # -> Keys, reverse(ValuesValuesA)
sort_list_3 = SortList(Keys=area_6.Area, ValuesValuesA=geometry_2)  # -> Keys, reverse(ValuesValuesA)
move = Move(Geometry=evaluate_curve_2.Point, Motion=amplitude)  # -> Geometry, Transform
move_2 = Move(Geometry=evaluate_curve.Point, Motion=amplitude)  # -> Geometry, Transform
mass_addition_4 = MassAddition(Input=collision_many_many.Collision)  # -> Result, PartialResults
cross_reference = CrossReference(ListListA=area_6.Centroid, ListListB=area_6.Centroid, CrossMode=5)  # -> graft(ListListA), graft(ListListB)
point_14 = Point(simplify(graft(move_2.Geometry)))
point_15 = Point(simplify(graft(move.Geometry)))
partition_list_2 = PartitionList(List=sort_list_3.ValuesValuesA, Size=Slider(2, range=0..10))  # -> simplify(Chunks)
list_item_7 = ListItem(List=partition_list_2, Index=0, Wrap=True)  # -> Item, Item1
point_16 = Point(flatten([point_10, point_11, point_12, point_13, point_14, point_15]))
curve_4 = Curve([list_item_7.Item, list_item_7.Item1])
curve_5 = Curve(list_item_7.Item1)
point_17 = Point([cross_reference.ListListA, cross_reference.ListListB])
polyline = PolyLine(Vertices=point_16, Closed=False)
explode_tree_3 = ExplodeTree(Data=partition_list_2)  # -> Branch0, Branch1, Branch2, Branch3, Branch4, Branch5, Branch6, Branch7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
nestingtwoitems = CSharpScript(x=curve_4, Reference="C:\Users\Paula\AppData\Roaming\Grasshopper\Libraries\ClipperTools.dll")  # -> A; inputs x: list of Polyline
# ---------- nestingtwoitems: C# usings ----------
using System.IO;
using System.Linq;
using System.Data;
using System.Drawing;
using System.Reflection;
using System.Windows.Forms;
using System.Xml;
using System.Xml.Linq;
using System.Runtime.InteropServices;

using Rhino.DocObjects;
using Rhino.Collections;
using GH_IO;
using GH_IO.Serialization;
using StudioAvw.Geometry;
using ClipperLib;
# ---------- nestingtwoitems: C# ----------
    // We want to cast(change from one data type to another) our list of polylines to curves, so that
    // we can call the AreaMassProperties class and its method .Compute to get the area of the polygons
    // after that we can now create a List of KeyValuePair to assign the area of our polygons to our
    // polygons so that we can sort them later according to their areas.
    /*
    List<Curve> one = new List<Curve>();
    double[] areas = new Double[x.Count];
    var curves = new List<KeyValuePair<Polyline, double>>();

    for(int i = 0; i < x.Count; ++i)
    {

    one.Add(x.ElementAt(i).ToNurbsCurve());
    areas[i] = AreaMassProperties.Compute(one.ElementAt(i)).Area;
    curves.Add(new KeyValuePair<Polyline, double>(x.ElementAt(i), areas[i]));

    }

    // Here is where the sorting according to area values takes place.
    curves.Sort(Compare1);
    curves.Reverse();
    // We retrieve a list of curves from our List of KeyValuePairs
    List<Polyline> curve = (from kvp in curves select kvp.Key).Distinct().ToList();
    curve.Reverse();
    */

    List<Polyline> curve = x;

    // We create and populate trees with the points of the curves, so that we can
    // sort each of the lower left points of each of the curves according to the
    // sum of their Xs and Ys positions.
    List<List<Point3d>> pts = new List<List<Point3d>>();
    DataTree<Point3d> tree = new DataTree<Point3d>();
    DataTree<double> treeSum = new DataTree<double>();
    var points = new DataTree<KeyValuePair<Point3d, double>>();
    var point = new List<Point3d>[curve.Count];
    DataTree<Point3d> treeLowerLeft = new DataTree<Point3d>();

    for(int i = 0; i < curve.Count; ++i)
    {

      pts.Add(curve[i].ToList());
      pts[i].RemoveAt(pts[i].Count - 1);
      GH_Path path = new GH_Path(i);

      for(int j = 0; j < pts[i].Count; ++j)
      {

        tree.Add(pts[i][j], path);
        treeSum.Add(pts[i][j].X + pts[i][j].Y, path);

        points.Add(new KeyValuePair<Point3d, double>(tree.Branch(i)[j], treeSum.Branch(i)[j]), path);

        points.Branch(i).Sort(Compare2);
        points.Branch(i).Reverse();
        point[i] = (from kvp in points.Branch(i) select kvp.Key).Distinct().ToList();
        point[i].Reverse();

      }

    }

    for(int i = 0; i < tree.BranchCount; ++i)
      for(int j = 0; j < tree.Branch(i).Count; ++j)
      {

        treeLowerLeft.Add(point[i][j], new GH_Path(i));

      }

    var treeOut = new DataTree<Point3d>();

    for(int i = 0; i < treeLowerLeft.BranchCount; ++i)
      for(int j = 0; j < treeLowerLeft.Branch(i).Count; ++j)
      {

        treeOut.Add(treeLowerLeft.Branch(i)[0], new GH_Path(i));

      }

    /*
    // Create the data structures and initialize them
    DataTree<Point3d> points = new DataTree<Point3d>();
    List<List<Point3d>> lists = new List<List<Point3d>>();

    // Fill the nested list with the list of points
    for(int i = 0; i < x.Count; ++i)
    {

      lists.Add(x[i].ToList());

    }

    // Fill the data tree with the list of points
    for(int i = 0; i < lists.Count; ++i)
    {

      var path = new GH_Path(i);

      for(int j = 0; j < lists[i].Count; ++j )
      {

        points.Add(lists[i][j], path);

      }

    }
    */


    // No Fit Polygon from minkowsky difference using the clipper lib
    Polyline polyOne = curve[0];
    Polyline polyTwo = curve[curve.Count - 1];

    Point3d center = treeOut.Branch(0).ElementAt(0);
    Vector3d zAxis = Vector3d.ZAxis;
    Plane p = new Rhino.Geometry.Plane(center, zAxis);

    double tolerance = 1e-8;
    List<Polyline> outCurves = new List<Polyline>();
    List<Polyline> outDisplacedCurves = new List<Polyline>();
    foreach(List<IntPoint> path in ClipperLib.Clipper.MinkowskiDiff(polyOne.ToPath2D(p, tolerance), polyTwo.ToPath2D(p, tolerance)))
    {

      Polyline plSum = path.ToPolyline(p, tolerance, true);
      outCurves.Add(plSum);

    }

    Polyline NFP = outCurves[0];

    //B = NFP;

    List<Point3d> ptNFP;
    ptNFP = NFP.ToList();
    ptNFP.RemoveAt(0);

    List<Vector3d> vectors = new List<Vector3d>();
    for(int i = 0; i < ptNFP.Count; ++i)
    {

      vectors.Add(new Vector3d(ptNFP.ElementAt(i) - treeOut.Branch(0)[0]));

    }

    List<Curve> translated = new List<Curve>();
    Polyline[] polys = new Polyline[ptNFP.Count];
    List<List<Point3d>> polyPoint = new List<List<Point3d>>();

    List<Point3d> pointsA = new List<Point3d>();
    pointsA = polyTwo.ToList();
    pointsA.RemoveAt(pointsA.Count - 1);
    DataTree<Point3d> polyPoints = new DataTree<Point3d>();
    DataTree<Point3d> APoints = new DataTree<Point3d>();
    for(int i = 0; i < ptNFP.Count; ++i)
    {

      var path = new GH_Path(i);
      Curve oney = polyOne.ToNurbsCurve();
      oney.Translate(vectors.ElementAt(i));
      translated.Add(oney);
      translated.ElementAt(i).TryGetPolyline(out polys[i]);
      polyPoint.Add(polys[i].ToList());

      for(int j = 0; j < polyPoint[i].Count - 1; ++j)
      {

        polyPoints.Add(polyPoint[i][j], path);

      }

    }

    for(int i = 0; i < ptNFP.Count; ++i)
      for(int j = 0; j < pointsA.Count; ++j)
      {

        var path = new GH_Path(i);
        APoints.Add(pointsA[j], path);

      }

    for(int i = 0; i < polyPoints.BranchCount; ++i)
      for(int j = 0; j < polyPoints.Branch(i).Count; ++j)
      {

        APoints.Add(polyPoints.Branch(i)[j], new GH_Path(i));

      }

    var list = new Grasshopper.Kernel.Geometry.Node2List[APoints.BranchCount];
    var polyLines = new Polyline[APoints.BranchCount];
    var curvesConvex = new Curve[APoints.BranchCount];
    var convexArea = new Double[APoints.BranchCount];
    var convexSort = new List<KeyValuePair<Polyline, double>>();
    var hullSort = new List<KeyValuePair<Polyline, double>>();

    for(int i = 0; i < APoints.BranchCount; ++i)
    {

      list[i] = new Grasshopper.Kernel.Geometry.Node2List(APoints.Branch(i));
      polyLines[i] = Grasshopper.Kernel.Geometry.ConvexHull.Solver.ComputeHull(list[i]);
      curvesConvex[i] = polyLines[i].ToNurbsCurve();
      convexArea[i] = AreaMassProperties.Compute(curvesConvex[i]).Area;
      convexSort.Add(new KeyValuePair<Polyline, double>(polys[i], convexArea[i]));
      hullSort.Add(new KeyValuePair<Polyline, double>(polyLines[i], convexArea[i]));

    }

    // Output the polygons with no convex hull
    // Here is where the sorting according to area values takes place.
    convexSort.Sort(Compare1);
    convexSort.Reverse();
    // We retrieve a list of polylines from our List of KeyValuePairs
    List<Polyline> polyFinal = (from kvp in convexSort select kvp.Key).Distinct().ToList();
    polyFinal.Reverse();

    // Output the convex hull polygons
    // Here is where the sorting according to area values takes place.
    hullSort.Sort(Compare1);
    hullSort.Reverse();
    // We retrieve a list of polylines from our List of KeyValuePairs
    List<Polyline> hullFinal = (from kvp in hullSort select kvp.Key).Distinct().ToList();
    hullFinal.Reverse();

    A = polyFinal;
# ---------- nestingtwoitems: C# additional code ----------
  static int Compare1(KeyValuePair<Polyline, double> a, KeyValuePair<Polyline, double> b)
  {

    return a.Value.CompareTo(b.Value);

  }

  static int Compare2(KeyValuePair<Point3d, double> a, KeyValuePair<Point3d, double> b)
  {

    return a.Value.CompareTo(b.Value);

  }
# ---------- end nestingtwoitems ----------
list_item_8 = ListItem(List=point_17, Index=0, Wrap=True)  # -> Item, Item1
geometry_3 = Geometry(explode_tree_3.Branch0)
list_item_9 = ListItem(List=nestingtwoitems, Index=Slider(0, range=0..3), Wrap=True)
vector_2pt = Vector2Pt(PointA=list_item_8.Item, PointB=list_item_8.Item1, Unitize=False)  # -> Vector, Length
rectanglew_h = CSharpScript(rectangleList=sort_list_3.ValuesValuesA)  # -> Width, Height; inputs rectangleList: list of Rectangle3d
# ---------- rectanglew_h: C# ----------
    var widths = new List<double>();
    var heights = new List<double>();
    
    for( int i = 0; i < rectangleList.Count; ++i )
    {
    
      widths.Add( rectangleList[i].Width );
      heights.Add( rectangleList[i].Height );
    
    }
    
    Width = widths;
    Height = heights;
# ---------- end rectanglew_h ----------
area_7 = Area(Geometry=geometry_3, UseTasks=False)  # -> Area, Centroid
area_8 = Area(Geometry=[curve_5, list_item_9])  # -> Area, Centroid
panel_52 = Panel(rectanglew_h.Height)
panel_53 = Panel(rectanglew_h.Width)
vector_display = VectorDisplay(Anchor=list_item_8.Item, Vector=vector_2pt.Vector)
list_item_10 = ListItem(List=sort_list_3.ValuesValuesA, Index=Slider(0, range=0..12), Wrap=True)  # -> Item, Item1, Item2, Item3, Item4, Item5, Item6, Item7
mass_addition_5 = MassAddition(Input=area_8.Area)  # -> Result, PartialResults
multiplication_8 = Multiplication(A=rectanglew_h.Width, B=0.5)
circle = Circle(Plane=sort_list_2.ValuesValuesA, Radius=multiplication_8)
curve_6 = Curve(list_item_10.Item)
curve_7 = Curve(list_item_10.Item1)
curve_8 = Curve(list_item_10.Item2)
curve_9 = Curve(list_item_10.Item3)
curve_10 = Curve(list_item_10.Item4)
curve_11 = Curve(list_item_10.Item5)
curve_12 = Curve(list_item_10.Item6)
curve_13 = Curve(list_item_10.Item7)
number_slider_9 = Slider(0.25, range=0..10)  # disabled
number_slider_10 = Slider(1.271, range=0..10)  # disabled
merge_4 = Merge(Data1=curve_6, Data2=curve_7)
nestingtwoitemsoptimized = CSharpScript(x=merge_4, Reference="C:\USERS\PAULA\APPDATA\ROAMING\GRASSHOPPER\LIBRARIES\ClipperTools.dll")  # -> A, B; inputs x: list of Polyline
# ---------- nestingtwoitemsoptimized: C# ----------
    List<Polyline> curve = x;

    // We create and populate trees with the points of the curves, so that we can
    // sort each of the lower left points of each of the curves according to the
    // sum of their Xs and Ys positions.
    List<List<Point3d>> pts = new List<List<Point3d>>();
    var points = new DataTree<KeyValuePair<Point3d, double>>();
    var point = new List<Point3d>[curve.Count];
    var treeOut = new DataTree<Point3d>();
    for(int i = 0; i < curve.Count; ++i)
    {

      pts.Add(curve[i].ToList());
      pts[i].RemoveAt(pts[i].Count - 1);
      GH_Path path = new GH_Path(i);

      for(int j = 0; j < pts[i].Count; ++j)
      {

        points.Add(new KeyValuePair<Point3d, double>(pts[i][j], pts[i][j].X + pts[i][j].Y), path);

        points.Branch(i).Sort(Compare2);
        points.Branch(i).Reverse();
        point[i] = (from kvp in points.Branch(i) select kvp.Key).Distinct().ToList();
        point[i].Reverse();
        treeOut.Add(point[i][0], new GH_Path(i));

      }

    }

    // No Fit Polygon from minkowsky difference using the clipper lib
    Polyline polyOne = curve[0];
    Polyline polyTwo = curve[curve.Count - 1];

    Point3d center = treeOut.Branch(0).ElementAt(0);
    Vector3d zAxis = Vector3d.ZAxis;
    Plane p = new Rhino.Geometry.Plane(center, zAxis);

    double tolerance = 1e-8;
    List<Polyline> outCurves = new List<Polyline>();
    List<Polyline> outDisplacedCurves = new List<Polyline>();
    foreach(List<IntPoint> path in ClipperLib.Clipper.MinkowskiDiff(polyOne.ToPath2D(p, tolerance), polyTwo.ToPath2D(p, tolerance)))
    {

      Polyline plSum = path.ToPolyline(p, tolerance, true);
      outCurves.Add(plSum);

    }

    Polyline NFP = outCurves[0];
    List<Point3d> ptNFP;
    ptNFP = NFP.ToList();
    ptNFP.RemoveAt(0);

    List<Vector3d> vectors = new List<Vector3d>();
    for(int i = 0; i < ptNFP.Count; ++i)
    {

      vectors.Add(new Vector3d(ptNFP.ElementAt(i) - treeOut.Branch(0)[0]));

    }

    List<Curve> translated = new List<Curve>();
    Polyline[] polys = new Polyline[ptNFP.Count];
    List<List<Point3d>> polyPoint = new List<List<Point3d>>();

    List<Point3d> pointsA = new List<Point3d>();
    pointsA = polyTwo.ToList();
    pointsA.RemoveAt(pointsA.Count - 1);
    DataTree<Point3d> polyPoints = new DataTree<Point3d>();
    DataTree<Point3d> APoints = new DataTree<Point3d>();
    for(int i = 0; i < ptNFP.Count; ++i)
    {

      var path = new GH_Path(i);
      Curve oney = polyOne.ToNurbsCurve();
      oney.Translate(vectors.ElementAt(i));
      translated.Add(oney);
      translated.ElementAt(i).TryGetPolyline(out polys[i]);
      polyPoint.Add(polys[i].ToList());

      for(int j = 0; j < polyPoint[i].Count - 1; ++j)
      {

        polyPoints.Add(polyPoint[i][j], path);
        APoints.Add(pointsA[j], path);
        APoints.Add(polyPoints.Branch(i)[j], path);

      }

    }
    
    var polyLines = new Polyline[APoints.BranchCount];
    var convexArea = new Double[APoints.BranchCount];
    var convexSort = new List<KeyValuePair<Polyline, double>>();
    var hullSort = new List<KeyValuePair<Polyline, double>>();

    for(int i = 0; i < APoints.BranchCount; ++i)
    {

      polyLines[i] = Grasshopper.Kernel.Geometry.ConvexHull.Solver.ComputeHull(new Grasshopper.Kernel.Geometry.Node2List(APoints.Branch(i)));
      convexArea[i] = AreaMassProperties.Compute(polyLines[i].ToNurbsCurve()).Area;
      convexSort.Add(new KeyValuePair<Polyline, double>(polys[i], convexArea[i]));
      hullSort.Add(new KeyValuePair<Polyline, double>(polyLines[i], convexArea[i]));

    }

    // Output the polygons with no convex hull
    // Here is where the sorting according to area values takes place.
    convexSort.Sort(Compare1);
    convexSort.Reverse();
    // We retrieve a list of polylines from our List of KeyValuePairs
    List<Polyline> polyFinal = (from kvp in convexSort select kvp.Key).Distinct().ToList();
    polyFinal.Reverse();

    // Output the convex hull polygons
    // Here is where the sorting according to area values takes place.
    hullSort.Sort(Compare1);
    hullSort.Reverse();
    // We retrieve a list of polylines from our List of KeyValuePairs
    List<Polyline> hullFinal = (from kvp in hullSort select kvp.Key).Distinct().ToList();
    hullFinal.Reverse();

    A = polyFinal;
    B = hullFinal;
# ---------- nestingtwoitemsoptimized: C# additional code ----------
  static int Compare1(KeyValuePair<Polyline, double> a, KeyValuePair<Polyline, double> b)
  {

    return a.Value.CompareTo(b.Value);

  }

  static int Compare2(KeyValuePair<Point3d, double> a, KeyValuePair<Point3d, double> b)
  {

    return a.Value.CompareTo(b.Value);

  }
# ---------- end nestingtwoitemsoptimized ----------
nestingtwoitems_2 = CSharpScript(x=merge_4, Reference="C:\USERS\PAULA\APPDATA\ROAMING\GRASSHOPPER\LIBRARIES\ClipperTools.dll")  # -> A, B; inputs x: list of Polyline
# ---------- nestingtwoitems_2: C# ----------
    // We want to cast(change from one data type to another) our list of polylines to curves, so that
    // we can call the AreaMassProperties class and its method .Compute to get the area of the polygons
    // after that we can now create a List of KeyValuePair to assign the area of our polygons to our
    // polygons so that we can sort them later according to their areas.
    /*
    List<Curve> one = new List<Curve>();
    double[] areas = new Double[x.Count];
    var curves = new List<KeyValuePair<Polyline, double>>();

    for(int i = 0; i < x.Count; ++i)
    {

      one.Add(x.ElementAt(i).ToNurbsCurve());
      areas[i] = AreaMassProperties.Compute(one.ElementAt(i)).Area;
      curves.Add(new KeyValuePair<Polyline, double>(x.ElementAt(i), areas[i]));

    }

    // Here is where the sorting according to area values takes place.
    curves.Sort(Compare1);
    //curves.Reverse();
    // We retrieve a list of curves from our List of KeyValuePairs
    List<Polyline> curve = (from kvp in curves select kvp.Key).Distinct().ToList();
    //curve.Reverse();
    */

    List<Polyline> curve = x;

    // We create and populate trees with the points of the curves, so that we can
    // sort each of the lower left points of each of the curves according to the
    // sum of their Xs and Ys positions.
    List<List<Point3d>> pts = new List<List<Point3d>>();
    DataTree<Point3d> tree = new DataTree<Point3d>();
    DataTree<double> treeSum = new DataTree<double>();
    var points = new DataTree<KeyValuePair<Point3d, double>>();
    var point = new List<Point3d>[curve.Count];
    DataTree<Point3d> treeLowerLeft = new DataTree<Point3d>();

    for(int i = 0; i < curve.Count; ++i)
    {

      pts.Add(curve[i].ToList());
      pts[i].RemoveAt(pts[i].Count - 1);
      GH_Path path = new GH_Path(i);

      for(int j = 0; j < pts[i].Count; ++j)
      {

        tree.Add(pts[i][j], path);
        treeSum.Add(pts[i][j].X + pts[i][j].Y, path);

        points.Add(new KeyValuePair<Point3d, double>(tree.Branch(i)[j], treeSum.Branch(i)[j]), path);

        points.Branch(i).Sort(Compare2);
        points.Branch(i).Reverse();
        point[i] = (from kvp in points.Branch(i) select kvp.Key).Distinct().ToList();
        point[i].Reverse();

      }

    }

    for(int i = 0; i < tree.BranchCount; ++i)
      for(int j = 0; j < tree.Branch(i).Count; ++j)
      {

        treeLowerLeft.Add(point[i][j], new GH_Path(i));

      }

    var treeOut = new DataTree<Point3d>();

    for(int i = 0; i < treeLowerLeft.BranchCount; ++i)
      for(int j = 0; j < treeLowerLeft.Branch(i).Count; ++j)
      {

        treeOut.Add(treeLowerLeft.Branch(i)[0], new GH_Path(i));

      }

    /*
    // Create the data structures and initialize them
    DataTree<Point3d> points = new DataTree<Point3d>();
    List<List<Point3d>> lists = new List<List<Point3d>>();

    // Fill the nested list with the list of points
    for(int i = 0; i < x.Count; ++i)
    {

      lists.Add(x[i].ToList());

    }

    // Fill the data tree with the list of points
    for(int i = 0; i < lists.Count; ++i)
    {

      var path = new GH_Path(i);

      for(int j = 0; j < lists[i].Count; ++j )
      {

        points.Add(lists[i][j], path);

      }

    }
    */


    // No Fit Polygon from minkowsky difference using the clipper lib
    Polyline polyOne = curve[0];
    Polyline polyTwo = curve[curve.Count - 1];

    Point3d center = treeOut.Branch(0).ElementAt(0);
    Vector3d zAxis = Vector3d.ZAxis;
    Plane p = new Rhino.Geometry.Plane(center, zAxis);

    double tolerance = 1e-8;
    List<Polyline> outCurves = new List<Polyline>();
    List<Polyline> outDisplacedCurves = new List<Polyline>();
    foreach(List<IntPoint> path in ClipperLib.Clipper.MinkowskiDiff(polyOne.ToPath2D(p, tolerance), polyTwo.ToPath2D(p, tolerance)))
    {

      Polyline plSum = path.ToPolyline(p, tolerance, true);
      outCurves.Add(plSum);

    }

    Polyline NFP = outCurves[0];

    //B = NFP;

    List<Point3d> ptNFP;
    ptNFP = NFP.ToList();
    ptNFP.RemoveAt(0);

    List<Vector3d> vectors = new List<Vector3d>();
    for(int i = 0; i < ptNFP.Count; ++i)
    {

      vectors.Add(new Vector3d(ptNFP.ElementAt(i) - treeOut.Branch(0)[0]));

    }

    List<Curve> translated = new List<Curve>();
    Polyline[] polys = new Polyline[ptNFP.Count];
    List<List<Point3d>> polyPoint = new List<List<Point3d>>();

    List<Point3d> pointsA = new List<Point3d>();
    pointsA = polyTwo.ToList();
    pointsA.RemoveAt(pointsA.Count - 1);
    DataTree<Point3d> polyPoints = new DataTree<Point3d>();
    DataTree<Point3d> APoints = new DataTree<Point3d>();
    for(int i = 0; i < ptNFP.Count; ++i)
    {

      var path = new GH_Path(i);
      Curve oney = polyOne.ToNurbsCurve();
      oney.Translate(vectors.ElementAt(i));
      translated.Add(oney);
      translated.ElementAt(i).TryGetPolyline(out polys[i]);
      polyPoint.Add(polys[i].ToList());

      for(int j = 0; j < polyPoint[i].Count - 1; ++j)
      {

        polyPoints.Add(polyPoint[i][j], path);

      }

    }

    for(int i = 0; i < ptNFP.Count; ++i)
      for(int j = 0; j < pointsA.Count; ++j)
      {

        var path = new GH_Path(i);
        APoints.Add(pointsA[j], path);

      }

    for(int i = 0; i < polyPoints.BranchCount; ++i)
      for(int j = 0; j < polyPoints.Branch(i).Count; ++j)
      {

        APoints.Add(polyPoints.Branch(i)[j], new GH_Path(i));

      }

    var list = new Grasshopper.Kernel.Geometry.Node2List[APoints.BranchCount];
    var polyLines = new Polyline[APoints.BranchCount];
    var curvesConvex = new Curve[APoints.BranchCount];
    var convexArea = new Double[APoints.BranchCount];
    var convexSort = new List<KeyValuePair<Polyline, double>>();
    var hullSort = new List<KeyValuePair<Polyline, double>>();

    for(int i = 0; i < APoints.BranchCount; ++i)
    {

      list[i] = new Grasshopper.Kernel.Geometry.Node2List(APoints.Branch(i));
      polyLines[i] = Grasshopper.Kernel.Geometry.ConvexHull.Solver.ComputeHull(list[i]);
      curvesConvex[i] = polyLines[i].ToNurbsCurve();
      convexArea[i] = AreaMassProperties.Compute(curvesConvex[i]).Area;
      convexSort.Add(new KeyValuePair<Polyline, double>(polys[i], convexArea[i]));
      hullSort.Add(new KeyValuePair<Polyline, double>(polyLines[i], convexArea[i]));

    }

    // Output the polygons with no convex hull
    // Here is where the sorting according to area values takes place.
    convexSort.Sort(Compare1);
    convexSort.Reverse();
    // We retrieve a list of polylines from our List of KeyValuePairs
    List<Polyline> polyFinal = (from kvp in convexSort select kvp.Key).Distinct().ToList();
    polyFinal.Reverse();

    // Output the convex hull polygons
    // Here is where the sorting according to area values takes place.
    hullSort.Sort(Compare1);
    hullSort.Reverse();
    // We retrieve a list of polylines from our List of KeyValuePairs
    List<Polyline> hullFinal = (from kvp in hullSort select kvp.Key).Distinct().ToList();
    hullFinal.Reverse();

    A = polyFinal;
    B = hullFinal;
# ---------- nestingtwoitems_2: C# additional code ----------
  static int Compare1(KeyValuePair<Polyline, double> a, KeyValuePair<Polyline, double> b)
  {

    return a.Value.CompareTo(b.Value);

  }

  static int Compare2(KeyValuePair<Point3d, double> a, KeyValuePair<Point3d, double> b)
  {

    return a.Value.CompareTo(b.Value);

  }
# ---------- end nestingtwoitems_2 ----------
pauls = Pauls(L=number_slider_9, A=number_slider_10)  # disabled
number_slider_11 = Slider(2, range=0..3)
curve_14 = Curve(pauls)  # disabled
list_item_11 = ListItem(List=nestingtwoitems_2.A, Index=number_slider_11, Wrap=True)
list_item_12 = ListItem(List=nestingtwoitems_2.B, Index=number_slider_11, Wrap=True)
merge_5 = Merge(Data1=curve_8, Data2=list_item_12)
nestingtwoitems_3 = CSharpScript(x=merge_5, Reference="C:\USERS\PAULA\APPDATA\ROAMING\GRASSHOPPER\LIBRARIES\ClipperTools.dll")  # -> A, B; inputs x: list of Polyline; same code as nestingtwoitems_2
number_slider_12 = Slider(1, range=0..3)
list_item_13 = ListItem(List=nestingtwoitems_3.A, Index=number_slider_12, Wrap=True)
list_item_14 = ListItem(List=nestingtwoitems_3.B, Index=number_slider_12, Wrap=True)
merge_6 = Merge(Data1=curve_9, Data2=list_item_14)
nestingtwoitems_4 = CSharpScript(x=merge_6, Reference="C:\USERS\PAULA\APPDATA\ROAMING\GRASSHOPPER\LIBRARIES\ClipperTools.dll")  # -> A, B; inputs x: list of Polyline; same code as nestingtwoitems_2
number_slider_13 = Slider(1, range=0..3)
list_item_15 = ListItem(List=nestingtwoitems_4.A, Index=number_slider_13, Wrap=True)
merge_7 = Merge(Data1=curve_7, Data2=list_item_11, Data3=list_item_13, Data4=list_item_15)
list_item_16 = ListItem(List=nestingtwoitems_4.B, Index=number_slider_13, Wrap=True)

# ==== cluster Pauls
L = ClusterInput()
A = ClusterInput()
crv = ClusterInput()
crv_2 = Curve(flatten(crv))
divlength = DivideLength(Curve=crv_2, Length=L)  # -> Points, Tangents, Parameters
Z = UnitZ(Factor=1)
lng = ListLength(List=divlength.Points)  # -> flatten(Length)
divide = DivideCurve(Curve=crv_2, Count=lng, Kinks=True)  # -> Points, Tangents, Parameters
xprod = CrossProduct(VectorA=divide.Tangents, VectorB=Z, Unitize=False)  # -> Vector, Length
amp = Amplitude(Vector=xprod.Vector, Amplitude=A)
move = Move(Geometry=divide.Points, Motion=amp)  # -> Geometry, Transform
vdis = VectorDisplay(Anchor=divide.Points, Vector=amp)
cir = Circle(Plane=move.Geometry, Radius=A)  # -> graft(Circle)
ccx = CurveCurve(CurveA=cir, CurveB=crv_2)  # -> simplify(Points), ParamsA, ParamsB
pshift = ShiftPaths(Data=ccx.Points, Offset=-1)
lng_2 = ListLength(List=pshift)
equals = Equality(FirstNumber=lng_2, SecondNumber=Slider(1, range=0..4))  # -> Equality, Inequality
dispatch = Dispatch(List=flatten(divide.Points), DispatchPattern=flatten(equals.Equality))  # -> ListA, ListB
pt = Point(dispatch.ListA)
c_script = CSharpScript(pt=pt, t=L)  # -> out, A, B; inputs pt: list of Point3d, t: Double
# ---------- c_script: C# usings ----------
using System.IO;
using System.Linq;
using System.Data;
using System.Drawing;
using System.Reflection;
using System.Windows.Forms;
using System.Xml;
using System.Xml.Linq;
using System.Runtime.InteropServices;

using Rhino.DocObjects;
using Rhino.Collections;
using GH_IO;
using GH_IO.Serialization;
# ---------- c_script: C# ----------
    List<Point3d> PtOut = new List<Point3d>();
    Point3d temp = pt[0];
    int ind1 = pt.IndexOf(temp);
    PtOut.Add(temp);
    pt.RemoveAt(0);
    double d = new double();

    int N = pt.Count;

    for(int i = 0; i < N;i++){


      if(ind1 == pt.Count ){
        ind1 = 0;
      }



      d = temp.DistanceTo(pt[ind1]);

      if(d > 1.5 * t){
        temp = Point3dList.ClosestPointInList(pt, temp);
        ind1 = pt.IndexOf(temp);
      }
      else{
        temp = pt[ind1];
      }

      PtOut.Add(temp);
      pt.Remove(temp);
    }
    PtOut.Add(PtOut[0]);
    Polyline Poly = new Polyline(PtOut);

    A = Poly;
    B = PtOut;
# ---------- end c_script ----------
crv_3 = Curve(c_script.A)
crv_4 = ClusterOutput(crv_3)

# ==== cluster Att_toR
B = ClusterInput()
att = ClusterInput()
att_2 = Attributes(att)
prgm = Programme(Attributes=att_2)  # -> Tags, Areas, Colors, Legends
expression = Expression(x=prgm.Areas, Expression="Sqrt(x/π)")
multiplication = Multiplication(A=expression, B=B)
material = CreateMaterial(Diffuse=prgm.Colors, Specular=RGB(255, 255, 255), Emission=RGB(0, 0, 0), Transparency=0.5, Shine=0)
M = ClusterOutput(material)
R = ClusterOutput(multiplication)
