# Grasshopper definition FloorPlanGHOne.gh (Grasshopper 1.0.7)
# plug-ins: treesloth01, FloorsAndVolumes, TT Toolbox, SpaceSyntaxDesign_GH

text = Text(Tree({1}: ["Área de control vehicular - Vigilancia", "1", "1.5", "1.5", "1"], {2}: ["Parqueaderos vehicular (5,00 x 2,50 mts)", "5", "12.5", "62.5", "1"], {3}: ["Parqueaderos discapacitados (5,00 x 3,70 mts)", "1", "18.5", "18.5", "1"], {4}: ["Parqueaderos bicicletas/motos", "5", "1.2", "6", "1"], {5}: ["Zona de Parqueo ambulancias", "1", "11", "11", "1"], {6}: ["*", "*", "*", "*", ""]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))
partitiontreeatchar = CSharpScript(data=text, erase="*")  # -> A; inputs data: tree of String, erase: String
# ---------- partitiontreeatchar: C# ----------
    var treeOut = new DataTree<string>();
    int path = 0;

    for( int i = 0; i < data.BranchCount; ++i )
      for( int j = 0; j < data.Branch(i).Count; ++j )
      {

        if( data.Branch(i)[j] != erase )
        {

          treeOut.Add(data.Branch(i)[j], new GH_Path(path));
          //path++;

        }
        
        else
        {
        
          path++;
        
        }

      }

    A = treeOut;
# ---------- end partitiontreeatchar ----------
columns = Curve([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])
boolean_toggle = BooleanToggle(False)
cleantreefromempty = CSharpScript(data=partitiontreeatchar)  # -> A; inputs data: tree of String
# ---------- cleantreefromempty: C# ----------
    var treeOut = new DataTree<string>();

    foreach( var path in data.Paths )
    {
    
      var branch = data.Branch(path);
      
      foreach( var item in branch )
      {
      
        if( !String.IsNullOrEmpty(item) )
        treeOut.Add( item, path );
      
      }
    
    }

    A = treeOut;
# ---------- end cleantreefromempty ----------
gene_pool = GenePool(
    Decimals=2,
    Maximum=1,
    Minimum=0,
    Value=[0.7391099784, 0.1303121267, 0.005614509809, 0.2202860183, 0.858906751, 0.4042975672, 0.5096383027, 0.7749257306, 0.1210632916, 0.3191320553, 0.998234855, 0.01787973056, 0.6161833939, 0.6093468883, 0.4360951848, 0.1514081294, 0.5330236864, 0.2464500248, 0.8699018801, 0.365249423, 0.4542958883, 0.6925012282, 0.1561447094])
gene_pool_2 = GenePool(
    Decimals=2,
    Maximum=1,
    Minimum=0,
    Value=[0.9477949519, 0.148604611, 0.7767652109, 0.8995576202, 0.5165604164, 0.8100209687, 0.6428454116, 0.652788515, 0.1768977773, 0.5226990644, 0.9076795051, 0.999120445, 0.1140714787, 0.8310783276, 0.0682874299, 0.2781102435, 0.08916403637, 0.9489330025, 0.7352910096, 0.1984965495, 0.4607138478, 0.989318334, 0.372096874])
curve = Curve(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)
renumber_paths = RenumberPaths(Data=cleantreefromempty)
text_2 = Text(Tree({1}: ["Área de control vehicular - Vigilancia", "1", "1.5", "1.5", "1", "", ""], {2}: ["Parqueaderos vehicular (5,00 x 2,50 mts)", "5", "12.5", "62.5", "1", "", ""], {3}: ["Parqueaderos discapacitados (5,00 x 3,70 mts)", "1", "18.5", "18.5", "1", "", ""], {4}: ["Parqueaderos bicicletas/motos", "5", "1.2", "6", "1", "", ""], {5}: ["Zona de Parqueo ambulancias", "1", "11", "11", "1", "", ""], {6}: ["*", "*", "*", "*", "", "", ""]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))
read_excel_sheet = ReadExcelSheet(Run=boolean_toggle, Worksheet="1", Listen=boolean_toggle)  # -> UserMessages, Columns, Rows
construct_point = ConstructPoint(XCoordinate=gene_pool, YCoordinate=gene_pool_2, ZCoordinate=0)
surface = Surface(reparameterize(curve))
evaluate_surface = EvaluateSurface(Surface=surface, Point=construct_point)  # -> Point, Normal, UDirection, VDirection, Frame
cullbranchesfromindex = CSharpScript(branches=renumber_paths, cullFrom=Slider(4, range=0..10))  # -> out, treeOut; inputs branches: tree of String, cullFrom: Int32
# ---------- cullbranchesfromindex: C# ----------
    var newTree = new DataTree<string>();

    for( int i = 0; i < branches.BranchCount; ++i )
    {

      var path = branches.Path(i);

      if( path.Indices[0] >= cullFrom )

        newTree.AddRange(branches.Branch(i), path);

    }

    treeOut = newTree;
# ---------- end cullbranchesfromindex ----------
partitiontreeatchar_2 = CSharpScript(data=text_2, erase="*")  # -> A; inputs data: tree of String, erase: String; same code as partitiontreeatchar
point = Point(evaluate_surface.Point)
renumber_paths_2 = RenumberPaths(Data=cullbranchesfromindex.treeOut)
cleantreefromempty_2 = CSharpScript(data=partitiontreeatchar_2)  # -> A; inputs data: tree of String; same code as cleantreefromempty
number_slider = Slider(4.091, range=0..10)
gene_pool_3 = GenePool(
    Decimals=2,
    Maximum=10,
    Minimum=5,
    Value=[7.934690997, 6.889443729, 8.001698606, 5.464351936, 9.092780631, 9.702318599, 7.354125521, 5.43, 5.06, 7.12, 6.984789785, 6.382051663, 8.749776359, 6.256582984, 5.17566937, 6.779282292, 5.340106152, 7.912539804, 9.900536821, 6.702777868, 8.611523767, 6.407633508, 5.082015728])
panel = Panel("PuntosTotalX")  # disabled
panel_2 = Panel("PuntosTotalY")  # disabled
construct_domain = ConstructDomain(DomainStart=0, DomainEnd=1)  # disabled
construct_domain_2 = ConstructDomain(DomainStart=0, DomainEnd=1)  # disabled
construct_domain_3 = ConstructDomain(DomainStart=0, DomainEnd=1)
construct_domain_4 = ConstructDomain(DomainStart=0, DomainEnd=1)
voronoi = Voronoi(Points=point, BruteForceOverride=False)  # disabled
renumber_paths_3 = RenumberPaths(Data=cleantreefromempty_2)
partition_list = PartitionList(List=renumber_paths_2, Size=Slider(5, range=0..10))
region_intersection = RegionIntersection(CurvesA=voronoi, CurvesB=curve)  # disabled
number_slider_2 = Slider(0.1, range=0..1)
gene_pool_4 = GenePool(Decimals=2, Maximum=10, Minimum=5, Value=[5, 5, 5, 5, 5, 5, 5.011922529, 5, 5, 5, 5, 5, 5, 5, 5, 5, 5, 5, 5, 5, 5, 5, 5])
cullbranchesfromindex_2 = CSharpScript(branches=renumber_paths_3, cullFrom=Slider(4, range=0..10))  # -> out, treeOut; inputs branches: tree of String, cullFrom: Int32; same code as cullbranchesfromindex
renumber_paths_4 = RenumberPaths(Data=cullbranchesfromindex_2.treeOut)
prunelastbranch = CSharpScript(branches=renumber_paths_4)  # -> prunedTree, branchCounter; inputs branches: tree of String
# ---------- prunelastbranch: C# ----------
    var treeOut = new DataTree<string>();

    for( int i = 0; i < branches.BranchCount - 1; ++i )
      treeOut.AddRange(branches.Branch(i), new GH_Path(i));

    prunedTree = treeOut;
    branchCounter = treeOut.BranchCount;
# ---------- end prunelastbranch ----------
text_3 = Text(partition_list)
puntosoriginaly = GenePool(Decimals=2, Maximum=1, Minimum=0, Value=[0.4167068794, 0.7828582161, 0.2381554415, 0.5])
puntosoriginalx = GenePool(Decimals=2, Maximum=1, Minimum=0, Value=[0.04695515989, 0.1055957303, 0.4789334668, 0.5])
discontinuity = Discontinuity(Curve=region_intersection, Level=1)  # -> Points, Parameters; disabled
list_item = ListItem(List=text_3, Index=Slider(2, range=0..3), Wrap=True)
number = Number(flatten(list_item))
expression = Expression(x=number, Expression="Sqrt(x/π)")
multiplication = Multiplication(A=gene_pool_3, B=expression)
ghpython_script = GhPythonScript(r=multiplication, P=point)  # -> PL; inputs r: list, P: list of Point3d
# ---------- ghpython_script: Python ----------
from ghpythonlib.componentbase import executingcomponent as component
import Grasshopper, GhPython
import System
import Rhino
import rhinoscriptsyntax as rs

class MyComponent(component):
    
    def RunScript(self, r, P):
        """Provides a scripting component.
            Inputs:
                x: The x script variable
                y: The y script variable
            Output:
                a: The a output variable"""
        
        __author__ = "Paula"
        __version__ = "2019.04.25"
        
        import rhinoscriptsyntax as rs
        from Rhino.Geometry import Point3d as P3
        from Rhino.Geometry import Polyline as PLine
        
        def taxicab_midnormal ( Point_1 = P3(0,0,0), Point_2 = P3(0,0,0) , leng = 10000):
                
            dx = abs(Point_1.X - Point_2.X)
            dy = abs(Point_1.Y - Point_2.Y)
            
            C = P3 ( ( ( Point_1.X + Point_2.X ) / 2 ), ( ( Point_1.Y + Point_2.Y ) / 2 ), ( ( Point_1.Z + Point_2.Z ) / 2 ) )
            
            """ MPQN, in which M is on the lengeft(X-) or bottom(Y-) """
            P = P3 (0,0,C.Z)
            Q = P3 (0,0,C.Z)
            M = P3 (0,0,C.Z)
            N = P3 (0,0,C.Z)
            
            if dx > dy:
                P.Y = C.Y + dy / 2
                Q.Y = C.Y - dy / 2
                M.Y = P.Y + leng
                N.Y = Q.Y - leng
                if bool(Point_1.Y > Point_2.Y) ^ bool(Point_1.X > Point_2.X):
                    P.X = C.X + dy / 2
                    Q.X = C.X - dy / 2
                else:
                    P.X = C.X - dy / 2
                    Q.X = C.X + dy / 2
                M.X = P.X
                N.X = Q.X
            else:
                if dx < dy:
                    P.X = C.X + dx / 2
                    Q.X = C.X - dx / 2
                    M.X = P.X + leng
                    N.X = Q.X - leng
                    if bool(Point_1.Y > Point_2.Y) ^ bool(Point_1.X > Point_2.X):
                        P.Y = C.Y + dx / 2
                        Q.Y = C.Y - dx / 2
                    else:
                        P.Y = C.Y - dx / 2
                        Q.Y = C.Y + dx / 2
                    M.Y = P.Y
                    N.Y = Q.Y
                else:
                    if bool(Point_1.Y > Point_2.Y) ^ bool(Point_1.X > Point_2.X):
                        P.Y = C.Y - dx / 2
                        Q.Y = C.Y + dx / 2
                        P.X = C.X - dy / 2
                        Q.X = C.X + dy / 2
                        M.Y = P.Y - leng
                        M.X = P.X - leng
                        N.Y = Q.Y + leng
                        N.X = Q.X + leng
                    else:
                        P.Y = C.Y - dx / 2
                        Q.Y = C.Y + dx / 2
                        P.X = C.X + dy / 2
                        Q.X = C.X - dy / 2
                        M.Y = P.Y - leng
                        M.X = P.X + leng
                        N.Y = Q.Y + leng
                        N.X = Q.X - leng
        
            return rs.AddPolyline( [M , P , Q , N] )
            
        def taxicab_circle ( point = P3(0,0,0), r = 1 ):
            A = P3( point.X + r, point.Y, point.Z )
            B = P3( point.X, point.Y + r, point.Z )
            C = P3( point.X - r, point.Y, point.Z )
            D = P3( point.X, point.Y - r, point.Z )
            return rs.AddPolyline( [A, B, C, D, A] )
            
        l = []
        
        """ PL = taxicab_midnormal ( A, B, r ) """
        
        pts = P
        
        polylines = []
        for i in range( len( P ) ):
            l.append( r[i] * 0.5 )
            polylines.append(taxicab_circle( P[i], l[i] ))
            rs.RotateObject( polylines[i], P[i], 45 )
        
        for i in range(len(polylines)):
            for j in range(i):
                if i == j:
                    continue
                if rs.CurveBooleanUnion( [ polylines[i], polylines[j] ] ):
                    MN = taxicab_midnormal( pts[i], pts[j], r[i] )
                    
                    ccx = rs.CurveCurveIntersection( polylines[i], MN )
                    if ccx is None:
                        continue
                    if ccx[0][0] == 2:
                        continue
                    para_a = [ ccx[0][5], ccx[1][5] ]
                    para_b = [ ccx[0][7], ccx[1][7] ]
                    
                    if para_b[0] > para_b[1]:
                        para_b = [ para_b[1], para_b[0] ]
                    
                    probable_dash = rs.SplitCurve(polylines[i], para_a)
                    edge = rs.TrimCurve(MN, para_b, False )
                    edgepts = rs.CurvePoints(edge)
                    
                    for crv in probable_dash:
                        crvpts = rs.CurvePoints(crv)
                        if rs.PointCompare( crvpts[0], edgepts[0] ):
                            crvpts.reverse()
                        newpl = rs.AddPolyline( edgepts + crvpts )
                        if rs.PointInPlanarClosedCurve( pts[i], newpl ):
                            polylines[i] = newpl
                            break
                    
                    
                    ccx = rs.CurveCurveIntersection( polylines[j], MN )
                    if ccx is None:
                        continue
                    para_a = [ ccx[0][5], ccx[1][5] ]
                    para_b = [ ccx[0][7], ccx[1][7] ]
                    
                    if para_b[0] > para_b[1]:
                        para_b = [ para_b[1], para_b[0] ]
                    
                    probable_dash = rs.SplitCurve(polylines[j], para_a)
                    edge = rs.TrimCurve(MN, para_b, False )
                    edgepts = rs.CurvePoints(edge)
                    
                    for crv in probable_dash:
                        crvpts = rs.CurvePoints(crv)
                        if rs.PointCompare( crvpts[0], edgepts[0] ):
                            crvpts.reverse()
                        newpl = rs.AddPolyline( edgepts + crvpts )
                        if rs.PointInPlanarClosedCurve( pts[j], newpl ):
                            polylines[j] = newpl
                            break
            
        
        PL = polylines
        
        # return outputs if you have them; here I try it for you:
        return PL
# ---------- end ghpython_script ----------
manhattan45 = GhPythonScript(r=multiplication, P=point)  # -> PL; inputs r: list, P: list of Point3d
# ---------- manhattan45: Python ----------
from ghpythonlib.componentbase import executingcomponent as component
import Grasshopper, GhPython
import System
import Rhino
import rhinoscriptsyntax as rs
from Rhino.Geometry import Point3d as P3
from Rhino.Geometry import Polyline as PLine

class MyComponent(component):
    
    def RunScript(self, r, P):
        
        def taxicab_midnormal ( Point_1 = P3(0,0,0), Point_2 = P3(0,0,0) , leng = 10000):
            
            dx = abs(Point_1.X - Point_2.X)
            dy = abs(Point_1.Y - Point_2.Y)
            
            C = P3 ( ( ( Point_1.X + Point_2.X ) / 2 ), ( ( Point_1.Y + Point_2.Y ) / 2 ), ( ( Point_1.Z + Point_2.Z ) / 2 ) )
            
            """ MPQN, in which M is on the lengeft(X-) or bottom(Y-) """
            P = P3 (0,0,C.Z)
            Q = P3 (0,0,C.Z)
            M = P3 (0,0,C.Z)
            N = P3 (0,0,C.Z)
            
            if dx > dy:
                P.Y = C.Y + dy / 2
                Q.Y = C.Y - dy / 2
                M.Y = P.Y + leng
                N.Y = Q.Y - leng
                if bool(Point_1.Y > Point_2.Y) ^ bool(Point_1.X > Point_2.X):
                    P.X = C.X + dy / 2
                    Q.X = C.X - dy / 2
                else:
                    P.X = C.X - dy / 2
                    Q.X = C.X + dy / 2
                M.X = P.X
                N.X = Q.X
            else:
                if dx < dy:
                    P.X = C.X + dx / 2
                    Q.X = C.X - dx / 2
                    M.X = P.X + leng
                    N.X = Q.X - leng
                    if bool(Point_1.Y > Point_2.Y) ^ bool(Point_1.X > Point_2.X):
                        P.Y = C.Y + dx / 2
                        Q.Y = C.Y - dx / 2
                    else:
                        P.Y = C.Y - dx / 2
                        Q.Y = C.Y + dx / 2
                    M.Y = P.Y
                    N.Y = Q.Y
                else:
                    if bool(Point_1.Y > Point_2.Y) ^ bool(Point_1.X > Point_2.X):
                        P.Y = C.Y - dx / 2
                        Q.Y = C.Y + dx / 2
                        P.X = C.X - dy / 2
                        Q.X = C.X + dy / 2
                        M.Y = P.Y - leng
                        M.X = P.X - leng
                        N.Y = Q.Y + leng
                        N.X = Q.X + leng
                    else:
                        P.Y = C.Y - dx / 2
                        Q.Y = C.Y + dx / 2
                        P.X = C.X + dy / 2
                        Q.X = C.X - dy / 2
                        M.Y = P.Y - leng
                        M.X = P.X + leng
                        N.Y = Q.Y + leng
                        N.X = Q.X - leng
        
            return rs.AddPolyline( [M , P , Q , N] )
        
        def taxicab_circle ( point = P3(0,0,0), r = 1 ):
            A = P3( point.X + r, point.Y, point.Z )
            B = P3( point.X, point.Y + r, point.Z )
            C = P3( point.X - r, point.Y, point.Z )
            D = P3( point.X, point.Y - r, point.Z )
            return rs.AddPolyline( [A, B, C, D, A] )
        
        l = []
        
        """ PL = taxicab_midnormal ( A, B, r ) """
        
        pts = P
        
        polylines = []
        for i in range( len( P ) ):
            l.append( r[i] * 0.5 )
            polylines.append(taxicab_circle( P[i], l[i] ))
            rs.RotateObject( polylines[i], P[i], 45 )
        
        for i in range(len(polylines)):
            for j in range(i):
                if i == j:
                    continue
                if rs.CurveBooleanUnion( [ polylines[i], polylines[j] ] ):
                    MN = taxicab_midnormal( pts[i], pts[j], r[i] )
                    
                    ccx = rs.CurveCurveIntersection( polylines[i], MN )
                    if ccx is None:
                        continue
                    if ccx[0][0] == 2:
                        continue
                    para_a = [ ccx[0][5], ccx[1][5] ]
                    para_b = [ ccx[0][7], ccx[1][7] ]
                    
                    if para_b[0] > para_b[1]:
                        para_b = [ para_b[1], para_b[0] ]
                    
                    probable_dash = rs.SplitCurve(polylines[i], para_a)
                    edge = rs.TrimCurve(MN, para_b, False )
                    edgepts = rs.CurvePoints(edge)
                    
                    for crv in probable_dash:
                        crvpts = rs.CurvePoints(crv)
                        if rs.PointCompare( crvpts[0], edgepts[0] ):
                            crvpts.reverse()
                        newpl = rs.AddPolyline( edgepts + crvpts )
                        if rs.PointInPlanarClosedCurve( pts[i], newpl ):
                            polylines[i] = newpl
                            break
                    
                    
                    ccx = rs.CurveCurveIntersection( polylines[j], MN )
                    if ccx is None:
                        continue
                    para_a = [ ccx[0][5], ccx[1][5] ]
                    para_b = [ ccx[0][7], ccx[1][7] ]
                    
                    if para_b[0] > para_b[1]:
                        para_b = [ para_b[1], para_b[0] ]
                    
                    probable_dash = rs.SplitCurve(polylines[j], para_a)
                    edge = rs.TrimCurve(MN, para_b, False )
                    edgepts = rs.CurvePoints(edge)
                    
                    for crv in probable_dash:
                        crvpts = rs.CurvePoints(crv)
                        if rs.PointCompare( crvpts[0], edgepts[0] ):
                            crvpts.reverse()
                        newpl = rs.AddPolyline( edgepts + crvpts )
                        if rs.PointInPlanarClosedCurve( pts[j], newpl ):
                            polylines[j] = newpl
                            break
            
        
        PL = polylines
        
        # return outputs if you have them; here I try it for you:
        return PL
# ---------- end manhattan45 ----------
region_intersection_2 = RegionIntersection(CurvesA=manhattan45, CurvesB=curve)
circle_fit = CircleFit(Points=discontinuity.Points)  # -> Circle, Radius, Deviation; disabled
construct_point_2 = ConstructPoint(XCoordinate=puntosoriginalx, YCoordinate=puntosoriginaly, ZCoordinate=0)
number_slider_3 = Slider(51, range=0..100)
prunelastbranch_2 = CSharpScript(branches=prunelastbranch.prunedTree)  # -> prunedTree, branchCounter; inputs branches: tree of String; same code as prunelastbranch
genepoolmodifier = GenePoolModifier(GeneList="PuntosOriginalX", Count=prunelastbranch_2.branchCounter, Domain=construct_domain_3)
genepoolmodifier_2 = GenePoolModifier(GeneList="PuntosOriginalY", Count=prunelastbranch_2.branchCounter, Domain=construct_domain_4)
surface_2 = Surface(region_intersection_2)
evaluate_surface_2 = EvaluateSurface(Surface=reparameterize(curve), Point=construct_point_2)  # -> Point, Normal, UDirection, VDirection, Frame
multiplication_2 = Multiplication(A=gene_pool_4, B=Slider(0.5, range=0..1))
construct_domain_5 = ConstructDomain(DomainStart=expr("-x", multiplication_2), DomainEnd=multiplication_2)  # -> flatten(Domain)
multiplication_3 = Multiplication(A=list_item, B=Slider(0.2, range=0..1))
rectangle = Rectangle(Plane=PlaneXY(0, 0, 0), XSize=number_slider_3, YSize=number_slider_3, Radius=0)  # -> Rectangle, Length
point_2 = Point(evaluate_surface_2.Point)
rectangle_2 = Rectangle(Plane=point, XSize=construct_domain_5, YSize=construct_domain_5, Radius=0)  # -> Rectangle, Length
ghpython_script_2 = GhPythonScript(r=point_2, P=point_2)  # -> PL; inputs r: list, P: list of Point3d; disabled; same code as ghpython_script
construct_domain_6 = ConstructDomain(DomainStart=expr("-x", multiplication_3), DomainEnd=multiplication_3)  # -> flatten(Domain)
partition_list_2 = PartitionList(List=prunelastbranch.prunedTree, Size=Slider(5, range=0..10))
region_intersection_3 = RegionIntersection(CurvesA=rectangle_2.Rectangle, CurvesB=curve)
curve_2 = Curve(region_intersection_3)
collision_many_many = CollisionManyMany(Colliders=curve_2)  # -> Collision, Indices
list_length = ListLength(List=region_intersection_3)
text_4 = Text(partition_list_2)
area = Area(Geometry=region_intersection_3, UseTasks=False)  # -> Area, Centroid
random = Random(Range=Domain(0, 1), Number=list_length, Seed=Slider(1000, range=0..1000))
random_2 = Random(Range=Domain(0, 1), Number=list_length, Seed=Slider(626, range=0..1000))
mass_addition = MassAddition(Input=collision_many_many.Collision)  # -> Result, PartialResults
random_3 = Random(Range=Domain(0, 1), Number=list_length, Seed=Slider(482, range=0..1000))
list_item_2 = ListItem(List=text_4, Index=Slider(0, range=0..3), Wrap=True)
flatten_tree = FlattenTree(Tree=list_item_2, Path="{0}")
list_length_2 = ListLength(List=flatten_tree)
genepoolmodifier_3 = GenePoolModifier(GeneList=panel, Count=list_length_2, Domain=construct_domain)  # disabled
genepoolmodifier_4 = GenePoolModifier(GeneList=panel_2, Count=list_length_2, Domain=construct_domain_2)  # disabled
series = Series(Start=0, Step=Slider(0.0363, range=0..1), Count=list_length_2)
series_2 = Series(Start=0, Step=Slider(0.0363, range=0..1), Count=list_length_2)
repeat_data = RepeatData(Data=Slider(0.5, range=0..1), Length=list_length_2)
construct_point_3 = ConstructPoint(XCoordinate=series_2, YCoordinate=series, ZCoordinate=0)
evaluate_surface_3 = EvaluateSurface(Surface=reparameterize(curve), Point=construct_point_3)  # -> Point, Normal, UDirection, VDirection, Frame
addindextolabels = CSharpScript(listIn=flatten_tree)  # -> listOut; inputs listIn: list of String
# ---------- addindextolabels: C# ----------
    var list = new List<string>();

    for( int i = 0; i < listIn.Count; ++i )
      list.Add(i.ToString() + " " + listIn[i]);

    listOut = list;
# ---------- end addindextolabels ----------
random_4 = Random(Range=Domain(0, 1), Number=list_length_2, Seed=Slider(3299, range=0..10000))
random_5 = Random(Range=Domain(0, 1), Number=list_length_2, Seed=Slider(3949, range=0..10000))
random_6 = Random(Range=Domain(0, 1), Number=list_length_2, Seed=Slider(3103, range=0..10000))
point_3 = Point(evaluate_surface_3.Point)
graphfromnodes_links = GraphFromNodesLinks(Points=point_3)  # -> Graph, GraphVertices, Attributes
colour_rgb_f = ColourRGBF(Alpha=1, Red=random_6, Green=random_5, Blue=random_4)
text_tag = TextTag(Location=point_3, Text=addindextolabels, Colour=colour_rgb_f)
dot_display = DotDisplay(Point=point_3, Colour=colour_rgb_f, Size=1)
explode_tree = ExplodeTree(Data=simplify(graft(point_3)))  # -> Branch0, Branch1, Branch2, Branch3, Branch4, Branch5, Branch6, Branch7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
panel_3 = Panel(flatten_tree)
line = Line(StartPoint=explode_tree.Branch0, EndPoint=explode_tree.Branch7)
line_2 = Line(StartPoint=explode_tree.Branch0, EndPoint=explode_tree.Branch8)
line_3 = Line(StartPoint=explode_tree.Branch1, EndPoint=explode_tree.Branch7)
line_4 = Line(StartPoint=explode_tree.Branch1, EndPoint=explode_tree.Branch8)
line_5 = Line(StartPoint=explode_tree.Branch0, EndPoint=explode_tree.Branch9)
line_6 = Line(StartPoint=explode_tree.Branch1, EndPoint=explode_tree.Branch9)
line_7 = Line(StartPoint=explode_tree.Branch2, EndPoint=explode_tree.Branch3)
line_8 = Line(StartPoint=explode_tree.Branch2, EndPoint=explode_tree.Branch4)
line_9 = Line(StartPoint=explode_tree.Branch5)
mass_addition_2 = MassAddition(Input=area.Area)  # -> Result, PartialResults
panel_4 = Panel(mass_addition.Result)
panel_5 = Panel(text_4)
colour_rgb_f_2 = ColourRGBF(Alpha=1, Red=random, Green=random_2, Blue=random_3)
surface_3 = Surface(region_intersection_3)
panel_6 = Panel(mass_addition_2.Result)
custom_preview = CustomPreview(Geometry=surface_3, Material=colour_rgb_f_2)
galapagos = Galapagos(fitness=addition, gene=[gene_pool, gene_pool_2])
panel_7 = Panel(list_item_2)
expression_2 = Expression(x=mass_addition.Result, z=Slider(1, range=0..100), Expression="If( x < z, 0, 10000 )")
expression_3 = Expression(
    x=mass_addition_2.Result,
    y=Slider(320, range=0..1000),
    z=Slider(300, range=0..1000),
    Expression="If( ( x < y) And ( x > z), 0, 1000 )")
addition = Addition(A=expression_3, B=expression_2)
panel_8 = Panel(addition)
