# Grasshopper definition IterationOne.gh (Grasshopper 1.0.7)
# plug-ins: SpacePartition, PTComponentLibrary, MetaHopper

# ---- group: InputData / Labels
txt = Text(Tree({0;0}: ["Unidades sanitarias mujeres / privadas"], {0;1}: ["Unidades sanitarias hombres / privadas"], {0;2}: ["Cuarto de aseo "], {0;3}: ["Área de aseo de residuos"], {0;4}: ["Almacen General Insumos de Aseo "], {0;5}: ["Área de UPC-Rack"]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))

# ---- group: InputData / Topology
int = Integer(Tree({0}: [7], {1}: [7], {2}: [3], {3}: [2, 11], {4}: [16, 21, 19], {5}: [19]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))

# ---- group: InputData / ID
txt_2 = Text(Tree({0;0}: ["5"], {0;1}: ["5"], {0;2}: ["5"], {0;3}: ["5"], {0;4}: ["5"], {0;5}: ["5"]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))

# ---- group: InputData / Areas
txt_3 = Text(Tree({0;0}: ["3"], {0;1}: ["3"], {0;2}: ["6"], {0;3}: ["1"], {0;4}: ["5"], {0;5}: ["4"]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))

# ---- group: InputData
number_slider = Slider(1, range=0..10)
path_mapper = PathMapper(txt, source="{A;B}", target="{A}")
path_mapper_2 = PathMapper(txt_3, source="{A;B}", target="{A}")
path_mapper_3 = PathMapper(int, source="{A;B}", target="{A}")
path_mapper_4 = PathMapper(txt_2, source="{A;B}", target="{A}")
prunebranches = CSharpScript(branches=path_mapper, howMany=number_slider)  # -> prunedTree, branchCounter; inputs branches: tree of String, howMany: Int32
# ---------- prunebranches: C# ----------
    var treeOut = new DataTree<string>();

    for( int i = 0; i < branches.BranchCount - howMany; ++i )
      treeOut.AddRange(branches.Branch(i), new GH_Path(i));

    prunedTree = treeOut;
    branchCounter = treeOut.BranchCount;
# ---------- end prunebranches ----------
prunebranches_2 = CSharpScript(branches=path_mapper_2, howMany=number_slider)  # -> prunedTree, branchCounter; inputs branches: tree of String, howMany: Int32; same code as prunebranches
ma = MassAddition(Input=prunebranches_2.prunedTree)  # -> Result, PartialResults
flatten = FlattenTree(Tree=prunebranches_2.prunedTree, Path="{0}")
lng = ListLength(List=flatten)
int_2 = Integer(Slider(4, range=0..10))

# ---- group: OriginalSilhouette
crv = Curve(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)

# ---- group: Voronoi
number_slider_2 = Slider(0, range=0..0.1)
subtraction = Subtraction(A=Slider(1, range=0..1), B=number_slider_2)
dom = ConstructDomain(DomainStart=number_slider_2, DomainEnd=subtraction)

# ----
genemodifier = GenePoolModifier(GeneList="SeedsX", Count=lng, Domain=dom, Randomize=Button(), PercentageOfRandomization=Slider(1, range=0..1))
genemodifier_2 = GenePoolModifier(GeneList="SeedsY", Count=lng, Domain=dom, Randomize=Button(), PercentageOfRandomization=Slider(1, range=0..1))
bbox = BoundingBox(Content=crv, Plane=PlaneXY(0, 0, 0))  # -> Box, Box_2
lng_2 = ListLength(List=flatten(ma.Result))
lng_3 = ListLength(List=flatten(ma.Result))
relay = Relay()
dom_2 = ConstructDomain(DomainStart=0, DomainEnd=1)
dom_3 = ConstructDomain(DomainStart=0, DomainEnd=1)
pt = Point(Point(-25.70833253, 12.4308895, 0))
pt_2 = Point(Point(-30.32239547, -7.451527156, 0))
ptsrfdomnum = SurfaceDomainNumber(Surface=bbox.Box, UNumber=Slider(2, range=0..100), VNumber=Slider(20, range=0..100))
genemodifier_3 = GenePoolModifier(GeneList="FirstStepY", Count=lng_2, Domain=dom_2, Randomize=Button(), PercentageOfRandomization=Slider(1, range=0..1))
genemodifier_4 = GenePoolModifier(GeneList="FirstStepX", Count=lng_3, Domain=dom_3, Randomize=Button(), PercentageOfRandomization=Slider(1, range=0..1))
firststepy = GenePool(Decimals=2, Maximum=1, Minimum=0, Value=[1, 0.84, 0.23, 0])
firststepx = GenePool(Decimals=2, Maximum=1, Minimum=0, Value=[0.95, 0.83, 1, 0.54])
ptpointatts = PointAttraction(Grid=ptsrfdomnum, PtAtts=[pt_2, pt], Magnitude=Slider(-0.86, range=-1.01..1))  # -> Grid, Weights
ptborders = GenerateBorders(Grid=ptsrfdomnum, PanelShape=0)  # -> simplify(Border)
ptborders_2 = GenerateBorders(Grid=ptpointatts.Grid, PanelShape=0)  # -> simplify(Border)
pt_3 = ConstructPoint(XCoordinate=firststepx, YCoordinate=firststepy, ZCoordinate=0)
number_slider_3 = Slider(10, range=0..10)
sortxy = SortPointsXY(Grid=flatten(ptborders_2))
evalsrf = EvaluateSurface(Surface=reparameterize(crv), Point=pt_3)  # -> Point, Normal, UDirection, VDirection, Frame
area = Area(Geometry=sortxy)  # -> Area, Centroid
sort = SortList(Keys=area.Area, ValuesA=area.Area)  # -> Keys, ValuesA
lng_4 = ListLength(List=sort.ValuesA)
voronoi = Voronoi(Points=evalsrf.Point, Boundary=bbox.Box, BruteForceOverride=False)
item = ListItem(List=sort.ValuesA, Index=expr("x-1", lng_4), Wrap=True)
multiplication = Multiplication(A=item, B=Slider(0.6, range=0..1))

# ---- group: SpacePartition / RandomColourSeed
number_slider_4 = Slider(40, range=0..100)
number_slider_5 = Slider(238, range=0..1000)
number_slider_6 = Slider(326, range=0..1000)

# ----
flatten_2 = FlattenTree(Tree=ma.Result, Path="{0}")
panel = Panel(flatten_2)
galapagos = Galapagos(fitness=c_script, gene=[firststepx, firststepy])

# ---- group: SpacePartition
toggle = GroupToggle(ToggleActive=True, ToggleVisible=False)  # disabled
number_slider_7 = Slider(0.001, range=0..0.001)
multiplication_2 = Multiplication(A=multiplication, B=Slider(0.7, range=0..1))
dom_4 = ConstructDomain(DomainStart=Slider(0, range=0..100), DomainEnd=Slider(255, range=0..1000))
number_slider_8 = Slider(241, range=0..255)

# ----
spacepartition = SpacePartition(VoronoiIn=voronoi, GridIn=sortxy, AreaIn=multiplication, Distance=multiplication_2)

# ---- group: SpacePartition (continued)
sortxy_2 = SortPointsXY(Grid=flatten(spacepartition))
pararunion = ParallelRegionUnion(Curves=spacepartition)
missing = MissingGridCells(CulledGrid=flatten(sortxy_2), OriginalGrid=sortxy)
mgtree = MergeTreeMissing(CulledGrid=pararunion, MissingGridCells=missing)
pararunion_2 = ParallelRegionUnion(Curves=mgtree)
parallelregionintersection = ParallelRegionIntersection(CurvesA=crv, CurvesB=pararunion_2)
lng_5 = ListLength(List=flatten(parallelregionintersection))
random = Random(Range=dom_4, Number=lng_5, Seed=[number_slider_4, number_slider_5, number_slider_6], Integers=True)
bang = ExplodeTree(Data=random)  # -> Branch0, Branch1, Branch2
srf = Surface(parallelregionintersection)
rgb = ColourRGB(Alpha=Slider(10, range=0..10), Red=bang.Branch0, Green=bang.Branch1, Blue=bang.Branch2)
rgb_2 = ColourRGB(
    Alpha=number_slider_8,
    Red=bang.Branch0,
    Green=[55, 209, 59, 216, 1, 112, 142, 1, 76, 111, 92, 58, 62, 60, 197, 158, 67, 19, 183, 163, 50, 202, 112, 182, 111],
    Blue=[9, 120, 163, 36, 100, 115, 248, 253, 79, 124, 119, 250, 189, 19, 44, 159, 229, 29, 128, 139, 34, 211, 22, 234, 166])
preview = CustomPreview(Geometry=graft(voronoi), Material=graft(rgb))

# ----
area_2 = Area(Geometry=parallelregionintersection, UseTasks=False)  # -> flatten(Area), Centroid
panel_2 = Panel(area_2.Area)
c_script = CSharpScript(x=flatten_2, y=area_2.Area)  # -> out, A; inputs x: list, y: list
# ---------- c_script: C# ----------
    int xSize = x.Count, ySize = y.Count, dif = Math.Abs(xSize - ySize);

    double fitness = 0.0;

    if( dif == 0 )

      for( int i = 0; i < xSize; ++i )
      {

        double temp = Convert.ToDouble(x[i]) - Convert.ToDouble(y[i]);

        fitness += ( temp * temp );

      }

    else
    {

      fitness += dif * 100000;

    }

    A = fitness;
# ---------- end c_script ----------
rgb_3 = ColourRGB(Alpha=number_slider_8, Red=expr("x*2", bang.Branch1), Green=expr("x*0.5", bang.Branch1), Blue=0)

# ---- group: SpacePartition (continued)
preview_2 = CustomPreview(Geometry=srf, Material=graft(rgb_3))
