# Grasshopper definition IterationTwo.gh (Grasshopper 1.0.7)
# plug-ins: SpacePartition, PTComponentLibrary, MetaHopper

# ---- group: InputData / Labels
txt = Text(Tree({0;0}: ["Unidades sanitarias mujeres / privadas"], {0;1}: ["Unidades sanitarias hombres / privadas"], {0;2}: ["Cuarto de aseo "], {0;3}: ["Área de aseo de residuos"], {0;4}: ["Almacen General Insumos de Aseo "], {0;5}: ["Área de UPC-Rack"]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))

# ---- group: InputData / Topology
int = Integer(Tree({0}: [7], {1}: [7], {2}: [3], {3}: [2, 11], {4}: [16, 21, 19], {5}: [19]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))

# ---- group: InputData / ID
txt_2 = Text(Tree({0;0}: ["5"], {0;1}: ["5"], {0;2}: ["5"], {0;3}: ["5"], {0;4}: ["5"], {0;5}: ["5"]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))

# ---- group: InputData / Areas
txt_3 = Text(Tree({0;0}: ["3"], {0;1}: ["3"], {0;2}: ["6"], {0;3}: ["1"], {0;4}: ["5"], {0;5}: ["4"]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))

# ---- group: InputData
number_slider = Slider(1, range=0..10)
path_mapper = PathMapper(txt, source="{A;B}", target="{A}")
path_mapper_2 = PathMapper(txt_3, source="{A;B}", target="{A}")
path_mapper_3 = PathMapper(int, source="{A;B}", target="{A}")
path_mapper_4 = PathMapper(txt_2, source="{A;B}", target="{A}")
prunebranches = CSharpScript(branches=path_mapper, howMany=number_slider)  # -> prunedTree, branchCounter; inputs branches: tree of String, howMany: Int32
# ---------- prunebranches: C# ----------
    var treeOut = new DataTree<string>();

    for( int i = 0; i < branches.BranchCount - howMany; ++i )
      treeOut.AddRange(branches.Branch(i), new GH_Path(i));

    prunedTree = treeOut;
    branchCounter = treeOut.BranchCount;
# ---------- end prunebranches ----------
prunebranches_2 = CSharpScript(branches=path_mapper_2, howMany=number_slider)  # -> prunedTree, branchCounter; inputs branches: tree of String, howMany: Int32; same code as prunebranches
ma = MassAddition(Input=prunebranches_2.prunedTree)  # -> Result, PartialResults
flatten = FlattenTree(Tree=prunebranches_2.prunedTree, Path="{0}")
lng = ListLength(List=flatten)
int_2 = Integer(Slider(4, range=0..10))

# ---- group: OriginalSilhouette
crv = Curve(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)

# ---- group: Voronoi
number_slider_2 = Slider(0, range=0..0.1)
subtraction = Subtraction(A=Slider(1, range=0..1), B=number_slider_2)
dom = ConstructDomain(DomainStart=number_slider_2, DomainEnd=subtraction)

# ----
genemodifier = GenePoolModifier(GeneList="SeedsX", Count=lng, Domain=dom, Randomize=Button(), PercentageOfRandomization=Slider(1, range=0..1))
genemodifier_2 = GenePoolModifier(GeneList="SeedsY", Count=lng, Domain=dom, Randomize=Button(), PercentageOfRandomization=Slider(1, range=0..1))
bbox = BoundingBox(Content=crv, Plane=PlaneXY(0, 0, 0))  # -> Box, Box_2
lng_2 = ListLength(List=flatten(ma.Result))
lng_3 = ListLength(List=flatten(ma.Result))
relay = Relay()
dom_2 = ConstructDomain(DomainStart=0, DomainEnd=1)
dom_3 = ConstructDomain(DomainStart=0, DomainEnd=1)
ptsrfdomnum = SurfaceDomainNumber(Surface=bbox.Box, UNumber=Slider(3, range=0..100), VNumber=Slider(20, range=0..100))
genemodifier_3 = GenePoolModifier(GeneList="FirstStepY", Count=lng_2, Domain=dom_2, Randomize=Button(), PercentageOfRandomization=Slider(1, range=0..1))
genemodifier_4 = GenePoolModifier(GeneList="FirstStepX", Count=lng_3, Domain=dom_3, Randomize=Button(), PercentageOfRandomization=Slider(1, range=0..1))
pt = Point(Point(-26.65934414, 6.506436596, 0))  # disabled
firststepy = GenePool(Decimals=2, Maximum=1, Minimum=0, Value=[0.57, 0.62, 1, 0.27])
firststepx = GenePool(Decimals=2, Maximum=1, Minimum=0, Value=[0.08, 0.74, 0, 0.42])
closestptgrid = ClosestPointInGrid(Grid=ptsrfdomnum, Point=pt)  # -> ClosestPointInGrid, BranchOfGrid, LeafOfGrid; disabled
pt_2 = ConstructPoint(XCoordinate=firststepx, YCoordinate=firststepy, ZCoordinate=0)
evalsrf = EvaluateSurface(Surface=reparameterize(crv), Point=pt_2)  # -> Point, Normal, UDirection, VDirection, Frame
number_slider_3 = Slider(4, range=0..10)
number_slider_4 = Slider(4, range=0..10)
number_slider_5 = Slider(4, range=0..10)
number_slider_6 = Slider(4, range=0..10)
number_slider_7 = Slider(1, range=0..1)
dom_4 = ConstructDomain(DomainStart=expr("-x", number_slider_4), DomainEnd=number_slider_4)
dom_5 = ConstructDomain(DomainStart=expr("-x", number_slider_3), DomainEnd=number_slider_3)
ptcol = ExtractColumn(Grid=ptsrfdomnum, Col=Slider(1, range=0..1))
lng_4 = ListLength(List=flatten(ptcol))
ptcol_2 = ExtractColumn(Grid=ptsrfdomnum, Col=number_slider_7)
lng_5 = ListLength(List=flatten(ptcol_2))
dom_6 = ConstructDomain(DomainStart=expr("-x", number_slider_6), DomainEnd=number_slider_6)
dom_7 = ConstructDomain(DomainStart=expr("-x", number_slider_5), DomainEnd=number_slider_5)
ptcol_3 = ExtractColumn(Grid=ptsrfdomnum, Col=Slider(2, range=0..2))
lng_6 = ListLength(List=flatten(ptcol_3))
ptcol_4 = ExtractColumn(Grid=ptsrfdomnum, Col=number_slider_7)
lng_7 = ListLength(List=flatten(ptcol_4))
genemodifier_5 = GenePoolModifier(GeneList="XList", Count=lng_4, Domain=dom_4, Randomize=Button(), PercentageOfRandomization=Slider(1, range=0..1))
genemodifier_6 = GenePoolModifier(GeneList="YList", Count=lng_5, Domain=dom_5, Randomize=Button(), PercentageOfRandomization=Slider(1, range=0..1))
genemodifier_7 = GenePoolModifier(GeneList="XListO", Count=lng_6, Domain=dom_6, Randomize=Button(), PercentageOfRandomization=Slider(1, range=0..1))
genemodifier_8 = GenePoolModifier(GeneList="YListO", Count=lng_7, Domain=dom_7, Randomize=Button(), PercentageOfRandomization=Slider(1, range=0..1))
xlist = GenePool(Decimals=2, Maximum=4, Minimum=-4, Value=[0, 0, 0, 0, 0, 0, 0, 0, 0, 0, 0, 0, 0, 0, 0, 0, 0, 0, 0, 0, 0])
ylist = GenePool(Decimals=2, Maximum=4, Minimum=-4, Value=[0, 0, 0, 0, 0, 0, 0, 0, 0, 0, 0, 0, 0, 0, 0, 0, 0, 0, 0, 0, 0])
xlisto = GenePool(Decimals=2, Maximum=4, Minimum=-4, Value=[0, 0, 0, 0, 0, 0, 0, 0, 0, 0, 0, 0, 0, 0, 0, 0, 0, 0, 0, 0, 0])
ylisto = GenePool(Decimals=2, Maximum=4, Minimum=-4, Value=[0, 0, 0, 0, 0, 0, 0, 0, 0, 0, 0, 0, 0, 0, 0, 0, 0, 0, 0, 0, 0])
c_script = CSharpScript(PointsIn=ptcol, XList=xlist, YList=ylist)  # -> PointsOut; inputs PointsIn: list; disabled
# ---------- c_script: C# ----------
    int size = PointsIn.Count;
    
    Point3d[] pointsOut = new Point3d[size];
    
    /*unsafe
    {
    
      fixed( object* pt = &PointsIn[0] )
      {
      
        object* t = pt;
        
      for( int i = 0; i < size; ++i )
      {
      
        
      
      }
        
      }

    }*/
# ---------- c_script: C# additional code ----------
  public unsafe static void Test()
  {
  
    
  
  }
# ---------- end c_script ----------
c_script_2 = CSharpScript(PointsIn=ptcol, XList=xlist, YList=ylist)  # -> PointsOut; inputs PointsIn: list, XList: list, YList: list
# ---------- c_script_2: C# ----------
    int size = PointsIn.Count;

    Point3d[] pointsOut = new Point3d[size];

    for( int i = 0; i < size; ++i )
    {

      Point3d temp = ( Point3d ) PointsIn[i];
      double tempX = ( double ) XList[i];
      double tempY = ( double ) YList[i];
      
      temp.X -= tempX;
      temp.Y -= tempY;
      
      pointsOut[i] = temp;
      
    }
    
    PointsOut = pointsOut;
# ---------- end c_script_2 ----------
c_script_3 = CSharpScript(PointsIn=ptcol_3, XList=xlisto, YList=ylisto)  # -> PointsOut; inputs PointsIn: list; disabled; same code as c_script
c_script_4 = CSharpScript(PointsIn=ptcol_3, XList=xlisto, YList=ylisto)  # -> PointsOut; inputs PointsIn: list, XList: list, YList: list; same code as c_script_2
number_slider_8 = Slider(4, range=0..10)
number_slider_9 = Slider(4, range=0..10)
indexlist = GenePool(Decimals=0, Maximum=20, Minimum=0, Value=[0, 6, 12, 20])
dom_8 = ConstructDomain(DomainStart=expr("-x", number_slider_9), DomainEnd=number_slider_9)
dom_9 = ConstructDomain(DomainStart=expr("-x", number_slider_8), DomainEnd=number_slider_8)
ptcol_5 = ExtractColumn(Grid=ptsrfdomnum, Col=Slider(1, range=0..1))
lng_8 = ListLength(List=ptcol_5)
subtraction_2 = Subtraction(A=lng_8, B=1)
dom_10 = ConstructDomain(DomainStart=0, DomainEnd=subtraction_2)
genemodifier_9 = GenePoolModifier(
    GeneList="IndexList",
    Count=Slider(4, range=0..10),
    Domain=dom_10,
    Randomize=Button(),
    PercentageOfRandomization=Slider(1, range=0..1))

# ---- group: SetToZero
toggle = GroupToggle(ToggleActive=True, ToggleVisible=False)  # disabled
number_slider_10 = Slider(0, range=0..100)  # disabled
button = Button()  # disabled
merge = Merge(Data1="XList", Data2="YList")  # disabled
remap = RemapNumbers(Value=number_slider_10, Source=dom_10, Target=Domain(0, 1))  # -> Mapped, Clipped; disabled
reinstatevalues = CSharpScript(
    Names="IndexList",
    Values=remap.Mapped,
    Run=button,
    Reference="C:\Program Files\Rhino 6\Plug-ins\Grasshopper\Components\GalapagosComponents.gha")  # inputs Names: list of String, Values: list of Double, Run: Boolean; disabled
# ---------- reinstatevalues: C# ----------
    GalapagosComponents.GalapagosGeneListObject GComp = null;
    Grasshopper.Kernel.Special.GH_NumberSlider slider = null;

    int counter = 0;

    var ghDocument = Component.OnPingDocument();

    if( ghDocument != null && Run == true )

      for( int i = 0; i < Names.Count; ++i )
      {

        foreach( IGH_DocumentObject obj in ghDocument.Objects )
        {

          if( obj.ToString() == "GalapagosComponents.GalapagosGeneListObject" )
          {

            GComp = (GalapagosComponents.GalapagosGeneListObject) obj;

            if( GComp.NickName == Names[i] )
            {

              for( int g = 0; g < GComp.Count; ++g )
              {

                GComp.set_NormalisedValue(g, Convert.ToDecimal(Values[0]));

                counter++;

              }

              GComp.ExpireSolution(true);

            }

          }

          if( obj.ToString() == "Grasshopper.Kernel.Special.GH_NumberSlider" )
          {

            slider = (Grasshopper.Kernel.Special.GH_NumberSlider) obj;

            if( slider.NickName == Names[i] )
            {

              slider.SetSliderValue(Convert.ToDecimal(Values[counter]));

              counter++;

              slider.ExpireSolution(true);

            }

          }

        }

      }
# ---------- end reinstatevalues ----------

# ----
ptcol_6 = ExtractColumn(Grid=ptsrfdomnum, Col=number_slider_7)
c_script_5 = CSharpScript(x=ptsrfdomnum)  # -> out, A; inputs x: tree
# ---------- c_script_5: C# ----------
    A = x.Branch(0).Count;
# ---------- end c_script_5 ----------
lng_9 = ListLength(List=indexlist)
genemodifier_10 = GenePoolModifier(GeneList="XListT", Count=lng_9, Domain=dom_8, Randomize=Button(), PercentageOfRandomization=Slider(1, range=0..1))
genemodifier_11 = GenePoolModifier(GeneList="YListT", Count=lng_9, Domain=dom_9, Randomize=Button(), PercentageOfRandomization=Slider(1, range=0..1))
subtraction_3 = Subtraction(A=c_script_5.A, B=1)
xlistt = GenePool(Decimals=2, Maximum=4, Minimum=-4, Value=[-0.48, 1.28, -1.35, 0.01])
ylistt = GenePool(Decimals=2, Maximum=4, Minimum=-4, Value=[0, 0, 0, 0])
dom_11 = ConstructDomain(DomainStart=0, DomainEnd=subtraction_3)
genemodifier_12 = GenePoolModifier(
    GeneList="IndexListO",
    Count=Slider(4, range=0..10),
    Domain=dom_11,
    Randomize=Button(),
    PercentageOfRandomization=Slider(1, range=0..1))
indexlisto = GenePool(Decimals=0, Maximum=3, Minimum=0, Value=[1.937130629, 0.343004123, 1.761329401, 0.4944070058])
item = ListItem(List=ptcol_5, Index=indexlist, Wrap=True)
c_script_6 = CSharpScript(PointsIn=simplify(ptsrfdomnum), Index=Slider(2, range=0..10), XList=xlistt, YList=ylistt, IndexList=indexlist)  # -> out, PointsOut; inputs PointsIn: tree, XList: list, YList: list, IndexList: list
# ---------- c_script_6: C# ----------
    int idX = Convert.ToInt32(Index);
    List<Point3d> pointsTemp = new List<Point3d>();
    //Print("Branches: {0}", PointsIn.BranchCount);

    int branchCount = PointsIn.BranchCount;

    for( int b = 0; b < branchCount; ++b )

      for( int i = 0; i < IndexList.Count; ++i )
      {

        int idY = Convert.ToInt32(IndexList[i]);
        //Print("idY: {0}", idY);

        if( idY == b )
        {

          Point3d temp = ( Point3d ) PointsIn.Branch(b)[idX];

          double tempX = ( double ) XList[i];
          double tempY = ( double ) YList[i];

          temp.X -= tempX;
          temp.Y -= tempY;

          pointsTemp.Add(temp);

        }

      }

    Polyline poly = new Polyline(pointsTemp);

    Curve curve = poly.ToNurbsCurve();
    double[] points = curve.DivideByCount(branchCount - 1, true);

    int divideSize = points.Length;

    Point3d[] pointsOut = new Point3d[divideSize];

    for( int i = 0; i < divideSize; ++i )
    {

      pointsOut[i] = curve.PointAt(points[i]);

    }
    
    //PointsOut = pointsOut;
    
    for( int b = 0; b < branchCount; ++b )
      PointsIn.Branch(b)[idX] = pointsOut[b];


    PointsOut = PointsIn;
# ---------- end c_script_6 ----------
c_script_7 = CSharpScript(PointsIn=ptcol_5, XList=xlistt, YList=ylistt, IndexList=indexlist)  # -> PointsOut; inputs PointsIn: list, XList: list, YList: list, IndexList: list
# ---------- c_script_7: C# ----------
    int size = XList.Count;

    //Point3d[] pointsOut = new Point3d[size];

    for( int i = 0; i < size; ++i )
    {

      int idX = Convert.ToInt32(IndexList[i]);
      
      Point3d temp = ( Point3d ) PointsIn[idX];
      double tempX = ( double ) XList[i];
      double tempY = ( double ) YList[i];

      temp.X -= tempX;
      temp.Y -= tempY;

      PointsIn[idX] = temp;

    }

    PointsOut = PointsIn;
# ---------- end c_script_7 ----------
panel = Panel(c_script_6.out)
number_slider_11 = Slider(10, range=0..10)
number_slider_12 = Slider(0, range=0..10)
number_slider_13 = Slider(1, range=0..1)
item_2 = ListItem(List=c_script_7, Index=indexlist, Wrap=True)
number_slider_14 = Slider(2, range=0..10)
dom_12 = ConstructDomain(DomainStart=expr("-x", number_slider_11), DomainEnd=number_slider_11)
dom_13 = ConstructDomain(DomainStart=Slider(-32, range=-100..-32), DomainEnd=Slider(-17, range=-100..-17))
pline = PolyLine(Vertices=item_2, Closed=False)
pt_3 = Point(Point(-18.83977906, 12.4308895, 0))
pt_4 = Point(Point(-32.98528082, -7.451527156, 0))
genemodifier_13 = GenePoolModifier(
    GeneList="PointOneY",
    Count=number_slider_14,
    Domain=dom_12,
    Randomize=Button(),
    PercentageOfRandomization=number_slider_13)
genemodifier_14 = GenePoolModifier(
    GeneList="PointOneX",
    Count=number_slider_14,
    Domain=dom_13,
    Randomize=Button(),
    PercentageOfRandomization=number_slider_13)
pointoney = GenePool(Decimals=2, Maximum=10, Minimum=-10, Value=[-10, -2.54])
pointonex = GenePool(Decimals=2, Maximum=-17, Minimum=-32, Value=[-21.15, -32])
number_slider_15 = Slider(10, range=0..10)
pt_5 = ConstructPoint(XCoordinate=pointonex, YCoordinate=pointoney, ZCoordinate=0)
ptpointatts = PointAttraction(Grid=ptsrfdomnum, PtAtts=pt_5, Magnitude=Slider(-0.86, range=-1.01..1))  # -> Grid, Weights
ptborders = GenerateBorders(Grid=ptpointatts.Grid, PanelShape=0)  # -> simplify(Border)
sortxy = SortPointsXY(Grid=flatten(ptborders))
area = Area(Geometry=sortxy)  # -> Area, Centroid
sort = SortList(Keys=area.Area, ValuesA=area.Area)  # -> Keys, ValuesA
lng_10 = ListLength(List=sort.ValuesA)
voronoi = Voronoi(Points=evalsrf.Point, Boundary=bbox.Box, BruteForceOverride=False)
item_3 = ListItem(List=sort.ValuesA, Index=expr("x-1", lng_10), Wrap=True)
multiplication = Multiplication(A=item_3, B=Slider(0.6, range=0..1))
galapagos = Galapagos(fitness=c_script_8, gene=[firststepx, firststepy, pointonex, pointoney])
ptcol_7 = ExtractColumn(Grid=ptpointatts.Grid, Col=[Slider(1, range=0..1), Slider(2, range=0..2)])
ptborders_2 = GenerateBorders(Grid=ptcol_7, PanelShape=0)  # -> simplify(flatten(Border))
boundary = BoundarySurfaces(Edges=ptborders_2)
sunion = SolidUnion(Breps=boundary)
labels = Panel("""Publico
SemiPrivado
PrivadoUno
PrivadoDos""")

# ---- group: SpacePartition / RandomColourSeed
number_slider_16 = Slider(40, range=0..100)
number_slider_17 = Slider(238, range=0..1000)
number_slider_18 = Slider(326, range=0..1000)

# ----
graft = GraftTree(Tree=labels, IncludeEmptyLists=True, IncludeNullItems=True)  # -> simplify(Tree)
flatten_2 = FlattenTree(Tree=ma.Result, Path="{0}")
multiplication_2 = Multiplication(A=flatten_2, B=Slider(0.9, range=0..1))
panel_2 = Panel(multiplication_2)

# ---- group: SpacePartition
toggle_2 = GroupToggle(ToggleActive=True, ToggleVisible=False)  # disabled
number_slider_19 = Slider(0.001, range=0..0.001)
multiplication_3 = Multiplication(A=multiplication, B=Slider(0.7, range=0..1))
dom_14 = ConstructDomain(DomainStart=Slider(0, range=0..100), DomainEnd=Slider(255, range=0..1000))
number_slider_20 = Slider(241, range=0..255)

# ----
spacepartition = SpacePartition(VoronoiIn=voronoi, GridIn=sortxy, AreaIn=multiplication, Distance=multiplication_3)

# ---- group: SpacePartition (continued)
sortxy_2 = SortPointsXY(Grid=flatten(spacepartition))
pararunion = ParallelRegionUnion(Curves=spacepartition)
missing = MissingGridCells(CulledGrid=flatten(sortxy_2), OriginalGrid=sortxy)
mgtree = MergeTreeMissing(CulledGrid=pararunion, MissingGridCells=missing)
pararunion_2 = ParallelRegionUnion(Curves=mgtree)
parallelregionintersection = ParallelRegionIntersection(CurvesA=crv, CurvesB=pararunion_2)
lng_11 = ListLength(List=flatten(parallelregionintersection))
random = Random(Range=dom_14, Number=lng_11, Seed=[number_slider_16, number_slider_17, number_slider_18], Integers=True)
bang = ExplodeTree(Data=random)  # -> Branch0, Branch1, Branch2
rgb = ColourRGB(Alpha=Slider(10, range=0..10), Red=bang.Branch0, Green=bang.Branch1, Blue=bang.Branch2)
rgb_2 = ColourRGB(
    Alpha=number_slider_20,
    Red=bang.Branch0,
    Green=[55, 209, 59, 216, 1, 112, 142, 1, 76, 111, 92, 58, 62, 60, 197, 158, 67, 19, 183, 163, 50, 202, 112, 182, 111],
    Blue=[9, 120, 163, 36, 100, 115, 248, 253, 79, 124, 119, 250, 189, 19, 44, 159, 229, 29, 128, 139, 34, 211, 22, 234, 166])
preview = CustomPreview(Geometry=graft(voronoi), Material=graft(rgb))

# ----
flatten_3 = FlattenTree(Tree=parallelregionintersection, Path="{0}")
rdiff = RegionDifference(CurvesA=graft(flatten_3), CurvesB=sunion)  # -> simplify(Result)
sortxy_3 = SortPointsXY(Grid=flatten(parallelregionintersection))
area_2 = Area(Geometry=rdiff, UseTasks=False)  # -> Area, Centroid
area_3 = Area(Geometry=sortxy_3)  # -> Area, Centroid
ma_2 = MassAddition(Input=area_2.Area)  # -> flatten(Result), PartialResults
addindextolabels = CSharpScript(labels=graft, areas=ma_2.Result)  # -> indexedLabels; inputs labels: list, areas: list
# ---------- addindextolabels: C# ----------
    var newLabels = new List<string>();

    for( int i = 0; i < labels.Count; ++i )
    {

      newLabels.Add((string) labels[i] + ' ' + Math.Round(( double ) areas[i], 3));

    }

    indexedLabels = newLabels;
# ---------- end addindextolabels ----------
panel_3 = Panel(ma_2.Result)
c_script_8 = CSharpScript(x=multiplication_2, y=ma_2.Result)  # -> out, A; inputs x: list, y: list
# ---------- c_script_8: C# ----------
    int xSize = x.Count, ySize = y.Count, dif = Math.Abs(xSize - ySize);

    double fitness = 0.0;

    if( dif == 0 )

      for( int i = 0; i < xSize; ++i )
      {

        double temp = Convert.ToDouble(x[i]) - Convert.ToDouble(y[i]);

        fitness += ( temp * temp ) * 0.0001;

      }

    else
    {

      fitness += dif * 100;

    }

    A = fitness;
# ---------- end c_script_8 ----------
rgb_3 = ColourRGB(Alpha=number_slider_20, Red=expr("x*2", bang.Branch1), Green=expr("x*0.5", bang.Branch1), Blue=0)
flatten_4 = FlattenTree(Tree=rgb_3, Path="{0}")

# ---- group: SpacePartition (continued)
srf = Surface(rdiff)
preview_2 = CustomPreview(Geometry=srf, Material=simplify(graft(flatten_4)))

# ----
tag = TextTag3D(Location=flatten(area_3.Centroid), Text=flatten(addindextolabels), Size=Slider(0.529, range=0..1), Justification=5)
panel_4 = Panel(c_script_8.A)
