# Grasshopper definition IterationTwo_SpaceSyntax.gh (Grasshopper 1.0.7)
# plug-ins: SpacePartition, PTComponentLibrary, MetaHopper, SpaceSyntaxDesign_GH

# ---- group: Data / InputData / Labels
txt = Text(Tree({0;0}: ["Unidades sanitarias mujeres / privadas"], {0;1}: ["Unidades sanitarias hombres / privadas"], {0;2}: ["Cuarto de aseo "], {0;3}: ["Área de aseo de residuos"], {0;4}: ["Almacen General Insumos de Aseo "], {0;5}: ["Área de UPC-Rack"]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))

# ---- group: Data / InputData / Areas
txt_2 = Text(Tree({0;0}: ["3"], {0;1}: ["3"], {0;2}: ["6"], {0;3}: ["1"], {0;4}: ["5"], {0;5}: ["4"]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))

# ---- group: Data / InputData / Topology
int = Integer(Tree({0}: [7], {1}: [7], {2}: [3], {3}: [2, 11], {4}: [16, 21, 19], {5}: [19]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))

# ---- group: Data / InputData / ID
txt_3 = Text(Tree({0;0}: ["5"], {0;1}: ["5"], {0;2}: ["5"], {0;3}: ["5"], {0;4}: ["5"], {0;5}: ["5"]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))

# ---- group: Data / InputData
number_slider = Slider(1, range=0..10)
path_mapper = PathMapper(txt, source="{A;B}", target="{A}")
path_mapper_2 = PathMapper(txt_2, source="{A;B}", target="{A}")
path_mapper_3 = PathMapper(int, source="{A;B}", target="{A}")
path_mapper_4 = PathMapper(txt_3, source="{A;B}", target="{A}")
prunebranches = CSharpScript(branches=path_mapper, howMany=number_slider)  # -> prunedTree, branchCounter; inputs branches: tree of String, howMany: Int32
# ---------- prunebranches: C# ----------
    var treeOut = new DataTree<string>();

    for( int i = 0; i < branches.BranchCount - howMany; ++i )
      treeOut.AddRange(branches.Branch(i), new GH_Path(i));

    prunedTree = treeOut;
    branchCounter = treeOut.BranchCount;
# ---------- end prunebranches ----------
prunebranches_2 = CSharpScript(branches=path_mapper_2, howMany=number_slider)  # -> prunedTree, branchCounter; inputs branches: tree of String, howMany: Int32; same code as prunebranches
ma = MassAddition(Input=prunebranches_2.prunedTree)  # -> Result, PartialResults
flatten = FlattenTree(Tree=prunebranches_2.prunedTree, Path="{0}")
lng = ListLength(List=flatten)
int_2 = Integer(Slider(4, range=0..10))

# ---- group: OriginalSilhouette
crv = Curve(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)

# ---- group: VoronoiSeeds
# In order for our algorithm to work, we need
# to create a Voronoi diagram, the Voronoi
# will be used for it's spatial properties in
# which the space is partitioned into a
# convex polygon that encompasses the
# minimum distance from each point to the
# other points in the set. This means that the
# Voronoi diagram will give us polygons that
# are proportional to the distance between
# the points, Symettry we will exploit to
# "seed" our algorithm with a discrete
# vector of possibilities.
number_slider_2 = Slider(1, range=0..1)
bbox = BoundingBox(Content=crv, Plane=PlaneXY(0, 0, 0))  # -> Box, Box_2
lng_2 = ListLength(List=flatten(ma.Result))
lng_3 = ListLength(List=flatten(ma.Result))
relay = Relay()
dom = ConstructDomain(DomainStart=0, DomainEnd=1)
dom_2 = ConstructDomain(DomainStart=0, DomainEnd=1)
ptsrfdomnum = SurfaceDomainNumber(Surface=bbox.Box, UNumber=Slider(3, range=0..100), VNumber=Slider(20, range=0..100))
genemodifier = GenePoolModifier(GeneList="FirstStepY", Count=lng_2, Domain=dom, Randomize=Button(), PercentageOfRandomization=number_slider_2)
genemodifier_2 = GenePoolModifier(GeneList="FirstStepX", Count=lng_3, Domain=dom_2, Randomize=Button(), PercentageOfRandomization=Slider(1, range=0..1))
firststepy = GenePool(Decimals=2, Maximum=1, Minimum=0, Value=[0.75, 0.77, 0.18, 0.51])
firststepx = GenePool(Decimals=2, Maximum=1, Minimum=0, Value=[0.24, 0.47, 0.67, 0])
pt = ConstructPoint(XCoordinate=firststepx, YCoordinate=firststepy, ZCoordinate=0)
evalsrf = EvaluateSurface(Surface=reparameterize(crv), Point=pt)  # -> Point, Normal, UDirection, VDirection, Frame
voronoi = Voronoi(Points=evalsrf.Point, Boundary=bbox.Box, BruteForceOverride=False)

# ----
# This are the indexes of the rows of the
# matrix to create the zig-zag design.
number_slider_3 = Slider(4, range=0..10)
howmanybranches = CSharpScript(x=ptsrfdomnum)  # -> A; inputs x: tree
# ---------- howmanybranches: C# ----------
    A = x.BranchCount;
# ---------- end howmanybranches ----------
subtraction = Subtraction(A=howmanybranches, B=1)
dom_3 = ConstructDomain(DomainStart=0, DomainEnd=subtraction)
genemodifier_3 = GenePoolModifier(
    GeneList="IndexList",
    Count=number_slider_3,
    Domain=dom_3,
    Randomize=Button(),
    PercentageOfRandomization=Slider(1, range=0..1))
indexlist = GenePool(Decimals=0, Maximum=20, Minimum=0, Value=[0, 6, 12, 20])
# Repeat the same process with the new
# grid, there are better ways to do this, but
# this seems more "modular".
number_slider_4 = Slider(1, range=0..1)
genemodifier_4 = GenePoolModifier(
    GeneList="IndexListT",
    Count=Slider(4, range=0..10),
    Domain=dom_3,
    Randomize=Button(),
    PercentageOfRandomization=number_slider_4)
indexlistt = GenePool(Decimals=0, Maximum=20, Minimum=0, Value=[0, 6, 12, 20])

# ---- group: SetToZero
# Useful tool to set the values of our Gene-
# Pools to zero.
toggle = GroupToggle(ToggleActive=True, ToggleVisible=False)  # disabled
number_slider_5 = Slider(0, range=0..100)  # disabled
button = Button()  # disabled
merge = Merge()  # disabled
remap = RemapNumbers(Value=number_slider_5, Source=dom_3, Target=Domain(0, 1))  # -> Mapped, Clipped; disabled
reinstatevalues = CSharpScript(
    Names="IndexList",
    Values=remap.Mapped,
    Run=button,
    Reference="C:\Program Files\Rhino 6\Plug-ins\Grasshopper\Components\GalapagosComponents.gha")  # inputs Names: list of String, Values: list of Double, Run: Boolean; disabled
# ---------- reinstatevalues: C# ----------
    GalapagosComponents.GalapagosGeneListObject GComp = null;
    Grasshopper.Kernel.Special.GH_NumberSlider slider = null;

    int counter = 0;

    var ghDocument = Component.OnPingDocument();

    if( ghDocument != null && Run == true )

      for( int i = 0; i < Names.Count; ++i )
      {

        foreach( IGH_DocumentObject obj in ghDocument.Objects )
        {

          if( obj.ToString() == "GalapagosComponents.GalapagosGeneListObject" )
          {

            GComp = (GalapagosComponents.GalapagosGeneListObject) obj;

            if( GComp.NickName == Names[i] )
            {

              for( int g = 0; g < GComp.Count; ++g )
              {

                GComp.set_NormalisedValue(g, Convert.ToDecimal(Values[0]));

                counter++;

              }

              GComp.ExpireSolution(true);

            }

          }

          if( obj.ToString() == "Grasshopper.Kernel.Special.GH_NumberSlider" )
          {

            slider = (Grasshopper.Kernel.Special.GH_NumberSlider) obj;

            if( slider.NickName == Names[i] )
            {

              slider.SetSliderValue(Convert.ToDecimal(Values[counter]));

              counter++;

              slider.ExpireSolution(true);

            }

          }

        }

      }
# ---------- end reinstatevalues ----------

# ----
# Pick the column of the matrix here!
column = Slider(2, range=0..10)
number_slider_6 = Slider(1, range=0..10)

# ---- group: Use this to see which
ptcol = ExtractColumn(Grid=ptsrfdomnum, Col=column)
item = ListItem(List=ptcol, Index=indexlist, Wrap=True)

# ----
# Translations in X
number_slider_7 = Slider(1, range=0..10)
dom_4 = ConstructDomain(DomainStart=expr("-x", number_slider_7), DomainEnd=number_slider_7)
lng_4 = ListLength(List=indexlist)
genemodifier_5 = GenePoolModifier(GeneList="XListT", Count=lng_4, Domain=dom_4, Randomize=Button(), PercentageOfRandomization=Slider(1, range=0..1))
xlistt = GenePool(Decimals=2, Maximum=1, Minimum=-1, Value=[0.82, -0.86, 0, 0.19])
number_slider_8 = Slider(1, range=0..10)
lng_5 = ListLength(List=indexlistt)
dom_5 = ConstructDomain(DomainStart=expr("-x", number_slider_8), DomainEnd=number_slider_8)
genemodifier_6 = GenePoolModifier(GeneList="XListTh", Count=lng_5, Domain=dom_5, Randomize=Button(), PercentageOfRandomization=Slider(1, range=0..1))
xlistth = GenePool(Decimals=2, Maximum=1, Minimum=-1, Value=[0.37, -1, 0.85, -0.99])

# ----
# Translations in Y
number_slider_9 = Slider(4, range=0..10)
dom_6 = ConstructDomain(DomainStart=expr("-x", number_slider_9), DomainEnd=number_slider_9)
genemodifier_7 = GenePoolModifier(GeneList="YListT", Count=lng_4, Domain=dom_6, Randomize=Button(), PercentageOfRandomization=Slider(1, range=0..1))
ylistt = GenePool(Decimals=2, Maximum=4, Minimum=-4, Value=[0, 0, 0, 0])
number_slider_10 = Slider(4, range=0..10)
dom_7 = ConstructDomain(DomainStart=expr("-x", number_slider_10), DomainEnd=number_slider_10)
genemodifier_8 = GenePoolModifier(GeneList="YListTh", Count=lng_5, Domain=dom_7, Randomize=Button(), PercentageOfRandomization=Slider(1, range=0..1))
ylistth = GenePool(Decimals=2, Maximum=4, Minimum=-4, Value=[0, 0, 0, 0])

# ----
# This script recreates the grid matrix, with
# the newly translated points of the column.
c_script = CSharpScript(PointsIn=simplify(ptsrfdomnum), Index=column, XList=xlistt, YList=ylistt, IndexList=indexlist)  # -> PointsOut; inputs PointsIn: tree, XList: list, YList: list, IndexList: list
# ---------- c_script: C# ----------
    int idX = Convert.ToInt32(Index);
    List<Point3d> pointsTemp = new List<Point3d>();
    //Print("Branches: {0}", PointsIn.BranchCount);

    int branchCount = PointsIn.BranchCount;

    for( int b = 0; b < branchCount; ++b )

      for( int i = 0; i < IndexList.Count; ++i )
      {

        int idY = Convert.ToInt32(IndexList[i]);
        //Print("idY: {0}", idY);

        if( idY == b )
        {

          Point3d temp = ( Point3d ) PointsIn.Branch(b)[idX];

          double tempX = ( double ) XList[i];
          double tempY = ( double ) YList[i];

          temp.X -= tempX;
          temp.Y -= tempY;

          pointsTemp.Add(temp);

        }

      }

    Polyline poly = new Polyline(pointsTemp);

    Curve curve = poly.ToNurbsCurve();
    double[] points = curve.DivideByCount(branchCount - 1, true);

    int divideSize = points.Length;

    Point3d[] pointsOut = new Point3d[divideSize];

    for( int i = 0; i < divideSize; ++i )
    {

      pointsOut[i] = curve.PointAt(points[i]);

    }
    
    //PointsOut = pointsOut;
    
    for( int b = 0; b < branchCount; ++b )
      PointsIn.Branch(b)[idX] = pointsOut[b];


    PointsOut = PointsIn;
# ---------- end c_script ----------
c_script_2 = CSharpScript(PointsIn=simplify(c_script), Index=number_slider_6, XList=xlistth, YList=ylistth, IndexList=indexlistt)  # -> PointsOut; inputs PointsIn: tree, XList: list, YList: list, IndexList: list; same code as c_script

# ---- group: SpacePartition / RandomColourSeed
number_slider_11 = Slider(40, range=0..100)
number_slider_12 = Slider(238, range=0..1000)
number_slider_13 = Slider(326, range=0..1000)

# ----
panel = Panel("BUBBLE DIAGRAM FORMATION")
P = Plane(PlaneXY(37.5980533, -3.579682718, 0))

# ---- group: AdvancedSettings
st = Slider(0.25, range=0..2)
st_2 = Slider(1.4, range=0..10)
it = Slider(4000, range=0..4000)
tolerance = Tolerance(0.0001)

# ----
galapagos = Galapagos(fitness=c_script_3, gene=[firststepx, firststepy, xlistt, xlistth])

# ---- group: SpacePartition
# Now we do intersections between the
# Voronoi diagram and the grid, when the
# resulting area of the intersection is bigger
# than the underlying grid's, we cull.
# The logic may be flawed sometimes, to
# take into account the special cases, we
# iterate the original grid with respect to the
# new one, if there are missing grid cells,
# we add them to the neighbours.
toggle_2 = GroupToggle(ToggleActive=True, ToggleVisible=False)  # disabled
ptborders = GenerateBorders(Grid=c_script_2, PanelShape=0)  # -> simplify(Border)
sortxy = SortPointsXY(Grid=flatten(ptborders))
area = Area(Geometry=sortxy)  # -> Area, Centroid
sort = SortList(Keys=area.Area, ValuesA=area.Area)  # -> Keys, ValuesA
lng_6 = ListLength(List=sort.ValuesA)
item_2 = ListItem(List=sort.ValuesA, Index=expr("x-1", lng_6), Wrap=True)
multiplication = Multiplication(A=item_2, B=Slider(0.6, range=0..1))
number_slider_14 = Slider(0.001, range=0..0.001)
multiplication_2 = Multiplication(A=multiplication, B=Slider(0.7, range=0..1))
spacepartition = SpacePartition(VoronoiIn=voronoi, GridIn=sortxy, AreaIn=multiplication, Distance=multiplication_2)
sortxy_2 = SortPointsXY(Grid=flatten(spacepartition))
pararunion = ParallelRegionUnion(Curves=spacepartition)
missing = MissingGridCells(CulledGrid=flatten(sortxy_2), OriginalGrid=sortxy)
mgtree = MergeTreeMissing(CulledGrid=pararunion, MissingGridCells=missing)
pararunion_2 = ParallelRegionUnion(Curves=mgtree)
parallelregionintersection = ParallelRegionIntersection(CurvesA=crv, CurvesB=pararunion_2)
flatten_2 = FlattenTree(Tree=parallelregionintersection, Path="{0}")
sortxy_3 = SortPointsXY(Grid=flatten(flatten_2))
lng_7 = ListLength(List=flatten(parallelregionintersection))
dom_8 = ConstructDomain(DomainStart=Slider(0, range=0..100), DomainEnd=Slider(255, range=0..1000))
random = Random(Range=dom_8, Number=lng_7, Seed=[number_slider_11, number_slider_12, number_slider_13], Integers=True)
bang = ExplodeTree(Data=random)  # -> Branch0, Branch1, Branch2
rgb = ColourRGB(Alpha=Slider(241, range=0..255), Red=expr("x*2", bang.Branch1), Green=expr("x*0.5", bang.Branch1), Blue=0)
flatten_3 = FlattenTree(Tree=rgb, Path="{0}")

# ----
spctopo = SpaceTopology(Curves=sortxy_3)
area_2 = Area(Geometry=sortxy_3, UseTasks=False)  # -> Area, Centroid
linetopo = LineTopology(PointTree=graft(area_2.Centroid), Topology=spctopo)  # -> flatten(LineTopology)

# ---- group: HackyWayOfEvaluatingTheIsoVist
# Here we can visualize which areas are
# visible from the specified point at which we
# run the IsoVist algo.
ptcol_2 = ExtractColumn(Grid=c_script_2, Col=[column, number_slider_6])
flip = FlipMatrix(Data=ptcol_2)
pline = PolyLine(Vertices=ptcol_2, Closed=False)
end = EndPoints(Curve=pline)  # -> Start, End
pline_2 = PolyLine(Vertices=flip, Closed=False)
pline_3 = PolyLine(Vertices=flatten(end.Start), Closed=False)
pline_4 = PolyLine(Vertices=flatten(end.End), Closed=False)
eval = EvaluateCurve(Curve=reparameterize(pline_2), Parameter=Slider(0.5, range=0..1))  # -> flatten(Point), Tangent, Angle
join = JoinCurves(Curves=flatten([pline, pline_3, pline_4]), Preserve=False)
pline_5 = PolyLine(Vertices=flatten(eval.Point), Closed=False)
Z = UnitZ(Factor=1)
move = Move(Geometry=flatten(eval.Point), Motion=Z)  # -> Geometry, Transform
viewpoint = Slider(1, range=0..19)
ln = Line(StartPoint=eval.Point, EndPoint=move.Geometry)
blx = BrepLine(Brep=crv, Line=ln, LimitToFirst=False, UseTasks=False)  # -> Curves, Points
item_3 = ListItem(List=flatten(blx.Points), Index=viewpoint, Wrap=True)
number_slider_15 = Slider(0.453, range=0..1)
boundary = BoundarySurfaces(Edges=join, UseTasks=False)
frgb = ColourRGBF(Alpha=Slider(1, range=0..1), Red=number_slider_15, Green=number_slider_15, Blue=number_slider_15)
preview = CustomPreview(Geometry=boundary, Material=frgb)

# ---- group: SpacePartition (continued)
rdiff = RegionDifference(CurvesA=graft(sortxy_3), CurvesB=join)  # -> simplify(Result)
boundary_2 = BoundarySurfaces(Edges=rdiff, UseTasks=False)
preview_2 = CustomPreview(Geometry=boundary_2, Material=simplify(graft(flatten_3)))

# ----
explode = Explode(Curve=flatten(rdiff), Recursive=True)  # -> flatten(Segments), Vertices
join_2 = JoinCurves(Curves=explode.Segments, Preserve=False)
simplify = SimplifyCurve(Curve=join_2)  # -> Curve, Simplified
disc = Discontinuity(Curve=simplify.Curve, Level=1)  # -> Points, Parameters
shatter = Shatter(Curve=graft(simplify.Curve), Parameters=disc.Parameters)  # -> flatten(Segments)

# ---- group: HackyWayOfEvaluatingTheIsoVist (continued)
flatten_4 = FlattenTree(Tree=rdiff, Path="{0}")
ivist = IsoVist(Plane=item_3, Count=Slider(1000, range=0..1000), Radius=Slider(37.055, range=0..100), Obstacles=flatten_4)  # -> Points, Distance, Index
pline_6 = PolyLine(Vertices=ivist.Points, Closed=True)
spacetopologyonemany = CSharpScript(CurveIn=pline_6, PointIn=item_3, CurvesIn=flatten_4)  # -> out, LineTopology, AbstractIndexTopology; inputs CurvesIn: list
# ---------- spacetopologyonemany: C# ----------
    Curve curve = ( Curve ) CurveIn;
    Point3d centroid = ( Point3d ) PointIn;

    DataTree<int> ptTree = new DataTree<int>();
    DataTree<Line> lineTree = new DataTree<Line>();

    for( int i = 0; i < CurvesIn.Count; ++i )
    {

      GH_Path path = new GH_Path(i);

      Curve tempCurve = ( Curve ) CurvesIn[i];
      
      Point3d tempCentroid = AreaMassProperties.Compute(tempCurve).Centroid;

      if( Curve.PlanarCurveCollision(tempCurve, curve, Plane.WorldXY, Rhino.RhinoDoc.ActiveDoc.ModelAbsoluteTolerance) )
      {

        ptTree.Add(i, path);
        lineTree.Add( new Line( centroid, tempCentroid ), path );

      }

    }

    AbstractIndexTopology = ptTree;

    LineTopology = lineTree;
# ---------- end spacetopologyonemany ----------
panel_2 = Panel(spacetopologyonemany.AbstractIndexTopology)
boundary_3 = BoundarySurfaces(Edges=pline_6, UseTasks=False)

# ---- group: Fitness/Cost Function
area_3 = Area(Geometry=rdiff, UseTasks=False)  # -> Area, Centroid
ma_2 = MassAddition(Input=area_3.Area)  # -> flatten(Result), PartialResults
flatten_5 = FlattenTree(Tree=ma.Result, Path="{0}")
multiplication_3 = Multiplication(A=flatten_5, B=Slider(0.9, range=0..1))
panel_3 = Panel(multiplication_3)
panel_4 = Panel(ma_2.Result)
c_script_3 = CSharpScript(x=multiplication_3, y=ma_2.Result)  # -> out, A; inputs x: list, y: list
# ---------- c_script_3: C# ----------
    int xSize = x.Count, ySize = y.Count, dif = Math.Abs(xSize - ySize);

    double fitness = 0.0;

    if( dif == 0 )

      for( int i = 0; i < xSize; ++i )
      {

        double tempY = y[i] != null ? Convert.ToDouble(y[i]) : 1000;
        
        double temp = Convert.ToDouble(x[i]) - tempY;

        fitness += ( temp * temp ) * 0.0001;

      }

    else
    {

      fitness += dif * 100;

    }

    A = fitness;
# ---------- end c_script_3 ----------
panel_5 = Panel(c_script_3.A)

# ---- group: Labels
toggle_3 = GroupToggle(ToggleActive=True, ToggleVisible=False)  # disabled
labels = Panel("""Publico
SemiPrivado
PrivadoUno
PrivadoDos""")
sortxy_4 = SortPointsXY(Grid=flatten(parallelregionintersection))
addindextolabels = CSharpScript(labels=labels, areas=ma_2.Result)  # -> indexedLabels; inputs labels: list, areas: list
# ---------- addindextolabels: C# ----------
    var newLabels = new List<string>();

    for( int i = 0; i < labels.Count; ++i )
    {

      newLabels.Add((string) labels[i] + ' ' + Math.Round(( double ) areas[i], 3));

    }

    indexedLabels = newLabels;
# ---------- end addindextolabels ----------
area_4 = Area(Geometry=sortxy_4)  # -> Area, Centroid
tag = TextTag3D(
    Location=flatten(area_4.Centroid),
    Text=flatten(addindextolabels),
    Size=Slider(0.529, range=0..1),
    Colour=RGB(255, 255, 255),
    Justification=5)

# ----
ma_3 = MassAddition(Input=ma_2.Result)  # -> flatten(Result), PartialResults

P_2 = Points(area_2.Centroid)
areas = Areas(ma_2.Result)
crv_2 = Curve(linetopo)
labels_2 = Labels(labels)
ta = Number(ma_3.Result)
nodelinkgraph = GraphFromNodesLinks(Points=P_2, Links=crv_2, Labels=labels_2, Areas=areas, TotalArea=ta)  # -> Graph, GraphVertices, Attributes
prgm = Programme(Attributes=nodelinkgraph.Attributes)  # -> Tags, Areas, Colors, Legends
legend = Legend(
    Colour=flatten_3,
    Tags=prgm.Legends,
    Rectangle={Plane=PlaneXY(-46.73424664, -1.490949524, 0), Size=Domain2(u=-5.834736179..5.834736179, v=-7.293420223..7.293420223)},
    LegendType=1)
G = Integer(nodelinkgraph.Graph)
gv = GV(nodelinkgraph.GraphVertices)
G_2 = Integer(G)
gv_2 = GV(gv)

c_script_4 = CSharpScript(x=nodelinkgraph.Attributes, y=flatten_3)  # -> out, A; inputs x: list, y: list of Color
# ---------- c_script_4: C# usings ----------
using System.Drawing;
# ---------- c_script_4: C# ----------
    List<object> objOut = new List<object>();
    
    objOut.Add(x[0]);
    objOut.Add(x[1]);
    objOut.Add(y);
    
    A = objOut;
# ---------- end c_script_4 ----------
pie = PieChart(Plane=P, Attributes=c_script_4.A, Radius=10)

att = Data(c_script_4.A)
att_2 = Data(att)
forcedirecteddrawing = ForceDirectedDrawing(
    Graph=G_2,
    Vertices=gv_2,
    Attributes=att_2,
    AttractionStrength=0.25,
    RepulsionStrength=1.4,
    ConvergenceTolearnce=tolerance,
    MaximumIterations=it,
    Active=Toggle(True))  # -> NewGraphVertices, IterationCount
panel_6 = Panel(forcedirecteddrawing.IterationCount)
diskograph = DiskoGraphDrawing(
    Plane=PlaneXY(0.3379422202, -0.5667962346, 0),
    Graph=G_2,
    Vertices=forcedirecteddrawing.NewGraphVertices,
    Attributes=att_2,
    Thickness=1)

panel_7 = Panel(c_script_4.A)
integration = IntegrationAnalysis(Graph=G_2, Attributes=att_2)  # -> DepthTable, DepthMap, RelativeASymetry, Integration, IntegrationRelativeColors, IntegrationTags
justifiedgraph = JustifiedGraphDrawing(
    ViewPointIndex=0,
    Plane=PlaneXY(0.5205372833, -10.57639108, 0),
    Size=10,
    Thickness=1,
    Graph=G_2,
    Attributes=att_2,
    DepthTable=integration.DepthTable)
