# Grasshopper definition MedialAxis.gh (Grasshopper 1.0.7)
# plug-ins: SpacePartition, ClipperComponents, Kangaroo Components, LunchBox, Weaverbird, Kangaroo2 Components

number_slider = Slider(300, range=0..1000)
# Medial Axis definition by Daniel Piker 10/09/09
# 
# spacesymmetrystructure.wordpress.com
panel = Panel("200")
nurbs = Curve(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)
crv = Curve(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)
crv_2 = Curve(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)
divide = DivideCurve(Curve=crv_2, Count=number_slider, Kinks=False)  # -> Points, Tangents, Parameters
flatten = FlattenTree(Tree=divide.Points, Path="{0}")
bbox = BoundingBox(Content=crv_2, Plane=PlaneXY(0, 0, 0))  # -> Box, Box_2
voronoi = Voronoi(Points=flatten, Boundary=bbox.Box, BruteForceOverride=False)
number_slider_2 = Slider(1000, range=0..10000)  # disabled
disc = Discontinuity(Curve=voronoi, Level=Slider(3, range=0..3))  # -> Points, Parameters
toggle = BooleanToggle(True)  # disabled
shatter = Shatter(Curve=graft(voronoi), Parameters=disc.Parameters, UseTasks=False)
flatten_2 = FlattenTree(Tree=shatter, Path="{0}")
ccx = CurveCurve(CurveA=flatten_2, CurveB=crv_2, UseTasks=False)  # -> Points, ParamsA, ParamsB
graft = GraftTree(Tree=flatten_2, IncludeEmptyLists=True, IncludeNullItems=True)
null = NullItem(Item=ccx.Points)  # -> NullFlags, InvalidFlags, Description
skeleton = MedialAxisSkeleton(CurveIn=crv_2, NumberOfSamples=number_slider_2, Preserve=toggle, Recursive=toggle)  # disabled
number_slider_3 = Slider(0.5, range=0..1)  # disabled
panel_2 = Panel(null.NullFlags)
dispatch = Dispatch(List=graft, DispatchPattern=null.NullFlags)  # -> ListA, ListB
number_slider_4 = Slider(1, range=0..100)  # disabled
crv_3 = Curve(flatten(dispatch.ListB))
crv_4 = Curve(flatten(dispatch.ListA))
number_slider_5 = Slider(0, range=0..100)  # disabled
toggle_2 = BooleanToggle(False)
skeleton_2 = CSharpScript(CurveIn=crv_2, NumberOfSamples=number_slider, Preserve=toggle_2)  # -> Spine; inputs CurveIn: Curve, NumberOfSamples: Int32, Preserve: Boolean; disabled
# ---------- skeleton_2: C# ----------
    Point3d[] divideCurve = new Point3d[NumberOfSamples];

    BoundingBox bbox = CurveIn.GetBoundingBox(true);

    CurveIn.DivideByCount(NumberOfSamples, true, out divideCurve);

    Point3d[] bboxCornersAll = bbox.GetCorners();

    Point3d[] bboxCorners = new Point3d[4];

    for( int i = 0; i < 4; ++i )
    {

      bboxCorners[i] = bboxCornersAll[i];

    }

    Grasshopper.Kernel.Geometry.Node2List nodesOne = new Grasshopper.Kernel.Geometry.Node2List(divideCurve);
    Grasshopper.Kernel.Geometry.Node2List nodesTwo = new Grasshopper.Kernel.Geometry.Node2List(bboxCorners);
    var connectivity = Grasshopper.Kernel.Geometry.Delaunay.Solver.Solve_Connectivity(nodesOne, 0.001, true);
    var solver = Grasshopper.Kernel.Geometry.Voronoi.Solver.Solve_Connectivity(nodesOne, connectivity, nodesTwo);

    int size = solver.Count, sizeJ = 0;

    Polyline poly = new Polyline();

    List<Curve>[] tempList = new List<Curve>[size];
    List<Curve> shatteredList = new List<Curve>();

    GH_Path path = new GH_Path();

    Curve tempCurveShattered = null;

    for( int i = 0; i < size; ++i )
    {

      path = new GH_Path(i);

      tempList[i] = new List<Curve>();

      poly = solver[i].ToPolyline();

      CurveSegments(tempList[i], poly.ToNurbsCurve(), true);

      sizeJ = tempList[i].Count;


      for( int j = 0; j < sizeJ; ++j )
      {

        tempCurveShattered = tempList[i][j];

        if( Rhino.Geometry.Intersect.Intersection.CurveCurve(CurveIn, tempCurveShattered, 0.001, 0.001).Count <= 0 )
        {

          shatteredList.Add(tempCurveShattered);

        }

      }

    }

    Curve[] joinedCurves = Rhino.Geometry.Curve.JoinCurves(shatteredList, 0.01, Preserve);

    Curve final = null;

    double max = double.MinValue, length = 0.0;

    Curve tempLengthCurve = null;

    for( int i = 0; i < joinedCurves.Length; ++i )
    {

      tempLengthCurve = joinedCurves[i];

      length = tempLengthCurve.GetLength();

      max = Math.Max(max, length);

      if(max == length)

        final = tempLengthCurve;

    }

    Spine = final;
# ---------- skeleton_2: C# additional code ----------
  static int Compare1(KeyValuePair<double, Curve> a, KeyValuePair<double, Curve> b)
  {

    return a.Key.CompareTo(b.Key);

  }

  protected bool CurveSegments(List<Curve> L, Curve crv, bool recursive)
  {
    if (crv == null) { return false; }

    PolyCurve polycurve = crv as PolyCurve;
    if (polycurve != null)
    {
      if (recursive) { polycurve.RemoveNesting(); }

      Curve[] segments = polycurve.Explode();

      if (segments == null) { return false; }
      if (segments.Length == 0) { return false; }

      if (recursive)
      {
        foreach (Curve S in segments)
        {
          CurveSegments(L, S, recursive);
        }
      }
      else
      {
        foreach (Curve S in segments)
        {
          L.Add(S.DuplicateShallow() as Curve);
        }
      }

      return true;
    }

    PolylineCurve polyline = crv as PolylineCurve;
    if (polyline != null)
    {
      if (recursive)
      {
        for (int i = 0; i < (polyline.PointCount - 1); i++)
        {
          L.Add(new LineCurve(polyline.Point(i), polyline.Point(i + 1)));
        }
      }
      else
      {
        L.Add(polyline.DuplicateCurve());
      }
      return true;
    }

    Polyline p;
    if (crv.TryGetPolyline(out p))
    {
      if (recursive)
      {
        for (int i = 0; i < (p.Count - 1); i++)
        {
          L.Add(new LineCurve(p[i], p[i + 1]));
        }
      }
      else
      {
        L.Add(new PolylineCurve(p));
      }
      return true;
    }

    //Maybe it's a LineCurve?
    LineCurve line = crv as LineCurve;
    if (line != null)
    {
      L.Add(line.DuplicateCurve());
      return true;
    }

    //It might still be an ArcCurve...
    ArcCurve arc = crv as ArcCurve;
    if (arc != null)
    {
      L.Add(arc.DuplicateCurve());
      return true;
    }

    //Nothing else worked, lets assume it's a nurbs curve and go from there...
    NurbsCurve nurbs = crv.ToNurbsCurve();
    if (nurbs == null) { return false; }

    double t0 = nurbs.Domain.Min;
    double t1 = nurbs.Domain.Max;
    double t;

    int LN = L.Count;

    do
    {
      if (!nurbs.GetNextDiscontinuity(Continuity.C1_locus_continuous, t0, t1, out t)) { break; }

      Interval trim = new Interval(t0, t);
      if (trim.Length < 1e-10)
      {
        t0 = t;
        continue;
      }

      Curve M = nurbs.DuplicateCurve();
      M = M.Trim(trim);
      if (M.IsValid) { L.Add(M); }

      t0 = t;
    } while (true);

    if (L.Count == LN) { L.Add(nurbs); }

    return true;
  }
# ---------- end skeleton_2 ----------
dupln = RemoveDuplicateLines(Lines=crv_4, Tolerance=0.01)
disc_2 = Discontinuity(Curve=dupln, Level=1)  # -> Points, Parameters; disabled
item = ListItem(List=disc_2.Points, Index=0, Wrap=True)  # -> Item, Item1; disabled
join = JoinCurves(Curves=dupln, Preserve=toggle_2)
number_slider_6 = Slider(0.426, range=0..10)  # disabled
number_slider_7 = Slider(5, range=0..10)
number_slider_8 = Slider(0.637, range=0..10)  # disabled
number_slider_9 = Slider(23, range=0..50)  # disabled
number_slider_10 = Slider(3, range=0..10)  # disabled
len = Length(Curve=join)
vec2pt = Vector2Pt(PointA=item.Item, PointB=item.Item1, Unitize=False)  # -> Vector, Length; disabled
ln = Line(StartPoint=item.Item, EndPoint=item.Item1)  # disabled
end = EndPoints(Curve=join)  # -> Start, End
flatten_3 = FlattenTree(Tree=vec2pt.Vector, Path="{0}")  # disabled
flatten_4 = FlattenTree(Tree=ln, Path="{0}")  # disabled
number_slider_11 = Slider(0, range=0..10)  # disabled
flatten_5 = FlattenTree(Tree=disc_2.Points, Path="{0}")  # disabled
number_slider_12 = Slider(9, range=0..10)  # disabled
c_script = CSharpScript(X=dupln)  # -> Out, A; disabled
inside = PointWithinCurve(crvs=dupln, crv=crv_2, Parallel=Toggle(True))  # -> A; inputs crvs: list of Curve, crv: Curve, Parallel: Boolean
# ---------- inside: C# usings ----------
using System.IO;
using System.Linq;
using System.Data;
using System.Drawing;
using System.Reflection;
using System.Windows.Forms;
using System.Xml;
using System.Xml.Linq;
using System.Runtime.InteropServices;

using Rhino.DocObjects;
using Rhino.Collections;
using GH_IO;
using GH_IO.Serialization;
# ---------- inside: C# ----------
    var inside = new List<Curve>();

    Curve temp = null;

    Polyline poly = new Polyline();

    Print(crv.IsPolyline().ToString());

    //if( crv.IsPolyline() == false )
    {

      if( !crv.TryGetPolyline(out poly) )
      {

        poly = crv.ToPolyline(0.001, 0.001, 0.001, 1000.00).ToPolyline();

      }

    }

    int size = crvs.Count;

    if( Parallel == true )
    {

      bool[] insideFlag = new bool[size];

      System.Threading.Tasks.Parallel.For(0, size, i =>
        {

        temp = crvs[i];

        if( IsInside(temp.PointAt(0), poly) )

          insideFlag[i] = true;

        else
        {

          insideFlag[i] = false;

        }

        });

      for( int i = 0; i < size; ++i )
      {

        if( insideFlag[i] == true )

          inside.Add(crvs[i]);

      }

    }

    else
    {

      for( int i = 0; i < size; ++i )
      {

        temp = crvs[i];

        if( IsInside(temp.PointAt(0), poly) )

          inside.Add(temp);

      }

    }

    A = inside;
# ---------- inside: C# additional code ----------
  bool IsInside (Point3d pt, Polyline crv)
  {
    Point3d pt1, pt2;
    bool oddNodes = false;

    for (int i = 0; i < crv.SegmentCount; i++) //for each contour line
    {

      pt1 = crv.SegmentAt(i).From; //get start and end pt
      pt2 = crv.SegmentAt(i).To;

      if ( (pt1[1] < pt[1] && pt2[1] >= pt[1] || pt2[1] < pt[1] && pt1[1] >= pt[1]) && (pt1[0] <= pt[0] || pt2[0] <= pt[0]) ) //if pt is between pts in y, and either of pts is before pt in x
        oddNodes ^= ( pt2[0] + (pt[1] - pt2[1]) * (pt1[0] - pt2[0]) / (pt1[1] - pt2[1]) < pt[0] ); //^= is xor
      //end.X + (pt-end).Y   * (start-end).X  /(start-end).Y   <   pt.X
    }


    if (!oddNodes)
    {
      double minDist = 1e10;
      for (int i = 0; i < crv.SegmentCount; i++) {
        Point3d cp = crv.SegmentAt(i).ClosestPoint(pt, true);
        //Point3d cp = mvContour[i].closestPoint(pt);
        //minDist = min(minDist, cp.distance(pt));
        minDist = Math.Min(minDist, cp.DistanceTo(pt));
      }
      if (minDist < 1e-10)
        return true;
    }

    if(oddNodes) return true;

    return false;
  }
# ---------- end inside ----------
crv_5 = Curve(inside)
disc_3 = Discontinuity(Curve=crv_5, Level=1)  # -> Points, Parameters
eval = EvaluateCurve(Curve=crv_5, Parameter=Slider(0.5, range=0..1))  # -> Point, Tangent, Angle
len_2 = Length(Curve=crv_5)
eval_2 = EvaluateCurve(Curve=crv_5, Parameter=number_slider_3)  # -> Point, Tangent, Angle; disabled
crv_6 = Curve(simplify(graft(inside)))  # disabled
disc_4 = Discontinuity(Curve=crv_5, Level=3)  # -> Points, Parameters; disabled
item_2 = ListItem(List=disc_4.Points, Index=0, Wrap=True)  # disabled
duppt = RemoveDuplicatePts(Points=eval.Point, Tolerance=0.01)
end_2 = EndPoints(Curve=crv_5)  # -> Start, End; disabled
dom = ConstructDomain(DomainStart=expr("-x", len_2), DomainEnd=len_2)
qt = QuadTree(Points=flatten(eval_2.Point), Plane=PlaneXY(0, 0, 0), Square=False, Group=number_slider_10)  # -> Quads, Points; disabled
c_script_2 = CSharpScript(Lines=crv_6)  # -> out, Bools; inputs Lines: tree of Line; disabled
# ---------- c_script_2: C# ----------
    var treeBool = new DataTree<bool>();
    
    for( int i = 0; i < Lines.BranchCount - 3; ++i )
    {
      
      var path = Lines.Path(i);
    
      for( int j = 0; j < Lines.Branch(i).Count; ++j )
      {
      
        if( Lines.Branch(i)[j].PointAt(0).CompareTo(Lines.Branch(i + 1)[j].PointAt(1)) > 0 && 
            Lines.Branch(i + 1)[j].PointAt(0).CompareTo(Lines.Branch(i + 2)[j].PointAt(1)) > 0 &&
            Lines.Branch(i + 2)[j].PointAt(0).CompareTo(Lines.Branch(i + 3)[j].PointAt(1)) > 0 )
        {
        
          treeBool.Add( false, path );
        
        }
        
        else
        {
        
          treeBool.Add( true, path );
        
        }
      
      }
    
    }
    
    Bools = treeBool;
# ---------- end c_script_2 ----------
eval_3 = EvaluateCurve(Curve=crv_5, Parameter=number_slider_4)  # -> graft(Point), Tangent, Angle; disabled
eval_4 = EvaluateCurve(Curve=crv_5, Parameter=number_slider_5)  # -> graft(Point), Tangent, Angle; disabled
cir = Circle(Plane=eval.Point, Radius=expr("x*0.5", len_2))
pdecon = Deconstruct(Point=end_2.Start)  # -> XComponent, YComponent, ZComponent; disabled
crv_7 = Curve(qt.Quads)  # disabled
spctopo = SpaceTopology(Curves=qt.Quads)  # disabled
flatten_6 = FlattenTree(Tree=qt.Quads, Path="{0}")  # disabled
area = Area(Geometry=flatten_6, UseTasks=False)  # -> Area, Centroid; disabled
multiplication = Multiplication(A=pdecon.XComponent, B=1000)  # disabled
rectangle = Rectangle(Plane=eval.Point, XSize=dom, YSize=dom, Radius=0)  # -> Rectangle, Length
sort_pt = SortPoints(Points=end_2.Start)  # -> Points, Indices; disabled
sort_pts = SortDuplicatePoints(Points=flatten([eval_4.Point, eval_3.Point]))  # -> UniquePoints, Indices; disabled
prox = Proximity2D(Points=flatten(eval_2.Point), Plane=PlaneXY(0, 0, 0), Group=5, MinRadius=number_slider_6, MaxRadius=number_slider_8)  # -> Links, Topology; disabled
ln_2 = Line(StartPoint=eval_4.Point, EndPoint=eval_3.Point)  # disabled
linetopo = LineTopology(PointTree=graft(area.Centroid), Topology=spctopo)  # disabled
c_script_3 = CSharpScript(x=eval_4.Point)  # -> out, A; inputs x: list of Point3d; disabled
# ---------- c_script_3: C# ----------
    Point3d.SortAndCullPointList(x, 0.001);

    A = x;
# ---------- end c_script_3 ----------
pdecon_2 = Deconstruct(Point=area.Centroid)  # -> XComponent, expr("x*1000", YComponent), ZComponent; disabled
number_slider_13 = Slider(1, range=0..1)  # disabled
item_3 = ListItem(List=qt.Points, Index=0, Wrap=True)  # disabled
spctopo_2 = SpaceTopology(Curves=cir)
addition = Addition(A=multiplication, B=pdecon.YComponent)  # disabled
sort = SortList(Keys=len, ValuesA=join)  # -> Keys, ValuesA; disabled
toggle_3 = BooleanToggle(False)  # disabled
shift = ShiftList(List=flatten_3, Shift=1, Wrap=False)  # disabled
lng = ListLength(List=spctopo_2)
lng_2 = ListLength(List=len)  # disabled
number_slider_14 = Slider(1, range=0..1)  # disabled
number_slider_15 = Slider(0, range=0..1)  # disabled
cull = CullPattern(List=crv_6, CullPattern=c_script_2.Bools)  # disabled
tag = TextTag()  # disabled
addition_2 = Addition(A=pdecon_2.XComponent, B=pdecon_2.YComponent)  # disabled
sort_2 = SortList(Keys=addition, ValuesA=end_2.Start)  # -> Keys, ValuesA; disabled
expression = Expression(x=flatten(lng), y=Slider(4, range=0..100), Expression="If( x ≥ y, False, True )")
linetopo_2 = LineTopology(PointTree=simplify(graft(eval.Point)), Topology=spctopo_2)
angle = Angle(VectorA=flatten_3, VectorB=shift)  # -> Angle, Reflex; disabled
pline = PolyLine(Vertices=sort_pts.UniquePoints, Closed=False)  # disabled
number_slider_16 = Slider(1, range=0..1)  # disabled
lng_3 = ListLength(List=linetopo)  # disabled
pline_2 = PolyLine(Vertices=c_script_3.A, Closed=False)  # disabled
c_script_4 = CSharpScript(Lines=inside, Tolerance=number_slider_11, Preserve=toggle_3)  # -> out, CurvesOut; inputs Lines: list of Curve, Tolerance: Double, Preserve: Boolean; disabled
# ---------- c_script_4: C# ----------
    Curve[] Joined = Curve.JoinCurves(Lines, Tolerance, Preserve);
    
    CurvesOut = Joined;
# ---------- end c_script_4 ----------
bbox_2 = BoundingBox(Content=c_script_4.CurvesOut, Plane=PlaneXY(0, 0, 0))  # -> Box, Box_2; disabled
crv_8 = Curve(inside)
disc_5 = Discontinuity(Curve=crv_8, Level=3)  # -> Points, Parameters; disabled
disc_6 = Discontinuity(Curve=crv_8, Level=2)  # -> flatten(Points), Parameters; disabled
sort_3 = SortList(Keys=addition_2, ValuesA=area.Centroid)  # -> Keys, ValuesA; disabled
deg = Degrees(Radians=angle.Angle)  # disabled
item_4 = ListItem(List=sort.ValuesA, Index=expr("x-1", lng_2), Wrap=True)  # disabled
expression_2 = Expression(x=flatten(lng_3), y=number_slider_12, Expression="If( x < y, False, True )")  # disabled
number_slider_17 = Slider(1, range=-10..1)  # disabled
number_slider_18 = Slider(9.2062, range=0..100)  # disabled
number_slider_19 = Slider(1, range=0..1)  # disabled
polyoffset = PolylineOffset(
    Polylines=skeleton,
    Distance=number_slider_19,
    Plane=Plane(origin=(0, 0, 0), x=(0, 0, 0), y=(0, 0, 0)),
    Tolerance=0.01,
    ClosedFillet=number_slider_16,
    OpenFillet=number_slider_16,
    Miter=2)  # -> Contour, Holes; disabled
polyoffset_2 = PolylineOffset(
    Polylines=c_script_4.CurvesOut,
    Distance=number_slider_14,
    Plane=Plane(origin=(0, 0, 0), x=(0, 0, 0), y=(0, 0, 0)),
    Tolerance=0.01,
    ClosedFillet=number_slider_13,
    OpenFillet=number_slider_13,
    Miter=2)  # -> Contour, Holes; disabled
disc_7 = Discontinuity(Curve=polyoffset_2.Contour, Level=3)  # -> Points, Parameters; disabled
points = PointList(Points=c_script_3.A)  # disabled
panel_3 = Panel(sort_pts.Indices)  # disabled
panel_4 = Panel(prox.Links)  # disabled
eval_5 = EvaluateCurve(Curve=crv_8, Parameter=number_slider_15)  # -> Point, Tangent, Angle; disabled
c_script_5 = CSharpScript(Points=disc_5.Points)  # -> out, Booleans; inputs Points: list of Point3d; disabled
# ---------- c_script_5: C# ----------
    var boolsOut = new List<bool>();
    
    for( int i = 0; i < Points.Count - 1; ++i )
    {
    
      if( Points[i].CompareTo(Points[i + 1]) == 0 )
      {
      
        boolsOut.Add( true );
      
      }
      
      else
      {
      
        boolsOut.Add( false );
      
      }
    
    }
    
    Booleans = boolsOut;
# ---------- end c_script_5 ----------
number_slider_20 = Slider(1, range=0..1)  # disabled
Z = UnitZ(Factor=1)  # disabled
shatter_2 = Shatter(Curve=polyoffset_2.Contour, Parameters=disc_7.Parameters)  # disabled
end_3 = EndPoints(Curve=item_4)  # -> Start, End; disabled
c_script_6 = CSharpScript()  # -> Out, A; disabled
lng_4 = ListLength(List=c_script_4.CurvesOut)  # disabled
expression_3 = Expression(x=deg, y=number_slider_18, Expression="If( x > y, True, False )")  # disabled
hull = ConvexHull(Points=disc_6.Points, Plane=PlaneXY(0, 0, 0))  # -> Hull, HullZ, Indices; disabled
number_slider_21 = Slider(0.2088, range=0..1)  # disabled
number_slider_22 = Slider(0.4662, range=0..1)  # disabled
cull_2 = CullPattern(List=flatten(crv_5), CullPattern=expression)
srf = Surface(polyoffset_2.Contour)  # disabled
crv_9 = Curve(crv_2)
xy = XYPlane(Origin=eval_5.Point)  # disabled
wbweave = WeaverbirdsMeshFromLinesWeaveBack(Lines=shatter_2, MaximumValence=4)  # disabled
polyoffset_3 = PolylineOffset(
    Polylines=item_4,
    Distance=number_slider_19,
    Plane=Plane(origin=(0, 0, 0), x=(0, 0, 0), y=(0, 0, 0)),
    Tolerance=0.01,
    ClosedFillet=number_slider_16,
    OpenFillet=number_slider_16,
    Miter=2)  # -> Contour, Holes; disabled
xprod = CrossProduct(VectorA=eval_5.Tangent, VectorB=Z, Unitize=False)  # -> Vector, Length; disabled
panel_5 = Panel(c_script_5.Booleans)  # disabled
crvprox = CurveProximity(CurveA=crv_2, CurveB=item_4)  # -> PointA, PointB, Distance; disabled
polyoffset_4 = PolylineOffset(
    Polylines=item_4,
    Distance=number_slider_17,
    Plane=Plane(origin=(0, 0, 0), x=(0, 0, 0), y=(0, 0, 0)),
    Tolerance=0.01,
    ClosedFillet=number_slider_16,
    OpenFillet=number_slider_16,
    Miter=2)  # -> Contour, Holes; disabled
srf_2 = Surface(hull.Hull)  # disabled
amp = Amplitude(Vector=xprod.Vector, Amplitude=number_slider_20)  # disabled
number_slider_23 = Slider(2.08, range=0..10)  # disabled
c_script_7 = CSharpScript(BoolsIn=c_script_5.Booleans)  # -> out, Booleans; inputs BoolsIn: list of Boolean; disabled
# ---------- c_script_7: C# ----------
    var boolsOut = new List<bool>();

    for( int i = 0; i < BoolsIn.Count - 1; ++i )
    {

      if( BoolsIn[i] == BoolsIn[i+1] )
      {

        boolsOut.Add(false);

      }

      else
      {

        boolsOut.Add(true);

      }

    }

    Booleans = boolsOut;
# ---------- end c_script_7 ----------
panel_6 = Panel(lng_4)  # disabled
cull_3 = CullPattern(List=flatten(item_3), CullPattern=invert(expression_2))  # disabled
number_slider_24 = Slider(1.065, range=0..10)  # disabled
number_slider_25 = Slider(0.71, range=0..10)  # disabled
join_2 = JoinCurves(Curves=cull_2, Preserve=False)
cir_2 = Circle(Plane=xy, Radius=number_slider_23)  # disabled
neg = Negative(Value=amp)  # disabled
number_slider_26 = Slider(0, range=0..1)  # disabled
offset = OffsetCurve(Curve=crv_2, Distance=Slider(-2.055, range=-10..0), Plane=PlaneXY(0, 0, 0), Corners=1)
disc_8 = Discontinuity(Curve=item_4, Level=1)  # -> Points, Parameters; disabled
inside_2 = PointWithinCurve(crvs=join_2, crv=offset, Parallel=Toggle(False))  # -> A; inputs crvs: list of Curve, crv: Curve, Parallel: Boolean
# ---------- inside_2: C# ----------
    var inside = new List<Curve>();

    Curve temp = null;

    Polyline poly = new Polyline();

    Print(crv.IsPolyline().ToString());

    //if( crv.IsPolyline() == false )
    {

      if( !crv.TryGetPolyline(out poly) )
      {

        poly = crv.ToPolyline(0.001, 0.001, 0.001, 1000.00).ToPolyline();

      }

    }

    int size = crvs.Count;

    if( Parallel == true )
    {

      bool[] insideFlag = new bool[size];

      System.Threading.Tasks.Parallel.For(0, size, i =>
        {

        temp = crvs[i];

        if( IsInside(temp.PointAt(0), poly) && IsInside(temp.PointAt(temp.GetLength()), poly) )

          insideFlag[i] = true;

        else
        {

          insideFlag[i] = false;

        }

        });

      for( int i = 0; i < size; ++i )
      {

        temp = crvs[i];

        if( insideFlag[i] == true && temp.GetLength() > 1.0 )

          inside.Add(temp);

      }

    }

    else if( Parallel == false )
    {

      for( int i = 0; i < size; ++i )
      {

        temp = crvs[i];

        if( IsInside(temp.PointAt(0), poly) )

          inside.Add(temp);
        /*
        for( double j = 0.0; j < temp.GetLength(); j += temp.GetLength() / 10 )
        {

          if( IsInside(temp.PointAt(j), poly) )

            inside.Add(temp);

        }*/

      }

    }

    A = inside;
# ---------- inside_2: C# additional code ----------
  bool IsInside (Point3d pt, Polyline crv)
  {
    Point3d pt1, pt2;
    bool oddNodes = false;

    for (int i = 0; i < crv.SegmentCount; i++) //for each contour line
    {

      pt1 = crv.SegmentAt(i).From; //get start and end pt
      pt2 = crv.SegmentAt(i).To;

      if ( (pt1[1] < pt[1] && pt2[1] >= pt[1] || pt2[1] < pt[1] && pt1[1] >= pt[1]) && (pt1[0] <= pt[0] || pt2[0] <= pt[0]) ) //if pt is between pts in y, and either of pts is before pt in x
        oddNodes ^= ( pt2[0] + (pt[1] - pt2[1]) * (pt1[0] - pt2[0]) / (pt1[1] - pt2[1]) < pt[0] ); //^= is xor
      //end.X + (pt-end).Y   * (start-end).X  /(start-end).Y   <   pt.X
    }


    if (!oddNodes)
    {
      double minDist = 1e10;
      for (int i = 0; i < crv.SegmentCount; i++) {
        Point3d cp = crv.SegmentAt(i).ClosestPoint(pt, true);
        //Point3d cp = mvContour[i].closestPoint(pt);
        //minDist = min(minDist, cp.distance(pt));
        minDist = Math.Min(minDist, cp.DistanceTo(pt));
      }
      if (minDist < 1e-10)
        return true;
    }

    if(oddNodes) return true;

    return false;
  }
# ---------- end inside_2 ----------
pt = ConstructPoint(XCoordinate=number_slider_21, YCoordinate=number_slider_22, ZCoordinate=0)  # disabled
srfsplit = SurfaceSplit(Surface=srf_2, Curves=c_script_4.CurvesOut)  # disabled
eval_6 = EvaluateCurve(Curve=reparameterize(item_4), Parameter=number_slider_26)  # -> Point, Tangent, Angle; disabled
move = Move(Geometry=crv_8, Motion=neg)  # -> Geometry, Transform; disabled
move_2 = Move(Geometry=crv_8, Motion=amp)  # -> Geometry, Transform; disabled
cull_4 = CullPattern(List=flatten_4, CullPattern=expression_3)  # disabled
cull_5 = CullPattern(List=disc_5.Points, CullPattern=c_script_7.Booleans)  # disabled
duppt_2 = RemoveDuplicatePts(Points=disc_8.Points, Tolerance=0.01)  # disabled
area_2 = Area(Geometry=srfsplit, UseTasks=False)  # -> Area, Centroid; disabled
disc_9 = Discontinuity(Curve=inside_2, Level=1)  # -> Points, Parameters
prox_2 = Proximity2D(Points=cull_3, Plane=PlaneXY(0, 0, 0), Group=5, MinRadius=number_slider_25, MaxRadius=number_slider_24)  # -> Links, Topology; disabled
shift_2 = ShiftList(List=disc_5.Points, Shift=1, Wrap=False)  # disabled
points_2 = PointList(Points=disc_8.Points)  # disabled
srf_3 = Surface(polyoffset_4.Contour)  # disabled
ccx_2 = CurveCurve(CurveA=move.Geometry, CurveB=move_2.Geometry)  # -> Points, ParamsA, ParamsB; disabled
number_slider_27 = Slider(1, range=0..1)
sort_pt_2 = SortPoints(Points=flatten(disc_9.Points))  # -> Points, Indices
sort_4 = SortList(Keys=area_2.Area, ValuesA=srfsplit)  # -> Keys, reverse(ValuesA); disabled
ln_3 = Line(StartPoint=disc_5.Points, EndPoint=shift_2)  # disabled
evalsrf = EvaluateSurface(Surface=reparameterize(srf_3), Point=pt)  # -> Point, Normal, UDirection, VDirection, Frame; disabled
debrep = DeconstructBrep(Brep=srf_3)  # -> Faces, Edges, Vertices; disabled
disc_10 = Discontinuity(Curve=skeleton, Level=2)  # -> Points, Parameters; disabled
pline_3 = PolyLine(Vertices=sort_pt_2.Points, Closed=False)
item_5 = ListItem(List=sort_4.ValuesA, Index=0, Wrap=True)  # -> Item, Item1, Item2, Item3; disabled
reb = RebuildCurve(Curve=item_4, Count=10, Tangents=False)  # disabled
fit = FitCurve(Curve=item_4)  # disabled
crv_10 = Curve([item_5.Item, item_5.Item1, item_5.Item2, item_5.Item3])  # disabled
polyoffset_5 = PolylineOffset(
    Polylines=pline_3,
    Distance=Slider(1.792, range=0..10),
    Plane=Plane(origin=(0, 0, 0), x=(0, 0, 0), y=(0, 0, 0)),
    Tolerance=0.01,
    ClosedFillet=number_slider_27,
    OpenFillet=number_slider_27,
    Miter=2)  # -> Contour, Holes
hull_2 = ConvexHull(Points=disc_10.Points, Plane=PlaneXY(0, 0, 0))  # -> Hull, HullZ, Indices; disabled
area_3 = Area(Geometry=hull_2.Hull)  # -> Area, Centroid; disabled
bbox_3 = BoundingBox(Content=crv_8, Plane=PlaneXY(0, 0, 0), UnionBox=False)  # -> Box, Box_2; disabled
number_slider_28 = Slider(1, range=0..1)  # disabled
disc_11 = Discontinuity(Curve=crv_10, Level=3)  # -> Points, Parameters; disabled
scale = Scale(Geometry=hull_2.Hull, Center=area_3.Centroid, Factor=number_slider_28)  # -> Geometry, Transform; disabled
shatter_3 = Shatter(Curve=crv_10, Parameters=disc_11.Parameters)  # disabled
srf_4 = Surface(scale.Geometry)  # disabled
crossref = CrossReference(ListA=shatter_3, ListB=shatter_3, CrossMode=1)  # -> ListA, ListB; disabled
srfsplit_2 = SurfaceSplit(Surface=srf_4, Curves=c_script_4.CurvesOut)  # disabled
wires = BrepWireframe(Brep=srfsplit_2, Density=-1)  # disabled
crv_11 = Curve(graft([crossref.ListA, crossref.ListB]))  # disabled
area_4 = Area(Geometry=srfsplit_2, UseTasks=True)  # -> Area, Centroid; disabled
debrep_2 = DeconstructBrep(Brep=srfsplit_2)  # -> Faces, Edges, Vertices; disabled
item_6 = ListItem(List=crv_11, Index=0, Wrap=True)  # -> Item, Item1; disabled
flatten_7 = FlattenTree(Tree=wires, Path="{0}")  # disabled
sort_5 = SortList(Keys=area_4.Area, ValuesA=srfsplit_2)  # -> Keys, reverse(ValuesA); disabled
ccx_3 = CurveCurve(CurveA=item_6.Item, CurveB=item_6.Item1, UseTasks=True)  # -> Points, ParamsA, ParamsB; disabled
join_3 = JoinCurves(Curves=flatten(wires), Preserve=True)  # -> simplify(Curves); disabled
item_7 = ListItem(List=sort_5.ValuesA, Index=0, Wrap=True)  # -> Item, Item1, Item2, Item3; disabled
null_2 = NullItem(Item=join_3)  # -> NullFlags, InvalidFlags, Description; disabled
cull_6 = CullPattern(List=join_3, CullPattern=invert(null_2.InvalidFlags))  # disabled
panel_7 = Panel(null_2.InvalidFlags)  # disabled
