# Grasshopper definition MedialAxis[0].gh (Grasshopper 1.0.7)
# plug-ins: SpacePartition, ClipperComponents, Kangaroo2 Components

number_slider = Slider(500, range=0..1000)
# Medial Axis definition by Daniel Piker 10/09/09
# 
# spacesymmetrystructure.wordpress.com
panel = Panel("200")
nurbs = Curve(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)
crv = Curve(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)
crv_2 = Curve(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)
crv_3 = Curve(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)
crv_4 = Curve(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)
divide = DivideCurve(Curve=crv_2, Count=number_slider, Kinks=False)  # -> Points, Tangents, Parameters
flatten = FlattenTree(Tree=divide.Points, Path="{0}")
bbox = BoundingBox(Content=crv_2, Plane=PlaneXY(0, 0, 0))  # -> Box, Box_2
voronoi = Voronoi(Points=flatten, Boundary=bbox.Box, BruteForceOverride=False)
disc = Discontinuity(Curve=voronoi, Level=Slider(3, range=0..3))  # -> Points, Parameters
shatter = Shatter(Curve=graft(voronoi), Parameters=disc.Parameters, UseTasks=False)
flatten_2 = FlattenTree(Tree=shatter, Path="{0}")
ccx = CurveCurve(CurveA=flatten_2, CurveB=crv_2, UseTasks=False)  # -> Points, ParamsA, ParamsB
graft = GraftTree(Tree=flatten_2, IncludeEmptyLists=True, IncludeNullItems=True)
null = NullItem(Item=ccx.Points)  # -> NullFlags, InvalidFlags, Description
dispatch = Dispatch(List=graft, DispatchPattern=null.NullFlags)  # -> ListA, ListB
skeleton = MedialAxisSkeleton(CurveIn=crv_2, NumberOfSamples=number_slider)
crv_5 = Curve(flatten(dispatch.ListA))
dupln = RemoveDuplicateLines(Lines=crv_5, Tolerance=0.01)
dupln_2 = RemoveDuplicateLines(Lines=skeleton, Tolerance=0.01)
toggle = BooleanToggle(True)
inside = InsideOriginal(CurvesToCull=dupln_2, BoundaryCurve=crv_2, ParallelComputing=toggle)
inside_2 = PointWithinCurve(crvs=dupln, crv=crv_2, Parallel=toggle)  # -> A; inputs crvs: list of Curve, crv: Curve, Parallel: Boolean
# ---------- inside_2: C# usings ----------
using System.IO;
using System.Linq;
using System.Data;
using System.Drawing;
using System.Reflection;
using System.Windows.Forms;
using System.Xml;
using System.Xml.Linq;
using System.Runtime.InteropServices;

using Rhino.DocObjects;
using Rhino.Collections;
using GH_IO;
using GH_IO.Serialization;
# ---------- inside_2: C# ----------
    var inside = new List<Curve>();

    Curve temp = null;

    Polyline poly = new Polyline();

    Print(crv.IsPolyline().ToString());

    //if( crv.IsPolyline() == false )
    {

      if( !crv.TryGetPolyline(out poly) )
      {

        poly = crv.ToPolyline(0.001, 0.001, 0.001, 1000.00).ToPolyline();

      }

    }

    int size = crvs.Count;

    if( Parallel == true )
    {

      bool[] insideFlag = new bool[size];

      System.Threading.Tasks.Parallel.For(0, size, i =>
        {

        //temp = crvs[i];

        if( IsInside(crvs[i].PointAt(0), poly) )

          insideFlag[i] = true;

        else
        {

          insideFlag[i] = false;

        }

        });

      for( int i = 0; i < size; ++i )
      {

        if( insideFlag[i] == true )

          inside.Add(crvs[i]);

      }

    }

    else
    {

      for( int i = 0; i < size; ++i )
      {

        temp = crvs[i];

        if( IsInside(temp.PointAt(0), poly) )

          inside.Add(temp);

      }

    }

    A = inside;
# ---------- inside_2: C# additional code ----------
  bool IsInside (Point3d pt, Polyline crv)
  {
    Point3d pt1, pt2;
    bool oddNodes = false;

    for (int i = 0; i < crv.SegmentCount; i++) //for each contour line
    {

      pt1 = crv.SegmentAt(i).From; //get start and end pt
      pt2 = crv.SegmentAt(i).To;

      if ( (pt1[1] < pt[1] && pt2[1] >= pt[1] || pt2[1] < pt[1] && pt1[1] >= pt[1]) && (pt1[0] <= pt[0] || pt2[0] <= pt[0]) ) //if pt is between pts in y, and either of pts is before pt in x
        oddNodes ^= ( pt2[0] + (pt[1] - pt2[1]) * (pt1[0] - pt2[0]) / (pt1[1] - pt2[1]) < pt[0] ); //^= is xor
      //end.X + (pt-end).Y   * (start-end).X  /(start-end).Y   <   pt.X
    }


    if (!oddNodes)
    {
      double minDist = 1e10;
      for (int i = 0; i < crv.SegmentCount; i++) {
        Point3d cp = crv.SegmentAt(i).ClosestPoint(pt, true);
        //Point3d cp = mvContour[i].closestPoint(pt);
        //minDist = min(minDist, cp.distance(pt));
        minDist = Math.Min(minDist, cp.DistanceTo(pt));
      }
      if (minDist < 1e-10)
        return true;
    }

    if(oddNodes) return true;

    return false;
  }
# ---------- end inside_2 ----------
skeleton_2 = MedialAxisSkeleton(CurveIn=crv_2, NumberOfSamples=number_slider, Preserve=Toggle(True), Recursive=Toggle(True))
crv_6 = Curve(inside_2)
len = Length(Curve=crv_6)
c_script = CSharpScript(CurvesIn=crv_6)  # -> CirclesOut; inputs CurvesIn: list of Curve; disabled
# ---------- c_script: C# ----------
    //List<Curve> circlesOut = new List<Curve>();

    int count = CurvesIn.Count;

    Curve[] circlesOut = new Curve[count];
    
    List<Curve> curvesOut = new List<Curve>();

    for( int i = 0; i < count; ++i )
    {

      circlesOut[i] = new Circle(CurvesIn[i].PointAt(0.5), CurvesIn[i].GetLength() * 0.5).ToNurbsCurve();

    }

    /*System.Threading.Tasks.Parallel.For( 0, size, i =>
    {

      circlesOut[i] = new Circle(CurvesIn[i].PointAt(0.5), CurvesIn[i].GetLength() * 0.5).ToNurbsCurve();

    });*/

    //var topoTree = new DataTree<int>();

    bool[][] cullPattern = new bool[count][];
    int[] topoPattern = new int[count];
    int counter = 0;

    for (int i = 0; i < count; ++i)
    {

      var path = new GH_Path(i);

      cullPattern[i] = new bool[count];

      System.Threading.Tasks.Parallel.For(0, count, j =>
        {

        if( j != i )
        {

          if( Curve.PlanarCurveCollision(circlesOut[i], circlesOut[j], Plane.WorldXY, Rhino.RhinoDoc.ActiveDoc.ModelAbsoluteTolerance) )
          {

            cullPattern[i][j] = true;

          }

          else
          {

            cullPattern[i][j] = false;

          }

        }

        else
        {

          cullPattern[i][j] = false;

        }

        });

      for( int j = 0; j < count; ++j )
      {

        if( cullPattern[i][j] == true )
        {

          //topoTree.Add(j, path);
          counter++;
          //topoPattern[i] = counter;
          //curvesOut.Add( CurvesIn[i] );
          
        }

      }
      
      topoPattern[i] = counter;
      
      counter = 0;
      
      if( topoPattern[i] < 3 )
      {
      
        curvesOut.Add( CurvesIn[i] );
      
      }

    }

    CirclesOut = curvesOut;
# ---------- end c_script ----------
disc_2 = Discontinuity(Curve=skeleton_2, Level=3)  # -> Points, Parameters; disabled
cut = CutCorners(CurvesToSplit=crv_6)
eval = EvaluateCurve(Curve=crv_6, Parameter=Slider(0.5, range=0..1))  # -> Point, Tangent, Angle
shatter_2 = Shatter(Curve=skeleton_2, Parameters=disc_2.Parameters)  # disabled
dupln_3 = RemoveDuplicateLines(Lines=shatter_2, Tolerance=0.01)  # disabled
multiplication = Multiplication(A=len, B=Slider(0.5, range=0..1))
number_slider_2 = Slider(0.5, range=0..1)  # disabled
len_2 = Length(Curve=dupln_3)  # disabled
cir = Circle(Plane=eval.Point, Radius=multiplication)
number_slider_3 = Slider(0.5, range=0..1)  # disabled
eval_2 = EvaluateCurve(Curve=reparameterize(dupln_3), Parameter=number_slider_2)  # -> Point, Tangent, Angle; disabled
spctopo = SpaceTopology(Curves=cir, ParallelComputing=Toggle(True))
lng = ListLength(List=spctopo)
multiplication_2 = Multiplication(A=len_2, B=number_slider_3)  # disabled
c_script_2 = CSharpScript(Curves=cir)  # -> out, A; inputs Curves: list of Curve, Parallel: Boolean, y: Double; disabled
# ---------- c_script_2: C# ----------
    A = Curve.PlanarCurveCollision( Curves[0], Curves[1], Plane.WorldXY, Rhino.RhinoDoc.ActiveDoc.ModelAbsoluteTolerance );
# ---------- end c_script_2 ----------
expression = Expression(x=flatten(lng), y=Slider(3, range=0..4), Expression="If( x ≥ y, False, True )")
cir_2 = Circle(Plane=eval_2.Point, Radius=multiplication_2)  # disabled
number_slider_4 = Slider(3, range=0..4)  # disabled
spctopo_2 = SpaceTopology(Curves=cir_2)  # disabled
area = Area(Geometry=crv_2)  # -> Area, Centroid
cull = CullPattern(List=flatten(crv_6), CullPattern=expression)
lng_2 = ListLength(List=spctopo_2)  # disabled
crv_7 = Curve(crv_2)
expression_2 = Expression(x=flatten(lng_2), y=number_slider_4, Expression="If( x ≥ y, False, True )")  # disabled
join = JoinCurves(Curves=cull, Preserve=False)
panel_2 = Panel(area.Area)
offset = OffsetCurve(Curve=crv_2, Distance=Slider(-1.669, range=-10..0), Plane=PlaneXY(0, 0, 0), Corners=1)
merge = Merge(Data1="Cocina", Data2="Cuarto", Data3="Sala")
intersectionculling = CSharpScript(Curves=join, CurveIn=offset, Tolerance=Slider(0.001, range=0..0.001), Parallel=Toggle(True))  # -> out, CurvesOut; inputs Curves: list of Curve, CurveIn: Curve, Tolerance: Double, Parallel: Boolean
# ---------- intersectionculling: C# ----------
    Rhino.Geometry.Intersect.CurveIntersections ixx;

    Curve temp = null;

    Polyline tempPoly = new Polyline();

    List<Curve> curvesOut = new List<Curve>();

    if( !CurveIn.TryGetPolyline(out tempPoly) )
    {

      tempPoly = CurveIn.ToPolyline(0.001, 0.001, 0.001, 1000.00).ToPolyline();

    }

    int size = Curves.Count;

    bool[] boolArray = new bool[size];

    if( Parallel == false )
    {

      for( int i = 0; i < size; ++i )
      {

        temp = Curves[i];

        ixx = Rhino.Geometry.Intersect.Intersection.CurveCurve(temp, CurveIn, Tolerance, Tolerance);

        if( Curves[i].GetLength() > 2.000 && IsInside(temp.PointAt(0), tempPoly) && ixx.Count == 0 )
        {

          curvesOut.Add(temp);

        }

      }

    }

    else
    {

      System.Threading.Tasks.Parallel.For(0, size, i =>
        {

        if( Curves[i].GetLength() > 2.000 && IsInside(Curves[i].PointAt(0), tempPoly) && Rhino.Geometry.Intersect.Intersection.CurveCurve(Curves[i], CurveIn, Tolerance, Tolerance).Count == 0 )
        {

          boolArray[i] = true;

        }

        else
        {

          boolArray[i] = false;

        }

        });

      for( int i = 0; i < size; ++i )
      {

        temp = Curves[i];

        if( boolArray[i] == true )
        {

          curvesOut.Add(temp);

        }

      }

    }

    CurvesOut = curvesOut;
# ---------- intersectionculling: C# additional code ----------
  bool IsInside (Point3d pt, Polyline crv)
  {
    Point3d pt1, pt2;
    bool oddNodes = false;

    for (int i = 0; i < crv.SegmentCount; i++) //for each contour line
    {

      pt1 = crv.SegmentAt(i).From; //get start and end pt
      pt2 = crv.SegmentAt(i).To;

      if ( (pt1[1] < pt[1] && pt2[1] >= pt[1] || pt2[1] < pt[1] && pt1[1] >= pt[1]) && (pt1[0] <= pt[0] || pt2[0] <= pt[0]) ) //if pt is between pts in y, and either of pts is before pt in x
        oddNodes ^= ( pt2[0] + (pt[1] - pt2[1]) * (pt1[0] - pt2[0]) / (pt1[1] - pt2[1]) < pt[0] ); //^= is xor
      //end.X + (pt-end).Y   * (start-end).X  /(start-end).Y   <   pt.X
    }


    if (!oddNodes)
    {
      double minDist = 1e10;
      for (int i = 0; i < crv.SegmentCount; i++) {
        Point3d cp = crv.SegmentAt(i).ClosestPoint(pt, true);
        //Point3d cp = mvContour[i].closestPoint(pt);
        //minDist = min(minDist, cp.distance(pt));
        minDist = Math.Min(minDist, cp.DistanceTo(pt));
      }
      if (minDist < 1e-10)
        return true;
    }

    if(oddNodes) return true;

    return false;
  }
# ---------- end intersectionculling ----------
merge_2 = Merge(Data1=Slider(1000, range=0..1000), Data2=Slider(847, range=0..1500), Data3=Slider(1464, range=0..1500))
intercull = IntersectionCulling(CurvesToCull=cut, BoundaryCurve=offset)
cull_2 = CullPattern(List=flatten(dupln_3), CullPattern=expression_2)  # disabled
ma = MassAddition(Input=merge_2)  # -> Result, PartialResults
lng_3 = ListLength(List=merge_2)
panel_3 = Panel(ma.Result)
dom = ConstructDomain(DomainStart=0, DomainEnd=1)
sortpoints = CSharpScript(CurvesIn=intercull, Tolerance=Slider(0.001, range=0..0.001))  # -> out, PolylineOut; inputs CurvesIn: list of Curve, Tolerance: Double
# ---------- sortpoints: C# ----------
    /*double min = double.MaxValue, val = 0.0, dist = 0.0;

    var listOut = new List<Point3d>();

    for( int i = 0; i < PointsIn.Count - 1; ++i )
    {

      dist = PointsIn[i].DistanceTo( PointsIn[i + 1] );

      val = Math.Min( dist, min );

      if( val == dist )
      {

        listOut.Add( PointsIn[i + 1] );

      }

    }

    //var polyOut = new Polyline( listOut );

    PolylineOut = listOut;*/
    
    List<Polyline> polyList = new List<Polyline>();
    
    List<Point3d> points = new List<Point3d>();
    
    Polyline tempPoly = new Polyline();
    
    for( int i = 0; i < CurvesIn.Count; ++i )
    {
      
      if( !CurvesIn[i].TryGetPolyline(out tempPoly) )
      {

        tempPoly = CurvesIn[i].ToPolyline(Tolerance, Tolerance, Tolerance, 1000.00).ToPolyline();

      }
    
      points.AddRange(tempPoly.ToArray());
    
    }
    
    Point3d[] pointy = Point3d.SortAndCullPointList(points, Tolerance);

    PolylineOut = new Polyline( pointy );
# ---------- end sortpoints ----------
reconstruct = ReconstructCurve(CurvesIn=intercull)
genemodifier = GenePoolModifier(GeneList="tParam", Count=lng_3, Domain=dom, Randomize=Button(), PercentageOfRandomization=Slider(1, range=0..1))
genemodifier_2 = GenePoolModifier(GeneList="tParamO", Count=lng_3, Domain=dom, Randomize=Button(), PercentageOfRandomization=Slider(1, range=0..1))
tparamo = GenePool(Decimals=2, Maximum=1, Minimum=0, Value=[0.4687304955, 0.1701581889, 0.9531094502])
tparam = GenePool(Decimals=2, Maximum=1, Minimum=0, Value=[0.73, 0.35, 0.21])
eval_3 = EvaluateCurve(Curve=reparameterize(crv_7), Parameter=tparamo)  # -> Point, Tangent, Angle
random = Random(Range=Domain(0, 1), Number=lng_3, Seed=Slider(463, range=0..1000))
random_2 = Random(Range=Domain(0, 1), Number=lng_3, Seed=Slider(393, range=0..1000))
random_3 = Random(Range=Domain(0, 1), Number=lng_3, Seed=Slider(280, range=0..1000))
frgb = ColourRGBF(Alpha=1, Red=random, Green=random_2, Blue=random_3)
number_slider_5 = Slider(2, range=0..2)
polyoffset = PolylineOffset(
    Polylines=sortpoints.PolylineOut,
    Distance=Slider(0.755, range=0..10),
    Plane=Plane(origin=(0, 0, 0), x=(0, 0, 0), y=(0, 0, 0)),
    Tolerance=0.01,
    ClosedFillet=number_slider_5,
    OpenFillet=number_slider_5,
    Miter=2)  # -> Contour, Holes
eval_4 = EvaluateCurve(Curve=reparameterize(polyoffset.Contour), Parameter=tparam)  # -> Point, Tangent, Angle
crv_cp = CurveClosestPoint(Point=eval_4.Point, Curve=crv_7)  # -> Point, Parameter, Distance
ln = Line(StartPoint=eval_4.Point, EndPoint=crv_cp.Point)
merge_3 = Merge(Data1=sortpoints.PolylineOut, Data2=ln)
flatten_3 = FlattenTree(Tree=merge_3, Path="{0}")
join_2 = JoinCurves(Curves=flatten_3, Preserve=False)
merge_4 = Merge(Data1=polyoffset.Contour, Data2=ln)  # -> flatten(Result)
srfsplit = SurfaceSplit(Surface=crv_7, Curves=merge_4)
area_2 = Area(Geometry=srfsplit, UseTasks=False)  # -> Area, Centroid
area_3 = Area(Geometry=polyoffset.Contour, UseTasks=False)  # -> Area, Centroid
panel_4 = Panel(area_3.Area)
addition = Addition(A=ma.Result, B=area_3.Area)
panel_5 = Panel(addition)
expression_3 = Expression(x=area_2.Area, y=area_3.Area, Expression="If( ( x - y ) < 0.01, True, False )")
num = Number(area_2.Area)
galapagos = Galapagos(fitness=ma_2, gene=tparam)
cull_3 = CullPattern(List=num, CullPattern=invert(expression_3))
expression_4 = Expression(x=merge_2, y=cull_3, Expression="Abs( x - y )")
ma_2 = MassAddition(Input=expression_4)  # -> Result, PartialResults
panel_6 = Panel(ma_2.Result)
cull_4 = CullPattern(List=srfsplit, CullPattern=invert(expression_3))
preview = CustomPreview(Geometry=cull_4, Material=frgb)
cull_5 = CullPattern(List=area_2.Centroid, CullPattern=invert(expression_3))
tag = TextTag(Location=cull_5, Text=merge, Colour=RGB(255, 255, 255))
