# Grasshopper definition PhysicsPacking.gh (Grasshopper 1.0.7)
# plug-ins: SpacePartition, treesloth01, PTComponentLibrary, Kangaroo2 Components

# ---- group: InputData / Labels
text = Text(Tree({0;0}: ["Unidades sanitarias mujeres / privadas"], {0;1}: ["Unidades sanitarias hombres / privadas"], {0;2}: ["Cuarto de aseo "], {0;3}: ["Área de aseo de residuos"], {0;4}: ["Almacen General Insumos de Aseo "], {0;5}: ["Área de UPC-Rack"]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))

# ---- group: InputData / Areas
text_2 = Text(Tree({0;0}: ["3"], {0;1}: ["3"], {0;2}: ["6"], {0;3}: ["1"], {0;4}: ["5"], {0;5}: ["4"]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))

# ---- group: InputData / Topology
integer = Integer(Tree({0}: [7], {1}: [7], {2}: [3], {3}: [2, 11], {4}: [16, 21, 19], {5}: [19]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))

# ---- group: InputData / ID
text_3 = Text(Tree({0;0}: ["5"], {0;1}: ["5"], {0;2}: ["5"], {0;3}: ["5"], {0;4}: ["5"], {0;5}: ["5"]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))

# ---- group: InputData
number_slider = Slider(1, range=0..10)
path_mapper = PathMapper(text, source="{A;B}", target="{A}")
path_mapper_2 = PathMapper(text_2, source="{A;B}", target="{A}")
path_mapper_3 = PathMapper(integer, source="{A;B}", target="{A}")
path_mapper_4 = PathMapper(text_3, source="{A;B}", target="{A}")
prunebranches = CSharpScript(branches=path_mapper, howMany=number_slider)  # -> prunedTree, branchCounter; inputs branches: tree of String, howMany: Int32
# ---------- prunebranches: C# ----------
    var treeOut = new DataTree<string>();

    for( int i = 0; i < branches.BranchCount - howMany; ++i )
      treeOut.AddRange(branches.Branch(i), new GH_Path(i));

    prunedTree = treeOut;
    branchCounter = treeOut.BranchCount;
# ---------- end prunebranches ----------
prunebranches_2 = CSharpScript(branches=path_mapper_2, howMany=number_slider)  # -> prunedTree, branchCounter; inputs branches: tree of String, howMany: Int32; same code as prunebranches
mass_addition = MassAddition(Input=prunebranches_2.prunedTree)  # -> Result, PartialResults
number_slider_2 = Slider(4, range=0..10)
flatten_tree = FlattenTree(Tree=prunebranches_2.prunedTree, Path="{0}")
list_length = ListLength(List=flatten_tree)
integer_2 = Integer(list_length)

# ----
number_slider_3 = Slider(21, range=0..21)
number_slider_4 = Slider(5, range=0..5)
number_slider_5 = Slider(0.1, range=0..0.1)
dom = ConstructDomain(DomainStart=expr("-x", number_slider_3), DomainEnd=number_slider_3)
dom_2 = ConstructDomain(DomainStart=expr("-x", number_slider_4), DomainEnd=number_slider_4)
subtraction = Subtraction(A=Slider(1, range=0..1), B=number_slider_5)
toggle = BooleanToggle(True)
number_slider_6 = Slider(25, range=0..100)
toggle_2 = BooleanToggle(True)
dom_3 = ConstructDomain(DomainStart=number_slider_5, DomainEnd=subtraction)
genemodifier = GenePoolModifier(
    GeneList="PointsX",
    Count=number_slider_6,
    Domain=dom_3,
    Randomize=Button(),
    PercentageOfRandomization=Slider(1, range=0..1))
genemodifier_2 = GenePoolModifier(
    GeneList="PointsY",
    Count=number_slider_6,
    Domain=dom_3,
    Randomize=Button(),
    PercentageOfRandomization=Slider(1, range=0..1))
toggle_3 = BooleanToggle(True)
rectangle = Rectangle(Plane=PlaneXY(0, 0, 0), XSize=dom_2, YSize=dom, Radius=0)  # -> Rectangle, Length
offset = OffsetCurve(Curve=rectangle.Rectangle, Distance=1, Plane=PlaneXY(0, 0, 0), Corners=1)
dom_4 = ConstructDomain(DomainStart=Slider(0.7, range=0..1), DomainEnd=Slider(1.5, range=0..10))
pointsy = GenePool(
    Decimals=2,
    Maximum=0.9,
    Minimum=0.1,
    Value=[0.2140706678, 0.785285598, 0.4417914534, 0.3640028862, 0.6467992394, 0.508041917, 0.5183068628, 0.5791312604, 0.8010340224, 0.8055068939, 0.6000262572, 0.1558724597, 0.3731355065, 0.4406143689, 0.1917650991, 0.7119934506, 0.3558582557, 0.1298343521, 0.4730765937, 0.3980475874, 0.547841611, 0.7583091225, 0.1009966955, 0.6701648909, 0.4575501336])
pointsx = GenePool(
    Decimals=2,
    Maximum=0.9,
    Minimum=0.1,
    Value=[0.1869033602, 0.1084055498, 0.3330265471, 0.4587887486, 0.302431189, 0.8965586368, 0.8492906373, 0.5143991904, 0.43080819, 0.6355596217, 0.8532898403, 0.2092844636, 0.8166597563, 0.8792622331, 0.7667291719, 0.2538228807, 0.4938209956, 0.6479328557, 0.7504073548, 0.192521298, 0.4218760272, 0.6190212353, 0.5099908477, 0.3580680867, 0.2905723383])
offset_2 = OffsetCurve(Curve=rectangle.Rectangle, Distance=Slider(10, range=0..10), Plane=PlaneXY(0, 0, 0), Corners=1)
loft = Loft(
    Curves=flatten([offset, rectangle.Rectangle]),
    Options={Adjust=False, Closed=False, LoftEnds=0, LoftSimp=0, LoftType=0, Rebuild=10, Refit=0.01})
genemodifier_3 = GenePoolModifier(GeneList="R", Count=number_slider_6, Domain=dom_4, Randomize=Button(), PercentageOfRandomization=Slider(1, range=0..1))
crv = Curve(rectangle.Rectangle)
debrep = DeconstructBrep(Brep=loft)  # -> Faces, Edges, Vertices
loft_2 = Loft(
    Curves=flatten([offset_2, rectangle.Rectangle]),
    Options={Adjust=False, Closed=False, LoftEnds=0, LoftSimp=0, LoftType=0, Rebuild=10, Refit=0.01})
debrep_2 = DeconstructBrep(Brep=loft_2)  # -> Faces, Edges, Vertices
division = Division(A=number_slider_3, B=Slider(4, range=0..10))
division_2 = Division(A=number_slider_4, B=Slider(1, range=0..10))
join = JoinCurves(Curves=debrep.Edges, Preserve=False)
pt = ConstructPoint(XCoordinate=pointsx, YCoordinate=pointsy, ZCoordinate=0)
evalsrf = EvaluateSurface(Surface=reparameterize(rectangle.Rectangle), Point=pt)  # -> Point, Normal, UDirection, VDirection, Frame
num = Number(0.7853981634)
wires = BrepWireframe(Brep=debrep_2.Faces, Density=-1)
genes = GenePool(Decimals=2, Maximum=1, Minimum=0, Value=[0.91, 0.09, 0.93, 0.27])
ptsrfdomlen = SurfaceDomainLength(Surface=crv, ULength=division_2, VLength=division)
multiplication = Multiplication(B=num)
subtraction_2 = Subtraction(B=multiplication)
genes_2 = GenePool(Decimals=2, Maximum=1, Minimum=0, Value=[0.31, 0.93, 0.66, 0.23])
join_2 = JoinCurves(Curves=wires, Preserve=False)  # -> flatten(Curves)
disc = Discontinuity(Curve=rectangle.Rectangle, Level=1)  # -> Points, Parameters
pt_2 = ConstructPoint(XCoordinate=genes_2, YCoordinate=genes, ZCoordinate=0)
shatter = Shatter(Curve=rectangle.Rectangle, Parameters=disc.Parameters, UseTasks=False)
number_slider_7 = Slider(3, range=0..10)
pt_3 = Point(Point(-8.889669476, 0.9571302321, 0))
pt_4 = Point(Point(12.49462611, 9.188623882, 0))
pt_5 = Point(Point(9.560380069, -10.5680755, 0))
pt_6 = Point(Point(-7.46573811, -9.521026165, 0))
number_slider_8 = Slider(0.0001, range=0..0.0001)
ptborders = GenerateBorders(Grid=ptsrfdomlen, PanelShape=0)  # -> simplify(flatten(Border))
evalsrf_2 = EvaluateSurface(Surface=reparameterize(rectangle.Rectangle), Point=pt_2)  # -> Point, Normal, UDirection, VDirection, Frame
data = Data(graft([pt_4, pt_6, pt_3, pt_5]))
Y = UnitY(Factor=expr("-x", Slider(0.002, range=0..1)))
voronoi = Voronoi(Points=evalsrf_2.Point, Boundary=rectangle.Rectangle, BruteForceOverride=False)
grab = Grab(On=True, Strength=1, Range=3)
item = ListItem(List=ptborders, Index=0, Wrap=True)
threshold = Threshold(1e-15)
area = Area(Geometry=item, UseTasks=False)  # -> Area, Centroid
multiplication_2 = Multiplication(A=area.Area, B=0.6)
number_slider_9 = Slider(0.1, range=0..1)  # disabled
plasticanchor = PlasticAnchor(Point=evalsrf.Point, Limit=0.001, Strength=number_slider_9)  # disabled
ma = MassAddition(Input=prunebranches_2.prunedTree)  # -> Result, PartialResults
number_slider_10 = Slider(0.001, range=0..0.001)  # disabled
spacepartition = SpacePartition(VoronoiIn=voronoi, GridIn=ptborders, AreaIn=multiplication_2, Tolerance=Slider(0.001, range=0..0.001))
number_slider_11 = Slider(250, range=0..10000)  # disabled
expression = Expression(x=ma.Result, Expression="( x * 0.3 ) + x")
sortxy = SortPointsXY(Grid=flatten(spacepartition))
genemodifier_4 = GenePoolModifier(
    GeneList="Colours",
    Count=Slider(4, range=0..10),
    Domain=Domain(0, 255),
    Randomize=Button(),
    PercentageOfRandomization=Slider(1, range=0..1))
construct_domain = ConstructDomain(DomainStart=Slider(0, range=0..100), DomainEnd=Slider(255, range=0..1000))
missing = MissingGridCells(CulledGrid=sortxy, OriginalGrid=ptborders)
pararunion = ParallelRegionUnion(Curves=spacepartition)
expression_2 = Expression(x=expression, y=Slider(0.2, range=0..1), Expression="x * y")
colours = GenePool(Decimals=0, Maximum=255, Minimum=0, Value=[105.5423208, 124.4570353, 74.52132848, 133.7994735])
mgtree = MergeTreeMissing(CulledGrid=pararunion, MissingGridCells=missing)
addition = Addition(A=expression_2, B=expression)
subtraction_3 = Subtraction(A=expression, B=expression_2)
pararunion_2 = ParallelRegionUnion(Curves=mgtree)
list_length_2 = ListLength(List=flatten(pararunion_2))
random = Random(Range=construct_domain, Number=list_length_2, Seed=colours, Integers=True)
explode_tree = ExplodeTree(Data=random)  # -> Branch0, Branch1, Branch2

# ---- group: OriginalSilhouette
curve = Curve(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)

# ----
colour_rgb = ColourRGB(Alpha=Slider(255, range=0..255), Red=explode_tree.Branch0, Green=explode_tree.Branch1, Blue=explode_tree.Branch2)
pcen = PolygonCenter(Polyline=curve)  # -> CenterV, CenterE, CenterA
pcen_2 = PolygonCenter(Polyline=crv)  # -> CenterV, CenterE, CenterA
vec2pt = Vector2Pt(PointA=pcen.CenterE, PointB=pcen_2.CenterE, Unitize=False)  # -> Vector, Length
galapagos = Galapagos(fitness=ma_2, gene=[genes, genes_2])
move = Move(Geometry=curve, Motion=vec2pt.Vector)  # -> Geometry, Transform
number_slider_12 = Slider(0.5, range=0..1)
number_slider_13 = Slider(1, range=0..1)
number_slider_14 = Slider(0.5, range=0..1)
number_slider_15 = Slider(0.5, range=0..1)
number_slider_16 = Slider(1, range=0..1)
number_slider_17 = Slider(1, range=0..1)
parallelregionintersection = ParallelRegionIntersection(CurvesA=move.Geometry, CurvesB=pararunion_2)
area_2 = Area(Geometry=parallelregionintersection, UseTasks=False)  # -> simplify(Area), Centroid
expression_3 = Expression(x=area_2.Area, y=addition, z=subtraction_3, Expression="If( ( x ≤ y ) and ( x ≥ z ), 0, 1000 )")
ma_2 = MassAddition(Input=flatten(expression_3))  # -> Result, PartialResults
srf = Surface(simplify(parallelregionintersection))
panel = Panel(area_2.Area)
custom_preview = CustomPreview(Geometry=srf, Material=graft(colour_rgb))
panel_2 = Panel(ma_2.Result)
dom_5 = ConstructDomain(DomainStart=Slider(0.6, range=0..1), DomainEnd=Slider(1, range=0..1))  # -> graft(Domain)
gnlst = GeneList(graft(["R", "R0", "R1", "R2"]))
bang = ExplodeTree(Data=parallelregionintersection)  # -> Branch0, Branch1, Branch2, Branch3
R = GenePool(
    Decimals=2,
    Maximum=1,
    Minimum=0.6,
    Value=[0.6632191124, 0.6294624856, 0.7037568845, 0.7953440065, 0.6979664129, 0.6160190545, 0.9254246419, 0.8586152963, 0.6709397091, 0.7730093238])
r1 = GenePool(
    Decimals=2,
    Maximum=1,
    Minimum=0.6,
    Value=[0.6632191124, 0.6294624856, 0.7037568845, 0.7953440065, 0.6979664129, 0.6160190545, 0.9254246419])
r0 = GenePool(Decimals=2, Maximum=1, Minimum=0.6, Value=[0.6632191124, 0.6294624856])
r2 = GenePool(
    Decimals=2,
    Maximum=1,
    Minimum=0.6,
    Value=[0.6632191124, 0.6294624856, 0.7037568845, 0.7953440065, 0.6979664129, 0.6160190545])
offsettree = CSharpScript(tree=parallelregionintersection, distance=Slider(-20, range=-20..10))  # -> out, A; inputs tree: tree of Curve, distance: Double
# ---------- offsettree: C# ----------
    /*var curves = x.Offset(Plane.WorldXY, -10, 1e-3, CurveOffsetCornerStyle.Sharp);

    var list = new List<Curve>();
    list.AddRange(curves);
    list.Add(x);

    Brep[] brep = Brep.CreateFromLoft(list, Point3d.Unset, Point3d.Unset, LoftType.Normal, false);

    A = brep;*/

    int branches = tree.BranchCount;

    DataTree<Curve> treeOut = new DataTree<Curve>();
    GH_Path path = new GH_Path();

    for( int i = 0; i < branches; ++i )
    {

      path = new GH_Path(i);

      //for( int j = 0; j < tree.Branch(i).Count; ++j )
      {

        treeOut.Add(tree.Branch(i)[0], path);
        treeOut.AddRange(tree.Branch(i)[0].Offset(Plane.WorldXY, distance, 1e-3, CurveOffsetCornerStyle.Sharp), path);

      }

    }

    A = treeOut;
# ---------- end offsettree ----------
lng = ListLength(List=prunebranches_2.prunedTree)
genemodifier_5 = GenePoolModifier(
    GeneList=gnlst,
    Count=lng,
    Domain=dom_5,
    Randomize=Button(),
    PercentageOfRandomization=graft([Slider(1, range=0..1), Slider(1, range=0..1), Slider(1, range=0..1), Slider(1, range=0..1)]))
sqrt = SquareRoot(Value=prunebranches_2.prunedTree)
loft_3 = Loft(Curves=offsettree.A, Options={Adjust=False, Closed=False, LoftEnds=0, LoftSimp=0, LoftType=0, Rebuild=10, Refit=0.01})
stack = StackTrees(Data0=R, Data1=r0, Data2=r1, Data3=r2, Reduce=True)
multiplication_3 = Multiplication(A=sqrt, B=stack)
division_3 = Division(A=prunebranches_2.prunedTree, B=multiplication_3)
multiplication_4 = Multiplication(A=division_3, B=0.5)
multiplication_5 = Multiplication(A=multiplication_3, B=0.5)
debrep_3 = DeconstructBrep(Brep=loft_3)  # -> simplify(Faces), Edges, Vertices
dom_6 = ConstructDomain(DomainStart=expr("-x", multiplication_4), DomainEnd=multiplication_4)
dom_7 = ConstructDomain(DomainStart=expr("-x", multiplication_5), DomainEnd=multiplication_5)
wires_2 = BrepWireframe(Brep=debrep_3.Faces, Density=-1)
pop2d = Populate2D(Region=parallelregionintersection, Count=lng, Seed=Slider(430, range=0..1000))
vec2pt_2 = Vector2Pt(PointA=pop2d, PointB=data, Unitize=False)  # -> Vector, Length
rev = Reverse(Vector=vec2pt_2.Vector)
load = Load(Point=pop2d, ForceVector=Y, Weighting=1)
amp = Amplitude(Vector=vec2pt_2.Vector, Amplitude=Slider(0.003, range=0..1))
load_2 = Load(Point=pop2d, ForceVector=amp, Weighting=1)
join_3 = JoinCurves(Curves=wires_2, Preserve=False)
rectangle_2 = Rectangle(Plane=pop2d, XSize=dom_7, YSize=dom_6, Radius=0)  # -> Rectangle, Length
path_mapper_5 = PathMapper(join_3, source="{A;B;C}", target="{A}")
cc = CurveCollide(Curves=rectangle_2.Rectangle, PassiveCurves=path_mapper_5, BasePlane=PlaneXY(0, 0, 0), Strength=1)  # -> Goal, Frames
solver = Solver(GoalObjects=[cc.Goal, load], Reset=Button(), Threshold=threshold, Tolerance=0.01, On=Toggle(False))  # -> I, V, O
clean = CleanTree(RemoveNulls=True, RemoveInvalid=True, RemoveEmpty=False, Tree=solver.O)
zombiesolver = ZombieSolver(GoalObjects=[cc.Goal, load_2], Threshold=number_slider_10, Tolerance=0.01, MaxIterations=number_slider_11)  # -> I, V, O; disabled
clean_2 = CleanTree(RemoveNulls=True, RemoveInvalid=True, RemoveEmpty=False, Tree=zombiesolver.O)  # disabled
c_script = CSharpScript(x=clean_2)  # -> A; inputs x: list; disabled
# ---------- c_script: C# ----------
    var listOut = new DataTree<Curve>();
    var list = new object[x.Count];
    Curve temp = null;
    
    for( int i = 0; i < x.Count; ++i )
    {
      
      list = ( object[] ) x[i];
      
      for( int j = 0; j < list.Length; ++j )
      {
        
        GH_Convert.ToCurve(list[j], ref temp, GH_Conversion.Both);
        
        listOut.Add(temp, new GH_Path(i));
      
      }
        
    }
    
    A = listOut;
# ---------- end c_script ----------
panel_3 = Panel(c_script)
crv_2 = Curve()
