# Grasshopper definition PhysicsPacking[0].gh (Grasshopper 1.0.7)
# plug-ins: SpacePartition, treesloth01, ClipperComponents, PTComponentLibrary, Kangaroo2 Components, Shortest Walk in Gh, SpaceSyntaxDesign_GH

# ---- group: InputData / Labels
text = Text(Tree({0;0}: ["Unidades sanitarias mujeres / privadas"], {0;1}: ["Unidades sanitarias hombres / privadas"], {0;2}: ["Cuarto de aseo "], {0;3}: ["Área de aseo de residuos"], {0;4}: ["Almacen General Insumos de Aseo "], {0;5}: ["Área de UPC-Rack"]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))

# ---- group: InputData / Areas
text_2 = Text(Tree({0;0}: ["3"], {0;1}: ["3"], {0;2}: ["6"], {0;3}: ["1"], {0;4}: ["5"], {0;5}: ["4"]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))

# ---- group: InputData / Topology
integer = Integer(Tree({0}: [7], {1}: [7], {2}: [3], {3}: [2, 11], {4}: [16, 21, 19], {5}: [19]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))

# ---- group: InputData / ID
text_3 = Text(Tree({0;0}: ["5"], {0;1}: ["5"], {0;2}: ["5"], {0;3}: ["5"], {0;4}: ["5"], {0;5}: ["5"]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))

# ---- group: InputData
number_slider = Slider(1, range=0..10)
path_mapper = PathMapper(text, source="{A;B}", target="{A}")
path_mapper_2 = PathMapper(text_2, source="{A;B}", target="{A}")
path_mapper_3 = PathMapper(integer, source="{A;B}", target="{A}")
path_mapper_4 = PathMapper(text_3, source="{A;B}", target="{A}")
prunebranches = CSharpScript(branches=path_mapper, howMany=number_slider)  # -> prunedTree, branchCounter; inputs branches: tree of String, howMany: Int32
# ---------- prunebranches: C# ----------
    var treeOut = new DataTree<string>();

    for( int i = 0; i < branches.BranchCount - howMany; ++i )
      treeOut.AddRange(branches.Branch(i), new GH_Path(i));

    prunedTree = treeOut;
    branchCounter = treeOut.BranchCount;
# ---------- end prunebranches ----------
prunebranches_2 = CSharpScript(branches=path_mapper_2, howMany=number_slider)  # -> prunedTree, branchCounter; inputs branches: tree of String, howMany: Int32; same code as prunebranches
mass_addition = MassAddition(Input=prunebranches_2.prunedTree)  # -> Result, PartialResults
number_slider_2 = Slider(4, range=0..10)
flatten_tree = FlattenTree(Tree=prunebranches_2.prunedTree, Path="{0}")
list_length = ListLength(List=flatten_tree)
integer_2 = Integer(list_length)

# ----
number_slider_3 = Slider(21, range=0..21)
number_slider_4 = Slider(5, range=0..5)
dom = ConstructDomain(DomainStart=expr("-x", number_slider_3), DomainEnd=number_slider_3)
dom_2 = ConstructDomain(DomainStart=expr("-x", number_slider_4), DomainEnd=number_slider_4)
bang = ExplodeTree(Data=prunebranches.prunedTree)  # -> Branch0, Branch1, Branch2, Branch3
bang_2 = ExplodeTree(Data=prunebranches_2.prunedTree)  # -> Branch0, Branch1, Branch2, Branch3
rectangle = Rectangle(Plane=PlaneXY(0, 0, 0), XSize=dom_2, YSize=dom, Radius=0)  # -> Rectangle, Length
num = Number(bang_2.Branch3)
dom_3 = ConstructDomain(DomainStart=0, DomainEnd=1)
number_slider_5 = Slider(4, range=0..10)
lng = ListLength(List=num)
genemodifier = GenePoolModifier(
    GeneList="VoroX",
    Count=number_slider_5,
    Domain=dom_3,
    Randomize=Button(),
    PercentageOfRandomization=Slider(1, range=0..1))
genemodifier_2 = GenePoolModifier(
    GeneList="VoroY",
    Count=number_slider_5,
    Domain=dom_3,
    Randomize=Button(),
    PercentageOfRandomization=Slider(1, range=0..1))
crv = Curve(rectangle.Rectangle)
division = Division(A=number_slider_3, B=Slider(3, range=0..50))
division_2 = Division(A=number_slider_4, B=Slider(0.5, range=0..10))
vorox = GenePool(Decimals=2, Maximum=1, Minimum=0, Value=[0.54, 0.7, 0.27, 0.41])
voroy = GenePool(Decimals=2, Maximum=1, Minimum=0, Value=[0.36, 0.05, 0.26, 0.63])
ptsrfdomlen = SurfaceDomainLength(Surface=crv, ULength=division_2, VLength=division)
pt = ConstructPoint(XCoordinate=vorox, YCoordinate=voroy, ZCoordinate=0)
dom_4 = ConstructDomain(DomainStart=expr("-x", Slider(9.861, range=0..21)), DomainEnd=Slider(10.74, range=0..21))
dom_5 = ConstructDomain(DomainStart=expr("-x", Slider(3.998, range=0..5)), DomainEnd=Slider(4.276, range=0..5))
ptborders = GenerateBorders(Grid=ptsrfdomlen, PanelShape=0)  # -> simplify(flatten(Border))
evalsrf = EvaluateSurface(Surface=reparameterize(rectangle.Rectangle), Point=pt)  # -> Point, Normal, UDirection, VDirection, Frame
voronoi = Voronoi(Points=evalsrf.Point, Boundary=rectangle.Rectangle, BruteForceOverride=False)
item = ListItem(List=ptborders, Index=0, Wrap=True)
area = Area(Geometry=item, UseTasks=False)  # -> Area, Centroid
dom_6 = ConstructDomain(DomainStart=0, DomainEnd=1)
multiplication = Multiplication(A=area.Area, B=0.6)
spacepartition = SpacePartition(VoronoiIn=voronoi, GridIn=ptborders, AreaIn=multiplication, Tolerance=Slider(0.001, range=0..0.001))
genemodifier_3 = GenePoolModifier(GeneList="VoroX0", Count=lng, Domain=dom_6, Randomize=Button(), PercentageOfRandomization=Slider(1, range=0..1))
genemodifier_4 = GenePoolModifier(GeneList="VoroY0", Count=lng, Domain=dom_6, Randomize=Button(), PercentageOfRandomization=Slider(1, range=0..1))
sortxy = SortPointsXY(Grid=flatten(spacepartition))
pararunion = ParallelRegionUnion(Curves=spacepartition)
voroy0 = GenePool(Decimals=2, Maximum=1, Minimum=0, Value=[0.85, 0.3, 0.3, 0.4, 0.19, 0])
vorox0 = GenePool(Decimals=2, Maximum=1, Minimum=0, Value=[0.1, 0.55, 0.2, 1, 0.58, 0.08])
missing = MissingGridCells(CulledGrid=sortxy, OriginalGrid=ptborders)
mgtree = MergeTreeMissing(CulledGrid=pararunion, MissingGridCells=missing)
genemodifier_5 = GenePoolModifier(
    GeneList="Colours",
    Count=Slider(3, range=0..10),
    Domain=Domain(0, 255),
    Randomize=Button(),
    PercentageOfRandomization=Slider(1, range=0..1))
pt_2 = ConstructPoint(XCoordinate=vorox0, YCoordinate=voroy0, ZCoordinate=0)
pararunion_2 = ParallelRegionUnion(Curves=mgtree)
colours = GenePool(Decimals=0, Maximum=255, Minimum=0, Value=[105.5423208, 124.4570353, 74.52132848])
construct_domain = ConstructDomain(DomainStart=Slider(0, range=0..100), DomainEnd=Slider(255, range=0..1000))
list_length_2 = ListLength(List=flatten(pararunion_2))

# ---- group: OriginalSilhouette
curve = Curve(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)

# ----
random = Random(Range=construct_domain, Number=list_length_2, Seed=colours, Integers=True)
pcen = PolygonCenter(Polyline=curve)  # -> CenterV, CenterE, CenterA
pcen_2 = PolygonCenter(Polyline=crv)  # -> CenterV, CenterE, CenterA
vec2pt = Vector2Pt(PointA=pcen.CenterE, PointB=pcen_2.CenterE, Unitize=False)  # -> Vector, Length
explode_tree = ExplodeTree(Data=random)  # -> Branch0, Branch1, Branch2
move = Move(Geometry=curve, Motion=vec2pt.Vector)  # -> Geometry, Transform
colour_rgb = ColourRGB(Alpha=Slider(255, range=0..255), Red=explode_tree.Branch0, Green=explode_tree.Branch1, Blue=explode_tree.Branch2)
genemodifier_6 = GenePoolModifier(GeneList="Colours0", Count=3, Domain=Domain(0, 255), Randomize=Button(), PercentageOfRandomization=Slider(1, range=0..1))
parallelregionintersection = ParallelRegionIntersection(CurvesA=move.Geometry, CurvesB=pararunion_2)
bang_3 = ExplodeTree(Data=parallelregionintersection)  # -> Branch0, Branch1, Branch2, Branch3
crv_2 = Curve(bang_3.Branch3)
area_2 = Area(Geometry=crv_2, UseTasks=False)  # -> Area, Centroid
rectangle_2 = Rectangle(Plane=area_2.Centroid, XSize=dom_5, YSize=dom_4, Radius=0)  # -> Rectangle, Length
ptsrfdomnum = SurfaceDomainNumber(Surface=rectangle_2.Rectangle, UNumber=Slider(3, range=0..10), VNumber=Slider(6, range=0..10))
ptborders_2 = GenerateBorders(Grid=ptsrfdomnum, PanelShape=Slider(0, range=0..3))  # -> simplify(flatten(Border))
evalsrf_2 = EvaluateSurface(Surface=reparameterize(rectangle_2.Rectangle), Point=pt_2)  # -> Point, Normal, UDirection, VDirection, Frame
voronoi_2 = Voronoi(Points=evalsrf_2.Point, Boundary=rectangle_2.Rectangle, BruteForceOverride=False)
item_2 = ListItem(List=ptborders_2, Index=0, Wrap=True)
area_3 = Area(Geometry=item_2, UseTasks=False)  # -> Area, Centroid
multiplication_2 = Multiplication(A=area_3.Area, B=0.6)
spacepartition_2 = SpacePartition(VoronoiIn=voronoi_2, GridIn=ptborders_2, AreaIn=multiplication_2, Tolerance=Slider(0.001, range=0..0.001))
sortxy_2 = SortPointsXY(Grid=flatten(spacepartition_2))
pararunion_3 = ParallelRegionUnion(Curves=spacepartition_2)
missing_2 = MissingGridCells(CulledGrid=sortxy_2, OriginalGrid=ptborders_2)
mgtree_2 = MergeTreeMissing(CulledGrid=pararunion_3, MissingGridCells=missing_2)
srf = Surface(simplify(parallelregionintersection))
custom_preview = CustomPreview(Geometry=srf, Material=graft(colour_rgb))
pararunion_4 = ParallelRegionUnion(Curves=mgtree_2)
colours0 = GenePool(Decimals=0, Maximum=255, Minimum=0, Value=[37.27674171, 0.4386627117, 92.2867755])
ma = MassAddition(Input=prunebranches_2.prunedTree)  # -> Result, PartialResults
construct_domain_2 = ConstructDomain(DomainStart=Slider(0, range=0..100), DomainEnd=Slider(255, range=0..1000))
list_length_3 = ListLength(List=flatten(pararunion_4))
ma_2 = MassAddition(Input=num)  # -> Result, PartialResults; disabled
number_slider_6 = Slider(1.4, range=0..10)  # disabled
number_slider_7 = Slider(0.24, range=0..1)  # disabled
random_2 = Random(Range=construct_domain_2, Number=list_length_3, Seed=colours0, Integers=True)
number_slider_8 = Slider(431, range=0..1000)
area_4 = Area(Geometry=parallelregionintersection, UseTasks=False)  # -> simplify(Area), Centroid
toggle = BooleanToggle(False)  # disabled
expression = Expression(x=area_4.Area, y=ma.Result, Expression="Abs( x - y ) * 0.1")
explode_tree_2 = ExplodeTree(Data=random_2)  # -> Branch0, Branch1, Branch2
crv_3 = Curve(crv_2)
skeleton = MedialAxisSkeleton(CurveIn=crv_3, NumberOfSamples=number_slider_8, Preserve=Toggle(False))
number_slider_9 = Slider(2, range=0..2)
colour_rgb_2 = ColourRGB(Alpha=Slider(255, range=0..255), Red=explode_tree_2.Branch0, Green=explode_tree_2.Branch1, Blue=explode_tree_2.Branch2)
disc = Discontinuity(Curve=skeleton, Level=2)  # -> Points, Parameters
parallelregionintersection_2 = ParallelRegionIntersection(CurvesA=crv_2, CurvesB=pararunion_4)
spctopo = SpaceTopology(Curves=flatten(parallelregionintersection_2))  # disabled
ma_3 = MassAddition(Input=flatten(expression))  # -> Result, PartialResults
shift = ShiftList(List=disc.Points, Shift=1, Wrap=False)
txt = Text(bang.Branch3)
panel = Panel(area_4.Area)
polyoffset = PolylineOffset(
    Polylines=skeleton,
    Distance=Slider(0.75, range=0..1),
    Plane=Plane(origin=(0, 0, 0), x=(0, 0, 0), y=(0, 0, 0)),
    Tolerance=0.01,
    ClosedFillet=number_slider_9,
    OpenFillet=number_slider_9,
    Miter=2)  # -> Contour, Holes
crv_4 = Curve(crv_2)
vec2pt_2 = Vector2Pt(PointA=disc.Points, PointB=shift, Unitize=False)  # -> Vector, Length
panel_2 = Panel(ma_3.Result)
skeleton_2 = MedialAxisSkeleton(CurveIn=crv_4, NumberOfSamples=Slider(431, range=0..1000), Preserve=Toggle(False))
shift_2 = ShiftList(List=vec2pt_2.Vector, Shift=1, Wrap=False)
vdis = VectorDisplay(Anchor=disc.Points, Vector=vec2pt_2.Vector)
galapagos = Galapagos(fitness=ma_3, gene=[voroy, vorox])
disc_2 = Discontinuity(Curve=skeleton_2, Level=3)  # -> Points, Parameters
disc_3 = Discontinuity(Curve=parallelregionintersection_2, Level=1)  # -> Points, Parameters
angle = Angle(VectorA=vec2pt_2.Vector, VectorB=shift_2)  # -> Angle, Reflex
reb = RebuildCurve(Curve=skeleton, Degree=Slider(1, range=0..1), Count=number_slider_8, Tangents=True)
lng_2 = ListLength(List=num)
shatter = Shatter(Curve=skeleton_2, Parameters=disc_2.Parameters)
shatter_2 = Shatter(Curve=parallelregionintersection_2, Parameters=disc_3.Parameters)
simplify = SimplifyCurve(Curve=reb)  # -> Curve, Simplified
null = NullItem(Item=angle.Angle)  # -> NullFlags, InvalidFlags, Description
number_slider_10 = Slider(1, range=0..1)  # disabled
pt_3 = Point(Point(0.2392978446, 4.35789389, 0))
pt_4 = Point(Point(0.2748303659, 12.96327204, 0))
number_slider_11 = Slider(0.75, range=0..1)  # disabled
flatten = FlattenTree(Tree=shatter_2, Path="{0}")
ln = Line(StartPoint=pt_3, EndPoint=pt_4)
concat = Concatenate(FragmentA=graft(txt), FragmentB=" ")  # -> simplify(Result)
galapagos_2 = Galapagos(fitness=ma_4, gene=[vorox0, voroy0])
cull = CullPattern(List=angle.Angle, CullPattern=invert(null.NullFlags))
expression_2 = Expression(x=cull, y=Slider(0.05, range=0..10), Expression="If( x < y, False, True )")
number_slider_12 = Slider(2, range=0..2)
shortwalk = ShortestWalk(Curves=shatter, WantedPath=ln)  # -> ShortestWalk, Succession, Direction, Length
shatter_3 = Shatter(Curve=skeleton, Parameters=disc.Parameters)
offset = OffsetCurve(Curve=shortwalk.ShortestWalk, Distance=Slider(1.5, range=0..10), Plane=PlaneXY(0, 0, 0), Corners=number_slider_10)  # disabled
ccx = CurveCurve(CurveA=shortwalk.ShortestWalk, CurveB=parallelregionintersection_2)  # -> Points, ParamsA, ParamsB
lng_3 = ListLength(List=ccx.Points)  # -> flatten(Length)
polyoffset_2 = PolylineOffset(
    Polylines=shortwalk.ShortestWalk,
    Distance=Slider(0.75, range=0..1),
    Plane=Plane(origin=(0, 0, 0), x=(0, 0, 0), y=(0, 0, 0)),
    Tolerance=0.01,
    ClosedFillet=number_slider_12,
    OpenFillet=number_slider_12,
    Miter=2)  # -> Contour, Holes
cull_2 = CullPattern(List=shatter_3, CullPattern=invert(expression_2))
end = EndPoints(Curve=offset)  # -> Start, End; disabled
end_2 = EndPoints(Curve=shortwalk.ShortestWalk)  # -> Start, End; disabled
lng_4 = ListLength(List=prunebranches_2.prunedTree)  # disabled
expression_3 = Expression(x=lng_3, Expression="If( x = 0, 10, 0 )")
panel_3 = Panel(num)
ln_2 = Line(StartPoint=[end.Start, end.End], EndPoint=[end_2.Start, end_2.End])  # disabled
rdiff = RegionDifference(CurvesA=parallelregionintersection_2, CurvesB=polyoffset_2.Contour)  # -> simplify(Result)
srf_2 = Surface(simplify(rdiff))
custom_preview_2 = CustomPreview(Geometry=srf_2, Material=graft(colour_rgb_2))
area_5 = Area(Geometry=rdiff, UseTasks=False)  # -> simplify(Area), Centroid
linetopo = LineTopology(PointTree=area_5.Centroid, Topology=spctopo)  # disabled
nodelinkgraph = GraphFromNodesLinks(Points=flatten(area_5.Centroid), Links=flatten(linetopo), Labels=bang.Branch3, Areas=num, TotalArea=ma_2.Result)  # -> Graph, GraphVertices, Attributes; disabled
forcedirecteddrawing = ForceDirectedDrawing(
    Graph=nodelinkgraph.Graph,
    Vertices=nodelinkgraph.GraphVertices,
    Attributes=nodelinkgraph.Attributes,
    AttractionStrength=number_slider_7,
    RepulsionStrength=number_slider_6,
    ConvergenceTolearnce=0.001,
    MaximumIterations=4000,
    Active=toggle)  # -> NewGraphVertices, IterationCount; disabled
diskograph = DiskoGraphDrawing(
    Plane=PlaneXY(21.92783355, 5.429748922, 0),
    Graph=nodelinkgraph.Graph,
    Vertices=nodelinkgraph.GraphVertices,
    Attributes=nodelinkgraph.Attributes,
    Thickness=1)  # disabled
flatten_2 = FlattenTree(Tree=area_5.Area, Path="{0}")
lng_5 = ListLength(List=flatten_2)
expression_4 = Expression(x=lng_5, y=lng_2, Expression="Abs( x - y )")
concat_2 = Concatenate(FragmentA=graft(concat), FragmentB=area_5.Area)  # -> simplify(Result)
expression_5 = Expression(x=flatten_2, y=num, Expression="Abs( x - y ) * 0.1")
tag = TextTag(Location=area_5.Centroid, Text=graft(concat_2))
ma_4 = MassAddition(Input=flatten([expression_5, expression_4, expression_3]))  # -> Result, PartialResults
panel_4 = Panel(area_5.Area)
panel_5 = Panel(ma_4.Result)
join = JoinCurves(Curves=flatten([ln_2, shortwalk.ShortestWalk, offset]), Preserve=False)  # disabled
number_slider_13 = Slider(20, range=-20..20)  # disabled
number_slider_14 = Slider(0.8, range=0..1)  # disabled
number_slider_15 = Slider(1.3, range=0..2)  # disabled
number_slider_16 = Slider(0.1, range=0..0.1)  # disabled
number_slider_17 = Slider(0.9, range=0..1)  # disabled
panel_6 = Panel("""EvaluateY
EvaluateY0
EvaluateY1
EvaluateY2""")  # disabled
panel_7 = Panel("""EvaluateX
EvaluateX0
EvaluateX1
EvaluateX2""")  # disabled
number_slider_18 = Slider(1, range=0..1)  # disabled
number_slider_19 = Slider(1, range=0..1)  # disabled
number_slider_20 = Slider(1, range=0..1)  # disabled
offsettree = CSharpScript(tree=pararunion_2, distance=number_slider_13)  # -> out, A; inputs tree: tree of Curve, distance: Double; disabled
# ---------- offsettree: C# ----------
    /*var curves = x.Offset(Plane.WorldXY, -10, 1e-3, CurveOffsetCornerStyle.Sharp);

    var list = new List<Curve>();
    list.AddRange(curves);
    list.Add(x);

    Brep[] brep = Brep.CreateFromLoft(list, Point3d.Unset, Point3d.Unset, LoftType.Normal, false);

    A = brep;*/

    int branches = tree.BranchCount;

    DataTree<Curve> treeOut = new DataTree<Curve>();
    GH_Path path = new GH_Path();

    for( int i = 0; i < branches; ++i )
    {

      path = new GH_Path(i);

      //for( int j = 0; j < tree.Branch(i).Count; ++j )
      {

        treeOut.Add(tree.Branch(i)[0], path);
        treeOut.AddRange(tree.Branch(i)[0].Offset(Plane.WorldXY, distance, 1e-3, CurveOffsetCornerStyle.Sharp), path);

      }

    }

    A = treeOut;
# ---------- end offsettree ----------
button = Button()  # disabled
button_2 = Button()  # disabled
button_3 = Button()  # disabled
txt_2 = Text(graft(panel_7))  # disabled
dom_7 = ConstructDomain(DomainStart=number_slider_16, DomainEnd=number_slider_17)  # disabled
txt_3 = Text(graft(panel_6))  # disabled
dom_8 = ConstructDomain(DomainStart=number_slider_14, DomainEnd=number_slider_15)  # -> graft(Domain); disabled
gnlst = GeneList(graft(["R", "R0", "R1", "R2"]))  # disabled
genemodifier_7 = GenePoolModifier(GeneList=txt_3, Count=lng_4, Domain=dom_7, Randomize=button_2, PercentageOfRandomization=number_slider_19)  # disabled
genemodifier_8 = GenePoolModifier(GeneList=txt_2, Count=lng_4, Domain=dom_7, Randomize=button, PercentageOfRandomization=number_slider_20)  # disabled
genemodifier_9 = GenePoolModifier(GeneList=gnlst, Count=lng_4, Domain=dom_8, Randomize=button_3, PercentageOfRandomization=number_slider_18)  # disabled
loft = Loft(Curves=offsettree.A, Options={Adjust=False, Closed=False, LoftEnds=0, LoftSimp=0, LoftType=0, Rebuild=10, Refit=0.01})  # disabled
evaluatex = GenePool(
    Decimals=2,
    Maximum=0.9,
    Minimum=0.1,
    Value=[0.5019107768, 0.6655651326, 0.6947049688, 0.3688574576, 0.8783050716, 0.6011884729, 0.2819833965, 0.2298568633, 0.6190275113, 0.1917496182])  # disabled
evaluatex0 = GenePool(Decimals=2, Maximum=0.9, Minimum=0.1, Value=[0.78, 0.32])  # disabled
evaluatex1 = GenePool(
    Decimals=2,
    Maximum=0.9,
    Minimum=0.1,
    Value=[0.5019107768, 0.6655651326, 0.6947049688, 0.3688574576, 0.8783050716, 0.6011884729, 0.2819833965])  # disabled
evaluatex2 = GenePool(
    Decimals=2,
    Maximum=0.9,
    Minimum=0.1,
    Value=[0.5019107768, 0.6655651326, 0.6947049688, 0.3688574576, 0.8783050716, 0.6011884729])  # disabled
evaluatey = GenePool(
    Decimals=2,
    Maximum=0.9,
    Minimum=0.1,
    Value=[0.7810926902, 0.3539967519, 0.7091909445, 0.5152241314, 0.400909019, 0.700125439, 0.290175397, 0.7351148385, 0.4055923854, 0.2136428316])  # disabled
evaluatey0 = GenePool(Decimals=2, Maximum=0.9, Minimum=0.1, Value=[0.7810926902, 0.3539967519])  # disabled
evaluatey1 = GenePool(
    Decimals=2,
    Maximum=0.9,
    Minimum=0.1,
    Value=[0.7810926902, 0.3539967519, 0.7091909445, 0.5152241314, 0.400909019, 0.700125439, 0.290175397])  # disabled
evaluatey2 = GenePool(
    Decimals=2,
    Maximum=0.9,
    Minimum=0.1,
    Value=[0.7810926902, 0.3539967519, 0.7091909445, 0.5152241314, 0.400909019, 0.700125439])  # disabled
R = GenePool(
    Decimals=2,
    Maximum=1.3,
    Minimum=0.8,
    Value=[1.105571903, 0.9428438475, 1.128052516, 1.142068132, 0.9767494449, 0.9921440147, 1.10408464, 1.155667976, 1.182088102, 0.923050601])  # disabled
r1 = GenePool(
    Decimals=2,
    Maximum=1.3,
    Minimum=0.8,
    Value=[1.105571903, 0.9428438475, 1.128052516, 1.142068132, 0.9767494449, 0.9921440147, 1.10408464])  # disabled
r0 = GenePool(Decimals=2, Maximum=1.3, Minimum=0.8, Value=[1.105571903, 0.9428438475])  # disabled
r2 = GenePool(
    Decimals=2,
    Maximum=1.3,
    Minimum=0.8,
    Value=[1.105571903, 0.9428438475, 1.128052516, 1.142068132, 0.9767494449, 0.9921440147])  # disabled
debrep = DeconstructBrep(Brep=loft)  # -> simplify(Faces), Edges, Vertices; disabled
sqrt = SquareRoot(Value=prunebranches_2.prunedTree)  # disabled
stack = StackTrees(Data0=evaluatex, Data1=evaluatex0, Data2=evaluatex1, Data3=evaluatex2, Reduce=True)  # disabled
stack_2 = StackTrees(Data0=evaluatey, Data1=evaluatey0, Data2=evaluatey1, Data3=evaluatey2, Reduce=True)  # disabled
wires = BrepWireframe(Brep=debrep.Faces, Density=-1)  # disabled
pt_5 = ConstructPoint(XCoordinate=stack, YCoordinate=stack_2, ZCoordinate=0)  # disabled
join_2 = JoinCurves(Curves=wires, Preserve=False)  # disabled
stack_3 = StackTrees(Data0=R, Data1=r0, Data2=r1, Data3=r2, Reduce=True)  # disabled
multiplication_3 = Multiplication(A=sqrt, B=stack_3)  # disabled
evalsrf_3 = EvaluateSurface(Surface=reparameterize(pararunion_2), Point=pt_5)  # -> simplify(Point), Normal, UDirection, VDirection, Frame; disabled
division_3 = Division(A=prunebranches_2.prunedTree, B=multiplication_3)  # disabled
path_mapper_5 = PathMapper(join_2, source="{A;B;C}", target="{A}")  # disabled
multiplication_4 = Multiplication(A=division_3, B=0.5)  # disabled
multiplication_5 = Multiplication(A=multiplication_3, B=0.5)  # disabled
srf_cp = SurfaceClosestPoint(Point=evalsrf_3.Point, Surface=pararunion_2)  # -> simplify(Point), UVPoint, Distance; disabled
pln = Plane(evalsrf_3.Frame)  # disabled
dom_9 = ConstructDomain(DomainStart=expr("-x", multiplication_4), DomainEnd=multiplication_4)  # disabled
dom_10 = ConstructDomain(DomainStart=expr("-x", multiplication_5), DomainEnd=multiplication_5)  # disabled
pt_6 = Point(srf_cp.Point)  # disabled
rectangle_3 = Rectangle(Plane=pt_6, XSize=dom_10, YSize=dom_9, Radius=0)  # -> Rectangle, Length; disabled
pt_7 = Point(Point(18.80242174, -2.224422874, 0))  # disabled
pt_8 = Point(Point(9.870904068, -11.24031262, 0))  # disabled
pt_9 = Point(Point(15.05201052, -11.30289059, 0))  # disabled
pt_10 = Point(Point(-17.17137498, 23.58812154, 0))  # disabled
number_slider_21 = Slider(3, range=0..10)  # disabled
data = Data(graft([pt_7, pt_8, pt_9, pt_10]))  # disabled
vec2pt_3 = Vector2Pt(PointA=pt_6, PointB=data, Unitize=False)  # -> unitize(Vector), Length; disabled
number_slider_22 = Slider(0.003, range=0..1)  # disabled
number_slider_23 = Slider(0.002, range=0..1)  # disabled
Y = UnitY(Factor=expr("-x", number_slider_23))  # disabled
amp = Amplitude(Vector=vec2pt_3.Vector, Amplitude=number_slider_22)  # disabled
grab = Grab(On=True, Strength=1, Range=3)  # disabled
load = Load(Point=pt_6, ForceVector=Y, Weighting=1)  # disabled
load_2 = Load(Point=pt_6, ForceVector=amp, Weighting=1)  # disabled
cc = CurveCollide(Curves=rectangle_3.Rectangle, Frames=pln, PassiveCurves=path_mapper_5, BasePlane=PlaneXY(0, 0, 0), Strength=1)  # -> Goal, Frames; disabled
toggle_2 = BooleanToggle(False)  # disabled
button_4 = Button()  # disabled
number_slider_24 = Slider(0.1, range=0..0.1)  # disabled
zombiesolver = ZombieSolver(GoalObjects=cc.Goal, Threshold=number_slider_24, Tolerance=0.01, MaxIterations=50000)  # -> I, V, O; disabled
solver = Solver(GoalObjects=[cc.Goal, load_2, grab], Reset=button_4, Threshold=1e-15, Tolerance=0.01, On=toggle_2)  # -> I, V, O; disabled
clean = CleanTree(RemoveNulls=True, RemoveInvalid=True, RemoveEmpty=False, Tree=zombiesolver.O)  # disabled
clean_2 = CleanTree(RemoveNulls=True, RemoveInvalid=True, RemoveEmpty=False, Tree=solver.O)  # disabled
c_script = CSharpScript(x=clean)  # -> A; inputs x: list; disabled
# ---------- c_script: C# ----------
    var listOut = new DataTree<Curve>();
    var list = new object[x.Count];
    Curve temp = null;
    
    for( int i = 0; i < x.Count; ++i )
    {
      
      list = ( object[] ) x[i];
      
      for( int j = 0; j < list.Length; ++j )
      {
        
        GH_Convert.ToCurve(list[j], ref temp, GH_Conversion.Both);
        
        listOut.Add(temp, new GH_Path(i));
      
      }
        
    }
    
    A = listOut;
# ---------- end c_script ----------
