# Grasshopper definition Quelea.gh (Grasshopper 1.0.7)
# plug-ins: Agent, Rabbit

particle = ConstructParticle(
    MinimumInitialVelocity=Vector(-0.1, -0.1, -0.1),
    MaximumInitialVelocity=Vector(0.1, 0.1, 0.1),
    Acceleration=Vector(0, 0, 0),
    Lifespan=Slider(100, range=0..100),
    Mass=1,
    BodySize=1,
    HistoryLength=1)
X = UnitX(Factor=Slider(1, range=0..1))
initialvel = InitialVelocity(Apply=True, Particle=particle, InitialDirection=X)
agent = ConstructAgent(Particle=particle, MaxSpeed=0.5, MaxForce=0.1, VisionRadius=5, VisionAngle=360)
crv = Curve(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)
end = EndPoints(Curve=crv)  # -> Start, End
number_slider = Slider(10, range=0..10)
followpath = FollowPathForce(
    Apply=True,
    Agent=agent,
    WeightMultiplier=Slider(1, range=0..1),
    Curve=crv,
    PathRadius=5,
    PredictionDistance=5,
    PathTargetDistance=5)
pt = Point(end.End)
pt_2 = Point(end.Start)
agent_2 = ConstructAgent(Particle=particle, MaxSpeed=0.5, MaxForce=initialvel, VisionRadius=5, VisionAngle=360)
panel = Panel(followpath)
ptemit = PointEmitter(ContinuousFlow=True, CreationRate=1, NumberOfQuelea=number_slider, Point=pt)
ptemit_2 = PointEmitter(ContinuousFlow=True, CreationRate=1, NumberOfQuelea=number_slider, Point=pt_2)
crv_2 = Curve(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)
el_cell = ElementaryCell()
srfenv = SurfaceEnvironment(Surface=crv_2)
timer = Timer(TimerInterval=1, Target=[system, engine])  # disabled
agent_3 = ConstructAgent(MaxSpeed=0.5, MaxForce=0.1, VisionRadius=5, VisionAngle=360)
system = System(Quelea=agent_2, Emitters=[ptemit_2, ptemit], Environment=srfenv)
engine = Engine(Reset=Button(), System=system)
desystem = DeconstructSystem(System=system)  # -> Quelea, QueleaNetwork
dequelea = DeconstructQuelea(Quelea=desystem.Quelea)  # -> Position, Velocity, Acceleration, Lifespan, ReferencePosition
