# Grasshopper definition ResearchAndDevelopment.gh (Grasshopper 1.0.7)
# plug-ins: SpacePartition, Human, PTComponentLibrary

number_slider = Slider(10, range=0..10)
point = Point(Point(-6.860263318, -5.139654171, 0))
construct_domain = ConstructDomain(DomainStart=expr("-x", number_slider), DomainEnd=number_slider)
construct_domain_2 = ConstructDomain(DomainStart=expr("-x", number_slider), DomainEnd=number_slider)
frgb = ColourRGBF(Alpha=1, Red=Slider(1, range=0..1), Green=Slider(0, range=0..1), Blue=Slider(0, range=0..1))
number_slider_2 = Slider(0.372, range=0..1)
frgb_2 = ColourRGBF(Alpha=1, Red=Slider(0, range=0..1), Green=Slider(0, range=0..1), Blue=Slider(1, range=0..1))
number_slider_3 = Slider(0.187, range=0..1)
dots = DotDisplay(Point=point, Colour=frgb_2, Size=number_slider_2)
rectangle = Rectangle(Plane=PlaneXY(0, 0, 0), XSize=construct_domain_2, YSize=construct_domain, Radius=0)  # -> Rectangle, Length
point_2 = Point(Point(-7.955923358, -8.091288463, 0))
number_slider_4 = Slider(50, range=0..100)
frgb_3 = ColourRGBF(Alpha=1, Red=Slider(1, range=0..1), Green=Slider(1, range=0..1), Blue=Slider(1, range=0..1))
divide_surface = DivideSurface(Surface=rectangle.Rectangle, UCount=number_slider, VCount=number_slider)  # -> simplify(Points), Normals, Parameters
number_slider_5 = Slider(1, range=0..1)
number_slider_6 = Slider(1, range=0..1)
random_attraction = RandomAttraction(Grid=divide_surface.Points, Magnitude=Slider(0, range=0..1))  # -> Grid, Weights
pt = Point(random_attraction.Grid)
closestptgrid = ClosestPointInGrid(Grid=pt, Point=point)  # -> ClosestPointInGrid, BranchOfGrid, LeafOfGrid
closestptgrid_2 = ClosestPointInGrid(Grid=pt, Point=point_2)  # -> ClosestPointInGrid, BranchOfGrid, LeafOfGrid
dots_2 = DotDisplay(Point=closestptgrid.ClosestPointInGrid, Colour=frgb, Size=number_slider_2)
shortdiagonal = ShortestPathDiagonals(
    Grid=pt,
    StartPointBranch=closestptgrid_2.BranchOfGrid,
    StartPointLeaf=closestptgrid_2.LeafOfGrid,
    EndPointBranch=closestptgrid.BranchOfGrid,
    EndPointLeaf=closestptgrid.LeafOfGrid)
shortorto = ShortestPathOrthogonal(
    Grid=pt,
    StartPointBranch=closestptgrid_2.BranchOfGrid,
    StartPointLeaf=closestptgrid_2.LeafOfGrid,
    EndPointBranch=closestptgrid.BranchOfGrid,
    EndPointLeaf=closestptgrid.LeafOfGrid)
closestpointingrid = CSharpScript(grid=simplify(pt), point=point_2)  # -> PointInGrid, Branch, Leaf; inputs grid: tree of Point3d, point: Point3d
# ---------- closestpointingrid: C# ----------
    int branchCount = grid.BranchCount;

    double minDistance = double.MaxValue;

    CustomPair cp;

    GH_Path path = new GH_Path();

    for( int i = 0; i < branchCount; ++i )
    {

      for( int j = 0; j < grid.Branch(i).Count; ++j )
      {

        double localDistance = point.DistanceTo(grid.Branch(i)[j]);
        cp.Key = localDistance;
        cp.Path = new GH_Path(i, j);
        minDistance = Math.Min(minDistance, localDistance);

        if( ( cp.Key - minDistance ) < 0.001 )
        {

          path = cp.Path;

        }

      }

    }

    int branch = path.Indices[0], leaf = path.Indices[1];
    
    PointInGrid = grid.Branch(branch)[leaf];

    Branch = branch;
    
    Leaf = leaf;
# ---------- closestpointingrid: C# additional code ----------
  struct CustomPair
  {

    public double Key;
    public GH_Path Path;

  }
# ---------- end closestpointingrid ----------
closestpointingrid_2 = CSharpScript(grid=pt, point=point)  # -> PointInGrid, Branch, Leaf; inputs grid: tree of Point3d, point: Point3d; same code as closestpointingrid
ln = Line(StartPoint=point, EndPoint=closestptgrid.ClosestPointInGrid)
dots_3 = DotDisplay(Point=pt, Colour=frgb_3, Size=Slider(0.137, range=0..1))
frgb_4 = ColourRGBF(Alpha=1, Red=0, Green=Slider(1, range=0..1), Blue=0)
pathfindingsquare = CSharpScript(
    grid=pt,
    idx=closestpointingrid.Branch,
    idj=closestpointingrid.Leaf,
    fidx=closestpointingrid_2.Branch,
    fjdx=closestpointingrid_2.Leaf)  # -> Shortest; inputs grid: tree of Point3d, idx: Int32, idj: Int32, fidx: Int32, fjdx: Int32
# ---------- pathfindingsquare: C# ----------
    int branchCount = grid.BranchCount;
    int maxTreeBranchCount = grid.Branch(branchCount - 1).Count;

    int x = idx % branchCount, y = idj % maxTreeBranchCount;

    Point3d tempPoint = new Point3d();
    Point3d point = grid.Branch(x)[y];
    Point3d finalPoint = grid.Branch(fidx % branchCount)[fjdx % maxTreeBranchCount];
    List<Point3d> tempList = new List<Point3d>();
    double minDistance = double.MaxValue, minDistanceOne = double.MaxValue;

    tempList.Add(point);

    CustomPair customPair, customPairOne;

    GH_Path path = new GH_Path();

    //while( tempPoint.CompareTo(finalPoint) != 0 )
    for( int i = 0; i < 10; ++i )
    {

      for( int xx = -1; xx < 2; ++xx )
      {

        int dX = x + xx, dY = y + xx;

        if( dX >= 0 && dX < branchCount && dY >= 0 && dY < maxTreeBranchCount )
        {

          double localDistance = finalPoint.DistanceTo(grid.Branch(dX)[y]);

          customPair.Key = localDistance;
          customPair.Value = grid.Branch(dX)[y];
          customPair.Path = new GH_Path(dX, y);

          minDistance = Math.Min(minDistance, localDistance);

          double localDistanceOne = finalPoint.DistanceTo(grid.Branch(x)[dY]);

          customPairOne.Key = localDistanceOne;
          customPairOne.Value = grid.Branch(x)[dY];
          customPairOne.Path = new GH_Path(x, dY);

          minDistanceOne = Math.Min(minDistanceOne, localDistanceOne);

          if( customPair.Key < customPairOne.Key )
          {

            if( ( customPair.Key - minDistance ) < 0.01 )
            {

              tempPoint = customPair.Value;
              path = customPair.Path;

            }

          }

          else
          {

            if( ( customPairOne.Key - minDistanceOne ) < 0.01 )
            {

              tempPoint = customPairOne.Value;
              path = customPairOne.Path;

            }

          }

        }

      }

      x = path.Indices[0];
      y = path.Indices[1];

      tempList.Add(tempPoint);

    }

    //Print("Path: " + path.ToString());

    Shortest = new Polyline(tempList);
# ---------- pathfindingsquare: C# additional code ----------
  struct CustomPair
  {

    public double Key;
    public Point3d Value;
    public GH_Path Path;

  }
# ---------- end pathfindingsquare ----------
pathfindingdiagonal = CSharpScript(
    grid=pt,
    idx=closestpointingrid.Branch,
    idj=closestpointingrid.Leaf,
    fidx=closestpointingrid_2.Branch,
    fjdx=closestpointingrid_2.Leaf)  # -> Shortest; inputs grid: tree of Point3d, idx: Int32, idj: Int32, fidx: Int32, fjdx: Int32
# ---------- pathfindingdiagonal: C# ----------
    int branchCount = grid.BranchCount;
    int maxTreeBranchCount = grid.Branch(branchCount - 1).Count;

    int x = idx % branchCount, y = idj % maxTreeBranchCount;

    Point3d tempPoint = new Point3d();
    Point3d point = grid.Branch(x)[y];
    Point3d finalPoint = grid.Branch(fidx % branchCount)[fjdx % maxTreeBranchCount];
    List<Point3d> tempList = new List<Point3d>();
    double minDistance = double.MaxValue;
    //var keyValuePair = new KeyValuePair<double, Point3d>();

    tempList.Add(point);

    CustomPair customPair;

    GH_Path path = new GH_Path();

    while( tempPoint.CompareTo(finalPoint) != 0 )
    {

      for( int xx = x - 1; xx < x + 2; ++xx )
        //System.Threading.Tasks.Parallel.For(x - 1, x + 2, xx =>
      {

        for( int yy = y - 1; yy < y + 2; ++yy )
          //System.Threading.Tasks.Parallel.For(y - 1, y + 2, yy =>
        {

          if( xx >= 0 && xx < branchCount && yy >= 0 && yy < maxTreeBranchCount )
          {

            double localDistance = finalPoint.DistanceTo(grid.Branch(xx)[yy]);

            customPair.Key = localDistance;
            customPair.Value = grid.Branch(xx)[yy];
            customPair.Path = new GH_Path(xx, yy);

            minDistance = Math.Min(minDistance, localDistance);

            if( ( customPair.Key - minDistance ) < 0.01 )
            {

              tempPoint = customPair.Value;
              path = customPair.Path;

            }

          }

        }

      }

      x = path.Indices[0];
      y = path.Indices[1];

      tempList.Add(tempPoint);

    }

    Shortest = new Polyline(tempList);
# ---------- pathfindingdiagonal: C# additional code ----------
  struct CustomPair
  {

    public double Key;
    public Point3d Value;
    public GH_Path Path;

  }
# ---------- end pathfindingdiagonal ----------
number_slider_7 = Slider(3, range=0..10)  # disabled
number_slider_8 = Slider(1, range=0..10)  # disabled
number_slider_9 = Slider(7, range=0..10)  # disabled
number_slider_10 = Slider(0, range=0..10)  # disabled
previewlw = CustomPreviewLineweights(Geometry=ln, Shader=frgb_4, Thickness=Slider(10, range=0..10), Absolute=False)
cellulate = Cellulate(Grid=pt)  # -> Wires, Cells, Meshes
number_slider_11 = Slider(1, range=0..1)  # disabled
number_slider_12 = Slider(1, range=0..1)  # disabled
len = Length(Curve=pathfindingdiagonal)
len_2 = Length(Curve=pathfindingsquare)
pathfinding = CSharpScript(
    grid=pt,
    idx=Slider(0, range=0..100),
    idj=Slider(8, range=0..100),
    fidx=Slider(97, range=0..100),
    fjdx=Slider(100, range=0..100))  # -> out, A, B, C, D; inputs grid: tree of Point3d, idx: Int32, idj: Int32, fidx: Int32, fjdx: Int32; disabled
# ---------- pathfinding: C# ----------
    int branchCount = grid.BranchCount;
    int maxTreeBranchCount = grid.Branch(branchCount - 1).Count;

    int x = idx % branchCount, y = idj % maxTreeBranchCount;

    Point3d tempPoint = new Point3d();
    Point3d point = grid.Branch(x)[y];
    Point3d finalPoint = grid.Branch(fidx % branchCount)[fjdx % maxTreeBranchCount];
    List<Point3d> tempList = new List<Point3d>();
    double minDistance = double.MaxValue;
    //var keyValuePair = new KeyValuePair<double, Point3d>();

    tempList.Add(point);

    CustomPair customPair;

    GH_Path path = new GH_Path();

    while( tempPoint.CompareTo(finalPoint) != 0 )
    {

      for( int xx = x - 1; xx < x + 2; ++xx )
        //System.Threading.Tasks.Parallel.For(x - 1, x + 2, xx =>
      {

        for( int yy = y - 1; yy < y + 2; ++yy )
          //System.Threading.Tasks.Parallel.For(y - 1, y + 2, yy =>
        {

          if( xx >= 0 && xx < branchCount && yy >= 0 && yy < maxTreeBranchCount )
          {

            double localDistance = finalPoint.DistanceTo(grid.Branch(xx)[yy]);

            customPair.Key = localDistance;
            customPair.Value = grid.Branch(xx)[yy];
            customPair.Path = new GH_Path(xx, yy);

            minDistance = Math.Min(minDistance, localDistance);

            if( ( customPair.Key - minDistance ) < 0.01 )
            {

              tempPoint = customPair.Value;
              path = customPair.Path;

            }

          }

        }

      }

      x = path.Indices[0];
      y = path.Indices[1];

      tempList.Add(tempPoint);

    }

    Print("Path: " + path.ToString());

    A = point;
    B = grid.Branch(x)[y];
    C = finalPoint;
    D = tempList;
# ---------- pathfinding: C# additional code ----------
  struct CustomPair
  {

    public double Key;
    public Point3d Value;
    public GH_Path Path;

  }
# ---------- end pathfinding ----------
c_script = CSharpScript(grid=divide_surface.Points, idx=number_slider_7, idj=number_slider_8, fidx=number_slider_10, fjdx=number_slider_9)  # -> out, A, B, C, D; inputs grid: tree of Point3d, idx: Int32, idj: Int32, fidx: Int32, fjdx: Int32; disabled
# ---------- c_script: C# ----------
    int branchCount = grid.BranchCount;
    int maxTreeBranchCount = grid.Branch(branchCount - 1).Count;

    int x = idx % branchCount, y = idj % maxTreeBranchCount;

    Point3d point = grid.Branch(x)[y];
    Point3d finalPoint = grid.Branch(fidx % branchCount)[fjdx % maxTreeBranchCount];
    List<Point3d> tempList = new List<Point3d>();

    for( int xx = x - 1; xx < x + 2; ++xx )
    {

      for( int yy = y - 1; yy < y + 2; ++yy )
      {

        if( xx >= 0 && xx < branchCount - 1 && yy >= 0 && yy < maxTreeBranchCount - 1 )
        {

          tempList.Add( grid.Branch(xx)[yy] );

        }

      }

    }
    
    point = Rhino.Collections.Point3dList.ClosestPointInList(tempList, finalPoint);
    
    A = point;
    B = grid.Branch(x)[y];
    C = finalPoint;
    D = tempList;
# ---------- c_script: C# additional code ----------
  void NearestNeighbor(out List<Point3d> outList, DataTree<Point3d> grid, Point3d finalPoint, int x, int y, int branchCount, int maxTreeBranchCount)
  {

    outList = new List<Point3d>();

    for( int xx = x - 1; xx < x + 1; ++xx )
    {

      for( int yy = y - 1; yy < y + 1; ++yy )
      {

        if( xx >= 0 && xx < branchCount - 1 && yy >= 0 && yy < maxTreeBranchCount - 1 )
        {


          if( grid.Branch(xx)[yy].DistanceTo(finalPoint) < grid.Branch(xx + 1)[yy + 1].DistanceTo(finalPoint) )
          {

            outList.Add(grid.Branch(xx)[yy]);

          }

          else
          {

            outList.Add(grid.Branch(xx + 1)[yy + 1]);

          }

        }

      }

    }

    //outList = tempList;

  }
# ---------- end c_script ----------
polyline = PolyLine(Vertices=pathfinding.D, Closed=False)
panel = Panel(len)
colour_rgb_f = ColourRGBF(Alpha=1, Red=Slider(1, range=0..1), Green=0, Blue=0)
panel_2 = Panel(len_2)
number_slider_13 = Slider(0.49, range=0..1)  # disabled
number_slider_14 = Slider(0.27, range=0..1)  # disabled
colour_rgb_f_2 = ColourRGBF(Alpha=1, Red=number_slider_11, Green=0, Blue=0)  # disabled
colour_rgb_f_3 = ColourRGBF(Alpha=1, Red=0, Green=Slider(1, range=0..1), Blue=0)
number_slider_15 = Slider(0.43, range=0..1)  # disabled
colour_rgb_f_4 = ColourRGBF(Alpha=1, Red=0, Green=number_slider_12, Blue=0)  # disabled
length = Length(Curve=polyline)
dot_display = DotDisplay(Point=pathfinding.D, Colour=colour_rgb_f, Size=Slider(0.17, range=0..1))
dot_display_2 = DotDisplay(Point=c_script.D, Colour=colour_rgb_f_2, Size=number_slider_14)  # disabled
number_slider_16 = Slider(1, range=0..1)  # disabled
dot_display_3 = DotDisplay(Point=c_script.B, Colour=RGB(0, 0, 0), Size=number_slider_13)  # disabled
dot_display_4 = DotDisplay(Point=pathfinding.C, Colour=colour_rgb_f_3, Size=Slider(0.34, range=0..1))
panel_3 = Panel(length)
dot_display_5 = DotDisplay(Point=c_script.C, Colour=colour_rgb_f_4, Size=number_slider_15)  # disabled
colour_rgb_f_5 = ColourRGBF(Alpha=1, Red=0, Green=0, Blue=Slider(1, range=0..1))
number_slider_17 = Slider(0.32, range=0..1)  # disabled
colour_rgb_f_6 = ColourRGBF(Alpha=1, Red=0, Green=0, Blue=number_slider_16)  # disabled
dot_display_6 = DotDisplay(Point=pathfinding.A, Colour=colour_rgb_f_5, Size=Slider(0.32, range=0..1))
dot_display_7 = DotDisplay(Point=c_script.A, Colour=colour_rgb_f_6, Size=number_slider_17)  # disabled
