# Grasshopper definition ResearchAndDevelopment[1].gh (Grasshopper 1.0.7)
# plug-ins: SpacePartition, Human, PTComponentLibrary

number_slider = Slider(5, range=0..10)
construct_domain = ConstructDomain(DomainStart=expr("-x", number_slider), DomainEnd=number_slider)
construct_domain_2 = ConstructDomain(DomainStart=expr("-x", number_slider), DomainEnd=number_slider)
frgb = ColourRGBF(Alpha=1, Red=Slider(1, range=0..1), Green=Slider(0, range=0..1), Blue=Slider(0, range=0..1))
number_slider_2 = Slider(0.187, range=0..1)
frgb_2 = ColourRGBF(Alpha=1, Red=Slider(0, range=0..1), Green=Slider(0, range=0..1), Blue=Slider(1, range=0..1))
number_slider_3 = Slider(0.17, range=0..1)
number_slider_4 = Slider(1, range=0..1)  # disabled
number_slider_5 = Slider(1, range=0..1)  # disabled
number_slider_6 = Slider(1, range=0..1)  # disabled
rectangle = Rectangle(Plane=PlaneXY(0, 0, 0), XSize=construct_domain, YSize=construct_domain_2, Radius=0)  # -> Rectangle, Length
number_slider_7 = Slider(50, range=0..100)
frgb_3 = ColourRGBF(Alpha=1, Red=number_slider_4, Green=number_slider_5, Blue=number_slider_6)  # disabled
number_slider_8 = Slider(15, range=0..100)
number_slider_9 = Slider(0.137, range=0..1)  # disabled
divide_surface = DivideSurface(Surface=rectangle.Rectangle, UCount=number_slider, VCount=number_slider)  # -> simplify(Points), Normals, Parameters
number_slider_10 = Slider(1, range=0..1)  # disabled
number_slider_11 = Slider(1, range=0..1)  # disabled
number_slider_12 = Slider(1, range=0..1)  # disabled
random_attraction = RandomAttraction(Grid=divide_surface.Points, Magnitude=Slider(0, range=0..1))  # -> Grid, Weights
pt = Point(random_attraction.Grid)
dots = DotDisplay(Point=pt, Colour=frgb_3, Size=number_slider_9)  # disabled
number_slider_13 = Slider(8, range=0..100)  # disabled
number_slider_14 = Slider(0, range=0..100)  # disabled
frgb_4 = ColourRGBF(Alpha=1, Red=0, Green=number_slider_11, Blue=0)  # disabled
number_slider_15 = Slider(100, range=0..100)  # disabled
number_slider_16 = Slider(97, range=0..100)  # disabled
number_slider_17 = Slider(3, range=0..10)  # disabled
number_slider_18 = Slider(1, range=0..10)  # disabled
number_slider_19 = Slider(7, range=0..10)  # disabled
number_slider_20 = Slider(0, range=0..10)  # disabled
number_slider_21 = Slider(10, range=0..10)  # disabled
number_slider_22 = Slider(1, range=0..1)  # disabled
cellulate = Cellulate(Grid=pt)  # -> Wires, Cells, Meshes
number_slider_23 = Slider(1, range=0..1)  # disabled
number_slider_24 = Slider(1, range=0..1)  # disabled
number_slider_25 = Slider(1, range=0..1)  # disabled
pathfinding = CSharpScript(grid=pt, idx=number_slider_14, idj=number_slider_13, fidx=number_slider_16, fjdx=number_slider_15)  # -> out, A, B, C, D; inputs grid: tree of Point3d, idx: Int32, idj: Int32, fidx: Int32, fjdx: Int32; disabled
# ---------- pathfinding: C# ----------
    int branchCount = grid.BranchCount;
    int maxTreeBranchCount = grid.Branch(branchCount - 1).Count;

    int x = idx % branchCount, y = idj % maxTreeBranchCount;

    Point3d tempPoint = new Point3d();
    Point3d point = grid.Branch(x)[y];
    Point3d finalPoint = grid.Branch(fidx % branchCount)[fjdx % maxTreeBranchCount];
    List<Point3d> tempList = new List<Point3d>();
    double minDistance = double.MaxValue;
    //var keyValuePair = new KeyValuePair<double, Point3d>();

    tempList.Add(point);

    CustomPair customPair;

    GH_Path path = new GH_Path();

    while( tempPoint.CompareTo(finalPoint) != 0 )
    {

      for( int xx = x - 1; xx < x + 2; ++xx )
        //System.Threading.Tasks.Parallel.For(x - 1, x + 2, xx =>
      {

        for( int yy = y - 1; yy < y + 2; ++yy )
          //System.Threading.Tasks.Parallel.For(y - 1, y + 2, yy =>
        {

          if( xx >= 0 && xx < branchCount && yy >= 0 && yy < maxTreeBranchCount )
          {

            double localDistance = finalPoint.DistanceTo(grid.Branch(xx)[yy]);

            customPair.Key = localDistance;
            customPair.Value = grid.Branch(xx)[yy];
            customPair.Path = new GH_Path(xx, yy);

            minDistance = Math.Min(minDistance, localDistance);

            if( ( customPair.Key - minDistance ) < 0.01 )
            {

              tempPoint = customPair.Value;
              path = customPair.Path;

            }

          }

        }

      }

      x = path.Indices[0];
      y = path.Indices[1];

      tempList.Add(tempPoint);

    }

    Print("Path: " + path.ToString());

    A = point;
    B = grid.Branch(x)[y];
    C = finalPoint;
    D = tempList;
# ---------- pathfinding: C# additional code ----------
  struct CustomPair
  {

    public double Key;
    public Point3d Value;
    public GH_Path Path;

  }
# ---------- end pathfinding ----------
c_script = CSharpScript(grid=divide_surface.Points, idx=number_slider_17, idj=number_slider_18, fidx=number_slider_20, fjdx=number_slider_19)  # -> out, A, B, C, D; inputs grid: tree of Point3d, idx: Int32, idj: Int32, fidx: Int32, fjdx: Int32; disabled
# ---------- c_script: C# ----------
    int branchCount = grid.BranchCount;
    int maxTreeBranchCount = grid.Branch(branchCount - 1).Count;

    int x = idx % branchCount, y = idj % maxTreeBranchCount;

    Point3d point = grid.Branch(x)[y];
    Point3d finalPoint = grid.Branch(fidx % branchCount)[fjdx % maxTreeBranchCount];
    List<Point3d> tempList = new List<Point3d>();

    for( int xx = x - 1; xx < x + 2; ++xx )
    {

      for( int yy = y - 1; yy < y + 2; ++yy )
      {

        if( xx >= 0 && xx < branchCount - 1 && yy >= 0 && yy < maxTreeBranchCount - 1 )
        {

          tempList.Add( grid.Branch(xx)[yy] );

        }

      }

    }
    
    point = Rhino.Collections.Point3dList.ClosestPointInList(tempList, finalPoint);
    
    A = point;
    B = grid.Branch(x)[y];
    C = finalPoint;
    D = tempList;
# ---------- c_script: C# additional code ----------
  void NearestNeighbor(out List<Point3d> outList, DataTree<Point3d> grid, Point3d finalPoint, int x, int y, int branchCount, int maxTreeBranchCount)
  {

    outList = new List<Point3d>();

    for( int xx = x - 1; xx < x + 1; ++xx )
    {

      for( int yy = y - 1; yy < y + 1; ++yy )
      {

        if( xx >= 0 && xx < branchCount - 1 && yy >= 0 && yy < maxTreeBranchCount - 1 )
        {


          if( grid.Branch(xx)[yy].DistanceTo(finalPoint) < grid.Branch(xx + 1)[yy + 1].DistanceTo(finalPoint) )
          {

            outList.Add(grid.Branch(xx)[yy]);

          }

          else
          {

            outList.Add(grid.Branch(xx + 1)[yy + 1]);

          }

        }

      }

    }

    //outList = tempList;

  }
# ---------- end c_script ----------
polyline = PolyLine(Vertices=pathfinding.D, Closed=False)  # disabled
number_slider_26 = Slider(0.17, range=0..1)  # disabled
colour_rgb_f = ColourRGBF(Alpha=1, Red=number_slider_22, Green=0, Blue=0)  # disabled
number_slider_27 = Slider(0.49, range=0..1)  # disabled
number_slider_28 = Slider(0.27, range=0..1)  # disabled
number_slider_29 = Slider(0.34, range=0..1)  # disabled
colour_rgb_f_2 = ColourRGBF(Alpha=1, Red=number_slider_23, Green=0, Blue=0)  # disabled
colour_rgb_f_3 = ColourRGBF(Alpha=1, Red=0, Green=number_slider_24, Blue=0)  # disabled
number_slider_30 = Slider(0.43, range=0..1)  # disabled
colour_rgb_f_4 = ColourRGBF(Alpha=1, Red=0, Green=number_slider_25, Blue=0)  # disabled
length = Length(Curve=polyline)  # disabled
dot_display = DotDisplay(Point=pathfinding.D, Colour=colour_rgb_f, Size=number_slider_26)  # disabled
number_slider_31 = Slider(1, range=0..1)  # disabled
dot_display_2 = DotDisplay(Point=c_script.D, Colour=colour_rgb_f_2, Size=number_slider_28)  # disabled
number_slider_32 = Slider(1, range=0..1)  # disabled
dot_display_3 = DotDisplay(Point=c_script.B, Colour=RGB(0, 0, 0), Size=number_slider_27)  # disabled
dot_display_4 = DotDisplay(Point=pathfinding.C, Colour=colour_rgb_f_3, Size=number_slider_29)  # disabled
panel = Panel(length)  # disabled
dot_display_5 = DotDisplay(Point=c_script.C, Colour=colour_rgb_f_4, Size=number_slider_30)  # disabled
point = Point(Point(5.507088388, -0.2413100049, 0))
closestptgrid = ClosestPointInGrid(Grid=pt, Point=point)  # -> ClosestPointInGrid, BranchOfGrid, LeafOfGrid; disabled
closestpointingrid = CSharpScript(grid=simplify(pt), point=point)  # -> PointInGrid, Branch, Leaf; inputs grid: tree of Point3d, point: Point3d
# ---------- closestpointingrid: C# ----------
    int branchCount = grid.BranchCount;

    double minDistance = double.MaxValue;

    CustomPair cp;

    GH_Path path = new GH_Path();

    for( int i = 0; i < branchCount; ++i )
    {

      for( int j = 0; j < grid.Branch(i).Count; ++j )
      {

        double localDistance = point.DistanceTo(grid.Branch(i)[j]);
        cp.Key = localDistance;
        cp.Path = new GH_Path(i, j);
        minDistance = Math.Min(minDistance, localDistance);

        if( ( cp.Key - minDistance ) < 0.001 )
        {

          path = cp.Path;

        }

      }

    }

    int branch = path.Indices[0], leaf = path.Indices[1];
    
    PointInGrid = grid.Branch(branch)[leaf];

    Branch = branch;
    
    Leaf = leaf;
# ---------- closestpointingrid: C# additional code ----------
  struct CustomPair
  {

    public double Key;
    public GH_Path Path;

  }
# ---------- end closestpointingrid ----------
dots_2 = DotDisplay(Point=closestpointingrid.PointInGrid, Colour=frgb_2, Size=number_slider_2)
point_2 = Point(Point(-4.68099898, -5.259131171, 0))
closestptgrid_2 = ClosestPointInGrid(Grid=pt, Point=point_2)  # -> ClosestPointInGrid, BranchOfGrid, LeafOfGrid; disabled
shortdiagonal = ShortestPathDiagonals(
    Grid=pt,
    StartPointBranch=closestptgrid.BranchOfGrid,
    StartPointLeaf=closestptgrid.LeafOfGrid,
    EndPointBranch=closestptgrid_2.BranchOfGrid,
    EndPointLeaf=closestptgrid_2.LeafOfGrid)  # disabled
shortorto = ShortestPathOrthogonal(
    Grid=pt,
    StartPointBranch=closestptgrid.BranchOfGrid,
    StartPointLeaf=closestptgrid.LeafOfGrid,
    EndPointBranch=closestptgrid_2.BranchOfGrid,
    EndPointLeaf=closestptgrid_2.LeafOfGrid)  # disabled
closestpointingrid_2 = CSharpScript(grid=pt, point=point_2)  # -> PointInGrid, Branch, Leaf; inputs grid: tree of Point3d, point: Point3d; same code as closestpointingrid
dots_3 = DotDisplay(Point=closestpointingrid_2.PointInGrid, Colour=frgb, Size=number_slider_2)
ln = Line(StartPoint=point_2, EndPoint=closestptgrid_2.ClosestPointInGrid)  # disabled
pathfindingsquare = CSharpScript(
    grid=pt,
    idx=closestpointingrid.Branch,
    idj=closestpointingrid.Leaf,
    fidx=closestpointingrid_2.Branch,
    fjdx=closestpointingrid_2.Leaf)  # -> Shortest; inputs grid: tree of Point3d, idx: Int32, idj: Int32, fidx: Int32, fjdx: Int32
# ---------- pathfindingsquare: C# ----------
    int branchCount = grid.BranchCount;
    int maxTreeBranchCount = grid.Branch(branchCount - 1).Count;

    int x = idx, y = idj;

    Point3d tempPoint = new Point3d();
    Point3d point = grid.Branch(x)[y];
    Point3d finalPoint = grid.Branch(fidx)[fjdx];
    List<Point3d> tempList = new List<Point3d>();
    double minDistance = double.MaxValue, minDistanceOne = double.MaxValue;

    tempList.Add(point);

    CustomPair customPair, customPairOne;

    GH_Path path = new GH_Path();

    //while( tempPoint.CompareTo(finalPoint) != 0 )
    for( int i = 0; i < 40; ++i )
    {

      for( int xx = -1; xx < 2; xx += 2 )
      {

        int dX = x + xx, dY = y + xx;

        if( dX >= 0 && dX < branchCount && dY >= 0 && dY < maxTreeBranchCount )
        {

          double localDistance = finalPoint.DistanceTo(grid.Branch(dX)[y]);

          customPair.Key = localDistance;
          customPair.Value = grid.Branch(dX)[y];
          customPair.Path = new GH_Path(dX, y);

          minDistance = Math.Min(minDistance, localDistance);

          double localDistanceOne = finalPoint.DistanceTo(grid.Branch(x)[dY]);

          customPairOne.Key = localDistanceOne;
          customPairOne.Value = grid.Branch(x)[dY];
          customPairOne.Path = new GH_Path(x, dY);

          minDistanceOne = Math.Min(minDistanceOne, localDistanceOne);

          if( minDistance < minDistanceOne )
          {

            if( ( customPair.Key - minDistance ) < 0.01 )
            {

              tempPoint = customPair.Value;
              path = customPair.Path;

            }

          }

          else
          {

            if( ( customPairOne.Key - minDistanceOne ) < 0.01 )
            {

              tempPoint = customPairOne.Value;
              path = customPairOne.Path;

            }

          }

        }

      }

      x = path.Indices[0];
      y = path.Indices[1];

      tempList.Add(tempPoint);

    }

    //Print("Path: " + path.ToString());

    Shortest = new Polyline(tempList);
# ---------- pathfindingsquare: C# additional code ----------
  struct CustomPair
  {

    public double Key;
    public Point3d Value;
    public GH_Path Path;

  }
# ---------- end pathfindingsquare ----------
pathfindingdiagonal = CSharpScript(
    grid=pt,
    idx=closestpointingrid.Branch,
    idj=closestpointingrid.Leaf,
    fidx=closestpointingrid_2.Branch,
    fjdx=closestpointingrid_2.Leaf)  # -> Shortest; inputs grid: tree of Point3d, idx: Int32, idj: Int32, fidx: Int32, fjdx: Int32
# ---------- pathfindingdiagonal: C# ----------
    int branchCount = grid.BranchCount;
    int maxTreeBranchCount = grid.Branch(branchCount - 1).Count;

    int x = idx % branchCount, y = idj % maxTreeBranchCount;

    Point3d tempPoint = new Point3d();
    Point3d point = grid.Branch(x)[y];
    Point3d finalPoint = grid.Branch(fidx % branchCount)[fjdx % maxTreeBranchCount];
    List<Point3d> tempList = new List<Point3d>();
    double minDistance = double.MaxValue;
    //var keyValuePair = new KeyValuePair<double, Point3d>();

    tempList.Add(point);

    CustomPair customPair;

    GH_Path path = new GH_Path();

    while( tempPoint.CompareTo(finalPoint) != 0 )
    {

      for( int xx = x - 1; xx < x + 2; ++xx )
        //System.Threading.Tasks.Parallel.For(x - 1, x + 2, xx =>
      {

        for( int yy = y - 1; yy < y + 2; ++yy )
          //System.Threading.Tasks.Parallel.For(y - 1, y + 2, yy =>
        {

          if( xx >= 0 && xx < branchCount && yy >= 0 && yy < maxTreeBranchCount )
          {

            double localDistance = finalPoint.DistanceTo(grid.Branch(xx)[yy]);

            customPair.Key = localDistance;
            customPair.Value = grid.Branch(xx)[yy];
            customPair.Path = new GH_Path(xx, yy);

            minDistance = Math.Min(minDistance, localDistance);

            if( ( customPair.Key - minDistance ) < 0.01 )
            {

              tempPoint = customPair.Value;
              path = customPair.Path;

            }

          }

        }

      }

      x = path.Indices[0];
      y = path.Indices[1];

      tempList.Add(tempPoint);

    }

    Shortest = new Polyline(tempList);
# ---------- pathfindingdiagonal: C# additional code ----------
  struct CustomPair
  {

    public double Key;
    public Point3d Value;
    public GH_Path Path;

  }
# ---------- end pathfindingdiagonal ----------
previewlw = CustomPreviewLineweights(Geometry=ln, Shader=frgb_4, Thickness=number_slider_21, Absolute=False)  # disabled
crv = Curve(pathfindingsquare)
len = Length(Curve=pathfindingdiagonal)  # disabled
len_2 = Length(Curve=pathfindingsquare)  # disabled
panel_2 = Panel(len)  # disabled
panel_3 = Panel(len_2)  # disabled
pathfindingsquare_2 = CSharpScript(
    grid=pt,
    idx=closestpointingrid.Branch,
    idj=closestpointingrid.Leaf,
    fidx=closestpointingrid_2.Branch,
    fjdx=closestpointingrid_2.Leaf)  # -> Shortest; inputs grid: tree of Point3d, idx: Int32, idj: Int32, fidx: Int32, fjdx: Int32
# ---------- pathfindingsquare_2: C# ----------
    int branchCount = grid.BranchCount;
    int maxTreeBranchCount = grid.Branch(branchCount - 1).Count;

    int x = idx, y = idj;

    Point3d tempPoint = new Point3d();
    Point3d point = grid.Branch(x)[y];
    Point3d finalPoint = grid.Branch(fidx)[fjdx];
    List<Point3d> tempList = new List<Point3d>();
    double minDistance = double.MaxValue, minDistanceOne = double.MaxValue;

    tempList.Add(point);

    CustomPair customPair, customPairOne;

    GH_Path path = new GH_Path();

    //while( tempPoint.CompareTo(finalPoint) != 0 )
    //for( int i = 0; i < 2; ++i )
    {

      for( int xx = -1; xx < 2; xx += 2 )
      {

        int dX = -666, dY = -666;
        int tempX = x + xx, tempY = y + xx;

        if( tempX >= 0 && tempX < branchCount && tempY >= 0 && tempY < maxTreeBranchCount )
        {
          dX = tempX;
          dY = tempY;
        }
        
        else if( tempX < 0 || tempY < 0 )
        {
          
          dX = x;
          dY = y;
        
        }
        //else{ dX = -666; }

        /*if( tempY >= 0 && tempY < maxTreeBranchCount )
          dY = tempY;*/
        
        //else{ dY = -666; }

        //if( dX >= 0 && dX < branchCount && dY >= 0 && dY < maxTreeBranchCount )
        //if( dY >= 0 && dY < maxTreeBranchCount )
        //if( dX >= 0 && dX < branchCount && dY >= 0 && dY < maxTreeBranchCount )
        {

          tempList.Add(grid.Branch(dX)[y]);
          tempList.Add(grid.Branch(x)[dY]);

          /*double localDistance = finalPoint.DistanceTo(grid.Branch(dX)[y]);

          customPair.Key = localDistance;
          customPair.Value = grid.Branch(dX)[y];
          customPair.Path = new GH_Path(dX, y);

          minDistance = Math.Min(minDistance, localDistance);

          double localDistanceOne = finalPoint.DistanceTo(grid.Branch(x)[dY]);

          customPairOne.Key = localDistanceOne;
          customPairOne.Value = grid.Branch(x)[dY];
          customPairOne.Path = new GH_Path(x, dY);

          minDistanceOne = Math.Min(minDistanceOne, localDistanceOne);

          if( minDistance < minDistanceOne )
          {

            if( ( customPair.Key - minDistance ) < 0.01 )
            {

              tempPoint = customPair.Value;
              path = customPair.Path;

            }

          }

          else
          {

            if( ( customPairOne.Key - minDistanceOne ) < 0.01 )
            {

              tempPoint = customPairOne.Value;
              path = customPairOne.Path;

            }

          }*/

        }

      }

      /*x = path.Indices[0];
      y = path.Indices[1];

      tempList.Add( tempPoint );*/

    }

    //Print("Path: " + path.ToString());

    Shortest = tempList;

    //Shortest = new Polyline(tempList);
# ---------- pathfindingsquare_2: C# additional code ----------
  struct CustomPair
  {

    public double Key;
    public Point3d Value;
    public GH_Path Path;

  }
# ---------- end pathfindingsquare_2 ----------
number_slider_33 = Slider(0.32, range=0..1)  # disabled
colour_rgb_f_5 = ColourRGBF(Alpha=1, Red=0, Green=0, Blue=number_slider_31)  # disabled
number_slider_34 = Slider(0.32, range=0..1)  # disabled
colour_rgb_f_6 = ColourRGBF(Alpha=1, Red=0, Green=0, Blue=number_slider_32)  # disabled
pathfindingsquare_3 = CSharpScript(
    grid=pt,
    idx=closestpointingrid.Branch,
    idj=closestpointingrid.Leaf,
    fidx=closestpointingrid_2.Branch,
    fjdx=closestpointingrid_2.Leaf)  # -> Shortest; inputs grid: tree of Point3d, idx: Int32, idj: Int32, fidx: Int32, fjdx: Int32
# ---------- pathfindingsquare_3: C# ----------
    int branchCount = grid.BranchCount;
    int maxTreeBranchCount = grid.Branch(branchCount - 1).Count;

    int x = idx, y = idj;

    Point3d tempPoint = new Point3d();
    Point3d point = grid.Branch(x)[y];
    Point3d finalPoint = grid.Branch(fidx)[fjdx];
    List<Point3d> tempList = new List<Point3d>();
    double minDistance = double.MaxValue, minDistanceOne = double.MaxValue;

    tempList.Add(point);

    CustomPair customPair, customPairOne;

    GH_Path path = new GH_Path();

    while( tempPoint.CompareTo(finalPoint) != 0 )
    //for( int i = 0; i < 20; ++i )
    {

      for( int xx = x - 1; xx < x + 2; xx+=2 )
      //System.Threading.Tasks.Parallel.For(x - 1, x + 2, xx =>
      {

        for( int yy = y - 1; yy < y + 2; yy+=2 )
        //System.Threading.Tasks.Parallel.For(y - 1, y + 2, yy =>
        {

          if( xx >= 0 && xx < branchCount && yy >= 0 && yy < maxTreeBranchCount )
          {

            double localDistance = finalPoint.DistanceTo(grid.Branch(xx)[y]);
  
            customPair.Key = localDistance;
            customPair.Value = grid.Branch(xx)[y];
            customPair.Path = new GH_Path(xx, y);
  
            minDistance = Math.Min(minDistance, localDistance);
  
            double localDistanceOne = finalPoint.DistanceTo(grid.Branch(x)[yy]);
  
            customPairOne.Key = localDistanceOne;
            customPairOne.Value = grid.Branch(x)[yy];
            customPairOne.Path = new GH_Path(x, yy);
  
            minDistanceOne = Math.Min(minDistanceOne, localDistanceOne);
  
            if( minDistance < minDistanceOne )
            {
  
              if( ( customPair.Key - minDistance ) < 0.01 )
              {
  
                tempPoint = customPair.Value;
                path = customPair.Path;
  
              }
  
            }
  
            else
            {
  
              if( ( customPairOne.Key - minDistanceOne ) < 0.01 )
              {
  
                tempPoint = customPairOne.Value;
                path = customPairOne.Path;
  
              }
  
            }
            
          }
          
        }

      }

      x = path.Indices[0];
      y = path.Indices[1];

      tempList.Add( tempPoint );

    }

    //Print("Path: " + path.ToString());

    //Shortest = tempList;

    Shortest = new Polyline(tempList);
# ---------- pathfindingsquare_3: C# additional code ----------
  struct CustomPair
  {

    public double Key;
    public Point3d Value;
    public GH_Path Path;

  }
# ---------- end pathfindingsquare_3 ----------
crv_2 = Curve(pathfindingsquare_3)
dot_display_6 = DotDisplay(Point=pathfinding.A, Colour=colour_rgb_f_5, Size=number_slider_33)  # disabled
dot_display_7 = DotDisplay(Point=c_script.A, Colour=colour_rgb_f_6, Size=number_slider_34)  # disabled
bang = ExplodeTree(Data=pt)  # -> Branch0, Branch1, Branch2, Branch3, Branch4, Branch5
frgb_5 = ColourRGBF(Alpha=1, Red=Slider(1, range=0..1), Green=Slider(1, range=0..1), Blue=Slider(1, range=0..1))
lng = ListLength(List=pathfindingsquare_3)
panel_4 = Panel(lng)
dots_4 = DotDisplay(Point=pathfindingsquare_3, Colour=frgb_5, Size=Slider(0.249, range=0..1))
item = ListItem(List=bang.Branch0, Index=0, Wrap=True)
