# Grasshopper definition SYNTAZTIC_NewVersion_PublicRelease_0.2.7.gh (Grasshopper 1.0.7)
# Copyright: All rights reserved
# plug-ins: SpacePartition, MeshEdit Components, Kangaroo Components, PTComponentLibrary, Weaverbird, Kangaroo2 Components, SpaceSyntaxDesign_GH

# ---- group: Just for demo! Don't make sense probably
panel = Panel("""Lobby
kitchen
Toilet1
Bed1
Bed2
Bath
Hall
Living
Toilet2""")
ta = Slider(154, range=0..1000)
gene_pool = GenePool(Decimals=1, Maximum=40, Minimum=4, Value=[12.52550695, 27.3, 4, 17.8, 32.8, 15.24241705, 13.3, 28.1, 40])
P = Points([<points referenced from the Rhino model> x9])
curve = Curve([<curve referenced from the Rhino model> x21])

# ----
panel_2 = Panel("BUBBLE DIAGRAM FORMATION")
P_2 = Plane(PlaneXY(48, 94, 0))

# ---- group: bounded to the number of triangulations
triangulation = Slider(6, range=0..8)

# ---- group: AdvancedSettings
st = Slider(0.1, range=0..2)
st_2 = Slider(0.805, range=0..10)
it = Slider(4000, range=0..4000)
tolerance = Tolerance(0.0001)

# ----
P_3 = Points(P)
curve_2 = Curve(curve)
labels = Labels(panel)
areas = Areas(gene_pool)
ta_2 = Number(ta)
graphfromnodes_links = GraphFromNodesLinks(Points=P_3, Links=curve_2, Labels=labels, Areas=areas, TotalArea=ta_2)  # -> Graph, GraphVertices, Attributes
programme = Programme(Attributes=graphfromnodes_links.Attributes)  # -> Tags, Areas, Colors, Legends
legend = Legend(
    Colour=programme.Colors,
    Tags=programme.Legends,
    Rectangle={Plane=PlaneXY(-7.231523162, 51.54212847, 0), Size=Domain2(u=0..11.18919631, v=0..16.33622662)},
    LegendType=1)
G = Integer(graphfromnodes_links.Graph)
gv = GV(graphfromnodes_links.GraphVertices)
att = Data(graphfromnodes_links.Attributes)
G_2 = Integer(G)
gv_2 = GV(gv)
att_2 = Data(att)
forcedirecteddrawing = ForceDirectedDrawing(
    Graph=G_2,
    Vertices=gv_2,
    Attributes=att_2,
    AttractionStrength=st,
    RepulsionStrength=st_2,
    ConvergenceTolearnce=tolerance,
    MaximumIterations=it,
    Active=Toggle(True))  # -> NewGraphVertices, IterationCount
panel_3 = Panel(forcedirecteddrawing.IterationCount)
diskographdrawing = DiskoGraphDrawing(Plane=PlaneXY(22, 225, 0), Graph=G_2, Vertices=forcedirecteddrawing.NewGraphVertices, Attributes=att_2, Thickness=1)

piechart = PieChart(Plane=P_2, Attributes=graphfromnodes_links.Attributes, Radius=10)

graph = Integer(G)
att_3 = Data(att)
panel_4 = Panel("Space Syntax Indicators")
viewpoint = Slider(4, range=0..12)
integration_analysis = IntegrationAnalysis(Graph=graph, Attributes=att_3)  # -> DepthTable, DepthMap, RelativeASymetry, Integration, IntegrationRelativeColors, IntegrationTags
differencefactor = DifferenceFactor(RelativeAsymetries=integration_analysis.RelativeASymetry)
panel_5 = Panel(differencefactor)
justifiedgraphdrawing = JustifiedGraphDrawing(
    ViewPointIndex=viewpoint,
    Plane=PlaneXY(35.04896553, 122.851078, 0),
    Size=10,
    Thickness=2,
    Graph=graph,
    Attributes=att_3,
    DepthTable=integration_analysis.DepthTable)
sort_list = SortList(
    Keys=integration_analysis.Integration,
    ValuesValuesA=integration_analysis.IntegrationRelativeColors,
    ValuesB=integration_analysis.IntegrationTags)  # -> Keys, ValuesValuesA, ValuesB
graph_2 = Integer(graph)
att_4 = Data(att_3)
entropy_analysis = EntropyAnalysis(Graph=graph_2, Attributes=att_4, DepthTable=integration_analysis.DepthTable, DepthMap=integration_analysis.DepthMap)  # -> Entropy, EntropyRelativeColors, EntropyTags
choice_analysis = ChoiceAnalysis(Graph=graph_2, Attributes=att_4)  # -> ShortestPaths, ChoiceBetweenness, ChoiceRelativeColors, ChoiceTags
control_analysis = ControlAnalysis(Graph=graph_2, Attributes=att_4)  # -> Control, ControlRelativeColors, ControlTags
legend_2 = Legend(
    Colour=sort_list.ValuesValuesA,
    Tags=sort_list.ValuesB,
    Rectangle={Plane=PlaneXY(12.76847684, 51.54212847, 0), Size=Domain2(u=0..11.18919631, v=0..16.33622662)},
    LegendType=1)
sort_list_2 = SortList(
    Keys=choice_analysis.ChoiceBetweenness,
    ValuesValuesA=choice_analysis.ChoiceRelativeColors,
    ValuesB=choice_analysis.ChoiceTags)  # -> Keys, ValuesValuesA, ValuesB
sort_list_3 = SortList(
    Keys=control_analysis.Control,
    ValuesValuesA=control_analysis.ControlRelativeColors,
    ValuesB=control_analysis.ControlTags)  # -> Keys, ValuesValuesA, ValuesB
sort_list_4 = SortList(
    Keys=entropy_analysis.Entropy,
    ValuesValuesA=entropy_analysis.EntropyRelativeColors,
    ValuesB=entropy_analysis.EntropyTags)  # -> Keys, ValuesValuesA, ValuesB
shortestpaths = Panel(choice_analysis.ShortestPaths)
legend_3 = Legend(
    Colour=sort_list_2.ValuesValuesA,
    Tags=sort_list_2.ValuesB,
    Rectangle={Plane=PlaneXY(52.76847684, 51.54212847, 0), Size=Domain2(u=0..11.18919631, v=0..16.33622662)},
    LegendType=1)
legend_4 = Legend(
    Colour=sort_list_3.ValuesValuesA,
    Tags=sort_list_3.ValuesB,
    Rectangle={Plane=PlaneXY(32.76847684, 51.54212847, 0), Size=Domain2(u=0..11.18919631, v=0..16.33622662)},
    LegendType=1)
legend_5 = Legend(
    Colour=sort_list_4.ValuesValuesA,
    Tags=sort_list_4.ValuesB,
    Rectangle={Plane=PlaneXY(72.76847684, 51.54212847, 0), Size=Domain2(u=0..11.18919631, v=0..16.33622662)},
    LegendType=1)

# ---- group: ForUrban Analysis
curve_3 = Curve([<curve referenced from the Rhino model> x292])
axiallinegraph = AxialLineGraph(AxialLines=curve_3)  # -> Graph, IsolatedAxialLines

# ----
# Space Syntax Indicators for Urban Studies (in progress)
# Read me!: This is a completely different story. It has nothing to do with the rest of this files. This group is just here to let you know we are building another set of tools for urban studies. A newer version of CONFIGURBANIST will be released soon if there is enough interest from public: http://www.grasshopper3d.com/group/cheetah
# 
# We are urrently busy developing a whole bunch of new tools for urban studies (network design and analysis for pedestrians and cyclists). If you support this action and want to see more coming, let us know through our page on the forum (Cheetah Group, the link above)
number_slider = Slider(7, range=3..18)
graph_3 = Integer(axiallinegraph.Graph)
integration_analysis_2 = IntegrationAnalysis(Graph=graph_3)  # -> DepthTable, DepthMap, RelativeASymetry, Integration, IntegrationRelativeColors, IntegrationTags
localintegration = LocalIntegration(DepthTree=integration_analysis_2.DepthTable, Radius=number_slider)
graph_4 = Integer(graph_3)
rc = RC(V=localintegration)
entropy_analysis_2 = EntropyAnalysis(Graph=graph_4, DepthTable=integration_analysis_2.DepthTable, DepthMap=integration_analysis_2.DepthMap)  # -> Entropy, EntropyRelativeColors, EntropyTags
control_analysis_2 = ControlAnalysis(Graph=graph_4)  # -> Control, ControlRelativeColors, ControlTags
custom_preview = CustomPreview(Geometry=curve_3, Shader=rc)

number_slider_2 = Slider(25, range=0..30)
number_slider_3 = Slider(19, range=0..30)
construct_domain = ConstructDomain(DomainStart=expr("-x", number_slider_2), DomainEnd=number_slider_2)
construct_domain_2 = ConstructDomain(DomainStart=expr("-x", number_slider_3), DomainEnd=number_slider_3)
point = Point(Point(-35.270718, 205.6531155, 0))
rectangle = Rectangle(Plane=point, XSize=construct_domain_2, YSize=construct_domain, Radius=0)  # -> Rectangle, Length
division = Division(A=number_slider_2, B=Slider(16, range=0..50))
division_2 = Division(A=number_slider_3, B=Slider(4.5, range=0..10))
surface_domain_length = SurfaceDomainLength(Surface=rectangle.Rectangle, ULength=division_2, VLength=division)
generate_borders = GenerateBorders(Grid=surface_domain_length, PanelShape=0)  # -> simplify(flatten(Border))
square_root = SquareRoot(Value=programme.Areas)
list_item = ListItem(List=generate_borders, Index=0, Wrap=True)
area = Area(Geometry=list_item, UseTasks=False)  # -> Area, Centroid
multiplication = Multiplication(A=area.Area, B=Slider(0.5, range=0..1))
construct_domain_3 = ConstructDomain(DomainStart=Slider(1, range=0..1), DomainEnd=Slider(1, range=0..2))  # -> graft(Domain)
genepoolmodifier = GenePoolModifier(
    GeneList="R",
    Count=Slider(9, range=0..100),
    Domain=construct_domain_3,
    Randomize=Button(),
    PercentageOfRandomization=Slider(1, range=0..1))
gnlst = GeneList(graft(["R", "R0", "R1", "R2"]))
mergetreemissing = MergeTreeMissing()
point_2 = Point(forcedirecteddrawing.NewGraphVertices)
voronoi = Voronoi(
    Points=point_2,
    Boundary={Plane=PlaneXY(-34.60885634, 121.4505572, 0), Size=Domain2(u=-11.06065528..11.06065528, v=-12.60244359..12.60244359)},
    BruteForceOverride=False)
area_2 = Area(Geometry=voronoi, UseTasks=False)  # -> Area, Centroid
R = GenePool(
    Decimals=2,
    Maximum=1.001,
    Minimum=1,
    Value=[1.000126456, 1.000082429, 1.000893646, 1.000147891, 1.000835869, 1.000079271, 1.000261897, 1.000319877, 1.000139362])
multiplication_2 = Multiplication(A=square_root, B=R)
division_3 = Division(A=programme.Areas, B=multiplication_2)
multiplication_3 = Multiplication(A=division_3, B=0.5)
multiplication_4 = Multiplication(A=multiplication_2, B=0.5)
construct_domain_4 = ConstructDomain(DomainStart=expr("-x", multiplication_3), DomainEnd=multiplication_3)
construct_domain_5 = ConstructDomain(DomainStart=expr("-x", multiplication_4), DomainEnd=multiplication_4)
rectangle_2 = Rectangle(Plane=point_2, XSize=construct_domain_5, YSize=construct_domain_4, Radius=0)  # -> Rectangle, Length
spacetopology = SpaceTopology(Curves=voronoi)
linetopology = LineTopology(PointTree=simplify(graft(area_2.Centroid)), Topology=spacetopology)
line = Line(flatten(linetopology))
removeduplicatelines = RemoveDuplicateLines(Lines=line, Tolerance=0.01)
weaverbird_s_mesh_from_lines_weave_back = WeaverbirdsMeshFromLinesWeaveBack(Lines=removeduplicatelines, MaximumValence=4)
mesh_explode = MeshExplode(Mesh=weaverbird_s_mesh_from_lines_weave_back, Interpolate=False)
curve_4 = Curve(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)
area_3 = Area(Geometry=mesh_explode, UseTasks=False)  # -> Area, Centroid
interconnectpoints = InterconnectPoints(Pts=point_2)
point_3 = Point(Point(-13.58333637, 136.2069849, 0))
point_4 = Point(Point(9.870904068, -11.24031262, 0))
point_5 = Point(Point(15.05201052, -11.30289059, 0))
point_6 = Point(Point(-17.17137498, 23.58812154, 0))
mesh_edges = MeshEdges(Mesh=mesh_explode)  # -> NakedEdges, InteriorEdges, NonManifoldEdges
number_slider_4 = Slider(3, range=0..10)
offsettree = CSharpScript(tree=curve_4, distance=Slider(-2.317, range=-20..20))  # -> out, A; inputs tree: tree of Curve, distance: Double
# ---------- offsettree: C# ----------
    /*var curves = x.Offset(Plane.WorldXY, -10, 1e-3, CurveOffsetCornerStyle.Sharp);

    var list = new List<Curve>();
    list.AddRange(curves);
    list.Add(x);

    Brep[] brep = Brep.CreateFromLoft(list, Point3d.Unset, Point3d.Unset, LoftType.Normal, false);

    A = brep;*/

    int branches = tree.BranchCount;

    DataTree<Curve> treeOut = new DataTree<Curve>();
    GH_Path path = new GH_Path();

    for( int i = 0; i < branches; ++i )
    {

      path = new GH_Path(i);

      //for( int j = 0; j < tree.Branch(i).Count; ++j )
      {

        treeOut.Add(tree.Branch(i)[0], path);
        treeOut.AddRange(tree.Branch(i)[0].Offset(Plane.WorldXY, distance, 1e-3, CurveOffsetCornerStyle.Sharp), path);

      }

    }

    A = treeOut;
# ---------- end offsettree ----------
data = Data()
vector_2pt = Vector2Pt(PointA=point_2, PointB=point_3, Unitize=False)  # -> unitize(Vector), Length
join_curves = JoinCurves(Curves=mesh_edges.NakedEdges, Preserve=False)
spacetopology_2 = SpaceTopology(Curves=flatten(join_curves))
linetopology_2 = LineTopology(PointTree=graft(forcedirecteddrawing.NewGraphVertices), Topology=G_2)  # -> flatten(LineTopology)
linetopology_3 = LineTopology(PointTree=simplify(graft(area_2.Centroid)), Topology=spacetopology_2)
radians = Radians(Degrees=Slider(90, range=0..100))
length = Length(Curve=linetopology_2)
relay = Relay()
loft = Loft(Curves=offsettree.A, Options={Adjust=False, Closed=False, LoftEnds=0, LoftSimp=0, LoftType=0, Rebuild=10, Refit=0.01})
shift_list = ShiftList(List=interconnectpoints, Shift=1, Wrap=True)
multiplication_5 = Multiplication(A=length, B=Slider(0.8237, range=0..10))
amplitude = Amplitude(Vector=vector_2pt.Vector, Amplitude=Slider(0.018, range=0..1))
unit_y = UnitY(Factor=expr("-x", Slider(0.009, range=0..1)))
number_slider_5 = Slider(0, range=0..10)
load = Load(Point=point_2, ForceVector=unit_y, Weighting=1)
load_2 = Load(Point=point_2, ForceVector=amplitude, Weighting=1)
grab = Grab(On=True, Strength=1, Range=3)
number_slider_6 = Slider(0.024137, range=0..0.1)
deconstruct_brep = DeconstructBrep(Brep=loft)  # -> simplify(Faces), Edges, Vertices
clampangle = ClampAngle(UpperLimit=1.570796327, LowerLimit=0.7853981634, Strength=1)
clampangle_2 = ClampAngle(LineA=interconnectpoints, LineB=shift_list, UpperLimit=radians, LowerLimit=radians, Strength=number_slider_5)
constanttension = ConstantTension(Line=linetopology_2, Strength=number_slider_5)
length_line = LengthLine(Line=linetopology_2, Length=multiplication_5, Strength=Slider(10, range=0..10))
brep_wireframe = BrepWireframe(Brep=deconstruct_brep.Faces, Density=-1)
plasticanchor = PlasticAnchor(Point=point_2, Limit=Slider(1, range=0..1), Strength=Slider(1, range=0..1))
join_curves_2 = JoinCurves(Curves=brep_wireframe, Preserve=False)  # -> flatten(Curves)
curvecollide = CurveCollide(Curves=rectangle_2.Rectangle, PassiveCurves=join_curves_2, BasePlane=PlaneXY(0, 0, 0), Strength=1)  # -> Goal, Frames
data_2 = Data(flatten([curvecollide.Goal, length_line, load]))
number_slider_7 = Slider(0, range=0..0.001)
solver = Solver(GoalObjects=data_2, Reset=Button(), Threshold=1e-15, Tolerance=0.01, On=Toggle(False))  # -> I, V, O
zombiesolver = ZombieSolver(GoalObjects=data_2, Threshold=Slider(0.1, range=0..0.1), Tolerance=0.01, MaxIterations=50000)  # -> I, V, O; disabled
clean_tree = CleanTree(RemoveNulls=True, RemoveInvalid=True, RemoveEmpty=False, Tree=zombiesolver.O)
solver_2 = Solver(
    GoalObjects=data_2,
    Reset=Button(),
    Restart=False,
    Parallel=True,
    Threshold=1e-15,
    Tolerance=0.01,
    AddCurrent=False,
    On=True)  # -> V, O
clean_tree_2 = CleanTree(RemoveNulls=True, RemoveInvalid=True, RemoveEmpty=False, Tree=solver.O)
c_script = CSharpScript(x=clean_tree)  # -> A; inputs x: list
# ---------- c_script: C# ----------
    var listOut = new DataTree<Curve>();
    var list = new object[x.Count];
    Curve temp = null;

    for( int i = 0; i < x.Count; ++i )
    {

      list = ( object[] ) x[i];
      
      if( list[0].GetType() == typeof( Rhino.Geometry.PolylineCurve ) )
      {
  
        for( int j = 0; j < list.Length; ++j )
        {
          
          GH_Convert.ToCurve(list[j], ref temp, GH_Conversion.Both);
  
          listOut.Add(temp, new GH_Path(i));
            
        }

      }
        
    }

    A = listOut;

    //A = list[0].GetType().ToString();
# ---------- end c_script ----------
rectangle_3 = Rectangle(Plane=solver_2.V, XSize=construct_domain_5, YSize=construct_domain_4, Radius=0)  # -> Rectangle, Length
panel_6 = Panel(clean_tree)
surface = Surface(clean_tree_2)

# ----
# Read me!: These tools are directly taken from our lab! One of them marked in red is just a dummy place holder, it does not do what it is supposed to do properly. If you find the subject interesting, then you need to develop one of the algorithms by yourself. Let us say this is a challenge we don't have time for anymore. If you are interested, search for rectangular graph drawing and st-directed graphs. Please let us know if you find a way, we will include your code in the next relase with proper acknoledgement and credits. Please let us know if you find other problems too. We are aware that the dimensionless drawing tool is also flawed. That is something we will solve after we find a proper way of rectangulation with your help. For the time being, we cannot offer further help on this part, please use them as they are. I (Pirouz) am writing my PhD and have very limited time considering my teaching and research tasks next to my PhD. Please consider these facts when asking for help.
panel_7 = Panel("SYNTACTIC EXPLORATIONS")
P_4 = Points(P_3)
curve_5 = Curve(curve_2)
labels_2 = Labels(labels)
areas_2 = Areas(areas)
ta_3 = Number(ta_2)
ta_4 = Slider(18, range=0..100)
xy_plane = XYPlane(Origin=Point(-35.92729571, 204.6599472, 0))
graphfromnodes_linkswithnews = GraphFromNodesLinksWithNEWS(Points=P_4, Links=curve_5, Labels=labels_2, Areas=areas_2, TotalArea=ta_4)  # -> Graph, GraphVertices, Attributes
graphedges = GraphEdges(Graph=graphfromnodes_linkswithnews.Graph, Vertices=graphfromnodes_linkswithnews.GraphVertices)
bp = BasePlane(xy_plane)
tutteconvexdrawing = TutteConvexDrawing(
    BasePlane=bp,
    Graph=graphfromnodes_linkswithnews.Graph,
    Vertices=graphfromnodes_linkswithnews.GraphVertices,
    Attributes=graphfromnodes_linkswithnews.Attributes)  # -> NewGraphVertices, ConvexFaceBorders, SubGraph, SubVertices, SubAttributes
diskographdrawing_2 = DiskoGraphDrawing(
    Plane=bp,
    Graph=graphfromnodes_linkswithnews.Graph,
    Vertices=tutteconvexdrawing.NewGraphVertices,
    Attributes=graphfromnodes_linkswithnews.Attributes,
    Thickness=3)
G_3 = Graph(tutteconvexdrawing.SubGraph)
att_5 = Attributes(tutteconvexdrawing.SubAttributes)
gv_3 = Vertices(tutteconvexdrawing.SubVertices)
exct = BooleanToggle(True)
triangulatemeshinallways = TriangulateMeshInAllWays(
    TutteOutputVerticesIncludingNEWS=tutteconvexdrawing.NewGraphVertices,
    ConvexFaceBorders=tutteconvexdrawing.ConvexFaceBorders,
    IndexOfTriangulation=triangulation,
    ExcludeDegenerateTINS=exct)  # -> AllTriangularMeshes, TheChosenTriangularMesh
dualgraph = DualGraph(NEWS_Triangulated_Mesh=triangulatemeshinallways.TheChosenTriangularMesh, SubAttributes=att_5)  # -> DualVertices, DualFaces, DualFaceBorders, DualFaceColors
me = ME(G=triangulatemeshinallways.TheChosenTriangularMesh)
surface_2 = Surface(dualgraph.DualFaceBorders)
custom_preview_2 = CustomPreview(Geometry=surface_2, Shader=dualgraph.DualFaceColors)
xy_plane_2 = XYPlane(Origin=Point(73, 235, 0))
cellgraph = CellGraph(Cells=dualgraph.DualFaceBorders)  # -> Graph, GraphVertices
G_4 = Graph(G_3)
att_6 = Attributes(att_5)
gv_4 = Vertices(gv_3)
xy_plane_3 = XYPlane(Origin=Point(64.65187553, 174.7278043, 0))
number_slider_8 = Slider(5, range=0..10)
forcedirecteddrawing_2 = ForceDirectedDrawing(
    Graph=cellgraph.Graph,
    Vertices=gv_4,
    Attributes=att_6,
    AttractionStrength=st,
    RepulsionStrength=st_2,
    ConvergenceTolearnce=0.001,
    MaximumIterations=4000,
    Active=Toggle(True))  # -> NewGraphVertices, IterationCount
xy_plane_4 = XYPlane(Origin=Point(58.48372734, 184.2431182, 0))
panel_8 = Panel(forcedirecteddrawing_2.IterationCount)
diskographdrawing_3 = DiskoGraphDrawing(Plane=xy_plane_4, Graph=G_4, Vertices=forcedirecteddrawing_2.NewGraphVertices, Attributes=att_6, Thickness=1)
att_7 = Attributes(att_6)
relocate_vertices = RelocateVertices(BasePLane=xy_plane_4, Vertices=forcedirecteddrawing_2.NewGraphVertices)
scale = Slider(1.9, range=0..10)
att_8 = Attributes(att_7)
curve_6 = Curve(<curve referenced from the Rhino model>)
att_tor = Att_toR(B=scale, att=att_8)  # -> R, M
weightedvoronoi = WeightedVoronoi(BasePlane=bp, Points=relocate_vertices, Radii=att_tor.R, BoundingCurve=curve_6)  # -> AdjacencyGraph, VoronoiCells
surface_3 = Surface(weightedvoronoi.VoronoiCells)
custom_preview_3 = CustomPreview(Geometry=surface_3, Shader=att_tor.M)

curve_7 = Curve(tutteconvexdrawing.ConvexFaceBorders)
discontinuity = Discontinuity(Curve=curve_7, Level=3)  # -> flatten(Points), Parameters
shatter = Shatter(Curve=graft(tutteconvexdrawing.ConvexFaceBorders), Parameters=discontinuity.Parameters, UseTasks=False)
weaverbird_s_mesh_from_lines_weave_back_2 = WeaverbirdsMeshFromLinesWeaveBack(Lines=shatter, MaximumValence=Slider(5, range=0..10))

# ---- group: This is just a funny toy!
rectangulatedual = RectangulateDual(
    BasePolane=xy_plane_2,
    DualVertices=dualgraph.DualVertices,
    DualFaces=dualgraph.DualFaces,
    DualFaceBorders=dualgraph.DualFaceBorders)  # -> RectangularVertices, RectangularFaceBorders

# ----
mesh = Mesh(triangulatemeshinallways.TheChosenTriangularMesh)
mesh_join = MeshJoin(Meshes=flatten(weaverbird_s_mesh_from_lines_weave_back_2))
weaverbird_s_join_meshes_and_weld = WeaverbirdsJoinMeshesAndWeld(Mesh=flatten(weaverbird_s_mesh_from_lines_weave_back_2), Weld=False)
curve_8 = Curve(flatten(dualgraph.DualFaceBorders))
mesh_flip = MeshFlip(Mesh=mesh_join)
c_script_2 = CSharpScript(x=rectangulatedual.RectangularVertices, y=rectangulatedual.RectangularFaceBorders)  # -> out, A, B; inputs x: tree of Point3d, y: tree of Curve
# ---------- c_script_2: C# ----------
    A = x.Branch(0);
    B = y.Branch(0);
# ---------- end c_script_2 ----------
dimensionlessdissection = DimensionLessDissection(
    BasePolane=xy_plane_3,
    RectangularVertices=rectangulatedual.RectangularVertices,
    RectangularFaceBorders=rectangulatedual.RectangularFaceBorders,
    CellGridSize=number_slider_8)

surface_4 = Surface(rectangulatedual.RectangularFaceBorders)
custom_preview_4 = CustomPreview(Geometry=surface_4, Shader=dualgraph.DualFaceColors)
surface_5 = Surface(dimensionlessdissection)
custom_preview_5 = CustomPreview(Geometry=surface_5, Shader=dualgraph.DualFaceColors)
dimensionlessdissection_2 = DimensionLessDissection(
    BasePolane=xy_plane_3,
    RectangularVertices=rectangulatedual.RectangularVertices,
    RectangularFaceBorders=rectangulatedual.RectangularFaceBorders,
    CellGridSize=number_slider_8)

weaverbird_s_dual_graph = WeaverbirdsDualGraph(MeshCurves=mesh_join, DualMode=1)
discontinuity_2 = Discontinuity(Curve=weaverbird_s_dual_graph, Level=3)  # -> flatten(Points), Parameters
shatter_2 = Shatter(Curve=graft(weaverbird_s_dual_graph), Parameters=discontinuity_2.Parameters, UseTasks=False)
weaverbird_s_mesh_from_lines_weave_back_3 = WeaverbirdsMeshFromLinesWeaveBack(Lines=shatter_2, MaximumValence=Slider(6, range=0..10))
mesh_join_2 = MeshJoin(Meshes=flatten(weaverbird_s_mesh_from_lines_weave_back_3))
deconstruct_mesh = DeconstructMesh(Mesh=mesh_join_2)  # -> Vertices, Faces, Colours, Normals
weaverbird_s_face_polylines = WeaverbirdsFacePolylines(Mesh=mesh_join_2)
spacepartition = SpacePartition(VoronoiIn=curve_8, GridIn=generate_borders, AreaIn=multiplication, Tolerance=Slider(0.1, range=0..0.1))
sortpointsxy = SortPointsXY(Grid=flatten(spacepartition))
missinggridcells = MissingGridCells(CulledGrid=sortpointsxy, OriginalGrid=generate_borders)
parallelregionunion = ParallelRegionUnion(Curves=spacepartition)
surface_6 = Surface(parallelregionunion)

# ==== cluster ME
G = ClusterInput()
Z = UnitZ(Factor=2)
move = Move(Geometry=G, Motion=Z)  # -> Geometry, Transform
faceb = FaceBoundaries(Mesh=move.Geometry)
material = CreateMaterial(
    Diffuse=ColourSwatch(SwatchColor=RGB(71, 71, 71)),
    Specular=RGB(255, 255, 255),
    Emission=RGB(0, 0, 0),
    Transparency=0.5,
    Shine=0)
preview = CustomPreview(Geometry=faceb, Shader=material)

# ==== cluster Att_toR
B = ClusterInput()
att = ClusterInput()
att_2 = Attributes(att)
prgm = Programme(Attributes=att_2)  # -> Tags, Areas, Colors, Legends
expression = Expression(x=prgm.Areas, Expression="Sqrt(x/π)")
multiplication = Multiplication(A=expression, B=B)
material = CreateMaterial(Diffuse=prgm.Colors, Specular=RGB(255, 255, 255), Emission=RGB(0, 0, 0), Transparency=0.5, Shine=0)
M = ClusterOutput(material)
R = ClusterOutput(multiplication)

# ==== cluster RC
V = ClusterInput()
V_2 = Value(V)
bnd = Bounds(Numbers=V_2)
remap = RemapNumbers(Value=V_2, Source=bnd, Target=Domain(0, 1))  # -> Mapped, Clipped
gradient = Gradient(
    LowerLimit=0,
    UpperLimit=1,
    Parameter=remap.Mapped,
    stops=[0: RGB(75, 107, 169), 0.251: RGB(173, 203, 249), 0.5: RGB(254, 244, 84), 0.747: RGB(234, 126, 0), 1: RGB(234, 38, 0)])
C = ClusterOutput(gradient)
