# Grasshopper definition SYNTAZTIC_NewVersion_PublicRelease_0.2.7_001A.gh (Grasshopper 1.0.7)
# Copyright: All rights reserved
# plug-ins: SyntacticGHPlugIn, SpaceSyntaxDesign_GH

# ---- group: Topology
integer = Integer(Tree({0}: [7], {1}: [7], {2}: [3], {3}: [2, 11], {4}: [16, 21, 19], {5}: [19]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))

# ---- group: ID
text = Text(Tree({0;0}: ["5"], {0;1}: ["5"], {0;2}: ["5"], {0;3}: ["5"], {0;4}: ["5"], {0;5}: ["5"]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))

# ---- group: labels
text_2 = Text(flatten(Tree({0;0}: ["Unidades sanitarias mujeres / privadas"], {0;1}: ["Unidades sanitarias hombres / privadas"], {0;2}: ["Cuarto de aseo "], {0;3}: ["Área de aseo de residuos"], {0;4}: ["Almacen General Insumos de Aseo "], {0;5}: ["Área de UPC-Rack"]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)))

# ---- group: Areas
text_3 = Text(flatten(Tree({0;0}: ["3"], {0;1}: ["3"], {0;2}: ["6"], {0;3}: ["1"], {0;4}: ["5"], {0;5}: ["4"]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)))

# ---- group: Just for demo! Don't make sense probably
P = Points([<points referenced from the Rhino model> x23])
crv = Curve([<curve referenced from the Rhino model> x33])

# ---- group: TA
ma = MassAddition(Input=text_3)  # -> Result, PartialResults

# ---- group: plot
crv_2 = Curve(<curve referenced from the Rhino model>)

# ----
panel = Panel("BUBBLE DIAGRAM FORMATION")
P_2 = Plane(PlaneXY(48, 94, 0))

# ---- group: bounded to the number of triangulations
triangulation = Slider(8, range=0..8)

# ---- group: AdvancedSettings
st = Slider(0.25, range=0..2)
st_2 = Slider(1.4, range=0..10)
it = Slider(4000, range=0..4000)
tolerance = Tolerance(0.0001)

# ----
P_3 = Points(P)
crv_3 = Curve(crv)
areas = Areas(text_3)
ta = Number(ma.Result)
labels = Labels(text_2)
nodelinkgraph = GraphFromNodesLinks(Points=P_3, Links=crv_3, Labels=labels, Areas=areas, TotalArea=ta)  # -> Graph, GraphVertices, Attributes
prgm = Programme(Attributes=nodelinkgraph.Attributes)  # -> Tags, Areas, Colors, Legends
legend = Legend(
    Colour=prgm.Colors,
    Tags=prgm.Legends,
    Rectangle={Plane=PlaneXY(-7.231523162, 51.54212847, 0), Size=Domain2(u=0..11.18919631, v=0..16.33622662)},
    LegendType=1)
att = Data(nodelinkgraph.Attributes)
G = Integer(nodelinkgraph.Graph)
gv = GV(nodelinkgraph.GraphVertices)
G_2 = Integer(G)
gv_2 = GV(gv)
att_2 = Data(att)
forcedirecteddrawing = ForceDirectedDrawing(
    Graph=G_2,
    Vertices=gv_2,
    Attributes=att_2,
    AttractionStrength=0.25,
    RepulsionStrength=1.4,
    ConvergenceTolearnce=tolerance,
    MaximumIterations=it,
    Active=Toggle(True))  # -> NewGraphVertices, IterationCount
panel_2 = Panel(forcedirecteddrawing.IterationCount)
diskograph = DiskoGraphDrawing(Plane=PlaneXY(22, 225, 0), Graph=G_2, Vertices=forcedirecteddrawing.NewGraphVertices, Attributes=att_2, Thickness=1)

pie = PieChart(Plane=P_2, Attributes=nodelinkgraph.Attributes, Radius=10)

graph = Integer(G)
att_3 = Data(att)
viewpoint = Slider(4, range=0..12)
panel_3 = Panel("Space Syntax Indicators")
integration = IntegrationAnalysis(Graph=graph, Attributes=att_3)  # -> DepthTable, DepthMap, RelativeASymetry, Integration, IntegrationRelativeColors, IntegrationTags
diff = DifferenceFactor(RelativeAsymetries=integration.RelativeASymetry)
panel_4 = Panel(diff)
sort = SortList(Keys=integration.Integration, ValuesA=integration.IntegrationRelativeColors, ValuesB=integration.IntegrationTags)  # -> Keys, ValuesA, ValuesB
justifiedgraph = JustifiedGraphDrawing(
    ViewPointIndex=viewpoint,
    Plane=PlaneXY(35.04896553, 122.851078, 0),
    Size=10,
    Thickness=2,
    Graph=graph,
    Attributes=att_3,
    DepthTable=integration.DepthTable)
graph_2 = Integer(graph)
att_4 = Data(att_3)
legend_2 = Legend(
    Colour=sort.ValuesA,
    Tags=sort.ValuesB,
    Rectangle={Plane=PlaneXY(12.76847684, 51.54212847, 0), Size=Domain2(u=0..11.18919631, v=0..16.33622662)},
    LegendType=1)
choice = ChoiceAnalysis(Graph=graph_2, Attributes=att_4)  # -> ShortestPaths, ChoiceBetweenness, ChoiceRelativeColors, ChoiceTags
control = ControlAnalysis(Graph=graph_2, Attributes=att_4)  # -> Control, ControlRelativeColors, ControlTags
entropy = EntropyAnalysis(Graph=graph_2, Attributes=att_4, DepthTable=integration.DepthTable, DepthMap=integration.DepthMap)  # -> Entropy, EntropyRelativeColors, EntropyTags
sort_2 = SortList(Keys=choice.ChoiceBetweenness, ValuesA=choice.ChoiceRelativeColors, ValuesB=choice.ChoiceTags)  # -> Keys, ValuesA, ValuesB
sort_3 = SortList(Keys=control.Control, ValuesA=control.ControlRelativeColors, ValuesB=control.ControlTags)  # -> Keys, ValuesA, ValuesB
sort_4 = SortList(Keys=entropy.Entropy, ValuesA=entropy.EntropyRelativeColors, ValuesB=entropy.EntropyTags)  # -> Keys, ValuesA, ValuesB
shortestpaths = Panel(choice.ShortestPaths)
legend_3 = Legend(
    Colour=sort_2.ValuesA,
    Tags=sort_2.ValuesB,
    Rectangle={Plane=PlaneXY(52.76847684, 51.54212847, 0), Size=Domain2(u=0..11.18919631, v=0..16.33622662)},
    LegendType=1)
legend_4 = Legend(
    Colour=sort_3.ValuesA,
    Tags=sort_3.ValuesB,
    Rectangle={Plane=PlaneXY(32.76847684, 51.54212847, 0), Size=Domain2(u=0..11.18919631, v=0..16.33622662)},
    LegendType=1)
legend_5 = Legend(
    Colour=sort_4.ValuesA,
    Tags=sort_4.ValuesB,
    Rectangle={Plane=PlaneXY(72.76847684, 51.54212847, 0), Size=Domain2(u=0..11.18919631, v=0..16.33622662)},
    LegendType=1)

# ---- group: ForUrban Analysis
crv_4 = Curve([<curve referenced from the Rhino model> x292])
alg = AxialLineGraph(AxialLines=crv_4)  # -> Graph, IsolatedAxialLines

# ----
# Space Syntax Indicators for Urban Studies (in progress)
# Read me!: This is a completely different story. It has nothing to do with the rest of this files. This group is just here to let you know we are building another set of tools for urban studies. A newer version of CONFIGURBANIST will be released soon if there is enough interest from public: http://www.grasshopper3d.com/group/cheetah
# 
# We are urrently busy developing a whole bunch of new tools for urban studies (network design and analysis for pedestrians and cyclists). If you support this action and want to see more coming, let us know through our page on the forum (Cheetah Group, the link above)
number_slider = Slider(7, range=3..18)
graph_3 = Integer(alg.Graph)
integration_2 = IntegrationAnalysis(Graph=graph_3)  # -> DepthTable, DepthMap, RelativeASymetry, Integration, IntegrationRelativeColors, IntegrationTags
l_itg = LocalIntegration(DepthTree=integration_2.DepthTable, Radius=number_slider)
graph_4 = Integer(graph_3)
rc = RC(V=l_itg)
control_2 = ControlAnalysis(Graph=graph_4)  # -> Control, ControlRelativeColors, ControlTags
entropy_2 = EntropyAnalysis(Graph=graph_4, DepthTable=integration_2.DepthTable, DepthMap=integration_2.DepthMap)  # -> Entropy, EntropyRelativeColors, EntropyTags
preview = CustomPreview(Geometry=crv_4, Shader=rc)

# ----
# Read me!: These tools are directly taken from our lab! One of them marked in red is just a dummy place holder, it does not do what it is supposed to do properly. If you find the subject interesting, then you need to develop one of the algorithms by yourself. Let us say this is a challenge we don't have time for anymore. If you are interested, search for rectangular graph drawing and st-directed graphs. Please let us know if you find a way, we will include your code in the next relase with proper acknoledgement and credits. Please let us know if you find other problems too. We are aware that the dimensionless drawing tool is also flawed. That is something we will solve after we find a proper way of rectangulation with your help. For the time being, we cannot offer further help on this part, please use them as they are. I (Pirouz) am writing my PhD and have very limited time considering my teaching and research tasks next to my PhD. Please consider these facts when asking for help.
panel_5 = Panel("SYNTACTIC EXPLORATIONS")
crv_5 = Curve(crv_3)
P_4 = Points(P_3)
labels_2 = Labels(labels)
areas_2 = Areas(areas)
ta_2 = Number(ta)
ta_3 = Slider(18, range=0..100)
news_graph = GraphFromNodesLinksWithNEWS(Points=P_4, Links=crv_5, Labels=labels_2, Areas=areas_2, TotalArea=ta_3)  # -> Graph, GraphVertices, Attributes
xy = XYPlane(Origin=Point(-35.92729571, 204.6599472, 0))
bp = BasePlane(xy)
ge = GraphEdges(Graph=news_graph.Graph, Vertices=news_graph.GraphVertices)
tuttedrawing = TutteConvexDrawing(BasePlane=bp, Graph=news_graph.Graph, Vertices=news_graph.GraphVertices, Attributes=news_graph.Attributes)  # -> NewGraphVertices, ConvexFaceBorders, SubGraph, SubVertices, SubAttributes
diskograph_2 = DiskoGraphDrawing(Plane=bp, Graph=news_graph.Graph, Vertices=tuttedrawing.NewGraphVertices, Attributes=news_graph.Attributes, Thickness=3)
G_3 = Graph(tuttedrawing.SubGraph)
gv_3 = Vertices(tuttedrawing.SubVertices)
att_5 = Attributes(tuttedrawing.SubAttributes)
exct = BooleanToggle(True)
triangulate = TriangulateMeshInAllWays(
    TutteOutputVerticesIncludingNEWS=tuttedrawing.NewGraphVertices,
    ConvexFaceBorders=tuttedrawing.ConvexFaceBorders,
    IndexOfTriangulation=triangulation,
    ExcludeDegenerateTINS=exct)  # -> AllTriangularMeshes, TheChosenTriangularMesh
dualgraph = DualGraph(NEWS_Triangulated_Mesh=triangulate.TheChosenTriangularMesh, SubAttributes=att_5)  # -> DualVertices, DualFaces, DualFaceBorders, DualFaceColors
me = ME(G=triangulate.TheChosenTriangularMesh)
srf = Surface(dualgraph.DualFaceBorders)
preview_2 = CustomPreview(Geometry=srf, Shader=dualgraph.DualFaceColors)
xy_2 = XYPlane(Origin=Point(73, 235, 0))
cgraph = CellGraph(Cells=dualgraph.DualFaceBorders)  # -> Graph, GraphVertices
G_4 = Graph(G_3)
gv_4 = Vertices(gv_3)
att_6 = Attributes(att_5)
xy_3 = XYPlane(Origin=Point(64.65187553, 174.7278043, 0))
xy_4 = XYPlane(Origin=Point(13, 200, 0))
forcedirecteddrawing_2 = ForceDirectedDrawing(
    Graph=cgraph.Graph,
    Vertices=gv_4,
    Attributes=att_6,
    AttractionStrength=0.25,
    RepulsionStrength=1.4,
    ConvergenceTolearnce=0.001,
    MaximumIterations=4000,
    Active=Toggle(True))  # -> NewGraphVertices, IterationCount
panel_6 = Panel(forcedirecteddrawing_2.IterationCount)
diskograph_3 = DiskoGraphDrawing(Plane=xy_4, Graph=G_4, Vertices=forcedirecteddrawing_2.NewGraphVertices, Attributes=att_6, Thickness=3)
att_7 = Attributes(att_6)
crv_6 = Curve(<curve referenced from the Rhino model>)
scale = Slider(1.9, range=0..10)
relocate = RelocateVertices(BasePLane=xy_4, Vertices=forcedirecteddrawing_2.NewGraphVertices)
att_8 = Attributes(att_7)
att_tor = Att_toR(B=scale, att=att_8)  # -> R, M
w_voronoi = WeightedVoronoi(BasePlane=bp, Points=relocate, Radii=att_tor.R, BoundingCurve=crv_6)  # -> AdjacencyGraph, VoronoiCells
srf_2 = Surface(w_voronoi.VoronoiCells)
preview_3 = CustomPreview(Geometry=srf_2, Shader=att_tor.M)

panel_7 = Panel(crv_5)
panel_8 = Panel(P_4)
panel_9 = Panel(ge)

# ---- group: This is just a funny toy!
rectangular = RectangulateDual(
    BasePolane=xy_2,
    DualVertices=dualgraph.DualVertices,
    DualFaces=dualgraph.DualFaces,
    DualFaceBorders=dualgraph.DualFaceBorders)  # -> RectangularVertices, RectangularFaceBorders

# ----
srf_3 = Surface(rectangular.RectangularFaceBorders)
preview_4 = CustomPreview(Geometry=srf_3, Shader=dualgraph.DualFaceColors)
dimensionless = DimensionLessDissection(
    BasePolane=xy_3,
    RectangularVertices=rectangular.RectangularVertices,
    RectangularFaceBorders=rectangular.RectangularFaceBorders,
    CellGridSize=Slider(5, range=0..10))
srf_4 = Surface(dimensionless)
preview_5 = CustomPreview(Geometry=srf_4, Shader=dualgraph.DualFaceColors)

# ==== cluster ME
G = ClusterInput()
Z = UnitZ(Factor=2)
move = Move(Geometry=G, Motion=Z)  # -> Geometry, Transform
faceb = FaceBoundaries(Mesh=move.Geometry)
material = CreateMaterial(
    Diffuse=ColourSwatch(SwatchColor=RGB(71, 71, 71)),
    Specular=RGB(255, 255, 255),
    Emission=RGB(0, 0, 0),
    Transparency=0.5,
    Shine=0)
preview = CustomPreview(Geometry=faceb, Shader=material)

# ==== cluster Att_toR
B = ClusterInput()
att = ClusterInput()
att_2 = Attributes(att)
prgm = Programme(Attributes=att_2)  # -> Tags, Areas, Colors, Legends
expression = Expression(x=prgm.Areas, Expression="Sqrt(x/π)")
multiplication = Multiplication(A=expression, B=B)
material = CreateMaterial(Diffuse=prgm.Colors, Specular=RGB(255, 255, 255), Emission=RGB(0, 0, 0), Transparency=0.5, Shine=0)
M = ClusterOutput(material)
R = ClusterOutput(multiplication)

# ==== cluster RC
V = ClusterInput()
V_2 = Value(V)
bnd = Bounds(Numbers=V_2)
remap = RemapNumbers(Value=V_2, Source=bnd, Target=Domain(0, 1))  # -> Mapped, Clipped
gradient = Gradient(
    LowerLimit=0,
    UpperLimit=1,
    Parameter=remap.Mapped,
    stops=[0: RGB(75, 107, 169), 0.251: RGB(173, 203, 249), 0.5: RGB(254, 244, 84), 0.747: RGB(234, 126, 0), 1: RGB(234, 38, 0)])
C = ClusterOutput(gradient)
