# Grasshopper definition SYNTAZTIC_NewVersion_PublicRelease_0.2.7_001B.gh (Grasshopper 1.0.7)
# Copyright: All rights reserved
# plug-ins: Weaverbird, SpaceSyntaxDesign_GH

panel = Panel("""Unidades sanitarias mujeres / privadas
Unidades sanitarias hombres / privadas
Oficina de Dirección con baño
Sala de Juntas
Archivo de historias clinicas
Deposito de medicamentos e insumos
Recepción y Control ( 2 Puestos de trabajo y archivo)
Caja ( 1 Puestos de trabajo)
Área de lokers funcionarios
Área de lokers personal asistencial
Área de bienestar de funcionarios / Cafeteria
Sala de espera (3 M2 por consultorio)
Cuarto de aseo 
Área de aseo de residuos
Almacen General Insumos de Aseo 
Área de UPC-Rack
Cuarto de compresores
Unidades sanitarias hombres Público (Discapacitados)
Unidades sanitarias mujeres Público (Discapacitados)
Consultorios Odontologícos
Ambiente de Esterilización 
Toma e interpretación de Radiografías odontológicas
Entrevistas
Cirugía
Unidades Niños
Circulación""")

# ---- group: points
point = Point([Point(-24.46296384, 11.45370252, 0), Point(-23.7416531, 14.108392, 0), Point(-24.24795107, -11.91101817, 0), Point(-24.10460923, -14.06114584, 0), Point(-24.67797661, -7.969117436, 0), Point(-30.48332132, 13.53215927, 0)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])

# ----
point_list = PointList(Points=point, Size=Slider(1, range=0..1))
point_2 = Point([<point referenced from the Rhino model> x4])
panel_2 = Panel("""3
3
9
12
6
5
6
4
6
6
5
12
6
1
5
4
5
4
4
48
15
4
24
12
24
70""")

# ---- group: plan
curve = Curve(<curve referenced from the Rhino model>)
area = Area(Geometry=curve)  # -> Area, Centroid
plane = Plane(area.Centroid)

# ---- group: lables
text = Text(panel)

# ---- group: Areas
text_2 = Text(panel_2)

# ---- group: TA
mass_addition = MassAddition(Input=text_2)  # -> Result, PartialResults

# ----
panel_3 = Panel(text)
panel_4 = Panel("BUBBLE DIAGRAM FORMATION")
P = Plane(PlaneXY(48, 94, 0))
radians = Radians(Degrees=Slider(35, range=0..100))

# ---- group: AdvancedSettings
st = Slider(1.3573, range=0..2)
st_2 = Slider(7.49, range=0..10)
it = Slider(4000, range=0..4000)
tolerance = Tolerance(0.0001)

# ----
unit_x = UnitX(Factor=Slider(118, range=0..1000))

# ---- group: ForUrban Analysis
curve_2 = Curve([<curve referenced from the Rhino model> x292])
axiallinegraph = AxialLineGraph(AxialLines=curve_2)  # -> Graph, IsolatedAxialLines

# ----
# Space Syntax Indicators for Urban Studies (in progress)
# Read me!: This is a completely different story. It has nothing to do with the rest of this files. This group is just here to let you know we are building another set of tools for urban studies. A newer version of CONFIGURBANIST will be released soon if there is enough interest from public: http://www.grasshopper3d.com/group/cheetah
# 
# We are urrently busy developing a whole bunch of new tools for urban studies (network design and analysis for pedestrians and cyclists). If you support this action and want to see more coming, let us know through our page on the forum (Cheetah Group, the link above)
number_slider = Slider(7, range=3..18)
graph = Integer(axiallinegraph.Graph)
integration_analysis = IntegrationAnalysis(Graph=graph)  # -> DepthTable, DepthMap, RelativeASymetry, Integration, IntegrationRelativeColors, IntegrationTags
localintegration = LocalIntegration(DepthTree=integration_analysis.DepthTable, Radius=number_slider)
graph_2 = Integer(graph)
rc = RC(V=localintegration)
entropy_analysis = EntropyAnalysis(Graph=graph_2, DepthTable=integration_analysis.DepthTable, DepthMap=integration_analysis.DepthMap)  # -> Entropy, EntropyRelativeColors, EntropyTags
control_analysis = ControlAnalysis(Graph=graph_2)  # -> Control, ControlRelativeColors, ControlTags
custom_preview = CustomPreview(Geometry=curve_2, Shader=rc)

# ---- group: bounded to the number of triangulations
triangulation = Slider(8, range=0..10)

# ---- group: topology
panel_5 = Panel("""0
1""")
panel_6 = Panel("""25
8
9
10""")
panel_7 = Panel("""6
25
3""")
panel_8 = Panel("""24
11
19
22""")
panel_9 = Panel("""17
18
19
24
23""")
panel_10 = Panel("""7
11
25""")
panel_11 = Panel("""8
9""")
panel_12 = Panel("""25
10""")
panel_13 = Panel("""17
18
21
25
22""")
panel_14 = Panel("""12
13""")
panel_15 = Panel("""14
25""")
panel_16 = Panel("""23
24""")
panel_17 = Panel("""19
20
23
24""")
panel_18 = Panel("""17
18""")
panel_19 = Panel("""24
4
25""")
panel_20 = Panel("""25
20""")
panel_21 = Panel("""24
25
21""")

# ----
labels = Labels(text)
areas = Areas(text_2)
ta = Number(mass_addition.Result)
P_2 = Points([<points referenced from the Rhino model> x26])

mass_addition_2 = MassAddition(Input=areas)  # -> Result, PartialResults

# ----
# Read me!: These tools are directly taken from our lab! One of them marked in red is just a dummy place holder, it does not do what it is supposed to do properly. If you find the subject interesting, then you need to develop one of the algorithms by yourself. Let us say this is a challenge we don't have time for anymore. If you are interested, search for rectangular graph drawing and st-directed graphs. Please let us know if you find a way, we will include your code in the next relase with proper acknoledgement and credits. Please let us know if you find other problems too. We are aware that the dimensionless drawing tool is also flawed. That is something we will solve after we find a proper way of rectangulation with your help. For the time being, we cannot offer further help on this part, please use them as they are. I (Pirouz) am writing my PhD and have very limited time considering my teaching and research tasks next to my PhD. Please consider these facts when asking for help.
P_3 = Points(P_2)
panel_22 = Panel("SYNTACTIC EXPLORATIONS")
labels_2 = Labels(labels)
areas_2 = Areas(areas)
ta_2 = Number(ta)
bp = BasePlane(plane)
exct = BooleanToggle(True)
xy_plane = XYPlane(Origin=Point(64.65187553, 174.7278043, 0))
xy_plane_2 = XYPlane(Origin=Point(13, 200, 0))
curve_3 = Curve(<curve referenced from the Rhino model>)
scale = Slider(1.9, range=0..10)

merge = Merge(Data1=P_3, Data2=point_2)
point_3 = Point(merge)
panel_23 = Panel(merge)
rotate_plane = RotatePlane(Plane=bp, Angle=radians)
move = Move(Geometry=bp, Motion=unit_x)  # -> Geometry, Transform

# ---- group: topology (continued)
point_4 = Point(point_3)
list_item = ListItem(List=point_4, Index=panel_5, Wrap=True)
list_item_2 = ListItem(List=point_4, Index=panel_6, Wrap=True)
list_item_3 = ListItem(List=point_4, Index="2", Wrap=True)
list_item_4 = ListItem(List=point_4, Index=panel_7, Wrap=True)
list_item_5 = ListItem(List=point_4, Index="3", Wrap=True)
list_item_6 = ListItem(List=point_4, Index="22", Wrap=True)
list_item_7 = ListItem(List=point_4, Index="4", Wrap=True)
list_item_8 = ListItem(List=point_4, Index=panel_8, Wrap=True)
list_item_9 = ListItem(List=point_4, Index="5", Wrap=True)
list_item_10 = ListItem(List=point_4, Index=panel_9, Wrap=True)
list_item_11 = ListItem(List=point_4, Index="6", Wrap=True)
list_item_12 = ListItem(List=point_4, Index=panel_10, Wrap=True)
list_item_13 = ListItem(List=point_4, Index="7", Wrap=True)
list_item_14 = ListItem(List=point_4, Index="11", Wrap=True)
list_item_15 = ListItem(List=point_4, Index=panel_11, Wrap=True)
list_item_16 = ListItem(List=point_4, Index=panel_12, Wrap=True)
list_item_17 = ListItem(List=point_4, Index="10", Wrap=True)
list_item_18 = ListItem(List=point_4, Index="11", Wrap=True)
list_item_19 = ListItem(List=point_4, Index="25", Wrap=True)
list_item_20 = ListItem(List=point_4, Index=panel_13, Wrap=True)
list_item_21 = ListItem(List=point_4, Index=panel_14, Wrap=True)
list_item_22 = ListItem(List=point_4, Index=panel_15, Wrap=True)
list_item_23 = ListItem(List=point_4, Index="14", Wrap=True)
list_item_24 = ListItem(List=point_4, Index="20", Wrap=True)
list_item_25 = ListItem(List=point_4, Index="25", Wrap=True)
list_item_26 = ListItem(List=point_4, Index=panel_16, Wrap=True)
list_item_27 = ListItem(List=point_4, Index="21", Wrap=True)
list_item_28 = ListItem(List=point_4, Index="25", Wrap=True)
list_item_29 = ListItem(List=point_4, Index="15", Wrap=True)
list_item_30 = ListItem(List=point_4, Index="16", Wrap=True)
list_item_31 = ListItem(List=point_4, Index="25", Wrap=True)
list_item_32 = ListItem(List=point_4, Index=panel_17, Wrap=True)
list_item_33 = ListItem(List=point_4, Index="22", Wrap=True)
list_item_34 = ListItem(List=point_4, Index=panel_19, Wrap=True)
list_item_35 = ListItem(List=point_4, Index="23", Wrap=True)
list_item_36 = ListItem(List=point_4, Index="19", Wrap=True)
list_item_37 = ListItem(List=point_4, Index="25", Wrap=True)
list_item_38 = ListItem(List=point_4, Index=panel_20, Wrap=True)
list_item_39 = ListItem(List=point_4, Index=panel_18, Wrap=True)
list_item_40 = ListItem(List=point_4, Index=panel_21, Wrap=True)
list_item_41 = ListItem(List=point_4, Index="24", Wrap=True)
list_item_42 = ListItem(List=point_4, Index="25", Wrap=True)
line = Line(StartPoint=list_item, EndPoint=list_item_2)
line_2 = Line(StartPoint=list_item_3, EndPoint=list_item_4)
line_3 = Line(StartPoint=list_item_5, EndPoint=list_item_6)
line_4 = Line(StartPoint=list_item_7, EndPoint=list_item_8)
line_5 = Line(StartPoint=list_item_9, EndPoint=list_item_10)
line_6 = Line(StartPoint=list_item_11, EndPoint=list_item_12)
line_7 = Line(StartPoint=list_item_13, EndPoint=list_item_14)
line_8 = Line(StartPoint=list_item_15, EndPoint=list_item_16)
line_9 = Line(StartPoint=list_item_17, EndPoint=list_item_19)
line_10 = Line(StartPoint=list_item_18, EndPoint=list_item_20)
line_11 = Line(StartPoint=list_item_21, EndPoint=list_item_22)
line_12 = Line(StartPoint=list_item_23, EndPoint=list_item_25)
line_13 = Line(StartPoint=list_item_24, EndPoint=list_item_26)
line_14 = Line(StartPoint=list_item_27, EndPoint=list_item_28)
line_15 = Line(StartPoint=list_item_29, EndPoint=list_item_31)
line_16 = Line(StartPoint=list_item_30, EndPoint=list_item_32)
line_17 = Line(StartPoint=list_item_33, EndPoint=list_item_34)
line_18 = Line(StartPoint=list_item_35, EndPoint=list_item_37)
line_19 = Line(StartPoint=list_item_36, EndPoint=list_item_38)
line_20 = Line(StartPoint=list_item_39, EndPoint=list_item_40)
line_21 = Line(StartPoint=list_item_41, EndPoint=list_item_42)
panel_24 = Panel(line)
panel_25 = Panel(line_2)
panel_26 = Panel(line_3)
panel_27 = Panel(line_4)
panel_28 = Panel(line_5)
panel_29 = Panel(line_6)
panel_30 = Panel(line_7)
panel_31 = Panel(line_8)
panel_32 = Panel(line_9)
panel_33 = Panel(line_10)
panel_34 = Panel(line_11)
panel_35 = Panel(line_12)
panel_36 = Panel(line_13)
panel_37 = Panel(line_14)
panel_38 = Panel(line_15)
panel_39 = Panel(line_16)
panel_40 = Panel(line_17)
panel_41 = Panel(line_19)
panel_42 = Panel(line_20)
panel_43 = Panel(line_18)
panel_44 = Panel(line_21)

# ----
list_item_43 = ListItem(List=point_4, Index="24", Wrap=True)
list_item_44 = ListItem(List=point_4, Index="29", Wrap=True)
list_item_45 = ListItem(List=point_4, Index="23", Wrap=True)
list_item_46 = ListItem(List=point_4, Index="26", Wrap=True)
list_item_47 = ListItem(List=point_4, Index="19", Wrap=True)
list_item_48 = ListItem(List=point_4, Index="27", Wrap=True)
list_item_49 = ListItem(List=point_4, Index="24", Wrap=True)
list_item_50 = ListItem(List=point_4, Index="28", Wrap=True)
line_22 = Line(StartPoint=list_item_43, EndPoint=list_item_44)
line_23 = Line(StartPoint=list_item_45, EndPoint=list_item_46)
line_24 = Line(StartPoint=list_item_47, EndPoint=list_item_48)
line_25 = Line(StartPoint=list_item_49, EndPoint=list_item_50)
panel_45 = Panel(line_22)
panel_46 = Panel(line_23)
panel_47 = Panel(line_24)
panel_48 = Panel(line_25)

# ---- group: topology (continued)
merge_2 = Merge(
    Data1=line,
    Data2=line_2,
    Data3=line_3,
    Data4=line_4,
    Data5=line_5,
    Data6=line_6,
    Data7=line_7,
    Data8=line_8,
    Data9=line_9,
    Data10=line_10,
    Data11=line_11,
    Data12=line_12,
    Data13=line_15,
    Data14=line_16,
    Data15=line_20,
    Data16=line_19,
    Data17=line_13,
    Data18=line_14,
    Data19=line_17,
    Data20=line_18,
    Data21=line_21,
    Data22=line_22,
    Data23=line_23,
    Data24=line_24,
    Data25=line_25)

geometry = Geometry(merge_2)

# ----
curve_4 = Curve(geometry)
graphfromnodes_links = GraphFromNodesLinks(Points=P_2, Links=curve_4, Labels=labels, Areas=areas, TotalArea=ta)  # -> Graph, GraphVertices, Attributes
programme = Programme(Attributes=graphfromnodes_links.Attributes)  # -> Tags, Areas, Colors, Legends
G = Integer(graphfromnodes_links.Graph)
gv = GV(graphfromnodes_links.GraphVertices)
att = Data(graphfromnodes_links.Attributes)
legend = Legend(
    Colour=programme.Colors,
    Tags=programme.Legends,
    Rectangle={Plane=PlaneXY(-7.231523162, 51.54212847, 0), Size=Domain2(u=0..11.18919631, v=0..16.33622662)},
    LegendType=1)
G_2 = Integer(G)
att_2 = Data(att)
gv_2 = GV(gv)
forcedirecteddrawing = ForceDirectedDrawing(
    Graph=G_2,
    Vertices=gv_2,
    Attributes=att_2,
    AttractionStrength=st,
    RepulsionStrength=st_2,
    ConvergenceTolearnce=tolerance,
    MaximumIterations=it,
    Active=Toggle(False))  # -> NewGraphVertices, IterationCount
panel_49 = Panel(forcedirecteddrawing.IterationCount)
diskographdrawing = DiskoGraphDrawing(Plane=plane, Graph=G_2, Vertices=forcedirecteddrawing.NewGraphVertices, Attributes=att_2, Thickness=1)

piechart = PieChart(Plane=P, Attributes=graphfromnodes_links.Attributes, Radius=10)

graph_3 = Integer(G)
att_3 = Data(att)
viewpoint = Slider(4, range=0..12)
panel_50 = Panel("Space Syntax Indicators")
integration_analysis_2 = IntegrationAnalysis(Graph=graph_3, Attributes=att_3)  # -> DepthTable, DepthMap, RelativeASymetry, Integration, IntegrationRelativeColors, IntegrationTags
differencefactor = DifferenceFactor(RelativeAsymetries=integration_analysis_2.RelativeASymetry)
panel_51 = Panel(differencefactor)
justifiedgraphdrawing = JustifiedGraphDrawing(
    ViewPointIndex=viewpoint,
    Plane=PlaneXY(35.04896553, 122.851078, 0),
    Size=10,
    Thickness=2,
    Graph=graph_3,
    Attributes=att_3,
    DepthTable=integration_analysis_2.DepthTable)
sort_list = SortList(
    Keys=integration_analysis_2.Integration,
    ValuesValuesA=integration_analysis_2.IntegrationRelativeColors,
    ValuesB=integration_analysis_2.IntegrationTags)  # -> Keys, ValuesValuesA, ValuesB
graph_4 = Integer(graph_3)
att_4 = Data(att_3)
entropy_analysis_2 = EntropyAnalysis(Graph=graph_4, Attributes=att_4, DepthTable=integration_analysis_2.DepthTable, DepthMap=integration_analysis_2.DepthMap)  # -> Entropy, EntropyRelativeColors, EntropyTags
choice_analysis = ChoiceAnalysis(Graph=graph_4, Attributes=att_4)  # -> ShortestPaths, ChoiceBetweenness, ChoiceRelativeColors, ChoiceTags
control_analysis_2 = ControlAnalysis(Graph=graph_4, Attributes=att_4)  # -> Control, ControlRelativeColors, ControlTags
legend_2 = Legend(
    Colour=sort_list.ValuesValuesA,
    Tags=sort_list.ValuesB,
    Rectangle={Plane=PlaneXY(12.76847684, 51.54212847, 0), Size=Domain2(u=0..11.18919631, v=0..16.33622662)},
    LegendType=1)
sort_list_2 = SortList(
    Keys=choice_analysis.ChoiceBetweenness,
    ValuesValuesA=choice_analysis.ChoiceRelativeColors,
    ValuesB=choice_analysis.ChoiceTags)  # -> Keys, ValuesValuesA, ValuesB
sort_list_3 = SortList(
    Keys=control_analysis_2.Control,
    ValuesValuesA=control_analysis_2.ControlRelativeColors,
    ValuesB=control_analysis_2.ControlTags)  # -> Keys, ValuesValuesA, ValuesB
sort_list_4 = SortList(
    Keys=entropy_analysis_2.Entropy,
    ValuesValuesA=entropy_analysis_2.EntropyRelativeColors,
    ValuesB=entropy_analysis_2.EntropyTags)  # -> Keys, ValuesValuesA, ValuesB
shortestpaths = Panel(choice_analysis.ShortestPaths)
legend_3 = Legend(
    Colour=sort_list_2.ValuesValuesA,
    Tags=sort_list_2.ValuesB,
    Rectangle={Plane=PlaneXY(52.76847684, 51.54212847, 0), Size=Domain2(u=0..11.18919631, v=0..16.33622662)},
    LegendType=1)
legend_4 = Legend(
    Colour=sort_list_3.ValuesValuesA,
    Tags=sort_list_3.ValuesB,
    Rectangle={Plane=PlaneXY(32.76847684, 51.54212847, 0), Size=Domain2(u=0..11.18919631, v=0..16.33622662)},
    LegendType=1)
legend_5 = Legend(
    Colour=sort_list_4.ValuesValuesA,
    Tags=sort_list_4.ValuesB,
    Rectangle={Plane=PlaneXY(72.76847684, 51.54212847, 0), Size=Domain2(u=0..11.18919631, v=0..16.33622662)},
    LegendType=1)

curve_5 = Curve(curve_4)
graphfromnodes_linkswithnews = GraphFromNodesLinksWithNEWS(Points=P_2, Links=curve_5, Labels=labels_2, Areas=areas_2, TotalArea=mass_addition_2.Result)  # -> Graph, GraphVertices, Attributes
graphedges = GraphEdges(Graph=graphfromnodes_linkswithnews.Graph, Vertices=graphfromnodes_linkswithnews.GraphVertices)
tutteconvexdrawing = TutteConvexDrawing(
    BasePlane=move.Geometry,
    Graph=graphfromnodes_linkswithnews.Graph,
    Vertices=graphfromnodes_linkswithnews.GraphVertices,
    Attributes=graphfromnodes_linkswithnews.Attributes)  # -> NewGraphVertices, ConvexFaceBorders, SubGraph, SubVertices, SubAttributes
G_3 = Graph(tutteconvexdrawing.SubGraph)
att_5 = Attributes(tutteconvexdrawing.SubAttributes)
gv_3 = Vertices(tutteconvexdrawing.SubVertices)
diskographdrawing_2 = DiskoGraphDrawing(
    Plane=bp,
    Graph=graphfromnodes_linkswithnews.Graph,
    Vertices=tutteconvexdrawing.NewGraphVertices,
    Attributes=graphfromnodes_linkswithnews.Attributes,
    Thickness=3)
triangulatemeshinallways = TriangulateMeshInAllWays(
    TutteOutputVerticesIncludingNEWS=tutteconvexdrawing.NewGraphVertices,
    ConvexFaceBorders=tutteconvexdrawing.ConvexFaceBorders,
    IndexOfTriangulation=triangulation,
    ExcludeDegenerateTINS=exct)  # -> AllTriangularMeshes, TheChosenTriangularMesh
G_4 = Graph(G_3)
gv_4 = Vertices(gv_3)
att_6 = Attributes(att_5)
me = ME(G=triangulatemeshinallways.AllTriangularMeshes)
att_7 = Attributes(att_6)
att_8 = Attributes(att_7)
att_tor = Att_toR(B=scale, att=att_8)  # -> R, M

delaunay_mesh = DelaunayMesh(Points=tutteconvexdrawing.NewGraphVertices, Plane=PlaneXY(0, 0, 0))
point_5 = Point(tutteconvexdrawing.NewGraphVertices)
weaverbird_s_dual_graph = WeaverbirdsDualGraph(MeshCurves=tutteconvexdrawing.ConvexFaceBorders, DualMode=0)
panel_52 = Panel(weaverbird_s_dual_graph)

dualgraph = DualGraph(NEWS_Triangulated_Mesh=delaunay_mesh, SubAttributes=att_5)  # -> DualVertices, DualFaces, DualFaceBorders, DualFaceColors
cellgraph = CellGraph(Cells=dualgraph.DualFaceBorders)  # -> Graph, GraphVertices
surface = Surface(dualgraph.DualFaceBorders)
forcedirecteddrawing_2 = ForceDirectedDrawing(
    Graph=cellgraph.Graph,
    Vertices=gv_4,
    Attributes=att_6,
    AttractionStrength=0.25,
    RepulsionStrength=1.4,
    ConvergenceTolearnce=0.001,
    MaximumIterations=4000,
    Active=Toggle(True))  # -> NewGraphVertices, IterationCount
diskographdrawing_3 = DiskoGraphDrawing(Plane=xy_plane_2, Graph=G_4, Vertices=forcedirecteddrawing_2.NewGraphVertices, Attributes=att_6, Thickness=3)
panel_53 = Panel(forcedirecteddrawing_2.IterationCount)
relocate_vertices = RelocateVertices(BasePLane=xy_plane_2, Vertices=forcedirecteddrawing_2.NewGraphVertices)
weightedvoronoi = WeightedVoronoi(BasePlane=bp, Points=relocate_vertices, Radii=att_tor.R, BoundingCurve=curve_3)  # -> AdjacencyGraph, VoronoiCells
custom_preview_2 = CustomPreview(Geometry=surface, Shader=dualgraph.DualFaceColors)
surface_2 = Surface(weightedvoronoi.VoronoiCells)
custom_preview_3 = CustomPreview(Geometry=surface_2, Shader=att_tor.M)

# ---- group: This is just a funny toy!
rectangulatedual = RectangulateDual(
    BasePolane=move.Geometry,
    DualVertices=dualgraph.DualVertices,
    DualFaces=dualgraph.DualFaces,
    DualFaceBorders=dualgraph.DualFaceBorders)  # -> RectangularVertices, RectangularFaceBorders

# ----
dimensionlessdissection = DimensionLessDissection(
    BasePolane=xy_plane,
    RectangularVertices=rectangulatedual.RectangularVertices,
    RectangularFaceBorders=rectangulatedual.RectangularFaceBorders,
    CellGridSize=Slider(5, range=0..10))
surface_3 = Surface(rectangulatedual.RectangularFaceBorders)
custom_preview_4 = CustomPreview(Geometry=surface_3, Shader=dualgraph.DualFaceColors)
surface_4 = Surface(dimensionlessdissection)
custom_preview_5 = CustomPreview(Geometry=surface_4, Shader=dualgraph.DualFaceColors)

curve_6 = Curve(rectangulatedual.RectangularFaceBorders)
panel_54 = Panel(rectangulatedual.RectangularVertices)

# ==== cluster ME
G = ClusterInput()
Z = UnitZ(Factor=2)
move = Move(Geometry=G, Motion=Z)  # -> Geometry, Transform
face_boundaries = FaceBoundaries(Mesh=move.Geometry)
material = CreateMaterial(
    Diffuse=ColourSwatch(SwatchColor=RGB(71, 71, 71)),
    Specular=RGB(255, 255, 255),
    Emission=RGB(0, 0, 0),
    Transparency=0.5,
    Shine=0)
preview = CustomPreview(Geometry=face_boundaries, Shader=material)

# ==== cluster Att_toR
B = ClusterInput()
att = ClusterInput()
att_2 = Attributes(att)
prgm = Programme(Attributes=att_2)  # -> Tags, Areas, Colors, Legends
expression = Expression(x=prgm.Areas, Expression="Sqrt(x/π)")
multiplication = Multiplication(A=expression, B=B)
material = CreateMaterial(Diffuse=prgm.Colors, Specular=RGB(255, 255, 255), Emission=RGB(0, 0, 0), Transparency=0.5, Shine=0)
M = ClusterOutput(material)
R = ClusterOutput(multiplication)

# ==== cluster RC
V = ClusterInput()
V_2 = Value(V)
bnd = Bounds(Numbers=V_2)
remap = RemapNumbers(Value=V_2, Source=bnd, Target=Domain(0, 1))  # -> Mapped, Clipped
gradient = Gradient(
    LowerLimit=0,
    UpperLimit=1,
    Parameter=remap.Mapped,
    stops=[0: RGB(75, 107, 169), 0.251: RGB(173, 203, 249), 0.5: RGB(254, 244, 84), 0.747: RGB(234, 126, 0), 1: RGB(234, 38, 0)])
C = ClusterOutput(gradient)
