# Grasshopper definition SpacePartition [3].gh (Grasshopper 1.0.7)
# plug-ins: SpacePartition, FloorsAndVolumes, Human, PTComponentLibrary, TT Toolbox, SpaceSyntaxDesign_GH

# ---- group: Progress
spacepartitionnoparallel = CSharpScript()  # -> culledGrid, R, G, B; inputs voronoiIn: list of Polyline, gridIn: list of Polyline, areaIn: Double, seed: Int32; disabled
# ---------- spacepartitionnoparallel: C# usings ----------
using System.Linq;
# ---------- spacepartitionnoparallel: C# ----------
    var intersections = new DataTree<Curve>();
    var bools = new DataTree<bool>();

    for( int i = 0; i < voronoiIn.Count; ++i )
    {

      var voro = voronoiIn[i].ToNurbsCurve();

      for( int j = 0; j < gridIn.Count; ++j )
      {

        intersections.AddRange(Curve.CreateBooleanIntersection(voro, gridIn[j].ToNurbsCurve(), 1e-3).ToList(), new GH_Path(i, j));

      }

    }

    for( int i = 0; i < intersections.BranchCount; ++i )
    {

      var tempList = intersections.Branch(i);
      var path = new GH_Path(intersections.Path(i).Indices[0]);
      bool temp = false;

      if( tempList.Count > 0 )
      {

        var area = AreaMassProperties.Compute(intersections.Branch(i)[0]).Area;

        temp = area < areaIn ? false : true;

        bools.Add(temp, path);

      }

      else
      {

        temp = false;
        bools.Add(temp, path);

      }

    }

    var treeOut = new DataTree<Polyline>();
    var coloursOutR = new DataTree<int>();
    var coloursOutG = new DataTree<int>();
    var coloursOutB = new DataTree<int>();
    //var coloursOut = new DataTree<System.Drawing.Color>();
    var rand = new Random(seed);

    for( int i = 0; i < bools.BranchCount; ++i )
    {

      var path = intersections.Path(i);

      coloursOutR.Add(rand.Next(0, 255), path);
      coloursOutG.Add(rand.Next(0, 255), path);
      coloursOutB.Add(rand.Next(0, 255), path);
      //coloursOut.Add( System.Drawing.Color.FromArgb( 255, rand.Next( 0, 255 ), rand.Next( 0, 255 ), rand.Next( 0, 255 ) ), path );

      for( int j = 0; j < bools.Branch(i).Count; ++j )
      {

        if( bools.Branch(i)[j] == true )
        {

          treeOut.Add(gridIn[j], path);

        }

      }

    }

    culledGrid = treeOut;
    R = coloursOutR;
    G = coloursOutG;
    B = coloursOutB;
    //R = coloursOut;
# ---------- end spacepartitionnoparallel ----------
number_slider = Slider(4051, range=0..10000)  # disabled
missinggridcells = CSharpScript()  # -> missing, places; inputs culledGrid: list of Polyline, originalGrid: list of Polyline; disabled
# ---------- missinggridcells: C# ----------
    List<Polyline> polys = new List<Polyline>();

    var temp = new List<Polyline>();

    int place = 0;
    
    List<int> placesL = new List<int>();

    int oGridC = originalGrid.Count;
    int cGridC = culledGrid.Count;

    int iter = oGridC - cGridC;

    for( int i = 0; i < iter; ++i )
    {

      polys.Add(BailOut(originalGrid, culledGrid, out place));
      culledGrid.Insert(place, originalGrid[place]);
      placesL.Add( place );

    }

    missing = polys;

    places = placesL;
# ---------- missinggridcells: C# additional code ----------
  Polyline BailOut(List<Polyline> originalGrid, List<Polyline> culledGrid, out int place)
  {

    place = 0;

    int oGridC = originalGrid.Count;
    int cGridC = culledGrid.Count;

    int iter = oGridC - cGridC;

    var tempPoly = new Polyline();

    var polysOut = new Polyline[iter];

    var cCenters = new Point3d[oGridC];
    var oCenters = new Point3d[oGridC];

    var distances = new int[oGridC];

    for( int i = place + 1; i < oGridC; ++i )
    {

      oCenters[i] = AreaMassProperties.Compute(originalGrid[i].ToNurbsCurve()).Centroid;

      if( i < cGridC )

        cCenters[i] = AreaMassProperties.Compute(culledGrid[i].ToNurbsCurve()).Centroid;

      else
      {

        cCenters[i] = Point3d.Unset;

      }

      distances[i] = oCenters[i].CompareTo(cCenters[i]);

      if( distances[i] != 0 )
      {

        tempPoly = originalGrid[i];

        place = i;

        break;

      }

    }

    return tempPoly;

  }
# ---------- end missinggridcells ----------
spacepartitionallparallel = CSharpScript()  # -> simplify(culledGrid); inputs voronoiIn: list of Curve, gridIn: list of Curve, areaIn: Double; disabled
# ---------- spacepartitionallparallel: C# ----------
    int voronoiCount = voronoiIn.Count;
    int gridCount = gridIn.Count;

    Curve[][][] tempJagged = new Curve[voronoiCount][][];
    bool[][] boolJagged = new bool[voronoiCount][];
    var treeOut = new DataTree<Curve>();

    bool temp = false;
    double area = 0.0;

    System.Threading.Tasks.Parallel.For( 0, voronoiCount, i =>
    {

      var path = new GH_Path(i);

      var voro = voronoiIn[i];

      tempJagged[i] = new Curve[gridCount][];
      boolJagged[i] = new bool[gridCount];

      System.Threading.Tasks.Parallel.For(0, gridCount, j =>
        {

        tempJagged[i][j] = Curve.CreateBooleanIntersection(voro, gridIn[j].ToNurbsCurve(), 1e-8);

        if( tempJagged[i][j].Length > 0 )
        {

          area = AreaMassProperties.Compute(tempJagged[i][j][0]).Area;

          temp = area < areaIn ? false : true;

          boolJagged[i][j] = temp;

        }

        else
        {

          boolJagged[i][j] = false;

        }

        });

    });
    
    for( int i = 0; i < boolJagged.Length; ++i )
      for( int j = 0; j < boolJagged[i].Length; ++j )
      {

        if( boolJagged[i][j] == true )
        {

          treeOut.Add(gridIn[j]);


        }

      }

    culledGrid = treeOut;
# ---------- end spacepartitionallparallel ----------
spacepartitioninternalparallel = CSharpScript()  # -> simplify(culledGrid); inputs voronoiIn: list of Curve, gridIn: list of Curve, areaIn: Double; disabled
# ---------- spacepartitioninternalparallel: C# ----------
    int voronoiCount = voronoiIn.Count;
    int gridCount = gridIn.Count;

    Curve[][][] tempJagged = new Curve[voronoiCount][][];
    bool[][] boolJagged = new bool[voronoiCount][];
    var treeOut = new DataTree<Curve>();

    bool temp = false;
    double area = 0.0;

    for( int i = 0; i < voronoiCount; ++i )
    {

      var path = new GH_Path(i);

      var voro = voronoiIn[i];

      tempJagged[i] = new Curve[gridCount][];
      boolJagged[i] = new bool[gridCount];

      System.Threading.Tasks.Parallel.For(0, gridCount, j =>
        {

        tempJagged[i][j] = Curve.CreateBooleanIntersection(voro, gridIn[j].ToNurbsCurve(), 1e-8);

        if( tempJagged[i][j].Length > 0 )
        {

          area = AreaMassProperties.Compute(tempJagged[i][j][0]).Area;

          temp = area < areaIn ? false : true;

          boolJagged[i][j] = temp;

        }

        else
        {

          boolJagged[i][j] = false;

        }

        });

      for( int j = 0; j < boolJagged[i].Length; ++j )
      {

        if( boolJagged[i][j] == true )
        {

          treeOut.Add(gridIn[j]);


        }

      }
      
    }

    culledGrid = treeOut;
# ---------- end spacepartitioninternalparallel ----------
parallelregionintersection = CSharpScript()  # -> out, A; inputs CurvesA: list of Curve, CurvesB: list of Curve; disabled
# ---------- parallelregionintersection: C# ----------
    Curve[][][] tempJagged = new Curve[CurvesA.Count][][];
    var treeOut = new List<Curve>();

    for( int i = 0; i < CurvesA.Count; ++i )
    {

      var voro = CurvesA[i];

      tempJagged[i] = new Curve[CurvesB.Count][];

      System.Threading.Tasks.Parallel.For(0, CurvesB.Count, j =>
        {

        tempJagged[i][j] = Curve.CreateBooleanIntersection(voro, CurvesB[j], 1e-3);

        });

      for( int j = 0; j < tempJagged[i].Length; ++j )
      {

        for( int k = 0; k < tempJagged[i][j].Length; ++k )
        {

          var path = new GH_Path(i);

          treeOut.Add(tempJagged[i][j][k]);


        }

      }

    }

    A = treeOut;
# ---------- end parallelregionintersection ----------

# ---- group: InputData / Labels
text = Text(Tree({0;0}: ["Unidades sanitarias mujeres / privadas"], {0;1}: ["Unidades sanitarias hombres / privadas"], {0;2}: ["Cuarto de aseo "], {0;3}: ["Área de aseo de residuos"], {0;4}: ["Almacen General Insumos de Aseo "], {0;5}: ["Área de UPC-Rack"]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))

# ---- group: InputData / Topology
integer = Integer(Tree({0}: [7], {1}: [7], {2}: [3], {3}: [2, 11], {4}: [16, 21, 19], {5}: [19]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))

# ---- group: InputData / ID
text_2 = Text(Tree({0;0}: ["5"], {0;1}: ["5"], {0;2}: ["5"], {0;3}: ["5"], {0;4}: ["5"], {0;5}: ["5"]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))

# ---- group: InputData / Areas
text_3 = Text(Tree({0;0}: ["3"], {0;1}: ["3"], {0;2}: ["6"], {0;3}: ["1"], {0;4}: ["5"], {0;5}: ["4"]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))

# ---- group: InputData
number_slider_2 = Slider(1, range=0..10)
path_mapper = PathMapper(text, source="{A;B}", target="{A}")
path_mapper_2 = PathMapper(text_3, source="{A;B}", target="{A}")
path_mapper_3 = PathMapper(integer, source="{A;B}", target="{A}")
path_mapper_4 = PathMapper(text_2, source="{A;B}", target="{A}")
prunebranches = CSharpScript(branches=path_mapper, howMany=number_slider_2)  # -> prunedTree, branchCounter; inputs branches: tree of String, howMany: Int32
# ---------- prunebranches: C# ----------
    var treeOut = new DataTree<string>();

    for( int i = 0; i < branches.BranchCount - howMany; ++i )
      treeOut.AddRange(branches.Branch(i), new GH_Path(i));

    prunedTree = treeOut;
    branchCounter = treeOut.BranchCount;
# ---------- end prunebranches ----------
prunebranches_2 = CSharpScript(branches=path_mapper_2, howMany=number_slider_2)  # -> prunedTree, branchCounter; inputs branches: tree of String, howMany: Int32; same code as prunebranches
mass_addition = MassAddition(Input=prunebranches_2.prunedTree)  # -> Result, PartialResults
flatten_tree = FlattenTree(Tree=prunebranches_2.prunedTree, Path="{0}")
list_length = ListLength(List=flatten_tree)
integer_2 = Integer(Slider(4, range=0..10))

# ---- group: Grid / Controllers
number_slider_3 = Slider(20, range=0..21)
number_slider_4 = Slider(4, range=0..5)
division = Division(A=number_slider_3, B=Slider(3, range=0..10))
division_2 = Division(A=number_slider_4, B=Slider(1, range=0..30))
number_slider_5 = Slider(0, range=0..1)  # disabled

# ----
point = Point(Point(-30.22731102, -18.72041778, 0))
point_2 = Point(Point(-23.83729354, 16.36997504, 0))

# ---- group: Voronoi / Controllers
seedsx = GenePool(Decimals=2, Maximum=0.9, Minimum=0.1, Value=[0.75, 0.52, 0.15, 0.47])
seedsy = GenePool(Decimals=2, Maximum=0.9, Minimum=0.1, Value=[0.31, 0.14, 0.47, 0.82])

# ----
colour_rgb = ColourRGB(Alpha=255, Red=Slider(1000, range=0..1000), Green=Slider(0, range=0..1000), Blue=Slider(0, range=0..1000))
number = Number(mass_addition.Result)
number_slider_6 = Slider(0.001, range=0..0.001)  # disabled
number_slider_7 = Slider(871, range=0..1000)  # disabled
list_item = ListItem(Index=number_slider_7, Wrap=True)  # -> Item, Item1; disabled

# ---- group: SpacePartition / OriginalSilhouette
curve = Curve(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)

# ---- group: SpacePartition / RandomColourSeed
number_slider_8 = Slider(33, range=0..100)
number_slider_9 = Slider(334, range=0..1000)
number_slider_10 = Slider(326, range=0..1000)

# ----
number_slider_11 = Slider(2.1159, range=0..3)  # disabled

# ---- group: AddAreaForCirculation
multiplication = Multiplication(A=number, B=0.3)
addition = Addition(A=number, B=multiplication)  # -> simplify(Result)

# ----
expression = Expression(x=flatten(addition), y=number_slider_11, Expression="sqrt(x*y/pi)")  # disabled
rectangle = Rectangle({Plane=PlaneXY(-26.68822757, 1.845959791, 0), Size=Domain2(u=-13.82335614..13.82335614, v=-24.68887624..24.68887624)})  # disabled
number_slider_12 = Slider(0.5, range=0..1)  # disabled
integer_3 = Integer(Tree({0}: [25], {1}: [8, 9, 10], {2}: [6, 25, 3], {3}: [2, 22], {4}: [24, 11, 19, 22], {5}: [17, 18, 19, 24, 23]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))
number_slider_13 = Slider(0, range=0..10)  # disabled
panel = Panel("""0: Privado
1: Privado
2: Público
3: SemiPrivado""")
text_4 = Text(prunebranches.prunedTree)
graft_tree = GraftTree(Tree=panel, IncludeEmptyLists=True, IncludeNullItems=True)  # -> simplify(Tree)
graft_tree_2 = GraftTree(Tree=text_4, IncludeEmptyLists=True, IncludeNullItems=True)
flatten_tree_2 = FlattenTree(Path="{0}")  # disabled
addindextolabels = CSharpScript(labels=graft_tree_2)  # -> indexedLabels; inputs labels: tree of String
# ---------- addindextolabels: C# ----------
    var newLabels = new DataTree<string>();
    
    for( int i = 0; i < labels.BranchCount; ++i )
      for( int j = 0; j < labels.Branch(i).Count; ++j )
      {
      
        newLabels.Add( i.ToString() + " " + labels.Branch(i)[j], new GH_Path(i) );
      
      }
    
    indexedLabels = newLabels;
# ---------- end addindextolabels ----------
list_length_2 = ListLength(List=flatten_tree_2)  # disabled
panel_2 = Panel(list_length_2)  # disabled
galapagos = Galapagos(fitness=mass_addition_3, gene=[seedsx, seedsy])

# ---- group: Perlin
number_slider_14 = Slider(22, range=0..100)  # disabled
number_slider_15 = Slider(4, range=0..10)  # disabled
number_slider_16 = Slider(0, range=0..100)  # disabled
construct_domain = ConstructDomain(DomainStart=number_slider_16, DomainEnd=number_slider_15)  # disabled
number_slider_17 = Slider(4, range=0..10)  # disabled
genepoolmodifier = GenePoolModifier(GeneList="Weights", Count=expr("x+1", number_slider_14), Domain=construct_domain)  # disabled
number_slider_18 = Slider(4, range=0..10)  # disabled
number_slider_19 = Slider(69, range=0..1000)  # disabled
number_slider_20 = Slider(3.2, range=0..10)  # disabled
number_slider_21 = Slider(0.430667, range=0..1)  # disabled
number_slider_22 = Slider(13.910642, range=0..100)  # disabled
number_slider_23 = Slider(32.088268, range=0..100)  # disabled
knot_vector = KnotVector(Count=expr("x+1", number_slider_14), Degree=number_slider_17, Periodic=False)  # disabled
weights = GenePool(Decimals=2, Maximum=4, Minimum=0, Value=[2, 2, 2, 2, 2, 2, 2, 2, 2, 2, 2, 2, 2, 2, 2, 2, 2, 2, 2, 2, 2, 2, 2])  # disabled
number_slider_24 = Slider(1000, range=0..1000)  # disabled
number_slider_25 = Slider(0, range=0..1000)  # disabled
number_slider_26 = Slider(0, range=0..1000)  # disabled
colour_rgb_2 = ColourRGB(Alpha=255, Red=number_slider_24, Green=number_slider_25, Blue=number_slider_26)  # disabled
number_slider_27 = Slider(3.01, range=0..10)  # disabled

# ---- group: Voronoi
number_slider_28 = Slider(0.1, range=0..0.1)
subtraction = Subtraction(A=Slider(1, range=0..1), B=number_slider_28)
dom = ConstructDomain(DomainStart=number_slider_28, DomainEnd=subtraction)
genemodifier = GenePoolModifier(GeneList="SeedsX", Count=integer_2, Domain=dom)
genemodifier_2 = GenePoolModifier(GeneList="SeedsY", Count=integer_2, Domain=dom)
pt = ConstructPoint(XCoordinate=seedsx, YCoordinate=seedsy, ZCoordinate=0)

# ---- group: Grid
dom_2 = ConstructDomain(DomainStart=expr("-x", number_slider_3), DomainEnd=number_slider_3)
dom_3 = ConstructDomain(DomainStart=expr("-x", number_slider_4), DomainEnd=number_slider_4)
point_3 = Point(Point(-27.55069635, 0.2364199029, 0))
deconstruct_domain = DeconstructDomain(Domain=dom_2)  # -> Start, End
rectangle_2 = Rectangle(Plane=point_3, XSize=dom_3, YSize=dom_2, Radius=0)  # -> Rectangle, Length
crv = Curve(rectangle_2.Rectangle)
ptsrfdomlen = SurfaceDomainLength(Surface=crv, ULength=division_2, VLength=division)
ptborders = GenerateBorders(Grid=ptsrfdomlen, PanelShape=0)  # -> simplify(Border)
crv_2 = Curve(flatten(ptborders))
area = Area(Geometry=ptborders, UseTasks=False)  # -> Area, Centroid

# ---- group: Perlin (continued)
range = Range(Domain=dom_2, Steps=number_slider_14)  # disabled
perlinnoise = CSharpScript(x=range, fre=number_slider_20, amp=number_slider_21, iter=number_slider_18, t=number_slider_23, seed=number_slider_19)  # -> out, A; inputs x: Double, fre: Double, amp: Double, iter: Int32, t: Double, seed: Int32; disabled
# ---------- perlinnoise: C# ----------
    //time+=1e-7;
    
    A = fbm(new vec3(x, 0, 0) + t, fre, amp, iter, seed);
# ---------- perlinnoise: C# additional code ----------
  //double time = 0;
  
  double hash(double a, int seed)
  {

    //return fract(Math.Sin(a) * 4513.15);
    var rand = new Random( seed );
    return rand.NextDouble() * ( 1.0 + 1.0 ) - 1.0;

  }

  double noise(vec3 x, int seed)
  {

    vec3 p = x.floor();
    vec3 k = x.fract();

    k *= k * k * ( 3.0 - 2.0 * k );

    double n = p.X() + p.Y() * 57.0 + p.Z() * 113.0;

    double a = hash(n, seed);
    double b = hash(n + 1.0, seed);
    double c = hash(n + 57.0, seed);
    double d = hash(n + 58.0, seed);

    double e = hash(n + 113.0, seed);
    double f = hash(n + 114.0, seed);
    double g = hash(n + 170.0, seed);
    double h = hash(n + 171.0, seed);

    double res = vec3.mix(vec3.mix(vec3.mix(a, b, k.X()), vec3.mix(c, d, k.X()), k.Y()),
      vec3.mix(vec3.mix(e, f, k.X()), vec3.mix(g, h, k.X()), k.Y()),
      k.Z()
      );

    return res;

  }

  double fbm(vec3 f, double freq, double ampl, int iter, int seed)
  {

    double amp = 1.0, fre = 1.7, res = 0.0;

    for( int i = 0; i < iter; ++i )
    {

      amp *= ampl;
      fre *= freq;

      amp += amp;

      res += amp * noise(fre * f, seed);

    }

    return res;

  }

  class vec3
  {

    double x, y, z;

    public vec3(double x, double y, double z)
    {

      this.x = x;
      this.y = y;
      this.z = z;

    }

    public vec3(Point3d point)
    {

      this.x = point.X;
      this.y = point.Y;
      this.z = point.Z;

    }

    public double X()
    {

      return x;

    }

    public double Y()
    {

      return y;

    }

    public double Z()
    {

      return z;

    }

    // Addition operator overload.
    public static vec3 operator+( vec3 x, vec3 y )
    {

      return new vec3(x.X() + y.X(), x.Y() + y.Y(), x.Z() + y.Z());

    }

    public static vec3 operator+( vec3 x, double y )
    {

      return new vec3(x.X() + y, x.Y() + y, x.Z() + y);

    }

    public static vec3 operator+( double y, vec3 x )
    {

      return new vec3(y + x.X(), y + x.Y(), y + x.Z());

    }

    // Subtraction operator overload.
    public static vec3 operator-( vec3 x, vec3 y )
    {

      return new vec3(x.X() - y.X(), x.Y() - y.Y(), x.Z() - y.Z());

    }

    public static vec3 operator-( vec3 x, double y )
    {

      return new vec3(x.X() - y, x.Y() - y, x.Z() - y);

    }

    public static vec3 operator-( double y, vec3 x )
    {

      return new vec3(y - x.X(), y - x.Y(), y - x.Z());

    }

    // Multiplication operator overload.
    public static vec3 operator*( vec3 x, vec3 y )
    {

      return new vec3(x.X() * y.X(), x.Y() * y.Y(), x.Z() * y.Z());

    }

    public static vec3 operator*( vec3 x, double y )
    {

      return new vec3(x.X() * y, x.Y() * y, x.Z() * y);

    }

    public static vec3 operator*( double y, vec3 x )
    {

      return new vec3(y * x.X(), y * x.Y(), y * x.Z());

    }

    // Fractional part of a vec3.
    public vec3 fract()
    {

      return new vec3(fract(x), fract(y), fract(y));

    }

    // Floor.
    public vec3 floor()
    {

      return new vec3(Math.Floor(x), Math.Floor(y), Math.Floor(z));

    }

    // Fractional part of a double.
    public double fract(double x)
    {

      return x - Math.Truncate(x);

    }

    // Linear interpolation of a double.
    public static double mix(double a, double b, double c)
    {

      return a - ( 1 - c ) + b * c;

    }

    // Linear interpolation of a vec3.
    public static vec3 mix(vec3 a, vec3 b, double c)
    {

      double mixX = mix(a.X(), b.X(), c);
      double mixY = mix(a.Y(), b.Y(), c);
      double mixZ = mix(a.Z(), b.Y(), c);

      return new vec3(mixX, mixY, mixZ);

    }

    public Point3d toPoint()
    {

      return new Point3d(this.X(), this.Y(), this.Z());

    }

  }

  public double fract(double x)
  {

    return x - Math.Truncate(x);

  }
# ---------- end perlinnoise ----------
construct_point = ConstructPoint(XCoordinate=perlinnoise.A, YCoordinate=range, ZCoordinate=0)  # disabled
list_item_2 = ListItem(List=construct_point, Index=0, Wrap=True)  # disabled
unit_y = UnitY(Factor=deconstruct_domain.Start)  # disabled
move = Move(Geometry=point_3, Motion=unit_y)  # -> Geometry, Transform; disabled
vector_2pt = Vector2Pt(PointA=list_item_2, PointB=move.Geometry, Unitize=False)  # -> Vector, Length; disabled
move_2 = Move(Geometry=construct_point, Motion=vector_2pt.Vector)  # -> Geometry, Transform; disabled
nurbs_curve_pwk = NurbsCurvePWK(Points=move_2.Geometry, Weights=weights, Knots=knot_vector)  # -> Curve, Length, Domain; disabled
custom_preview_lineweights = CustomPreviewLineweights(Geometry=nurbs_curve_pwk.Curve, Shader=colour_rgb_2, Thickness=number_slider_27, Absolute=False)  # disabled

# ----
pointtoclosestpath = CSharpScript(grid=ptsrfdomlen, point=point)  # -> xOut, yOut; inputs grid: tree of Point3d, point: Point3d; disabled
# ---------- pointtoclosestpath: C# ----------
    int branchCount = grid.BranchCount;

    double minDistance = double.MaxValue;

    CustomPair cp;

    GH_Path path = new GH_Path();

    for( int i = 0; i < branchCount; ++i )
    {

      for( int j = 0; j < grid.Branch(i).Count; ++j )
      {

        double localDistance = point.DistanceTo(grid.Branch(i)[j]);
        cp.Key = localDistance;
        cp.Path = new GH_Path(i, j);
        minDistance = Math.Min(minDistance, localDistance);

        if( ( cp.Key - minDistance ) < 0.001 )
        {

          path = cp.Path;

        }

      }

    }

    xOut = path.Indices[0];
    yOut = path.Indices[1];
# ---------- pointtoclosestpath: C# additional code ----------
  struct CustomPair
  {

    public double Key;
    public GH_Path Path;

  }
# ---------- end pointtoclosestpath ----------
pointtoclosestpath_2 = CSharpScript(grid=ptsrfdomlen, point=point_2)  # -> xOut, yOut; inputs grid: tree of Point3d, point: Point3d; disabled; same code as pointtoclosestpath
closestptgrid = ClosestPointInGrid(Grid=ptsrfdomlen, Point=point)  # -> ClosestPointInGrid, BranchOfGrid, LeafOfGrid
closestptgrid_2 = ClosestPointInGrid(Grid=ptsrfdomlen, Point=point_2)  # -> ClosestPointInGrid, BranchOfGrid, LeafOfGrid
shortorto = ShortestPathOrthogonal(
    Grid=ptsrfdomlen,
    StartPointBranch=closestptgrid.BranchOfGrid,
    StartPointLeaf=closestptgrid.LeafOfGrid,
    EndPointBranch=closestptgrid_2.BranchOfGrid,
    EndPointLeaf=closestptgrid_2.LeafOfGrid)
pathfinding = CSharpScript(
    grid=ptsrfdomlen,
    idx=pointtoclosestpath.xOut,
    idj=pointtoclosestpath.yOut,
    fidx=pointtoclosestpath_2.xOut,
    fjdx=pointtoclosestpath_2.yOut)  # -> points; inputs grid: tree of Point3d, idx: Int32, idj: Int32, fidx: Int32, fjdx: Int32; disabled
# ---------- pathfinding: C# ----------
    int branchCount = grid.BranchCount;
    int maxTreeBranchCount = grid.Branch(branchCount - 1).Count;

    int x = idx % branchCount, y = idj % maxTreeBranchCount;

    Point3d tempPoint = new Point3d();
    Point3d point = grid.Branch(x)[y];
    Point3d finalPoint = grid.Branch(fidx % branchCount)[fjdx % maxTreeBranchCount];
    List<Point3d> tempList = new List<Point3d>();
    double minDistance = double.MaxValue;
    //var keyValuePair = new KeyValuePair<double, Point3d>();

    tempList.Add(point);

    CustomPair customPair;

    GH_Path path = new GH_Path();

    while( tempPoint.CompareTo(finalPoint) != 0 )
    {

      for( int xx = x - 1; xx < x + 2; ++xx )
        //System.Threading.Tasks.Parallel.For(x - 1, x + 2, xx =>
      {

        for( int yy = y - 1; yy < y + 2; ++yy )
          //System.Threading.Tasks.Parallel.For(y - 1, y + 2, yy =>
        {

          if( xx >= 0 && xx < branchCount && yy >= 0 && yy < maxTreeBranchCount )
          {

            double localDistance = finalPoint.DistanceTo(grid.Branch(xx)[yy]);

            customPair.Key = localDistance;
            customPair.Value = grid.Branch(xx)[yy];
            customPair.Path = new GH_Path(xx, yy);

            minDistance = Math.Min(minDistance, localDistance);

            if( ( customPair.Key - minDistance ) < 0.01 )
            {

              tempPoint = customPair.Value;
              path = customPair.Path;

            }

          }

        }

      }

      x = path.Indices[0];
      y = path.Indices[1];

      tempList.Add(tempPoint);

    }

    Print("Path: " + path.ToString());

    points = tempList;
# ---------- pathfinding: C# additional code ----------
  struct CustomPair
  {

    public double Key;
    public Point3d Value;
    public GH_Path Path;

  }
# ---------- end pathfinding ----------

# ---- group: Voronoi (continued)
evalsrf = EvaluateSurface(Surface=reparameterize(crv), Point=pt)  # -> Point, Normal, UDirection, VDirection, Frame
pt_2 = Point(evalsrf.Point)
voronoi = Voronoi(Points=pt_2, Boundary=rectangle_2.Rectangle, BruteForceOverride=False)

# ----
polyline = PolyLine(Vertices=pathfinding, Closed=False)  # disabled

# ---- group: Circulation
collision_one_many = CollisionOneMany(Collider=nurbs_curve_pwk.Curve, Obstacles=graft(crv_2))  # -> Collision, Index; disabled
cull_pattern = CullPattern(List=crv_2, CullPattern=flatten(collision_one_many.Collision))  # disabled
parallelregionunion = ParallelRegionUnion(Curves=cull_pattern)  # disabled
parallelregionintersection_2 = ParallelRegionIntersection(CurvesA=curve, CurvesB=parallelregionunion)  # disabled
surface = Surface(parallelregionintersection_2)  # disabled
colour_rgb_f = ColourRGBF(Alpha=1, Red=0, Green=0, Blue=0)  # disabled
custom_preview = CustomPreview(Geometry=surface, Material=colour_rgb_f)  # disabled

# ---- group: Grid (continued)
curve_attraction = CurveAttraction(Grid=ptsrfdomlen, CrvAtts=nurbs_curve_pwk.Curve, Magnitude=number_slider_5)  # -> Grid, Weights; disabled

# ----
custom_preview_lineweights_2 = CustomPreviewLineweights(Geometry=shortorto, Shader=colour_rgb, Thickness=Slider(5, range=0..10), Absolute=False)

# ---- group: ManhattanVoronoi
number_slider_29 = Slider(10, range=0..10)  # disabled
ghpython_script = GhPythonScript(r=number_slider_29, P=evalsrf.Point)  # -> out, PL; inputs P: list of Point3d; disabled
# ---------- ghpython_script: Python ----------
__author__ = "Paula"
__version__ = "2019.04.23"

import rhinoscriptsyntax as rs
from Rhino.Geometry import Point3d as P3
from Rhino.Geometry import Polyline as PLine

def taxicab_midnormal ( Point_1 = P3(0,0,0), Point_2 = P3(0,0,0) , leng = 10000):
    dx = abs(Point_1.X - Point_2.X)
    dy = abs(Point_1.Y - Point_2.Y)
    
    C = P3 ( ( Point_1.X + Point_2.X ) / 2, ( Point_1.Y + Point_2.Y ) / 2, ( Point_1.Z + Point_2.Z ) / 2)
    
    """ MPQN, in which M is on the lengeft(X-) or bottom(Y-) """
    P = P3 (0,0,C.Z)
    Q = P3 (0,0,C.Z)
    M = P3 (0,0,C.Z)
    N = P3 (0,0,C.Z)
    
    if dx > dy:
        P.Y = C.Y + dy / 2
        Q.Y = C.Y - dy / 2
        M.Y = P.Y + leng
        N.Y = Q.Y - leng
        if bool(Point_1.Y > Point_2.Y) ^ bool(Point_1.X > Point_2.X):
            P.X = C.X + dy / 2
            Q.X = C.X - dy / 2
        else:
            P.X = C.X - dy / 2
            Q.X = C.X + dy / 2
        M.X = P.X
        N.X = Q.X
    else:
        if dx < dy:
            P.X = C.X + dx / 2
            Q.X = C.X - dx / 2
            M.X = P.X + leng
            N.X = Q.X - leng
            if bool(Point_1.Y > Point_2.Y) ^ bool(Point_1.X > Point_2.X):
                P.Y = C.Y + dx / 2
                Q.Y = C.Y - dx / 2
            else:
                P.Y = C.Y - dx / 2
                Q.Y = C.Y + dx / 2
            M.Y = P.Y
            N.Y = Q.Y
        else:
            if bool(Point_1.Y > Point_2.Y) ^ bool(Point_1.X > Point_2.X):
                P.Y = C.Y - dx / 2
                Q.Y = C.Y + dx / 2
                P.X = C.X - dy / 2
                Q.X = C.X + dy / 2
                M.Y = P.Y - leng
                M.X = P.X - leng
                N.Y = Q.Y + leng
                N.X = Q.X + leng
            else:
                P.Y = C.Y - dx / 2
                Q.Y = C.Y + dx / 2
                P.X = C.X + dy / 2
                Q.X = C.X - dy / 2
                M.Y = P.Y - leng
                M.X = P.X + leng
                N.Y = Q.Y + leng
                N.X = Q.X - leng

    return rs.AddPolyline( [M , P , Q , N] )

def taxicab_circle ( point = P3(0,0,0), r = 1 ):
    A = P3( point.X + r, point.Y, point.Z )
    B = P3( point.X, point.Y + r, point.Z )
    C = P3( point.X - r, point.Y, point.Z )
    D = P3( point.X, point.Y - r, point.Z )
    return rs.AddPolyline( [A, B, C, D, A] )

l = 2 * r

""" PL = taxicab_midnormal ( A, B, r ) """

pts = P

polylines = []
for i in range( len( P ) ):
    polylines.append(taxicab_circle( P[i], l ))

for i in range(len(polylines)):
    for j in range(i):
        if i == j:
            continue
        if rs.CurveBooleanUnion( [ polylines[i], polylines[j] ] ):
            MN = taxicab_midnormal( pts[i], pts[j], l )
            
            ccx = rs.CurveCurveIntersection( polylines[i], MN )
            if ccx is None:
                continue
            if ccx[0][0] == 2:
                continue
            para_a = [ ccx[0][5], ccx[1][5] ]
            para_b = [ ccx[0][7], ccx[1][7] ]
            
            if para_b[0] > para_b[1]:
                para_b = [ para_b[1], para_b[0] ]
            
            probable_dash = rs.SplitCurve(polylines[i], para_a)
            edge = rs.TrimCurve(MN, para_b, False )
            edgepts = rs.CurvePoints(edge)
            
            for crv in probable_dash:
                crvpts = rs.CurvePoints(crv)
                if rs.PointCompare( crvpts[0], edgepts[0] ):
                    crvpts.reverse()
                newpl = rs.AddPolyline( edgepts + crvpts )
                if rs.PointInPlanarClosedCurve( pts[i], newpl ):
                    polylines[i] = newpl
                    break
            
            
            ccx = rs.CurveCurveIntersection( polylines[j], MN )
            if ccx is None:
                continue
            para_a = [ ccx[0][5], ccx[1][5] ]
            para_b = [ ccx[0][7], ccx[1][7] ]
            
            if para_b[0] > para_b[1]:
                para_b = [ para_b[1], para_b[0] ]
            
            probable_dash = rs.SplitCurve(polylines[j], para_a)
            edge = rs.TrimCurve(MN, para_b, False )
            edgepts = rs.CurvePoints(edge)
            
            for crv in probable_dash:
                crvpts = rs.CurvePoints(crv)
                if rs.PointCompare( crvpts[0], edgepts[0] ):
                    crvpts.reverse()
                newpl = rs.AddPolyline( edgepts + crvpts )
                if rs.PointInPlanarClosedCurve( pts[j], newpl ):
                    polylines[j] = newpl
                    break
    

PL = polylines
# ---------- end ghpython_script ----------
region_intersection = RegionIntersection(CurvesA=ghpython_script.PL)  # disabled
curve_2 = Curve(region_intersection)  # disabled
surface_2 = Surface(curve_2)  # disabled

# ----
curve_3 = Curve(voronoi)
surface_3 = Surface(curve_3)
area_2 = Area(Geometry=crv_2, UseTasks=False)  # -> Area, Centroid
sort_list = SortList(Keys=area_2.Area, ValuesValuesA=area_2.Area)  # -> Keys, ValuesValuesA; disabled
list_length_3 = ListLength(List=sort_list.ValuesValuesA)  # disabled
subtraction_2 = Subtraction(A=list_length_3, B=1)  # disabled
list_item_3 = ListItem(List=area_2.Area, Index=Slider(0, range=0..50), Wrap=True)
multiplication_2 = Multiplication(A=list_item_3, B=Slider(0.6, range=0..1))
weightedvoronoi = WeightedVoronoi(BasePlane=PlaneXY(0, 0, 0), Points=evalsrf.Point, Radii=expression, BoundingCurve=rectangle)  # -> AdjacencyGraph, VoronoiCells; disabled
curve_4 = Curve(weightedvoronoi.VoronoiCells)  # disabled
list_length_4 = ListLength(List=crv_2)  # disabled
expression_2 = Expression(x=list_length_4, y=list_length_2, Expression="If( x ≠ y, False, True )")  # disabled
panel_3 = Panel(expression_2)  # disabled

# ---- group: AddMissingCells
curve_5 = Curve(crv_2)
cluster = Cluster(gridcells=curve_5)

# ---- group: SpacePartition
documenttolerance = CSharpScript()  # -> A; disabled
# ---------- documenttolerance: C# ----------
    A = Rhino.RhinoDoc.ActiveDoc.ModelAbsoluteTolerance;
# ---------- end documenttolerance ----------
spacepartition = SpacePartition(VoronoiIn=curve_3, GridIn=crv_2, AreaIn=multiplication_2, Tolerance=Slider(0.1, range=0..1))
parallelregionunion_2 = ParallelRegionUnion(Curves=spacepartition)
path_mapper_5 = PathMapper(parallelregionunion_2, source="{A;B}", target="{A}")
construct_domain_2 = ConstructDomain(DomainStart=Slider(0, range=0..100), DomainEnd=Slider(255, range=0..1000))

# ---- group: AddMissingCells (continued)
curve_6 = Curve(flatten(spacepartition))
area_3 = Area(Geometry=path_mapper_5, UseTasks=False)  # -> Area, Centroid

# ----
cluster_2 = Cluster(gridcells=curve_6)

# ---- group: AddMissingCells (continued)
sanitycheck = CSharpScript(culledGrid=cluster_2)  # -> checkedGrid; inputs culledGrid: list of Curve; disabled
# ---------- sanitycheck: C# ----------
    var check = checkGrid(culledGrid);

    checkedGrid = check;
# ---------- sanitycheck: C# additional code ----------
  List<Curve> checkGrid(List<Curve> culledGrid)
  {

    var outCurves = new List<Curve>();

    int cGridC = culledGrid.Count;

    for( int i = 0; i < cGridC - 1; ++i )
    {

      if( AreaMassProperties.Compute(culledGrid[i]).Centroid.CompareTo(AreaMassProperties.Compute(culledGrid[i + 1]).Centroid) != 0 )
      {

        //culledGrid.RemoveAt(i);
        outCurves.Add(culledGrid[i]);

      }

    }
    
    if( AreaMassProperties.Compute(culledGrid[cGridC - 1]).Centroid.CompareTo(AreaMassProperties.Compute(culledGrid[cGridC - 2]).Centroid) != 0 )

    outCurves.Add(culledGrid[cGridC - 1]);

    return outCurves;

  }
# ---------- end sanitycheck ----------
missinggridcells_2 = MissingGridCells(CulledGrid=cluster_2, OriginalGrid=cluster)
area_4 = Area(Geometry=missinggridcells_2, UseTasks=False)  # -> Area, Centroid
polytopo = CSharpScript(missingList=missinggridcells_2, originalList=path_mapper_5)  # -> relations; inputs missingList: list of Polyline, originalList: tree of Polyline
# ---------- polytopo: C# usings ----------
//using System.Linq;
# ---------- polytopo: C# ----------
    var topoTree = new DataTree<int>();

    int missingCount = missingList.Count;
    int originalCount = originalList.BranchCount;

    for( int i = 0; i < missingCount; ++i )
    {

      var temp = missingList[i];

      var path = new GH_Path(i);

      for( int j = 0; j < originalCount; ++j )
      {

        // Here's the bug!....
        //for( int k = 0; k < originalList.Branch(i).Count; ++k )

          if( j != i )

            if( Curve.PlanarCurveCollision(temp.ToNurbsCurve(), originalList.Branch(j)[0].ToNurbsCurve(), Plane.WorldXY, 1e-3) )
            {

              topoTree.Add(j, path);

            }

      }

    }

    relations = topoTree;
# ---------- end polytopo ----------
linetopo = CSharpScript(missing=area_4.Centroid, original=area_3.Centroid, relations=polytopo)  # -> lines, index; inputs missing: list of Point3d, original: tree of Point3d, relations: tree of Int32
# ---------- linetopo: C# ----------
    var linesOut = new DataTree<Line>();
    var keyValuePair = new DataTree<KeyValuePair<double, int>>();
    var intTree = new DataTree<int>();

    var tempList = new List<KeyValuePair<double, int>>();

    Point3d a = new Point3d();

    var path = new GH_Path();

    for( int i = 0; i < missing.Count; ++i )
    {

      var temp = missing[i];

      path = new GH_Path(i);

      for( int j = 0; j < relations.Branch(i).Count; ++j )
      {

        int ind = relations.Branch(i)[j];

        a = original.Branch(ind)[0];

        linesOut.Add(new Line(temp, a), path);
        keyValuePair.Add(new KeyValuePair<double, int>(temp.DistanceTo(a), ind), path);

      }

    }

    for( int i = 0; i < keyValuePair.BranchCount; ++i )
    {

      keyValuePair.Branch(i).Sort(Compare1);

      intTree.Add(keyValuePair.Branch(i)[0].Value, new GH_Path(i));

    }
    lines = linesOut;
    index = intTree;
# ---------- linetopo: C# additional code ----------
  static int Compare1(KeyValuePair<double, int> a, KeyValuePair<double, int> b)
  {
    return a.Key.CompareTo(b.Key);
  }
# ---------- end linetopo ----------
mergetreemissing = CSharpScript(tree=spacepartition, list=missinggridcells_2, index=linetopo.index)  # -> reconstructed; inputs tree: tree of Polyline, list: list of Polyline, index: tree of Int32
# ---------- mergetreemissing: C# ----------
    for( int i = 0; i < index.BranchCount; ++i )
    {

      int temp = index.Branch(i)[0];

      for( int j = 0; j < tree.BranchCount; ++j )
      {

        if( j == temp )

          tree.Branch(j).Add( list[i] );

      }

    }

    reconstructed = tree;
# ---------- end mergetreemissing ----------
parallelregionunion_3 = ParallelRegionUnion(Curves=mergetreemissing)

# ----
c_script = CSharpScript(culledTree=spacepartition, culledList=sanitycheck)  # -> out, A; inputs culledTree: tree of Curve, culledList: list of Curve; disabled
# ---------- c_script: C# ----------
    DataTree<Curve> treeOut = new DataTree<Curve>();

    int culledListSize = culledList.Count;
    int culledTreeBranches = culledTree.BranchCount;
    bool temp = false;
//    int counter = 0;

    for( int i = 0; i < culledListSize; ++i )
    
      for( int j = 0; j < culledTreeBranches; ++j )
      {
  
        int culledTreeBranchSize = culledTree.Branch(j).Count;
  
        GH_Path path = culledTree.Path(j);
  
        for( int k = 0; k < culledTreeBranchSize; ++k )
        {
  
          if( AreaMassProperties.Compute(culledTree.Branch(j)[k]).Centroid.CompareTo(AreaMassProperties.Compute(culledList[i]).Centroid) != 0 )
          {
  
            temp = true;
  
          }
          
  //        if( counter < culledListSize - 1 )
  //        
  //        counter++;
  //        Print( counter.ToString() );
  
        }

    }
    
    A = treeOut;
# ---------- end c_script ----------
surface_4 = Surface(c_script.A)  # disabled
area_5 = Area(Geometry=c_script.A)  # -> Area, Centroid; disabled
remove_duplicate_points = RemoveDuplicatePoints(InputPoints=area_5.Centroid, Tolerance=0.001)  # -> OutputPoints, FirstPointIndexes; disabled

# ---- group: SpacePartition (continued)
parallelregionintersection_3 = ParallelRegionIntersection(CurvesA=curve, CurvesB=parallelregionunion_3)  # -> simplify(Result)
list_length_5 = ListLength(List=flatten(parallelregionunion_3))
random = Random(Range=construct_domain_2, Number=list_length_5, Seed=[number_slider_8, number_slider_9, number_slider_10], Integers=True)
explode_tree = ExplodeTree(Data=random)  # -> Branch0, Branch1, Branch2
curve_7 = Curve(parallelregionintersection_3)
region_difference = RegionDifference(CurvesA=flatten(curve_7), CurvesB=parallelregionintersection_2)  # -> simplify(graft(Result)); disabled
colour_rgb_3 = ColourRGB(Alpha=Slider(10, range=0..10), Red=explode_tree.Branch0, Green=explode_tree.Branch1, Blue=explode_tree.Branch2)  # disabled
colour_rgb_4 = ColourRGB(Alpha=255, Red=explode_tree.Branch0, Green=explode_tree.Branch1, Blue=explode_tree.Branch2)
surface_5 = Surface(curve_7)
custom_preview_2 = CustomPreview(Geometry=graft(surface_3), Material=graft(colour_rgb_3))  # disabled
custom_preview_3 = CustomPreview(Geometry=surface_5, Material=graft(colour_rgb_4))

# ---- group: CalculateThresholdOfArea
area_6 = Area(Geometry=parallelregionunion_3, UseTasks=False)  # -> simplify(Area), simplify(Centroid)
multiplication_3 = Multiplication(A=addition, B=Slider(0.2, range=0..1))
addition_2 = Addition(A=addition, B=multiplication_3)  # -> simplify(Result)
subtraction_3 = Subtraction(A=addition, B=multiplication_3)  # -> simplify(Result)
null_item = NullItem(Item=area_6.Area)  # -> NullFlags, InvalidFlags, Description
expression_3 = Expression(x=null_item.InvalidFlags, y=area_6.Area, Expression="If( True, y, 1000 )")
expression_4 = Expression(x=expression_3, y=addition_2, z=subtraction_3, Expression="If( ( x < y) And ( x > z), 0, 1000 )")

# ---- group: Topology
flatten_tree_3 = FlattenTree(Tree=parallelregionunion_3, Path="{0}")
polytopo_2 = CSharpScript(curveList=flatten_tree_3)  # -> relations; inputs curveList: list of Curve
# ---------- polytopo_2: C# ----------
    //var repeat = new DataTree<Polyline>();

    var topoTree = new DataTree<int>();

    //var treeIndex = new DataTree<int>();

    int count = curveList.Count;

    for( int i = 0; i < count; ++i )
    {

      var path = new GH_Path(i);

      //repeat.AddRange(curveList, path);

      var temp = curveList[i];

      //treeIndex.Add(i, path);

      for( int j = 0; j < count; ++j )
      {

        if( j != i )

          if( Curve.PlanarCurveCollision(temp, curveList[j], Plane.WorldXY, 1e-3) )
          {

            topoTree.Add(j, path);

          }

      }

    }

    relations = topoTree;

    //index = treeIndex;
# ---------- end polytopo_2 ----------
linetopo_2 = CSharpScript(points=area_6.Centroid, relations=polytopo_2)  # -> lines; inputs points: tree of Point3d, relations: tree of Int32
# ---------- linetopo_2: C# ----------
    var linesOut = new DataTree<Line>();

    for( int i = 0; i < relations.BranchCount; ++i )
    {

      int count = relations.Branch(i).Count;

      for( int j = 0; j < count; ++j )
      {

        linesOut.Add(new Line(points.Branch(i)[0], points.Branch(relations.Branch(i)[j])[0]), new GH_Path(i));
        
      }

    }

    lines = linesOut;
# ---------- end linetopo_2 ----------

# ----
length = Length(Curve=linetopo_2)  # -> reverse(Length); disabled
list_item_4 = ListItem(List=length, Index=number_slider_13, Wrap=True)  # disabled
multiplication_4 = Multiplication(A=list_item_4, B=number_slider_12)  # disabled
expression_5 = Expression(x=area_6.Area, y=list_item_4, Expression="sqrt( x / pi )")  # disabled
circle = Circle(Plane=area_6.Centroid, Radius=expression_5)  # disabled
c_script_2 = CSharpScript(AreaTree=area_6.Area)  # disabled
flatten_tree_4 = FlattenTree(Tree=area_6.Area, Path="{0}")
list_length_6 = ListLength(List=flatten_tree_4)

# ---- group: SpaceSyntax
mass_addition_2 = MassAddition(Input=flatten(addition))  # -> Result, PartialResults
graphfromnodes_links = GraphFromNodesLinks(
    Points=flatten(area_6.Centroid),
    Links=flatten(linetopo_2),
    Labels=flatten(graft_tree),
    Areas=flatten(addition),
    TotalArea=mass_addition_2.Result)  # -> Graph, GraphVertices, Attributes
forcedirecteddrawing = ForceDirectedDrawing(
    Graph=polytopo_2,
    Vertices=flatten(pt_2),
    Attributes=graphfromnodes_links.Attributes,
    AttractionStrength=0.25,
    RepulsionStrength=Slider(0.3, range=0..10),
    ConvergenceTolearnce=Slider(0.538, range=0..10),
    MaximumIterations=Slider(2000, range=0..10000),
    Active=Toggle(True))  # -> NewGraphVertices, IterationCount
diskographdrawing = DiskoGraphDrawing(
    Plane=PlaneXY(16.90127812, 6.56851581, 0),
    Graph=polytopo_2,
    Vertices=forcedirecteddrawing.NewGraphVertices,
    Attributes=graphfromnodes_links.Attributes,
    Thickness=1)

# ----
expression_6 = Expression(x=list_length_6, y=integer_2, Expression="If( x ≠ y, 100000, 0 )")
text_tag = TextTag(Location=area_6.Centroid, Text=graft_tree)

# ---- group: CalculateThresholdOfArea (continued)
mass_addition_3 = MassAddition(Input=flatten([expression_4, expression_6]))  # -> Result, PartialResults

# ----
panel_4 = Panel(mass_addition_3.Result)

# ==== cluster Cluster
gridcells = ClusterInput()  # Input the grid cells to sort according to their X and Y positions.
curve = Curve(gridcells)
area = Area(Geometry=curve, UseTasks=False)  # -> Area, Centroid
deconstruct = Deconstruct(Point=area.Centroid)  # -> XComponent, expr("x*1000", YComponent), ZComponent
addition = Addition(A=deconstruct.XComponent, B=deconstruct.YComponent)
sort_list = SortList(Keys=addition, ValuesValuesA=curve)  # -> Keys, ValuesValuesA
sortedvalues = ClusterOutput(sort_list.ValuesValuesA)  # Outputs the sorted grid cells according to their X and Y positions.
