# Grasshopper definition SpacePartition.gh (Grasshopper 1.0.7)
# plug-ins: SpacePartition, FloorsAndVolumes, Human, PTComponentLibrary, LunchBox, Ivy, SpaceSyntaxDesign_GH

# ---- group: Progress
spacepartitionnoparallel = CSharpScript()  # -> culledGrid, R, G, B; inputs voronoiIn: list of Polyline, gridIn: list of Polyline, areaIn: Double, seed: Int32; disabled
# ---------- spacepartitionnoparallel: C# usings ----------
using System.Linq;
# ---------- spacepartitionnoparallel: C# ----------
    var intersections = new DataTree<Curve>();
    var bools = new DataTree<bool>();

    for( int i = 0; i < voronoiIn.Count; ++i )
    {

      var voro = voronoiIn[i].ToNurbsCurve();

      for( int j = 0; j < gridIn.Count; ++j )
      {

        intersections.AddRange(Curve.CreateBooleanIntersection(voro, gridIn[j].ToNurbsCurve(), 1e-3).ToList(), new GH_Path(i, j));

      }

    }

    for( int i = 0; i < intersections.BranchCount; ++i )
    {

      var tempList = intersections.Branch(i);
      var path = new GH_Path(intersections.Path(i).Indices[0]);
      bool temp = false;

      if( tempList.Count > 0 )
      {

        var area = AreaMassProperties.Compute(intersections.Branch(i)[0]).Area;

        temp = area < areaIn ? false : true;

        bools.Add(temp, path);

      }

      else
      {

        temp = false;
        bools.Add(temp, path);

      }

    }

    var treeOut = new DataTree<Polyline>();
    var coloursOutR = new DataTree<int>();
    var coloursOutG = new DataTree<int>();
    var coloursOutB = new DataTree<int>();
    //var coloursOut = new DataTree<System.Drawing.Color>();
    var rand = new Random(seed);

    for( int i = 0; i < bools.BranchCount; ++i )
    {

      var path = intersections.Path(i);

      coloursOutR.Add(rand.Next(0, 255), path);
      coloursOutG.Add(rand.Next(0, 255), path);
      coloursOutB.Add(rand.Next(0, 255), path);
      //coloursOut.Add( System.Drawing.Color.FromArgb( 255, rand.Next( 0, 255 ), rand.Next( 0, 255 ), rand.Next( 0, 255 ) ), path );

      for( int j = 0; j < bools.Branch(i).Count; ++j )
      {

        if( bools.Branch(i)[j] == true )
        {

          treeOut.Add(gridIn[j], path);

        }

      }

    }

    culledGrid = treeOut;
    R = coloursOutR;
    G = coloursOutG;
    B = coloursOutB;
    //R = coloursOut;
# ---------- end spacepartitionnoparallel ----------
polytopo = CSharpScript()  # -> relations; inputs missingList: list of Curve, originalList: tree of Curve; disabled
# ---------- polytopo: C# usings ----------
//using System.Linq;
# ---------- polytopo: C# ----------
    var topoTree = new DataTree<int>();

    int missingCount = missingList.Count;
    int originalCount = originalList.BranchCount;

    for( int i = 0; i < missingCount; ++i )
    {

      var temp = missingList[i];

      var path = new GH_Path(i);

      for( int j = 0; j < originalCount; ++j )
      {

        // Here's the bug!....
        //for( int k = 0; k < originalList.Branch(i).Count; ++k )

        if( j != i )

          if( Curve.PlanarCurveCollision(temp, originalList.Branch(j)[0], Plane.WorldXY, 1e-3) )
          {

            topoTree.Add(j, path);

          }

      }

    }

    relations = topoTree;
# ---------- end polytopo ----------
number_slider = Slider(4051, range=0..10000)  # disabled
polytopo_2 = CSharpScript()  # -> relations; inputs curveList: list of Polyline; disabled
# ---------- polytopo_2: C# ----------
    var topoTree = new DataTree<int>();

    int count = curveList.Count;

    for( int i = 0; i < count; ++i )
    {

      var path = new GH_Path(i);

      var temp = curveList[i];

      for( int j = 0; j < count; ++j )
      {

        if( j != i )

          if( Curve.PlanarCurveCollision(temp.ToNurbsCurve(), curveList[j].ToNurbsCurve(), Plane.WorldXY, 1e-3) )
          {

            topoTree.Add(j, path);

          }

      }

    }

    relations = topoTree;
# ---------- end polytopo_2 ----------
sanitycheck = CSharpScript()  # -> checkedGrid; inputs culledGrid: list of Curve; disabled
# ---------- sanitycheck: C# ----------
    var check = checkGrid(culledGrid);

    checkedGrid = check;
# ---------- sanitycheck: C# additional code ----------
  List<Curve> checkGrid(List<Curve> culledGrid)
  {

    var outCurves = new List<Curve>();

    int cGridC = culledGrid.Count;

    for( int i = 0; i < cGridC - 1; ++i )
    {

      if( AreaMassProperties.Compute(culledGrid[i]).Centroid.CompareTo(AreaMassProperties.Compute(culledGrid[i + 1]).Centroid) != 0 )
      {

        //culledGrid.RemoveAt(i);
        outCurves.Add(culledGrid[i]);

      }

    }
    
    if( AreaMassProperties.Compute(culledGrid[cGridC - 1]).Centroid.CompareTo(AreaMassProperties.Compute(culledGrid[cGridC - 2]).Centroid) != 0 )

    outCurves.Add(culledGrid[cGridC - 1]);

    return outCurves;

  }
# ---------- end sanitycheck ----------
missinggridcells = CSharpScript()  # -> missing, places; inputs culledGrid: list of Polyline, originalGrid: list of Polyline; disabled
# ---------- missinggridcells: C# ----------
    List<Polyline> polys = new List<Polyline>();

    var temp = new List<Polyline>();

    int place = 0;
    
    List<int> placesL = new List<int>();

    int oGridC = originalGrid.Count;
    int cGridC = culledGrid.Count;

    int iter = oGridC - cGridC;

    for( int i = 0; i < iter; ++i )
    {

      polys.Add(BailOut(originalGrid, culledGrid, out place));
      culledGrid.Insert(place, originalGrid[place]);
      placesL.Add( place );

    }

    missing = polys;

    places = placesL;
# ---------- missinggridcells: C# additional code ----------
  Polyline BailOut(List<Polyline> originalGrid, List<Polyline> culledGrid, out int place)
  {

    place = 0;

    int oGridC = originalGrid.Count;
    int cGridC = culledGrid.Count;

    int iter = oGridC - cGridC;

    var tempPoly = new Polyline();

    var polysOut = new Polyline[iter];

    var cCenters = new Point3d[oGridC];
    var oCenters = new Point3d[oGridC];

    var distances = new int[oGridC];

    for( int i = place + 1; i < oGridC; ++i )
    {

      oCenters[i] = AreaMassProperties.Compute(originalGrid[i].ToNurbsCurve()).Centroid;

      if( i < cGridC )

        cCenters[i] = AreaMassProperties.Compute(culledGrid[i].ToNurbsCurve()).Centroid;

      else
      {

        cCenters[i] = Point3d.Unset;

      }

      distances[i] = oCenters[i].CompareTo(cCenters[i]);

      if( distances[i] != 0 )
      {

        tempPoly = originalGrid[i];

        place = i;

        break;

      }

    }

    return tempPoly;

  }
# ---------- end missinggridcells ----------
linetopo = CSharpScript(relations=polytopo)  # -> lines, index; inputs missingGrid: list of Curve, originalGrid: tree of Curve, relations: tree of Int32; disabled
# ---------- linetopo: C# ----------
    List<Point3d> missing = new List<Point3d>();
    
    double tolerance = Rhino.RhinoDoc.ActiveDoc.ModelAbsoluteTolerance;
    
    for( int i = 0; i < missingGrid.Count; ++i )
    {
    
      missing.Add( AreaMassProperties.Compute( missingGrid[i], tolerance ).Centroid );
    
    }
    
    DataTree<Point3d> original = new DataTree<Point3d>();
    
    for( int i = 0; i < originalGrid.BranchCount; ++i )
    {
      
      GH_Path pathGrid = originalGrid.Path(i);
      
      for( int j = 0; j < originalGrid.Branch(i).Count; ++j )
      {
        
        original.Add( AreaMassProperties.Compute( originalGrid.Branch(i)[j], tolerance ).Centroid, pathGrid );
        
      }
      
    }
    
    DataTree<Line> linesOut = new DataTree<Line>();
    DataTree<KeyValuePair<double, int>> keyValuePair = new DataTree<KeyValuePair<double, int>>();
    DataTree<int> intTree = new DataTree<int>();

    List<KeyValuePair<double, int>> tempList = new List<KeyValuePair<double, int>>();

    Point3d a = new Point3d();

    GH_Path path = new GH_Path();

    for( int i = 0; i < missing.Count; ++i )
    {

      Point3d temp = missing[i];

      path = new GH_Path(i);

      for( int j = 0; j < relations.Branch(i).Count; ++j )
      {

        int ind = relations.Branch(i)[j];

        a = original.Branch(ind)[0];

        linesOut.Add(new Line(temp, a), path);
        keyValuePair.Add(new KeyValuePair<double, int>(temp.DistanceTo(a), ind), path);

      }

    }

    for( int i = 0; i < keyValuePair.BranchCount; ++i )
    {

      keyValuePair.Branch(i).Sort(Compare1);

      intTree.Add(keyValuePair.Branch(i)[0].Value, new GH_Path(i));

    }
    lines = linesOut;
    index = intTree;
# ---------- linetopo: C# additional code ----------
  static int Compare1(KeyValuePair<double, int> a, KeyValuePair<double, int> b)
  {
    return a.Key.CompareTo(b.Key);
  }
# ---------- end linetopo ----------
mergetreemissing = CSharpScript()  # -> reconstructed; inputs tree: tree of Curve, list: list of Curve; disabled
# ---------- mergetreemissing: C# ----------
    var topoTree = new DataTree<int>();

    List<Point3d> missing = new List<Point3d>();

    double tolerance = Rhino.RhinoDoc.ActiveDoc.ModelAbsoluteTolerance;

    int missingCount = list.Count;
    int originalCount = tree.BranchCount;
    
    GH_Path pathOne = new GH_Path();

    for( int i = 0; i < missingCount; ++i )
    {

      Curve temp = list[i];
      
      missing.Add(AreaMassProperties.Compute(temp, tolerance).Centroid);

      pathOne = new GH_Path(i);

      for( int j = 0; j < originalCount; ++j )
      {

        if( j != i )

          if( Curve.PlanarCurveCollision(temp, tree.Branch(j)[0], Plane.WorldXY, 1e-3) )
          {

            topoTree.Add(j, pathOne);

          }

      }

    }
    
    DataTree<Point3d> original = new DataTree<Point3d>();

    for( int i = 0; i < tree.BranchCount; ++i )
    {

      GH_Path pathGrid = tree.Path(i);

      for( int j = 0; j < tree.Branch(i).Count; ++j )
      {

        original.Add(AreaMassProperties.Compute(tree.Branch(i)[j], tolerance).Centroid, pathGrid);

      }

    }

    DataTree<KeyValuePair<double, int>> keyValuePair = new DataTree<KeyValuePair<double, int>>();
    DataTree<int> intTree = new DataTree<int>();

    List<KeyValuePair<double, int>> tempList = new List<KeyValuePair<double, int>>();

    Point3d a = new Point3d();

    GH_Path path = new GH_Path();
    
    for( int i = 0; i < missing.Count; ++i )
    {

      Point3d temp = missing[i];

      path = new GH_Path(i);

      for( int j = 0; j < topoTree.Branch(i).Count; ++j )
      {

        int ind = topoTree.Branch(i)[j];

        a = original.Branch(ind)[0];

        keyValuePair.Add(new KeyValuePair<double, int>(temp.DistanceTo(a), ind), path);

      }

    }

    for( int i = 0; i < keyValuePair.BranchCount; ++i )
    {

      keyValuePair.Branch(i).Sort(Compare1);

      intTree.Add(keyValuePair.Branch(i)[0].Value, new GH_Path(i));

    }
    
    for( int i = 0; i < intTree.BranchCount; ++i )
    {

      int temp = intTree.Branch(i)[0];

      for( int j = 0; j < tree.BranchCount; ++j )
      {

        if( j == temp )

          tree.Branch(j).Add(list[i]);

      }

    }

    reconstructed = tree;
# ---------- mergetreemissing: C# additional code ----------
  static int Compare1(KeyValuePair<double, int> a, KeyValuePair<double, int> b)
  {
    return a.Key.CompareTo(b.Key);
  }
# ---------- end mergetreemissing ----------
linetopo_2 = CSharpScript(relations=polytopo_2)  # -> lines; inputs points: tree of Point3d, relations: tree of Int32; disabled
# ---------- linetopo_2: C# ----------
    var linesOut = new DataTree<Line>();

    for( int i = 0; i < relations.BranchCount; ++i )
    {

      int count = relations.Branch(i).Count;

      for( int j = 0; j < count; ++j )
      {

        linesOut.Add(new Line(points.Branch(i)[0], points.Branch(relations.Branch(i)[j])[0]), new GH_Path(i));
        
      }

    }

    lines = linesOut;
# ---------- end linetopo_2 ----------
spacepartitionparalleldict = CSharpScript(seed=number_slider)  # -> simplify(culledGrid), R, G, B; inputs voronoiIn: list of Curve, gridIn: list of Curve, areaIn: Double, seed: Int32; disabled
# ---------- spacepartitionparalleldict: C# ----------
    Curve[][][] tempJagged = new Curve[voronoiIn.Count][][];
    var treeOut = new DataTree<Polyline>();
    var coloursOutR = new DataTree<int>();
    var coloursOutG = new DataTree<int>();
    var coloursOutB = new DataTree<int>();
    var rand = new Random(seed);
    Polyline tempPoly = new Polyline();

    for( int i = 0; i < voronoiIn.Count; ++i )
    {
      
      var path = new GH_Path(i);

      var voro = voronoiIn[i].ToNurbsCurve();

      tempJagged[i] = new Curve[gridIn.Count][];

      System.Threading.Tasks.Parallel.For(0, gridIn.Count, j =>
        {

        tempJagged[i][j] = Curve.CreateBooleanIntersection(voro, gridIn[j].ToNurbsCurve(), 1e-8);

        });
      
      for( int j = 0; j < tempJagged[i].Length; ++j )
      {
        
        coloursOutR.Add(rand.Next(0, 255), path);
        coloursOutG.Add(rand.Next(0, 255), path);
        coloursOutB.Add(rand.Next(0, 255), path);

        bool temp = false;

        if( tempJagged[i][j].Length > 0 )
        {

          var area = AreaMassProperties.Compute(tempJagged[i][j][0]).Area;

          temp = area < areaIn ? false : true;
          
          if( temp == true )
          {
            
            gridIn[j].TryGetPolyline( out tempPoly );
            
            treeOut.Add(tempPoly, path);
            
          }

        }
        
      }

    }

    culledGrid = treeOut;
    R = coloursOutR;
    G = coloursOutG;
    B = coloursOutB;
    //R = coloursOut;
# ---------- end spacepartitionparalleldict ----------
mergetreemissing_2 = CSharpScript(index=linetopo.index)  # -> reconstructed; inputs tree: tree of Curve, list: list of Curve, index: tree of Int32; disabled
# ---------- mergetreemissing_2: C# ----------
    for( int i = 0; i < index.BranchCount; ++i )
    {
      
      int temp = index.Branch(i)[0];
      
      for( int j = 0; j < tree.BranchCount; ++j )
      {
     
        if( j == temp )
          
          tree.Branch(j).Add( list[i] );
        
      }
    
    }
    
    reconstructed = tree;
# ---------- end mergetreemissing_2 ----------
parallelregionintersection = CSharpScript()  # -> out, A; inputs CurvesA: list of Curve, CurvesB: list of Curve; disabled
# ---------- parallelregionintersection: C# ----------
    Curve[][][] tempJagged = new Curve[CurvesA.Count][][];
    var treeOut = new List<Curve>();

    for( int i = 0; i < CurvesA.Count; ++i )
    {

      var voro = CurvesA[i];

      tempJagged[i] = new Curve[CurvesB.Count][];

      System.Threading.Tasks.Parallel.For(0, CurvesB.Count, j =>
        {

        tempJagged[i][j] = Curve.CreateBooleanIntersection(voro, CurvesB[j], 1e-3);

        });

      for( int j = 0; j < tempJagged[i].Length; ++j )
      {

        for( int k = 0; k < tempJagged[i][j].Length; ++k )
        {

          var path = new GH_Path(i);

          treeOut.Add(tempJagged[i][j][k]);


        }

      }

    }

    A = treeOut;
# ---------- end parallelregionintersection ----------

# ---- group: InputData / Labels
text = Text(Tree({0;0}: ["Unidades sanitarias mujeres / privadas"], {0;1}: ["Unidades sanitarias hombres / privadas"], {0;2}: ["Cuarto de aseo "], {0;3}: ["Área de aseo de residuos"], {0;4}: ["Almacen General Insumos de Aseo "], {0;5}: ["Área de UPC-Rack"]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))

# ---- group: InputData / Topology
integer = Integer(Tree({0}: [7], {1}: [7], {2}: [3], {3}: [2, 11], {4}: [16, 21, 19], {5}: [19]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))

# ---- group: InputData / ID
text_2 = Text(Tree({0;0}: ["5"], {0;1}: ["5"], {0;2}: ["5"], {0;3}: ["5"], {0;4}: ["5"], {0;5}: ["5"]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))

# ---- group: InputData / Areas
text_3 = Text(Tree({0;0}: ["3"], {0;1}: ["3"], {0;2}: ["6"], {0;3}: ["1"], {0;4}: ["5"], {0;5}: ["4"]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))

# ---- group: InputData
number_slider_2 = Slider(1, range=0..10)
path_mapper = PathMapper(text, source="{A;B}", target="{A}")
path_mapper_2 = PathMapper(text_3, source="{A;B}", target="{A}")
path_mapper_3 = PathMapper(integer, source="{A;B}", target="{A}")
path_mapper_4 = PathMapper(text_2, source="{A;B}", target="{A}")
prunebranches = CSharpScript(branches=path_mapper, howMany=number_slider_2)  # -> prunedTree, branchCounter; inputs branches: tree of String, howMany: Int32
# ---------- prunebranches: C# ----------
    var treeOut = new DataTree<string>();

    for( int i = 0; i < branches.BranchCount - howMany; ++i )
      treeOut.AddRange(branches.Branch(i), new GH_Path(i));

    prunedTree = treeOut;
    branchCounter = treeOut.BranchCount;
# ---------- end prunebranches ----------
prunebranches_2 = CSharpScript(branches=path_mapper_2, howMany=number_slider_2)  # -> prunedTree, branchCounter; inputs branches: tree of String, howMany: Int32; same code as prunebranches
mass_addition = MassAddition(Input=prunebranches_2.prunedTree)  # -> Result, PartialResults
number_slider_3 = Slider(4, range=0..10)
flatten_tree = FlattenTree(Tree=prunebranches_2.prunedTree, Path="{0}")
list_length = ListLength(List=flatten_tree)
integer_2 = Integer(list_length)

# ---- group: Grid / Controllers
number_slider_4 = Slider(21, range=0..21)
number_slider_5 = Slider(5, range=0..5)
division = Division(A=number_slider_4, B=Slider(8, range=0..10))
division_2 = Division(A=number_slider_5, B=Slider(4, range=0..10))
number_slider_6 = Slider(0.918, range=0..1)

# ---- group: Voronoi / Controllers
seedsx = GenePool(
    Decimals=2,
    Maximum=1,
    Minimum=0,
    Value=[0.5327277098, 0.9440542361, 0.7408860273, 0.6411075209, 0.9662627289, 0.3655481815, 0.1585695986, 0.3178060168, 0.8669077022, 0.2345660931, 0.1875163122, 0.9641877827, 0.2093988597, 0.9956775564, 0.5749366631, 0.2128016442, 0.4784328507, 0.1935628071, 0.8067486146, 0.9531704606, 0.8128678733, 0.130804184, 0.9652035697, 0.03342526128, 0.08794142915])
seedsy = GenePool(
    Decimals=2,
    Maximum=1,
    Minimum=0,
    Value=[0.7759084836, 0.5282287717, 0.5601556141, 0.1199530378, 0.8240799791, 0.2021416254, 0.2302231785, 0.2918156531, 0.4401336896, 0.4003667284, 0.5925877335, 0.184473585, 0.0284037213, 0.06976905655, 0.7505334656, 0.1251533037, 0.9736113767, 0.2553710124, 0.06862049786, 0.5336514425, 0.7897316705, 0.9110978641, 0.8487407439, 0.3410475116, 0.746589322])

# ----
number = Number(prunebranches_2.prunedTree)
number_slider_7 = Slider(2, range=0..10)  # disabled
number_slider_8 = Slider(1, range=0..10)  # disabled
number_slider_9 = Slider(25, range=0..100)  # disabled
number_slider_10 = Slider(16, range=0..100)  # disabled
number_slider_11 = Slider(27, range=0..100)  # disabled
number_slider_12 = Slider(23, range=0..100)  # disabled
number_slider_13 = Slider(94, range=0..100)  # disabled
number_slider_14 = Slider(0.25, range=0..10)  # disabled
number_slider_15 = Slider(10, range=0..100)  # disabled
number_slider_16 = Slider(24, range=0..100)  # disabled
number_slider_17 = Slider(0.3, range=0..1)  # disabled
pt = Point(Point(-31.42949494, -20.33034701, 0))  # disabled
number_slider_18 = Slider(2, range=0..10)  # disabled
division_3 = Division(A=number_slider_4, B=number_slider_7)  # disabled
division_4 = Division(A=number_slider_5, B=number_slider_8)  # disabled
P = Plane(PlaneXY(-32.75051943, -20.27070341, 0))  # disabled
P_2 = Plane(pt)  # disabled
ptpolar2d = PolarGrid(
    Plane=PlaneXY(-28.01292744, -1.068898689, 0),
    RadialDistance=1,
    PolarAngle=10,
    RadialNumber=number_slider_9,
    PolarNumber=10,
    FullCircle=True)  # disabled
number_slider_19 = Slider(6, range=0..100)  # disabled
hexgrid = Hexagonal(Plane=P_2, Size=number_slider_14, ExtentX=number_slider_12, ExtentY=number_slider_13)  # -> Cells, Points; disabled
trigrid = Triangular(Plane=P, Size=number_slider_18, ExtentX=number_slider_15, ExtentY=number_slider_16)  # -> flatten(Cells), Points; disabled
number_slider_20 = Slider(0, range=0..1)
polygon = Polygon(Plane=PlaneXY(0, 0, 0), Radius=3, Segments=number_slider_19, FilletRadius=0)  # -> Polygon, Length; disabled
ptborders = GenerateBorders(Grid=ptpolar2d, PanelShape=0)  # -> simplify(flatten(Border)); disabled
crv = Curve(flatten(hexgrid.Cells))  # disabled
number_slider_21 = Slider(1, range=0..10)  # disabled
colour_rgb_f = ColourRGBF(Alpha=1, Red=0, Green=number_slider_20, Blue=number_slider_20)
crv_2 = Curve([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])  # disabled
crv_3 = Curve([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])  # disabled

# ---- group: SpacePartition / OriginalSilhouette
curve = Curve(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)

# ---- group: RandomColourSeed
toggle = BooleanToggle(True)
number_slider_22 = Slider(70, range=0..100)
number_slider_23 = Slider(453, range=0..1000)
number_slider_24 = Slider(128, range=0..1000)
colours = GenePool(Decimals=0, Maximum=255, Minimum=0, Value=[17.0001572, 163.0217918, 103.3522034])
genemodifier = GenePoolModifier(
    GeneList="Colours",
    Count=Slider(3, range=0..10),
    Domain=Domain(0, 255),
    Randomize=Button(),
    PercentageOfRandomization=Slider(0.42, range=0..1))

# ---- group: AddAreaForCirculation
multiplication = Multiplication(A=number, B=0.3)
addition = Addition(A=number, B=multiplication)  # -> simplify(Result)

# ----
panel = Panel("""0: Privado
1: Privado
2: Público
3: SemiPrivado""")
text_4 = Text(prunebranches.prunedTree)
graft_tree = GraftTree(Tree=panel, IncludeEmptyLists=True, IncludeNullItems=True)  # -> simplify(Tree)
graft_tree_2 = GraftTree(Tree=text_4, IncludeEmptyLists=True, IncludeNullItems=True)
addindextolabels = CSharpScript(labels=graft_tree_2)  # -> indexedLabels; inputs labels: tree of String
# ---------- addindextolabels: C# ----------
    var newLabels = new DataTree<string>();
    
    for( int i = 0; i < labels.BranchCount; ++i )
      for( int j = 0; j < labels.Branch(i).Count; ++j )
      {
      
        newLabels.Add( i.ToString() + " " + labels.Branch(i)[j], new GH_Path(i) );
      
      }
    
    indexedLabels = newLabels;
# ---------- end addindextolabels ----------
galapagos = Galapagos(fitness=mass_addition_2, gene=[seedsx, seedsy])

# ---- group: Grid
number_slider_25 = Slider(22, range=0..100)
construct_domain = ConstructDomain(DomainStart=Slider(0, range=0..100), DomainEnd=Slider(4, range=0..10))
genepoolmodifier = GenePoolModifier(GeneList="Weights", Count=expr("x+1", number_slider_25), Domain=construct_domain)
knot_vector = KnotVector(Count=expr("x+1", number_slider_25), Degree=Slider(3, range=0..10), Periodic=False)
dom = ConstructDomain(DomainStart=expr("-x", number_slider_4), DomainEnd=number_slider_4)
range = Range(Domain=dom, Steps=number_slider_25)
dom_2 = ConstructDomain(DomainStart=expr("-x", number_slider_5), DomainEnd=number_slider_5)
weights = GenePool(Decimals=2, Maximum=4, Minimum=0, Value=[2, 2, 2, 2, 2, 2, 2, 2, 2, 2, 2, 2, 2, 2, 2, 2, 2, 2, 2, 2, 2, 2, 2])
point = Point(Point(-27.55069635, 0.2364199029, 0))
deconstruct_domain = DeconstructDomain(Domain=dom)  # -> Start, End
rectangle = Rectangle(Plane=point, XSize=dom_2, YSize=dom, Radius=0)  # -> Rectangle, Length
unit_y = UnitY(Factor=deconstruct_domain.Start)
colour_rgb = ColourRGB(Alpha=255, Red=Slider(1000, range=0..1000), Green=Slider(0, range=0..1000), Blue=Slider(0, range=0..1000))
move = Move(Geometry=point, Motion=unit_y)  # -> Geometry, Transform
crv_4 = Curve(rectangle.Rectangle)
ptsrfdomlen = SurfaceDomainLength(Surface=crv_4, ULength=division_2, VLength=division)
ptborders_2 = GenerateBorders(Grid=ptsrfdomlen, PanelShape=0)  # -> simplify(Border)
crv_5 = Curve(flatten(ptborders_2))
area = Area(Geometry=ptborders_2, UseTasks=False)  # -> Area, Centroid

# ---- group: Voronoi
number_slider_26 = Slider(0, range=0..0.1)
subtraction = Subtraction(A=Slider(1, range=0..1), B=number_slider_26)
toggle_2 = BooleanToggle(True)
toggle_3 = BooleanToggle(True)
gnlst = GeneList("SeedsY")
gnlst_2 = GeneList("SeedsX")
dom_3 = ConstructDomain(DomainStart=number_slider_26, DomainEnd=subtraction)
genemodifier_2 = GenePoolModifier(GeneList=gnlst, Count=integer_2, Domain=dom_3, Randomize=Button(), PercentageOfRandomization=Slider(1, range=0..1))
genemodifier_3 = GenePoolModifier(GeneList=gnlst_2, Count=integer_2, Domain=dom_3, Randomize=Button(), PercentageOfRandomization=Slider(1, range=0..1))
pt_2 = ConstructPoint(XCoordinate=seedsx, YCoordinate=seedsy, ZCoordinate=0)
evalsrf = EvaluateSurface(Surface=reparameterize(crv_4), Point=pt_2)  # -> Point, Normal, UDirection, VDirection, Frame
pt_3 = Point(evalsrf.Point)
voronoi = Voronoi(Points=pt_3, Boundary=rectangle.Rectangle, BruteForceOverride=False)

# ---- group: Grid / Perlin
number_slider_27 = Slider(13.910642, range=0..100)
perlinnoise = CSharpScript(
    x=range,
    fre=Slider(3.2, range=0..10),
    amp=Slider(0.491529, range=0..1),
    iter=Slider(4, range=0..10),
    t=Slider(49.68122, range=0..100),
    seed=Slider(358, range=0..1000))  # -> out, A; inputs x: Double, fre: Double, amp: Double, iter: Int32, t: Double, seed: Int32
# ---------- perlinnoise: C# ----------
    //time+=1e-7;
    
    A = fbm(new vec3(x, 0, 0) + t, fre, amp, iter, seed);
# ---------- perlinnoise: C# additional code ----------
  //double time = 0;
  
  double hash(double a, int seed)
  {

    //return fract(Math.Sin(a) * 4513.15);
    var rand = new Random( seed );
    return rand.NextDouble() * ( 1.0 + 1.0 ) - 1.0;

  }

  double noise(vec3 x, int seed)
  {

    vec3 p = x.floor();
    vec3 k = x.fract();

    k *= k * k * ( 3.0 - 2.0 * k );

    double n = p.X() + p.Y() * 57.0 + p.Z() * 113.0;

    double a = hash(n, seed);
    double b = hash(n + 1.0, seed);
    double c = hash(n + 57.0, seed);
    double d = hash(n + 58.0, seed);

    double e = hash(n + 113.0, seed);
    double f = hash(n + 114.0, seed);
    double g = hash(n + 170.0, seed);
    double h = hash(n + 171.0, seed);

    double res = vec3.mix(vec3.mix(vec3.mix(a, b, k.X()), vec3.mix(c, d, k.X()), k.Y()),
      vec3.mix(vec3.mix(e, f, k.X()), vec3.mix(g, h, k.X()), k.Y()),
      k.Z()
      );

    return res;

  }

  double fbm(vec3 f, double freq, double ampl, int iter, int seed)
  {

    double amp = 1.0, fre = 1.7, res = 0.0;

    for( int i = 0; i < iter; ++i )
    {

      amp *= ampl;
      fre *= freq;

      amp += amp;

      res += amp * noise(fre * f, seed);

    }

    return res;

  }

  class vec3
  {

    double x, y, z;

    public vec3(double x, double y, double z)
    {

      this.x = x;
      this.y = y;
      this.z = z;

    }

    public vec3(Point3d point)
    {

      this.x = point.X;
      this.y = point.Y;
      this.z = point.Z;

    }

    public double X()
    {

      return x;

    }

    public double Y()
    {

      return y;

    }

    public double Z()
    {

      return z;

    }

    // Addition operator overload.
    public static vec3 operator+( vec3 x, vec3 y )
    {

      return new vec3(x.X() + y.X(), x.Y() + y.Y(), x.Z() + y.Z());

    }

    public static vec3 operator+( vec3 x, double y )
    {

      return new vec3(x.X() + y, x.Y() + y, x.Z() + y);

    }

    public static vec3 operator+( double y, vec3 x )
    {

      return new vec3(y + x.X(), y + x.Y(), y + x.Z());

    }

    // Subtraction operator overload.
    public static vec3 operator-( vec3 x, vec3 y )
    {

      return new vec3(x.X() - y.X(), x.Y() - y.Y(), x.Z() - y.Z());

    }

    public static vec3 operator-( vec3 x, double y )
    {

      return new vec3(x.X() - y, x.Y() - y, x.Z() - y);

    }

    public static vec3 operator-( double y, vec3 x )
    {

      return new vec3(y - x.X(), y - x.Y(), y - x.Z());

    }

    // Multiplication operator overload.
    public static vec3 operator*( vec3 x, vec3 y )
    {

      return new vec3(x.X() * y.X(), x.Y() * y.Y(), x.Z() * y.Z());

    }

    public static vec3 operator*( vec3 x, double y )
    {

      return new vec3(x.X() * y, x.Y() * y, x.Z() * y);

    }

    public static vec3 operator*( double y, vec3 x )
    {

      return new vec3(y * x.X(), y * x.Y(), y * x.Z());

    }

    // Fractional part of a vec3.
    public vec3 fract()
    {

      return new vec3(fract(x), fract(y), fract(y));

    }

    // Floor.
    public vec3 floor()
    {

      return new vec3(Math.Floor(x), Math.Floor(y), Math.Floor(z));

    }

    // Fractional part of a double.
    public double fract(double x)
    {

      return x - Math.Truncate(x);

    }

    // Linear interpolation of a double.
    public static double mix(double a, double b, double c)
    {

      return a - ( 1 - c ) + b * c;

    }

    // Linear interpolation of a vec3.
    public static vec3 mix(vec3 a, vec3 b, double c)
    {

      double mixX = mix(a.X(), b.X(), c);
      double mixY = mix(a.Y(), b.Y(), c);
      double mixZ = mix(a.Z(), b.Y(), c);

      return new vec3(mixX, mixY, mixZ);

    }

    public Point3d toPoint()
    {

      return new Point3d(this.X(), this.Y(), this.Z());

    }

  }

  public double fract(double x)
  {

    return x - Math.Truncate(x);

  }
# ---------- end perlinnoise ----------

# ---- group: Grid (continued)
construct_point = ConstructPoint(XCoordinate=perlinnoise.A, YCoordinate=range, ZCoordinate=0)
list_item = ListItem(List=construct_point, Index=0, Wrap=True)
vector_2pt = Vector2Pt(PointA=list_item, PointB=move.Geometry, Unitize=False)  # -> Vector, Length
move_2 = Move(Geometry=construct_point, Motion=vector_2pt.Vector)  # -> Geometry, Transform
nurbs_curve_pwk = NurbsCurvePWK(Points=move_2.Geometry, Weights=weights, Knots=knot_vector)  # -> Curve, Length, Domain
custom_preview_lineweights = CustomPreviewLineweights(Geometry=nurbs_curve_pwk.Curve, Shader=colour_rgb, Thickness=Slider(3.01, range=0..10), Absolute=False)
curve_attraction = CurveAttraction(Grid=ptsrfdomlen, CrvAtts=nurbs_curve_pwk.Curve, Magnitude=number_slider_6)  # -> Grid, Weights

# ----
del = DelaunayMesh(Points=flatten(ptsrfdomlen), Plane=PlaneXY(0, 0, 0))  # disabled

# ---- group: ManhattanVoronoi
number_slider_28 = Slider(10, range=0..10)  # disabled
ghpython_script = GhPythonScript(r=number_slider_28, P=pt_3)  # -> out, PL; inputs P: list of Point3d; disabled
# ---------- ghpython_script: Python ----------
__author__ = "Paula"
__version__ = "2019.04.23"

import rhinoscriptsyntax as rs
from Rhino.Geometry import Point3d as P3
from Rhino.Geometry import Polyline as PLine

def taxicab_midnormal ( Point_1 = P3(0,0,0), Point_2 = P3(0,0,0) , leng = 10000):
    dx = abs(Point_1.X - Point_2.X)
    dy = abs(Point_1.Y - Point_2.Y)
    
    C = P3 ( ( Point_1.X + Point_2.X ) / 2, ( Point_1.Y + Point_2.Y ) / 2, ( Point_1.Z + Point_2.Z ) / 2)
    
    """ MPQN, in which M is on the lengeft(X-) or bottom(Y-) """
    P = P3 (0,0,C.Z)
    Q = P3 (0,0,C.Z)
    M = P3 (0,0,C.Z)
    N = P3 (0,0,C.Z)
    
    if dx > dy:
        P.Y = C.Y + dy / 2
        Q.Y = C.Y - dy / 2
        M.Y = P.Y + leng
        N.Y = Q.Y - leng
        if bool(Point_1.Y > Point_2.Y) ^ bool(Point_1.X > Point_2.X):
            P.X = C.X + dy / 2
            Q.X = C.X - dy / 2
        else:
            P.X = C.X - dy / 2
            Q.X = C.X + dy / 2
        M.X = P.X
        N.X = Q.X
    else:
        if dx < dy:
            P.X = C.X + dx / 2
            Q.X = C.X - dx / 2
            M.X = P.X + leng
            N.X = Q.X - leng
            if bool(Point_1.Y > Point_2.Y) ^ bool(Point_1.X > Point_2.X):
                P.Y = C.Y + dx / 2
                Q.Y = C.Y - dx / 2
            else:
                P.Y = C.Y - dx / 2
                Q.Y = C.Y + dx / 2
            M.Y = P.Y
            N.Y = Q.Y
        else:
            if bool(Point_1.Y > Point_2.Y) ^ bool(Point_1.X > Point_2.X):
                P.Y = C.Y - dx / 2
                Q.Y = C.Y + dx / 2
                P.X = C.X - dy / 2
                Q.X = C.X + dy / 2
                M.Y = P.Y - leng
                M.X = P.X - leng
                N.Y = Q.Y + leng
                N.X = Q.X + leng
            else:
                P.Y = C.Y - dx / 2
                Q.Y = C.Y + dx / 2
                P.X = C.X + dy / 2
                Q.X = C.X - dy / 2
                M.Y = P.Y - leng
                M.X = P.X + leng
                N.Y = Q.Y + leng
                N.X = Q.X - leng

    return rs.AddPolyline( [M , P , Q , N] )

def taxicab_circle ( point = P3(0,0,0), r = 1 ):
    A = P3( point.X + r, point.Y, point.Z )
    B = P3( point.X, point.Y + r, point.Z )
    C = P3( point.X - r, point.Y, point.Z )
    D = P3( point.X, point.Y - r, point.Z )
    return rs.AddPolyline( [A, B, C, D, A] )

l = 2 * r

""" PL = taxicab_midnormal ( A, B, r ) """

pts = P

polylines = []
for i in range( len( P ) ):
    polylines.append(taxicab_circle( P[i], l ))

for i in range(len(polylines)):
    for j in range(i):
        if i == j:
            continue
        if rs.CurveBooleanUnion( [ polylines[i], polylines[j] ] ):
            MN = taxicab_midnormal( pts[i], pts[j], l )
            
            ccx = rs.CurveCurveIntersection( polylines[i], MN )
            if ccx is None:
                continue
            if ccx[0][0] == 2:
                continue
            para_a = [ ccx[0][5], ccx[1][5] ]
            para_b = [ ccx[0][7], ccx[1][7] ]
            
            if para_b[0] > para_b[1]:
                para_b = [ para_b[1], para_b[0] ]
            
            probable_dash = rs.SplitCurve(polylines[i], para_a)
            edge = rs.TrimCurve(MN, para_b, False )
            edgepts = rs.CurvePoints(edge)
            
            for crv in probable_dash:
                crvpts = rs.CurvePoints(crv)
                if rs.PointCompare( crvpts[0], edgepts[0] ):
                    crvpts.reverse()
                newpl = rs.AddPolyline( edgepts + crvpts )
                if rs.PointInPlanarClosedCurve( pts[i], newpl ):
                    polylines[i] = newpl
                    break
            
            
            ccx = rs.CurveCurveIntersection( polylines[j], MN )
            if ccx is None:
                continue
            para_a = [ ccx[0][5], ccx[1][5] ]
            para_b = [ ccx[0][7], ccx[1][7] ]
            
            if para_b[0] > para_b[1]:
                para_b = [ para_b[1], para_b[0] ]
            
            probable_dash = rs.SplitCurve(polylines[j], para_a)
            edge = rs.TrimCurve(MN, para_b, False )
            edgepts = rs.CurvePoints(edge)
            
            for crv in probable_dash:
                crvpts = rs.CurvePoints(crv)
                if rs.PointCompare( crvpts[0], edgepts[0] ):
                    crvpts.reverse()
                newpl = rs.AddPolyline( edgepts + crvpts )
                if rs.PointInPlanarClosedCurve( pts[j], newpl ):
                    polylines[j] = newpl
                    break
    

PL = polylines
# ---------- end ghpython_script ----------
region_intersection = RegionIntersection(CurvesA=ghpython_script.PL, CurvesB=rectangle.Rectangle)  # disabled
curve_2 = Curve(region_intersection)  # disabled
surface = Surface(curve_2)  # disabled

# ----
grphmsh = GraphFromMesh(InputMesh=del)  # disabled
grph2msh = GraphToMesh(MeshGraph=grphmsh)  # disabled
collision_one_many = CollisionOneMany(Collider=nurbs_curve_pwk.Curve, Obstacles=graft(crv_5))  # -> Collision, Index
curve_3 = Curve(voronoi)
medges = MeshEdges(Mesh=grph2msh)  # -> NakedEdges, InteriorEdges, NonManifoldEdges; disabled
surface_2 = Surface(curve_3)
cull_pattern = CullPattern(List=crv_5, CullPattern=flatten(collision_one_many.Collision))
crv_6 = Curve([medges.InteriorEdges, medges.NakedEdges])  # disabled
parallelregionunion = ParallelRegionUnion(Curves=cull_pattern)
hex = HexagonCells(Surface=rectangle.Rectangle, UDivisions=number_slider_10, VDivisions=number_slider_11, TParameter=number_slider_17)  # -> HexagonCells, Centers; disabled
parallelregionintersection_2 = ParallelRegionIntersection(CurvesA=curve, CurvesB=parallelregionunion)
crv_7 = Curve(voronoi)
ptsrfdomlen_2 = SurfaceDomainLength(Surface=crv_4, ULength=division_4, VLength=division_3)  # disabled
crv_8 = Curve(hex.HexagonCells)  # disabled
surface_3 = Surface(parallelregionintersection_2)
ptmorph2d = Morph2D(Grid=ptsrfdomlen_2, PatternCurves=crv_3, Shift_i=number_slider_21, Shift_j=number_slider_21)  # disabled
custom_preview = CustomPreview(Geometry=surface_3, Material=colour_rgb_f)
parallelregionintersection_3 = ParallelRegionIntersection(CurvesB=surface_3)
srf = Surface(ptmorph2d)  # disabled
join = JoinCurves(Curves=ptmorph2d, Preserve=False)  # disabled
crv_9 = Curve(srf)  # disabled
clean = CleanTree(RemoveNulls=True, RemoveInvalid=True, RemoveEmpty=False, Tree=crv_9)  # -> flatten(Tree); disabled
crv_10 = Curve(clean)  # disabled

# ---- group: SpacePartition
nickname = SortPointsXY(Grid=crv_5)
list_item_2 = ListItem(List=nickname, Index=Slider(0, range=0..50), Wrap=True)
area_2 = Area(Geometry=list_item_2, UseTasks=False)  # -> Area, Centroid
multiplication_2 = Multiplication(A=area_2.Area, B=Slider(0.5, range=0..1))
spacepartition = SpacePartition(VoronoiIn=crv_7, GridIn=crv_5, AreaIn=multiplication_2, Tolerance=0.001)
pararunion = ParallelRegionUnion(Curves=spacepartition)
construct_domain_2 = ConstructDomain(DomainStart=Slider(0, range=0..100), DomainEnd=Slider(255, range=0..1000))

# ---- group: AddMissingCells
curve_4 = Curve(flatten(spacepartition))
nickname_2 = SortPointsXY(Grid=crv_5)
nickname_3 = SortPointsXY(Grid=curve_4)
missing = MissingGridCells(CulledGrid=nickname_3, OriginalGrid=nickname_2)
mgtree = MergeTreeMissing(CulledGrid=pararunion, MissingGridCells=missing)
pararunion_2 = ParallelRegionUnion(Curves=mgtree)

# ---- group: SpacePartition (continued)
parallelregionintersection_4 = ParallelRegionIntersection(CurvesA=curve, CurvesB=pararunion_2)
list_length_2 = ListLength(List=flatten(parallelregionintersection_4))
random = Random(Range=construct_domain_2, Number=list_length_2, Seed=colours, Integers=True)
explode_tree = ExplodeTree(Data=random)  # -> Branch0, Branch1, Branch2
region_difference = RegionDifference(CurvesA=parallelregionintersection_4, CurvesB=surface_3)  # disabled
colour_rgb_2 = ColourRGB(Alpha=Slider(77, range=0..255), Red=explode_tree.Branch0, Green=explode_tree.Branch1, Blue=explode_tree.Branch2)
colour_rgb_3 = ColourRGB(Alpha=255, Red=explode_tree.Branch0, Green=explode_tree.Branch1, Blue=explode_tree.Branch2)
surface_4 = Surface(parallelregionintersection_4)
custom_preview_2 = CustomPreview(Geometry=graft(surface_2), Material=graft(colour_rgb_2))
custom_preview_3 = CustomPreview(Geometry=surface_4, Material=graft(colour_rgb_3))

# ---- group: CalculateThresholdOfArea
flatten = FlattenTree(Tree=addition, Path="{0}")  # -> simplify(graft(Tree))
area_3 = Area(Geometry=parallelregionintersection_4, UseTasks=False)  # -> simplify(Area), Centroid
multiplication_3 = Multiplication(A=flatten, B=Slider(0.1, range=0..1))
addition_2 = Addition(A=flatten, B=multiplication_3)  # -> simplify(Result)
subtraction_2 = Subtraction(A=flatten, B=multiplication_3)  # -> simplify(Result)
null_item = NullItem(Item=area_3.Area)  # -> NullFlags, InvalidFlags, Description
expression = Expression(x=null_item.InvalidFlags, y=area_3.Area, Expression="If( True, y, 1000 )")
c_script = CSharpScript(AreaTree=area_3.Area)  # disabled
lng = ListLength(List=flatten(area_3.Area))
expression_2 = Expression(x=lng, y=Slider(25, range=0..100), Expression="If( x ≠ y, 1000000, 0 )")
expression_3 = Expression(x=expression, y=addition_2, z=subtraction_2, Expression="If( ( x < y) And ( x > z), 0, 1000 )")
mass_addition_2 = MassAddition(Input=flatten([expression_3, expression_2]))  # -> Result, PartialResults

# ---- group: Topology
flatten_tree_2 = FlattenTree(Tree=parallelregionintersection_4, Path="{0}")  # disabled
spctopo = SpaceTopology(Curves=flatten_tree_2)  # disabled
linetopo_3 = LineTopology(PointTree=simplify(area_3.Centroid), Topology=spctopo)  # disabled

# ---- group: SpaceSyntax
mass_addition_3 = MassAddition(Input=flatten(addition))  # -> Result, PartialResults; disabled
graphfromnodes_links = GraphFromNodesLinks(
    Points=flatten(area_3.Centroid),
    Links=flatten(linetopo_3),
    Labels=flatten(addindextolabels),
    Areas=flatten(addition),
    TotalArea=mass_addition_3.Result)  # -> Graph, GraphVertices, Attributes; disabled
number_slider_29 = Slider(0.3, range=0..10)  # disabled
number_slider_30 = Slider(2, range=0..10)  # disabled
number_slider_31 = Slider(2000, range=0..10000)  # disabled
boolean_toggle = BooleanToggle(True)  # disabled
forcedirecteddrawing = ForceDirectedDrawing(
    Graph=spctopo,
    Vertices=flatten(pt_3),
    Attributes=graphfromnodes_links.Attributes,
    AttractionStrength=0.25,
    RepulsionStrength=number_slider_29,
    ConvergenceTolearnce=number_slider_30,
    MaximumIterations=number_slider_31,
    Active=boolean_toggle)  # -> NewGraphVertices, IterationCount; disabled
diskographdrawing = DiskoGraphDrawing(
    Plane=PlaneXY(16.90127812, 6.56851581, 0),
    Graph=spctopo,
    Vertices=forcedirecteddrawing.NewGraphVertices,
    Attributes=graphfromnodes_links.Attributes,
    Thickness=1)  # disabled

# ----
text_tag = TextTag(Location=area_3.Centroid, Text=addindextolabels)
panel_2 = Panel(mass_addition_2.Result)
