# Grasshopper definition SpacePartition[4].gh (Grasshopper 1.0.7)
# plug-ins: SpacePartition, MeshEdit Components, ClipperComponents, Human, PTComponentLibrary, Weaverbird, MetaHopper, Kangaroo2 Components

# ---- group: Progress
spacepartitionnoparallel = CSharpScript()  # -> culledGrid, R, G, B; inputs voronoiIn: list of Polyline, gridIn: list of Polyline, areaIn: Double, seed: Int32; disabled
# ---------- spacepartitionnoparallel: C# usings ----------
using System.Linq;
# ---------- spacepartitionnoparallel: C# ----------
    var intersections = new DataTree<Curve>();
    var bools = new DataTree<bool>();

    for( int i = 0; i < voronoiIn.Count; ++i )
    {

      var voro = voronoiIn[i].ToNurbsCurve();

      for( int j = 0; j < gridIn.Count; ++j )
      {

        intersections.AddRange(Curve.CreateBooleanIntersection(voro, gridIn[j].ToNurbsCurve(), 1e-3).ToList(), new GH_Path(i, j));

      }

    }

    for( int i = 0; i < intersections.BranchCount; ++i )
    {

      var tempList = intersections.Branch(i);
      var path = new GH_Path(intersections.Path(i).Indices[0]);
      bool temp = false;

      if( tempList.Count > 0 )
      {

        var area = AreaMassProperties.Compute(intersections.Branch(i)[0]).Area;

        temp = area < areaIn ? false : true;

        bools.Add(temp, path);

      }

      else
      {

        temp = false;
        bools.Add(temp, path);

      }

    }

    var treeOut = new DataTree<Polyline>();
    var coloursOutR = new DataTree<int>();
    var coloursOutG = new DataTree<int>();
    var coloursOutB = new DataTree<int>();
    //var coloursOut = new DataTree<System.Drawing.Color>();
    var rand = new Random(seed);

    for( int i = 0; i < bools.BranchCount; ++i )
    {

      var path = intersections.Path(i);

      coloursOutR.Add(rand.Next(0, 255), path);
      coloursOutG.Add(rand.Next(0, 255), path);
      coloursOutB.Add(rand.Next(0, 255), path);
      //coloursOut.Add( System.Drawing.Color.FromArgb( 255, rand.Next( 0, 255 ), rand.Next( 0, 255 ), rand.Next( 0, 255 ) ), path );

      for( int j = 0; j < bools.Branch(i).Count; ++j )
      {

        if( bools.Branch(i)[j] == true )
        {

          treeOut.Add(gridIn[j], path);

        }

      }

    }

    culledGrid = treeOut;
    R = coloursOutR;
    G = coloursOutG;
    B = coloursOutB;
    //R = coloursOut;
# ---------- end spacepartitionnoparallel ----------
number_slider = Slider(4051, range=0..10000)  # disabled
pointtoclosestpath = CSharpScript()  # -> xOut, yOut; inputs grid: tree of Point3d, point: Point3d; disabled
# ---------- pointtoclosestpath: C# ----------
    int branchCount = grid.BranchCount;

    double minDistance = double.MaxValue;

    CustomPair cp;

    GH_Path path = new GH_Path();

    for( int i = 0; i < branchCount; ++i )
    {

      for( int j = 0; j < grid.Branch(i).Count; ++j )
      {

        double localDistance = point.DistanceTo(grid.Branch(i)[j]);
        cp.Key = localDistance;
        cp.Path = new GH_Path(i, j);
        minDistance = Math.Min(minDistance, localDistance);

        if( ( cp.Key - minDistance ) < 0.001 )
        {

          path = cp.Path;

        }

      }

    }

    xOut = path.Indices[0];
    yOut = path.Indices[1];
# ---------- pointtoclosestpath: C# additional code ----------
  struct CustomPair
  {

    public double Key;
    public GH_Path Path;

  }
# ---------- end pointtoclosestpath ----------
pointtoclosestpath_2 = CSharpScript()  # -> xOut, yOut; inputs grid: tree of Point3d, point: Point3d; disabled; same code as pointtoclosestpath
missinggridcells = CSharpScript()  # -> missing, places; inputs culledGrid: list of Polyline, originalGrid: list of Polyline; disabled
# ---------- missinggridcells: C# ----------
    List<Polyline> polys = new List<Polyline>();

    var temp = new List<Polyline>();

    int place = 0;
    
    List<int> placesL = new List<int>();

    int oGridC = originalGrid.Count;
    int cGridC = culledGrid.Count;

    int iter = oGridC - cGridC;

    for( int i = 0; i < iter; ++i )
    {

      polys.Add(BailOut(originalGrid, culledGrid, out place));
      culledGrid.Insert(place, originalGrid[place]);
      placesL.Add( place );

    }

    missing = polys;

    places = placesL;
# ---------- missinggridcells: C# additional code ----------
  Polyline BailOut(List<Polyline> originalGrid, List<Polyline> culledGrid, out int place)
  {

    place = 0;

    int oGridC = originalGrid.Count;
    int cGridC = culledGrid.Count;

    int iter = oGridC - cGridC;

    var tempPoly = new Polyline();

    var polysOut = new Polyline[iter];

    var cCenters = new Point3d[oGridC];
    var oCenters = new Point3d[oGridC];

    var distances = new int[oGridC];

    for( int i = place + 1; i < oGridC; ++i )
    {

      oCenters[i] = AreaMassProperties.Compute(originalGrid[i].ToNurbsCurve()).Centroid;

      if( i < cGridC )

        cCenters[i] = AreaMassProperties.Compute(culledGrid[i].ToNurbsCurve()).Centroid;

      else
      {

        cCenters[i] = Point3d.Unset;

      }

      distances[i] = oCenters[i].CompareTo(cCenters[i]);

      if( distances[i] != 0 )
      {

        tempPoly = originalGrid[i];

        place = i;

        break;

      }

    }

    return tempPoly;

  }
# ---------- end missinggridcells ----------
pathfinding = CSharpScript(idx=pointtoclosestpath.xOut, idj=pointtoclosestpath.yOut, fidx=pointtoclosestpath_2.xOut, fjdx=pointtoclosestpath_2.yOut)  # -> points; inputs grid: tree of Point3d, idx: Int32, idj: Int32, fidx: Int32, fjdx: Int32; disabled
# ---------- pathfinding: C# ----------
    int branchCount = grid.BranchCount;
    int maxTreeBranchCount = grid.Branch(branchCount - 1).Count;

    int x = idx % branchCount, y = idj % maxTreeBranchCount;

    Point3d tempPoint = new Point3d();
    Point3d point = grid.Branch(x)[y];
    Point3d finalPoint = grid.Branch(fidx % branchCount)[fjdx % maxTreeBranchCount];
    List<Point3d> tempList = new List<Point3d>();
    double minDistance = double.MaxValue;
    //var keyValuePair = new KeyValuePair<double, Point3d>();

    tempList.Add(point);

    CustomPair customPair;

    GH_Path path = new GH_Path();

    while( tempPoint.CompareTo(finalPoint) != 0 )
    {

      for( int xx = x - 1; xx < x + 2; ++xx )
        //System.Threading.Tasks.Parallel.For(x - 1, x + 2, xx =>
      {

        for( int yy = y - 1; yy < y + 2; ++yy )
          //System.Threading.Tasks.Parallel.For(y - 1, y + 2, yy =>
        {

          if( xx >= 0 && xx < branchCount && yy >= 0 && yy < maxTreeBranchCount )
          {

            double localDistance = finalPoint.DistanceTo(grid.Branch(xx)[yy]);

            customPair.Key = localDistance;
            customPair.Value = grid.Branch(xx)[yy];
            customPair.Path = new GH_Path(xx, yy);

            minDistance = Math.Min(minDistance, localDistance);

            if( ( customPair.Key - minDistance ) < 0.01 )
            {

              tempPoint = customPair.Value;
              path = customPair.Path;

            }

          }

        }

      }

      x = path.Indices[0];
      y = path.Indices[1];

      tempList.Add(tempPoint);

    }

    Print("Path: " + path.ToString());

    points = tempList;
# ---------- pathfinding: C# additional code ----------
  struct CustomPair
  {

    public double Key;
    public Point3d Value;
    public GH_Path Path;

  }
# ---------- end pathfinding ----------
spacepartitionallparallel = CSharpScript()  # -> simplify(culledGrid); inputs voronoiIn: list of Curve, gridIn: list of Curve, areaIn: Double; disabled
# ---------- spacepartitionallparallel: C# ----------
    int voronoiCount = voronoiIn.Count;
    int gridCount = gridIn.Count;

    Curve[][][] tempJagged = new Curve[voronoiCount][][];
    bool[][] boolJagged = new bool[voronoiCount][];
    var treeOut = new DataTree<Curve>();

    bool temp = false;
    double area = 0.0;

    System.Threading.Tasks.Parallel.For( 0, voronoiCount, i =>
    {

      var path = new GH_Path(i);

      var voro = voronoiIn[i];

      tempJagged[i] = new Curve[gridCount][];
      boolJagged[i] = new bool[gridCount];

      System.Threading.Tasks.Parallel.For(0, gridCount, j =>
        {

        tempJagged[i][j] = Curve.CreateBooleanIntersection(voro, gridIn[j].ToNurbsCurve(), 1e-8);

        if( tempJagged[i][j].Length > 0 )
        {

          area = AreaMassProperties.Compute(tempJagged[i][j][0]).Area;

          temp = area < areaIn ? false : true;

          boolJagged[i][j] = temp;

        }

        else
        {

          boolJagged[i][j] = false;

        }

        });

    });
    
    for( int i = 0; i < boolJagged.Length; ++i )
      for( int j = 0; j < boolJagged[i].Length; ++j )
      {

        if( boolJagged[i][j] == true )
        {

          treeOut.Add(gridIn[j]);


        }

      }

    culledGrid = treeOut;
# ---------- end spacepartitionallparallel ----------
spacepartitioninternalparallel = CSharpScript()  # -> simplify(culledGrid); inputs voronoiIn: list of Curve, gridIn: list of Curve, areaIn: Double; disabled
# ---------- spacepartitioninternalparallel: C# ----------
    int voronoiCount = voronoiIn.Count;
    int gridCount = gridIn.Count;

    Curve[][][] tempJagged = new Curve[voronoiCount][][];
    bool[][] boolJagged = new bool[voronoiCount][];
    var treeOut = new DataTree<Curve>();

    bool temp = false;
    double area = 0.0;

    for( int i = 0; i < voronoiCount; ++i )
    {

      var path = new GH_Path(i);

      var voro = voronoiIn[i];

      tempJagged[i] = new Curve[gridCount][];
      boolJagged[i] = new bool[gridCount];

      System.Threading.Tasks.Parallel.For(0, gridCount, j =>
        {

        tempJagged[i][j] = Curve.CreateBooleanIntersection(voro, gridIn[j].ToNurbsCurve(), 1e-8);

        if( tempJagged[i][j].Length > 0 )
        {

          area = AreaMassProperties.Compute(tempJagged[i][j][0]).Area;

          temp = area < areaIn ? false : true;

          boolJagged[i][j] = temp;

        }

        else
        {

          boolJagged[i][j] = false;

        }

        });

      for( int j = 0; j < boolJagged[i].Length; ++j )
      {

        if( boolJagged[i][j] == true )
        {

          treeOut.Add(gridIn[j]);


        }

      }
      
    }

    culledGrid = treeOut;
# ---------- end spacepartitioninternalparallel ----------
parallelregionintersection = CSharpScript()  # -> out, A; inputs CurvesA: list of Curve, CurvesB: list of Curve; disabled
# ---------- parallelregionintersection: C# ----------
    Curve[][][] tempJagged = new Curve[CurvesA.Count][][];
    var treeOut = new List<Curve>();

    for( int i = 0; i < CurvesA.Count; ++i )
    {

      var voro = CurvesA[i];

      tempJagged[i] = new Curve[CurvesB.Count][];

      System.Threading.Tasks.Parallel.For(0, CurvesB.Count, j =>
        {

        tempJagged[i][j] = Curve.CreateBooleanIntersection(voro, CurvesB[j], 1e-3);

        });

      for( int j = 0; j < tempJagged[i].Length; ++j )
      {

        for( int k = 0; k < tempJagged[i][j].Length; ++k )
        {

          var path = new GH_Path(i);

          treeOut.Add(tempJagged[i][j][k]);


        }

      }

    }

    A = treeOut;
# ---------- end parallelregionintersection ----------
pline = PolyLine(Vertices=pathfinding, Closed=False)  # disabled

# ---- group: InputData / Labels
txt = Text(Tree({0;0}: ["Unidades sanitarias mujeres / privadas"], {0;1}: ["Unidades sanitarias hombres / privadas"], {0;2}: ["Cuarto de aseo "], {0;3}: ["Área de aseo de residuos"], {0;4}: ["Almacen General Insumos de Aseo "], {0;5}: ["Área de UPC-Rack"]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))

# ---- group: InputData / Topology
int = Integer(Tree({0}: [7], {1}: [7], {2}: [3], {3}: [2, 11], {4}: [16, 21, 19], {5}: [19]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))

# ---- group: InputData / ID
txt_2 = Text(Tree({0;0}: ["5"], {0;1}: ["5"], {0;2}: ["5"], {0;3}: ["5"], {0;4}: ["5"], {0;5}: ["5"]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))

# ---- group: InputData / Areas
txt_3 = Text(Tree({0;0}: ["3"], {0;1}: ["3"], {0;2}: ["6"], {0;3}: ["1"], {0;4}: ["5"], {0;5}: ["4"]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))

# ---- group: InputData
number_slider_2 = Slider(1, range=0..10)
path_mapper = PathMapper(txt, source="{A;B}", target="{A}")
path_mapper_2 = PathMapper(txt_3, source="{A;B}", target="{A}")
path_mapper_3 = PathMapper(int, source="{A;B}", target="{A}")
path_mapper_4 = PathMapper(txt_2, source="{A;B}", target="{A}")
prunebranches = CSharpScript(branches=path_mapper, howMany=number_slider_2)  # -> prunedTree, branchCounter; inputs branches: tree of String, howMany: Int32
# ---------- prunebranches: C# ----------
    var treeOut = new DataTree<string>();

    for( int i = 0; i < branches.BranchCount - howMany; ++i )
      treeOut.AddRange(branches.Branch(i), new GH_Path(i));

    prunedTree = treeOut;
    branchCounter = treeOut.BranchCount;
# ---------- end prunebranches ----------
prunebranches_2 = CSharpScript(branches=path_mapper_2, howMany=number_slider_2)  # -> prunedTree, branchCounter; inputs branches: tree of String, howMany: Int32; same code as prunebranches
ma = MassAddition(Input=prunebranches_2.prunedTree)  # -> Result, PartialResults
flatten = FlattenTree(Tree=prunebranches_2.prunedTree, Path="{0}")
lng = ListLength(List=flatten)
int_2 = Integer(Slider(4, range=0..10))

# ---- group: Grid / Controllers
number_slider_3 = Slider(20.818, range=0..21)
number_slider_4 = Slider(4.392, range=0..5)
number_slider_5 = Slider(6, range=0..10)  # disabled
number_slider_6 = Slider(1, range=0..30)  # disabled
division = Division(A=number_slider_3, B=number_slider_5)  # disabled
division_2 = Division(A=number_slider_4, B=number_slider_6)  # disabled
number_slider_7 = Slider(0, range=0..1)  # disabled

# ----
pt = Point(Point(-30.22731102, -18.72041778, 0))  # disabled
pt_2 = Point(Point(-23.83729354, 16.36997504, 0))  # disabled
number_slider_8 = Slider(10, range=0..10)  # disabled
number_slider_9 = Slider(1, range=0..1)  # disabled
number_slider_10 = Slider(0.5, range=0..1)  # disabled
number_slider_11 = Slider(0, range=0..1)  # disabled
Z = UnitZ(Factor=1)  # disabled

# ---- group: Voronoi / Controllers
seedsx = GenePool(
    Decimals=4,
    Maximum=1,
    Minimum=0,
    Value=[1, 0.9619, 0.8486, 0.5935, 0, 0.4555, 0.5736, 0.413, 0.0394, 0.8345, 0.1985, 1, 0, 0.8929, 0.474, 0.156, 0, 0.0778, 0.5616, 0.8085, 0.2722, 0.1816, 1, 0.8818, 0.2285])
seedsy = GenePool(
    Decimals=4,
    Maximum=1,
    Minimum=0,
    Value=[0.7383, 0, 0.5811, 0.1416, 0.4559, 0.3962, 0.6995, 0.8896, 0.9707, 0.9041, 0.2249, 0.2287, 0, 0.3339, 0.3498, 0.1315, 0.4636, 0.0994, 0.6014, 0.8461, 0.9088, 0.3197, 0, 1, 0.7524])

# ----
number_slider_12 = Slider(1000, range=0..1000)  # disabled
number_slider_13 = Slider(0, range=0..1000)  # disabled
number_slider_14 = Slider(0, range=0..1000)  # disabled
number_slider_15 = Slider(9, range=0..10)  # disabled
number_slider_16 = Slider(2.61, range=0..10)  # disabled
number_slider_17 = Slider(6, range=0..100)  # disabled
number_slider_18 = Slider(13, range=0..100)  # disabled
number_slider_19 = Slider(1, range=0..1)  # disabled
number_slider_20 = Slider(0.907, range=0..10)  # disabled
number_slider_21 = Slider(-5.701, range=-10..10)  # disabled
number_slider_22 = Slider(8, range=0..10)
series = Series(Start=0, Step=1, Count=number_slider_17)  # -> expr("-x", Series); disabled
rgb = ColourRGB(Alpha=255, Red=number_slider_12, Green=number_slider_13, Blue=number_slider_14)  # disabled
series_2 = Series(Start=number_slider_19, Step=number_slider_20, Count=number_slider_18)  # disabled
number_slider_23 = Slider(10, range=0..10)  # disabled
number_slider_24 = Slider(0, range=0..100)  # disabled
number_slider_25 = Slider(5, range=0..10)  # disabled
number_slider_26 = Slider(19, range=0..100)  # disabled
number_slider_27 = Slider(0, range=0..20)  # disabled
number_slider_28 = Slider(100, range=0..100)  # disabled
number_slider_29 = Slider(10, range=0..10)  # disabled
number_slider_30 = Slider(0, range=0..100)  # disabled
num = Number(ma.Result)
number_slider_31 = Slider(7.87, range=0..10)  # disabled
number_slider_32 = Slider(10, range=0..10)  # disabled
number_slider_33 = Slider(10.001, range=-10..10.001)  # disabled
Z_2 = UnitZ(Factor=1)  # disabled
number_slider_34 = Slider(0, range=0..10)  # disabled
line = Line(Line((2.814707438, -1.355663716, 0), (3.419507101, 7.867531141, 0)))
line_2 = Line(Line((-0.1336909177, 4.38993308, 0), (6.594705331, 4.38993308, 0)))
threshold = Slider(15, range=0..200)
c_script = CSharpScript(x=line, y=line_2)  # -> out, A; inputs x: Curve, y: Curve
# ---------- c_script: C# ----------
    Interval interval = new Interval();
    
    var ccx = Curve.PlanarCurveCollision(x, y, Plane.WorldXY, 1e-7);
    
    A = ccx;
# ---------- c_script: C# additional code ----------
  public void LineLineIntx(Point3d pt1, Point3d pt2, Point3d pt3, Point3d pt4, ref Interval interval) {
    // via Paul Bourke: http://www-cs.ccny.cuny.edu/~wolberg/capstone/intersection/Intersection%20point%20of%20two%20lines.html
    double denom = ( pt4.Y - pt3.Y ) * ( pt2.X - pt1.X ) - ( pt4.X - pt3.X ) * ( pt2.Y - pt1.Y );

    if( denom != 0 )
    {
      double u1 = ( ( pt4.X - pt3.X ) * ( pt1.Y - pt3.Y ) - ( pt4.Y - pt3.Y ) * ( pt1.X - pt3.X ) ) / denom;
      double u2 = ( ( pt2.X - pt1.X ) * ( pt1.Y - pt3.Y ) - ( pt2.Y - pt1.Y ) * ( pt1.X - pt3.X ) ) / denom;

      interval = new Interval(u1, u2);

    }

  }
# ---------- end c_script ----------

# ---- group: PREVENTS INFINITE LOOPS (ALSO ALLOWS STEPPING THROUGH PROCESS)
threshold_2 = Slider(14, range=0..40)

# ---- group: ARBITRARY VERY HIGH NUMBER
threshold_3 = Integer(1000)

# ---- group: SpacePartition / OriginalSilhouette
crv = Curve(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)

# ----
crv_2 = Curve(crv)
crv_3 = Curve(crv_2)
disc = Discontinuity(Curve=crv_3, Level=1)  # -> Points, Parameters; disabled
del = DelaunayMesh(Points=disc.Points, Plane=PlaneXY(0, 0, 0))  # disabled
explode = MeshExplode(Mesh=del, Interpolate=False)  # disabled
mcx = MeshCurve(Mesh=explode, Curve=crv_3)  # -> Points, Faces; disabled
offset = OffsetCurve(Curve=crv_3, Distance=series, Plane=PlaneXY(0, 0, 0), Corners=1)  # disabled
polyoffset = PolylineOffset(
    Polylines=crv_3,
    Distance=series_2,
    Plane=Plane(origin=(0, 0, 0), x=(0, 0, 0), y=(0, 0, 0)),
    Tolerance=0.01,
    ClosedFillet=1,
    OpenFillet=1,
    Miter=2)  # -> Contour, Holes; disabled
crv_4 = Curve(polyoffset.Holes)  # disabled
flatten_2 = FlattenTree(Tree=crv_4, Path="{0}")  # disabled
disc_2 = Discontinuity(Curve=crv_4, Level=3)  # -> Points, Parameters; disabled
lng_2 = ListLength(List=flatten_2)  # disabled
division_3 = Division(A=lng_2, B=number_slider_8)  # disabled
cdiv = Derivatives(Curve=crv_4, Parameter=disc_2.Parameters)  # -> Point, FirstDerivative; disabled
partition = PartitionList(List=flatten_2, Size=division_3)  # disabled
xprod = CrossProduct(VectorA=Z, VectorB=cdiv.FirstDerivative, Unitize=False)  # -> Vector, Length; disabled
boundary = BoundarySurfaces(Edges=flatten(crv_4))  # disabled
boundary_2 = BoundarySurfaces(Edges=partition)  # disabled
vdis = VectorDisplay(Anchor=cdiv.Point, Vector=unitize(xprod.Vector))
area = Area(Geometry=boundary, UseTasks=False)  # -> Area, Centroid; disabled
shatter = Shatter(Curve=crv_4, Parameters=disc_2.Parameters)  # -> simplify(Segments); disabled
c_script_2 = CSharpScript(Points=disc_2.Points, y=number_slider_15)  # -> out, A; inputs Points: tree of Point3d, y: Int32; disabled
# ---------- c_script_2: C# usings ----------
using Rhino.Collections;
# ---------- c_script_2: C# ----------
    DataTree<Point3d> pointsOut = new DataTree<Point3d>();

    int size = Points.BranchCount;

    //Point3d.ClosestPointInList();

    //double minDistance = double.MaxValue, tempDist = 0.0;

    for( int i = 1; i < size; ++i )
    {

      for( int j = 0; j < Points.Branch(i).Count; ++j )
      {

        //pointsOut.Add(Point3dList.ClosestPointInList(Points.Branch(i - 1), Points.Branch(i)[j]), new GH_Path(j));
        pointsOut.Add(Points.Branch(i)[j], new GH_Path(j));


      }

    }

    A = pointsOut;

/*
    //    Polyline[] poly = new Polyline[size];

    DataTree<Point3d> pointsOut = new DataTree<Point3d>();

    for( int i = 0; i < size; ++i )
    {

      for( int j = 0; j < Points.Branch(i).Count; ++j )
      {


        pointsOut.Add(Points.Branch(i)[j], new GH_Path(j));

        //        poly[i] = new Polyline(Points.Branch(i)[j]);

      }

    }

    A = pointsOut;*/
# ---------- end c_script_2 ----------
flatten_3 = FlattenTree(Tree=shatter, Path="{0}")  # disabled
pline_2 = PolyLine(Vertices=c_script_2.A, Closed=True)  # disabled
end = EndPoints(Curve=shatter)  # -> Start, End; disabled
item = ListItem(List=disc_2.Points, Index=number_slider_24, Wrap=True)  # -> Item, Item1, Item2, Item3; disabled
points = PointList(Points=c_script_2.A, Size=number_slider_16)  # disabled
null = NullItem(Item=disc_2.Points)  # -> NullFlags, InvalidFlags, Description; disabled
bang = ExplodeTree(Data=simplify(disc_2.Points))  # -> Branch0, Branch1, Branch2, Branch3, Branch4, Branch5, Branch6, Branch7, Branch8, Branch9; disabled
bang_2 = ExplodeTree(Data=c_script_2.A)  # -> Branch0, Branch1, Branch2, Branch3, Branch4, Branch5, Branch6, Branch7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; disabled
item_2 = ListItem(List=end.Start, Index=number_slider_23, Wrap=True)  # -> Item, Item1, Item2, Item3; disabled
ccx = CurveCurve(CurveA=polyoffset.Holes, CurveB=crv_3)  # -> Points, ParamsA, ParamsB; disabled
points_2 = PointList(Points=disc_2.Points, Size=number_slider_16)  # disabled
cull = CullPattern(List=flatten(disc_2.Points), CullPattern=invert(flatten(null.NullFlags)))  # disabled
pline_3 = PolyLine(Vertices=flatten(item.Item), Closed=False)  # disabled
pline_4 = PolyLine(Vertices=flatten(item.Item1), Closed=False)  # disabled
pline_5 = PolyLine(Vertices=flatten(item.Item2), Closed=False)  # disabled
pline_6 = PolyLine(Vertices=flatten(item.Item3), Closed=False)  # disabled
pt_3 = Point([bang.Branch7, bang.Branch6, bang.Branch8])  # disabled
pt_4 = Point(bang_2.Branch10)  # disabled
item_3 = ListItem(List=disc_2.Points, Index=number_slider_26, Wrap=True)  # -> Item, Item1, Item2, Item3; disabled
null_2 = NullItem(Item=mcx.Points)  # -> NullFlags, InvalidFlags, Description; disabled
wbdual = WeaverbirdsDualGraph(MeshCurves=del, DualMode=0)  # disabled
medges = MeshEdges(Mesh=explode)  # -> NakedEdges, InteriorEdges, NonManifoldEdges; disabled
dispatch = Dispatch(List=graft(explode), DispatchPattern=null_2.NullFlags)  # -> ListA, ListB; disabled
c_script_3 = CSharpScript(Points=disc_2.Points, y=number_slider_15)  # -> out, A; inputs Points: tree of Point3d, y: Int32; disabled
# ---------- c_script_3: C# ----------
    DataTree<Point3d> pointsOut = new DataTree<Point3d>();

    int size = Points.BranchCount;

    //Point3d.ClosestPointInList();

    double minDistance = double.MaxValue, tempDist = 0.0;
    Point3d point = new Point3d();

    for( int i = 1; i < size; ++i )
    {

      for( int j = 0; j < Points.Branch(i).Count; ++j )
      {

        //pointsOut.Add(Point3dList.ClosestPointInList(Points.Branch(i - 1), Points.Branch(i)[j]), new GH_Path(j));
        point = Points.Branch(i)[j];
        tempDist = point.DistanceTo( Points.Branch(i - 1)[j] );
        minDistance = Math.Min( minDistance, tempDist );
        
        if( minDistance == point.DistanceTo( Points.Branch(i - 1)[j] ) )
        {
        
          Print(minDistance.ToString());
          //pointsOut.Add( point, new GH_Path(j) );

        }
          
      }
      
      minDistance = double.MaxValue;
      tempDist = 0.0;

    }

    A = pointsOut;

/*
    //    Polyline[] poly = new Polyline[size];

    DataTree<Point3d> pointsOut = new DataTree<Point3d>();

    for( int i = 0; i < size; ++i )
    {

      for( int j = 0; j < Points.Branch(i).Count; ++j )
      {


        pointsOut.Add(Points.Branch(i)[j], new GH_Path(j));

        //        poly[i] = new Polyline(Points.Branch(i)[j]);

      }

    }

    A = pointsOut;*/
# ---------- end c_script_3 ----------
c_script_4 = CSharpScript(Points=pt_3, y=number_slider_15)  # -> out, A; inputs Points: tree of Point3d, y: Int32; disabled
# ---------- c_script_4: C# ----------
    DataTree<Point3d> pointsOut = new DataTree<Point3d>();
    
    int size = Points.BranchCount;

    //Point3d.ClosestPointInList();
    
    //double minDistance = double.MaxValue, tempDist = 0.0;
    
    for( int i = 0; i < size; ++i )
    {
    
      for( int j = 0; j < Points.Branch(i).Count; ++j )
      {
      
        pointsOut.Add( Point3dList.ClosestPointInList( Points.Branch(i), Points.Branch(i)[j] ), new GH_Path(j) );
      
      }
    
    }
    
    A = pointsOut;

/*
    //    Polyline[] poly = new Polyline[size];

    DataTree<Point3d> pointsOut = new DataTree<Point3d>();

    for( int i = 0; i < size; ++i )
    {

      for( int j = 0; j < Points.Branch(i).Count; ++j )
      {


        pointsOut.Add(Points.Branch(i)[j], new GH_Path(j));

        //        poly[i] = new Polyline(Points.Branch(i)[j]);

      }

    }

    A = pointsOut;*/
# ---------- end c_script_4 ----------
crv_5 = Curve(polyoffset.Holes)  # disabled
points_3 = PointList(Points=cull)  # disabled
pline_7 = PolyLine(Vertices=flatten(item_3.Item), Closed=False)  # disabled
pline_8 = PolyLine(Vertices=flatten(item_3.Item1), Closed=False)  # disabled
pline_9 = PolyLine(Vertices=flatten(item_3.Item2), Closed=False)  # disabled
pline_10 = PolyLine(Vertices=flatten(item_3.Item3), Closed=False)  # disabled
pline_11 = PolyLine(Vertices=flatten(cull), Closed=False)  # disabled
pline_12 = PolyLine(Vertices=pt_4, Closed=False)  # disabled
pline_13 = PolyLine(Vertices=pt_3, Closed=True)  # disabled
points_4 = PointList(Points=pt_4, Size=number_slider_16)  # disabled
explode_2 = Explode(Curve=crv_3, Recursive=True)  # -> Segments, Vertices
flatten_4 = FlattenTree(Tree=disc_2.Points, Path="{0}")  # disabled
points_5 = PointList(Points=c_script_3.A, Size=number_slider_16)  # disabled
del_2 = DelaunayMesh(Points=flatten_4, Plane=PlaneXY(0, 0, 0))  # disabled
mesh = Mesh(dispatch.ListA)  # disabled
pline_14 = PolyLine(Vertices=c_script_3.A, Closed=True)  # disabled
pline_15 = PolyLine(Vertices=c_script_4.A, Closed=True)  # disabled
prox = Proximity2D(Points=flatten_4, Plane=PlaneXY(0, 0, 0), Group=number_slider_29, MinRadius=number_slider_27, MaxRadius=number_slider_28)  # -> flatten(Links), Topology; disabled
hull = ConvexHull(Points=flatten_4, Plane=PlaneXY(0, 0, 0))  # -> Hull, HullZ, Indices; disabled
voronoi = Voronoi(Points=flatten_4, Radius=number_slider_31, BruteForceOverride=False)  # disabled
cir = Circle(Plane=flatten_4, Radius=number_slider_31)  # disabled

# ----
# ATTENTION: Be sure there are no duplicate segments!
crv_6 = Curve(flatten(explode_2.Segments))
y_bounds = Domain(Domain(-180, 180))
grid_divisions = Integer(Slider(38, range=0..100))
x_bounds = Domain(Domain(-200, 200))

intercull = IntersectionCulling(CurvesToCull=flatten(prox.Links), BoundaryCurve=crv_3)  # disabled
area_2 = Area(Geometry=crv_3)  # -> Area, Centroid; disabled
panel = Panel(c_script_3.out)  # disabled
reconstruct = ReconstructCurve(CurvesIn=flatten(prox.Links))  # disabled
cut = CutCorners(CurvesToSplit=prox.Links)  # disabled
spctopo = SpaceTopology(Curves=voronoi)  # disabled
dom² = Domain²(DomainU=x_bounds, DomainV=y_bounds)
disc_3 = Discontinuity(Curve=crv_3, Level=1)  # -> Points, Parameters; disabled
ln = Line(StartPoint=area_2.Centroid, EndPoint=disc_3.Points)  # disabled

# ---- group: PREVIEW SUBDIV GRID
divide = DivideDomain²(Domain=dom², UCount=grid_divisions, VCount=grid_divisions)
dom = Domain²Components(Domain=divide)  # -> UComponent, VComponent
rectangle = Rectangle(Plane=PlaneXY(0, 0, 0), XSize=dom.UComponent, YSize=dom.VComponent, Radius=0)  # -> Rectangle, Length
preview = CustomPreview(Geometry=rectangle.Rectangle, Shader=ColourSwatch(SwatchColor=RGB(217, 217, 217)))

# ----
shatter_2 = Shatter(Curve=crv_3, Parameters=disc_3.Parameters)  # disabled

# ---- group: Spine
toggle = GroupToggle(ToggleActive=True, ToggleVisible=False)  # disabled
number_slider_35 = Slider(320, range=0..1000)  # disabled
crv_7 = Curve(crv_2)  # disabled
skeleton = MedialAxisSkeleton(CurveIn=crv_7, NumberOfSamples=number_slider_35, ParallelComputing=True)  # disabled
dupln = RemoveDuplicateLines(Lines=skeleton, Tolerance=0.01)  # disabled
inside = InsideOriginal(CurvesToCull=dupln, BoundaryCurve=crv_2, ParallelComputing=True)  # disabled
crv_8 = Curve(inside)  # disabled
cut_2 = CutCorners(CurvesToSplit=crv_8)  # disabled
number_slider_36 = Slider(0.913, range=-10..10)  # disabled
offset_2 = OffsetCurve(Curve=crv_7, Distance=number_slider_36, Plane=PlaneXY(0, 0, 0), Corners=1)  # disabled
intercull_2 = IntersectionCulling(CurvesToCull=cut_2, BoundaryCurve=offset_2, ParallelComputing=True)  # disabled
reconstruct_2 = ReconstructCurve(CurvesIn=intercull_2)  # disabled

# ----
lng_3 = ListLength(List=spctopo)  # -> flatten(Length); disabled
shift = ShiftList(List=ln, Shift=1, Wrap=True)  # disabled
cdiv_2 = Derivatives(Curve=crv_3, Parameter=disc_3.Parameters)  # -> Point, FirstDerivative; disabled
linetopo = LineTopology(PointTree=graft(flatten_4), Topology=spctopo)  # -> flatten(LineTopology); disabled
angle = Angle(VectorA=ln, VectorB=shift)  # -> Angle, Reflex; disabled
hem_open_xy_networks = VBScript(seg=flatten(crv_6), bnd=dom², sbdv=grid_divisions)  # -> out, flatten(e), flatten(eOV), flatten(ePE), flatten(eNE), flatten(eTE), flatten(eIF), flatten(v)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; inputs seg: list of Curve
# ---------- hem_open_xy_networks: VB ----------
    'Definition originally written For
    '  codeQuotidien.wordpress.org
    '  Trevor Patt
    '  trpatt@gmail.com

    '  Creative Commons:  Attribution/NonCommercial/ShareAlike

    '  Implementation of Half-Edge Mesh based on
    '    Computational Geometry: Algorithms and Applications
    '    (de Berg, Cheong, van Kreveld, and Overmas, 2008. Chapter 2)
    '    books.google.ch: http://goo.gl/vBq40



    Dim edgeList As New list(Of Line)
    Dim eOVlist As New dataTree(Of int32)
    Dim ePElist As New dataTree(Of int32)
    Dim eNElist As New dataTree(Of int32)
    Dim eTElist As New list(Of int32)
    Dim eIFlist As New list(Of int32)
    Dim vtxList As New list(Of point3d)
    Dim vIElist As New list(Of int32)
    Dim fList As New datatree(Of point3d)
    Dim fIElist As New dataTree(Of int32)

    Dim vIEall As New dataTree(Of int32)
    Dim eF As New list(Of Boolean)

    Dim eDegList As New List(Of Double)

    '********FOR EACH SEGMENT, ADD EDGE AND ITS REVERSE (twin) TO edgeList********
    Dim segCt As int32 = 0
    For i As int32=0 To seg.count - 1
      If seg(i).pointAtStart.distanceto(seg(i).pointAtEnd) > 0 Then
        edgeList.add(New Line(seg(i).pointAtStart, seg(i).pointAtEnd))
        edgeList.add(New Line(seg(i).pointAtEnd, seg(i).pointAtStart))
        eTEList.add((segCt * 2) + 1)
        eTEList.add((segCt * 2))
        'DEFAULT SETTING FOR ef IS TRUE (ie EDGE NEEDS TO BE ASSIGNED TO A FACE)
        ef.add(True)
        ef.add(True)
        eIFlist.add(-10)
        eIFlist.add(-10)

        EdgeDirection(edgeList(edgeList.count - 2), eDegList)
        segCt += 1
      End If
    Next

    Dim vtxTree As New dataTree(Of point3d)
    Dim vNdxTree As New dataTree(Of Int32)
    For i As int32=0 To sbdv - 1
      For j As int32=0 To sbdv - 1
        vtxTree.ensurepath(New gh_path(i, j))
        vNdxTree.ensurepath(New gh_path(i, j))
      Next
    Next


    '********CONSTRUCT VERTEX LIST FROM LIST OF HALF-EDGES********
    For i As int32=0 To edgeList.count - 1
      'boolCk = (is there a close point?, what is the index)
      Dim boolCk() As int32 = {0,-10}

      Dim vCt As int32 = vtxTree.datacount
      CheckLinePt(edgeList(i), vtxTree, vNdxTree, boolCk, bnd, sbdv, 0)

      'IF A NEW VERTEX WAS ADDED, THEN ADD EDGE INDEX TO vIE, vIEall, AND eOV
      If vtxTree.datacount > vCt Then
        vIElist.add(i)
        vIEall.add(i, New GH_Path(boolCk(1)))
        eOVlist.add(boolCk(1), New GH_Path(i))

      Else If boolCK(1) >= 0 Then
        vIEall.add(i, New GH_Path(boolCK(1)))
        eOVlist.add(boolCK(1), New GH_Path(i))
      End If
    Next



    '********FROM EACH HALF-EDGE..
    For i As int32=0 To edgeList.count - 1
      Dim boolCk() As int32 = {0,-10}
      'FIND VERTEX CORRESPONDING TO ENDPOINT (=boolCk(1))
      CheckLinePt(edgeList(i), vtxTree, vNdxTree, boolCk, bnd, sbdv, 1)

      'boolCk(1)=TARGET VERTEX, CHECK ANGLE OF ALL EDGES LEAVING THIS VERTEX
      Dim nxtVtxPth As New gh_path(boolCk(1))
      Dim angCk As Double = -100
      Dim ndx As int32 = -10
      'Dim xProd As vector3d = vector3d.CrossProduct(edgeList(i).direction, vector3d.ZAxis)



      '..FIND NEXT EDGE********
      For j As int32=0 To vIEall.branch(nxtVtxPth).count - 1
        If i <> eTElist(vIEall(nxtVtxPth, j)) Then
          Dim ang As Double = eDegList(eTElist(i)) - eDegList(vIEall(nxtVtxPth, j))
          If ang < 0 Then ang += 360
          If ang > angCk  Then
            angCk = ang
            ndx = j
          End If
        End If
      Next

      If ndx >= 0 Then
        eNElist.add(vIEall(nxtVtxPth, ndx), New GH_Path(i))
        ePElist.add(i, New GH_Path(vIEall(nxtVtxPth, ndx)))
      Else
        'NO NEXT EDGE FOUND, THEN NEXT EDGE IS TWIN
        angCk = math.PI
        ndx = eTElist(i)
        eNElist.add(eTElist(i), New GH_Path(i))
        ePElist.add(i, New GH_Path(eTElist(i)))
      End If
    Next



    '********FIND EDGE-LOOPS / 'FACES'********
    Dim faceCt As int32 = 0
    For i As int32=0 To edgeList.count - 1
      If ef(i) Then
        fList.add(edgeList(i).pointAt(0), New gh_path(faceCt))
        fIEList.add(i, New gh_path(faceCt))
        eIFlist(i) = faceCt
        ef(i) = False
        loopFace(edgeList, ef, eNElist, eNElist(New GH_Path(i), 0), i, fIElist, fList, eIFlist, faceCt)
        faceCt += 1
      End If
    Next


    '********CONVERT vtxTree (SORTED IN BRANCHES BY LOCATION IN GRID)TO LIST (IN ORDER OF INDEX VALUE)********
    For i As int32=0 To vtxTree.datacount - 1
      vtxList.add(Nothing)
    Next
    For i As int32=0 To vtxTree.datacount - 1
      Dim sortNdx As int32 = vNdxTree.alldata(i)
      vtxList(sortNdx) = vtxTree.alldata(i)
    Next

    e = edgeList
    eOV = eOVlist
    eNE = eNElist
    ePE = ePElist
    eTE = eTElist
    eIF = eIFlist
    v = vtxList ' vtxTree
    vIE = vIEall
    f = fList
    fIE = fIElist

    '********PRINT HEM STATS********
    print(vtxList.count & " vertices")
    print(faceCt & " faces")
    print(edgeList.count & " ½ edges")
# ---------- hem_open_xy_networks: VB additional code ----------
  Sub CheckLinePt(ByVal eCurr As Line, ByRef vTree As datatree(Of point3d), ByRef nTree As datatree (Of int32), ByRef ck As Array, ByVal dom As UVInterval, ByVal div As int32, ByVal t As Double)
    'WHEN t=0: CHECKING START POINT; WHEN t=1: CHECKING END POINT
    Dim ptCk As New point3d(eCurr.PointAt(t))

    'POINT VALUE (MINUS DOMAIN STARTING POINT) DIVIDED BY STEP, FLOORED
    Dim pthX As int32 = Math.floor((ptCk.X - dom.u0) / ((dom.U1 - dom.U0) / div))
    Dim pthY As int32 = Math.floor((ptCk.y - dom.v0) / ((dom.v1 - dom.v0) / div))
    pthX = math.min(math.Max(pthX, 0), div - 1)
    pthY = math.min(math.Max(pthY, 0), div - 1)
    Dim pthXY As New gh_path(pthX, pthY)
    ck(1) = -10

    'CHECK ALREADY ADDED NODES
    If vTree.pathExists(pthXY) Then
      For j As int32=0 To vTree.branch(pthXY).count - 1
        If ptCk.DistanceTo(vTree(pthXY, j)) < .1 Then
          ck(0) += 1
          ck(1) = nTree(pthXY, j)
          Exit For
        End If
      Next
    End If

    'IF NOT ALREADY ADDED, THEN ADD
    If  ck(0) = 0 AndAlso ck(1) < 0 Then
      ck(1) = vTree.datacount
      nTree.add(vTree.datacount, pthXY)
      vTree.add(ptCk, pthXY)
    End If

  End Sub


  Sub EdgeDirection(ByRef eCurr As Line, ByRef degList As List(Of Double))
    'FIND DIRECTION OF EDGE
    Dim deg As Double
    If eCurr.direction.x = 0 Then
      deg = (90 * (eCurr.Direction.Y / math.abs(eCurr.Direction.Y))) + 360
      deg = (360 + deg) Mod 360
    Else
      deg = ((math.atan(eCurr.Direction.Y / eCurr.Direction.x)) * 180 / math.PI)
      If eCurr.Direction.X < 0 Then deg = 180 + deg
      If eCurr.Direction.X > 0  Then deg = (360 + deg) Mod 360
    End If

    degList.add(deg)
    degList.add((deg + 180) Mod 360)
  End Sub


  Sub loopFace(ByVal eList As list(Of line), ByRef ck As list(Of Boolean), ByVal eNE As datatree(Of int32), ByVal n As int32, ByVal init As int32, ByRef fList As datatree(Of int32), ByRef f As datatree(Of point3d), ByRef efList As List(Of int32), ByRef ct As int32)
    If n <> init Then
      f.add(eList(n).pointAt(0), New gh_path(ct))
      fList.add(n, New gh_path(ct))
      efList(n) = ct
      ck(n) = False
      loopFace(eList, ck, eNE, eNE(New GH_Path(n), 0), init, fList, f, efList, ct)
    End If
  End Sub
# ---------- end hem_open_xy_networks ----------
points_6 = PointList(Points=disc_3.Points, Size=number_slider_32)  # disabled
xprod_2 = CrossProduct(VectorA=cdiv_2.FirstDerivative, VectorB=Z_2, Unitize=False)  # -> expr("-x", unitize(Vector)), Length; disabled
c_script_5 = CSharpScript(Lines=explode_2.Segments)  # -> out, A; inputs Lines: list of Line; disabled
# ---------- c_script_5: C# ----------
    double angle = 0.0;
    
    for( int i = 0; i < Lines.Count - 1; ++i )
    {
    
      EdgeDirection( Lines[i], ref angle );
      Print( angle.ToString() );
    
    }
# ---------- c_script_5: C# additional code ----------
  public void EdgeDirection(Line eCurr, ref double angle)
  {
    // FIND DIRECTION OF EDGE
    //double angle;
    if (eCurr.Direction.X == 0)
    {
      angle = 90 * (eCurr.Direction.Y / Math.Abs(eCurr.Direction.Y)) + 360;
      angle = (360 + angle) % 360;
    }
    else
    {
      angle = Math.Atan(eCurr.Direction.Y / eCurr.Direction.X) * 180 / Math.PI;
      if (eCurr.Direction.X < 0)
        angle = 180 + angle;
      if (eCurr.Direction.X > 0)
        angle = (360 + angle) % 360;
    }

  }
# ---------- end c_script_5 ----------
deg = Degrees(Radians=angle.Angle)  # disabled
join = JoinCurves(Curves=linetopo, Preserve=False)  # disabled
polyoffset_2 = PolylineOffset(
    Polylines=crv_3,
    Distance=number_slider_33,
    Plane=Plane(origin=(0, 0, 0), x=(0, 0, 0), y=(0, 0, 0)),
    Tolerance=0.01,
    ClosedFillet=1,
    OpenFillet=1,
    Miter=2)  # -> Contour, Holes
panel_2 = Panel(c_script_5.out)  # disabled
move = Move(Geometry=disc_3.Points, Motion=xprod_2.Vector)  # -> Geometry, Transform; disabled
expression = Expression(x=lng_3, y=number_slider_34, Expression="If( x > y, True, False )")  # disabled
cut_3 = CutCorners(CurvesToSplit=join)  # disabled
tag = TextTag(Location=disc_3.Points, Text=deg)  # disabled
c_script_6 = CSharpScript(seg=crv_6, bnd=dom², sbdv=grid_divisions)  # -> out, flatten(e), flatten(eOV), flatten(ePE), flatten(eNE), flatten(eTE), flatten(eIF), flatten(v)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; inputs seg: list of Curve, sbdv: Int32
# ---------- c_script_6: C# ----------
    List<Line> edgeList = new List<Line>();
    DataTree<int> eOVList = new DataTree<int>();
    DataTree<int> ePEList = new DataTree<int>();
    DataTree<int> eNEList = new DataTree<int>();
    List<int> eTEList = new List<int>();
    List<int> eIFList = new List<int>();
    List<Point3d> vtxList = new List<Point3d>();
    List<int> vIEList = new List<int>();
    DataTree<Point3d> fList = new DataTree<Point3d>();
    DataTree<int> fIEList = new DataTree<int>();
    DataTree<int> vIEall = new DataTree<int>();
    List<bool> eF = new List<bool>();
    List<double> eDegList = new List<double>();
    int segCt = 0;
    for( int i = 0; i <= seg.Count - 1; ++i )
    {

      if( seg[i].PointAtStart.DistanceTo(seg[i].PointAtEnd) > 0 )
      {
        edgeList.Add(new Line(seg[i].PointAtStart, seg[i].PointAtEnd));
        edgeList.Add(new Line(seg[i].PointAtEnd, seg[i].PointAtStart));
        eTEList.Add(((segCt * 2)
          + 1));
        eTEList.Add((segCt * 2));
        // DEFAULT SETTING FOR ef IS TRUE (ie EDGE NEEDS TO BE ASSIGNED TO A FACE)
        eF.Add(true);
        eF.Add(true);
        eIFList.Add(-10);
        eIFList.Add(-10);
        EdgeDirection(edgeList[edgeList.Count - 2], eDegList);
        //EdgeDirection(edgeList((edgeList.Count - 2)), eDegList);
        segCt++;

      }

    }

    DataTree<Point3d> vtxTree = new DataTree<Point3d>();
    DataTree<int> vNdxTree = new DataTree<int>();
    for( int i = 0; i <= sbdv - 1; i++ )
    {
      for( int j = 0; j <= sbdv - 1; j++ )
      {

        vtxTree.EnsurePath(new GH_Path(i, j));
        vNdxTree.EnsurePath(new GH_Path(i, j));

      }

    }

    // ********CONSTRUCT VERTEX List FROM List OF HALF-EDGES********
    for( int i = 0; i <= edgeList.Count - 1; i++ )
    {
      // boolCk = (is there a close point?, what is the index)
      int[] boolCk = {0,-10};
      int vCt = vtxTree.DataCount;
      CheckLinePt(edgeList[i], ref vtxTree, ref vNdxTree, ref boolCk, bnd, sbdv, 0);
      // IF A NEW VERTEX WAS AddED, THEN Add EDGE INDEX TO vIE, vIEall, AND eOV
      if ((vtxTree.DataCount > vCt)) {
        vIEList.Add(i);
        vIEall.Add(i, new GH_Path(boolCk[1]));
        eOVList.Add(boolCk[1], new GH_Path(i));
      }
      else if ((boolCk[1] >= 0)) {
        vIEall.Add(i, new GH_Path(boolCk[1]));
        eOVList.Add(boolCk[1], new GH_Path(i));
      }

    }

    // ********FROM EACH HALF-EDGE..
    for (int i = 0; i <= edgeList.Count - 1; i++) {
      int[] boolCk = {0, -10};
      // FIND VERTEX CORRESPONDING TO ENDPOINT (=boolCk(1))
      CheckLinePt(edgeList[i], ref vtxTree, ref vNdxTree, ref boolCk, bnd, sbdv, 1);
      // boolCk(1)=TARGET VERTEX, CHECK ANGLE OF ALL EDGES LEAVING THIS VERTEX
      GH_Path nxtVtxPth = new GH_Path(boolCk[1]);
      double angCk = -100;
      int ndx = -10;
      // Dim xProd As vector3d = vector3d.CrossProduct(edgeList(i).direction, vector3d.ZAxis)
      // ..FIND NEXT EDGE********
      for( int j = 0; j <= vIEall.Branch(nxtVtxPth).Count - 1; j++)
      {

        if( i != eTEList[vIEall.Branch(nxtVtxPth)[j]] )
        {

          double ang = eDegList[eTEList[i]] - eDegList[vIEall.Branch(nxtVtxPth)[j]];
          if( ang < 0 )
          {

            ang += 360;

          }

          if( ang > angCk )
          {

            angCk = ang;
            ndx = j;

          }

        }

      }

      if ((ndx >= 0)) {
        eNEList.Add(vIEall.Branch(nxtVtxPth)[ndx], new GH_Path(i));
        ePEList.Add(i, new GH_Path(vIEall.Branch(nxtVtxPth)[ndx]));
      }
      else {
        // NO NEXT EDGE FOUND, THEN NEXT EDGE IS TWIN
        angCk = Math.PI;
        ndx = eTEList[i];
        eNEList.Add(eTEList[i], new GH_Path(i));
        ePEList.Add(i, new GH_Path(eTEList[i]));
      }

    }

    int faceCt = 0;
    for (int i = 0; i <= edgeList.Count - 1; ++i )
    {

      if( eF[i] )
      {

        fList.Add(edgeList[i].PointAt(0), new GH_Path(faceCt));
        fIEList.Add(i, new GH_Path(faceCt));
        eIFList[i] = faceCt;
        eF[i] = false;
        loopFace(edgeList, ref eF, eNEList, eNEList.Branch(i)[0], i, ref fIEList, ref fList, ref eIFList, ref faceCt);
        faceCt++;

      }

    }

    // ********CONVERT vtxTree (SORTED IN BRANCHES BY LOCATION IN GRID)TO List (IN ORDER OF INDEX VALUE)********
    /*for( int i = 0; i <= vtxTree.DataCount - 1; i++ )
    {

    vtxList.Add(Point3d.Unset);

    }*/
    /*
    for( int i = 0; i <= vtxTree.DataCount - 1; i++ )
    {

    int sortNdx = vNdxTree.AllData();
    vtxList[sortNdx] = vtxTree.AllData();

    }*/

    vtxList.AddRange(fList.Branch(0));

    e = edgeList;
    eOV = eOVList;
    eNE = eNEList;
    ePE = ePEList;
    eTE = eTEList;
    eIF = eIFList;
    v = vtxList;
    //  vtxTree
    vIE = vIEall;
    f = fList;
    fIE = fIEList;
    // ********PRINT HEM STATS********
    Print((vtxList.Count.ToString() + " vertices"));
    Print((faceCt.ToString() + " faces"));
    Print((edgeList.Count.ToString() + " edges"));
# ---------- c_script_6: C# additional code ----------
  public void EdgeDirection(Line eCurr, List<double> degList)
  {
    // FIND DIRECTION OF EDGE
    double deg;
    if (eCurr.Direction.X == 0)
    {
      deg = 90 * (eCurr.Direction.Y / Math.Abs(eCurr.Direction.Y)) + 360;
      deg = (360 + deg) % 360;
    }
    else
    {
      deg = Math.Atan(eCurr.Direction.Y / eCurr.Direction.X) * 180 / Math.PI;
      if (eCurr.Direction.X < 0)
        deg = 180 + deg;
      if (eCurr.Direction.X > 0)
        deg = (360 + deg) % 360;
    }

    degList.Add(deg);
    degList.Add((deg + 180) % 360);

  }

  public void CheckLinePt(Line eCurr, ref DataTree<Point3d> vTree, ref DataTree<int> nTree, ref int[] ck, UVInterval dom, int div, double t)
  {
    // WHEN t=0: CHECKING START POINT; WHEN t=1: CHECKING END POINT
    var ptCk = new Point3d(eCurr.PointAt(t));

    // POINT VALUE (MINUS DOMAIN STARTING POINT) DIVIDED BY STEP, FLOORED
    int pthX = (int) Math.Floor((ptCk.X - dom.U0) / ((dom.U1 - dom.U0) / div));
    int pthY = (int) Math.Floor((ptCk.Y - dom.V0) / ((dom.V1 - dom.V0) / div));
    pthX = Math.Min(Math.Max(pthX, 0), div - 1);
    pthY = Math.Min(Math.Max(pthY, 0), div - 1);
    var pthXY = new GH_Path(pthX, pthY);
    ck[1] = -10;

    // CHECK ALREADY ADDED NODES
    if (vTree.PathExists(pthXY))
    {
      for (int j = 0; j <= vTree.Branch(pthXY).Count - 1; ++j)
      {
        if (ptCk.DistanceTo(vTree[pthXY, j]) < 0.1)
        {
          ck[0] += 1;
          ck[1] = nTree[pthXY, j];
          break;
        }
      }
    }

    // IF NOT ALREADY ADDED, THEN ADD
    if( ck[0] == 0 && ck[1] < 0 )
    {
      ck[1] = vTree.DataCount;
      nTree.Add(vTree.DataCount, pthXY);
      vTree.Add(ptCk, pthXY);
    }
  }

  public void loopFace(List<Line> eList, ref List<bool> ck, DataTree<int> eNE, int n, int init, ref DataTree<int> fList, ref DataTree<Point3d> f, ref List<int> efList, ref int ct)
  {
    if (n != init)
    {
      f.Add(eList[n].PointAt(0), new GH_Path(ct));
      fList.Add(n, new GH_Path(ct));
      efList[n] = ct;
      ck[n] = false;
      loopFace(eList, ref ck, eNE, eNE[new GH_Path(n), 0], init, ref fList, ref f, ref efList, ref ct);
    }
  }

  /*class SurroundingClass
  {
    public void CheckLinePt(Line eCurr, ref DataTree<Point3d> vTree, ref DataTree<int> nTree, ref Array ck, UVInterval dom, int div, double t)
    {
      // WHEN t=0: CHECKING START POINT; WHEN t=1: CHECKING END POINT
      var ptCk = new Point3d(eCurr.PointAt(t));

      // POINT VALUE (MINUS DOMAIN STARTING POINT) DIVIDED BY STEP, FLOORED
      int pthX = Math.Floor((ptCk.X - dom.u0) / ((dom.U1 - dom.U0) / div));
      int pthY = Math.Floor((ptCk.y - dom.v0) / ((dom.v1 - dom.v0) / div));
      pthX = Math.Min(Math.Max(pthX, 0), div - 1);
      pthY = Math.Min(Math.Max(pthY, 0), div - 1);
      var pthXY = new GH_Path(pthX, pthY);
      ck(1) = -10;

      // CHECK ALREADY ADDED NODES
      if (vTree.pathExists(pthXY))
      {
        for (int j = 0, loopTo = vTree.branch(pthXY).count - 1; j <= loopTo; j++)
        {
          if (ptCk.DistanceTo(vTree[pthXY, j]) < 0.1)
          {
            ck(0) += 1;
            ck(1) = nTree[pthXY, j];
            break;
          }
        }
      }

      // IF NOT ALREADY ADDED, THEN ADD
      if (Conversions.ToBoolean(Operators.ConditionalCompareObjectEqual(ck(0), 0, false)) && Conversions.ToBoolean(ck(1) < 0))
      {
        ck(1) = vTree.datacount;
        nTree.Add(vTree.datacount, pthXY);
        vTree.Add(ptCk, pthXY);
      }
    }


    public void EdgeDirection(ref Line eCurr, ref List<double> degList)
    {
      // FIND DIRECTION OF EDGE
      double deg;
      if (eCurr.direction.x == 0)
      {
        deg = 90 * (eCurr.Direction.Y / Math.abs(eCurr.Direction.Y)) + 360;
        deg = (360 + deg) % 360;
      }
      else
      {
        deg = Math.atan(eCurr.Direction.Y / eCurr.Direction.x) * 180 / Math.PI;
        if (eCurr.Direction.X < 0)
          deg = 180 + deg;
        if (eCurr.Direction.X > 0)
          deg = (360 + deg) % 360;
      }

      degList.Add(deg);
      degList.Add((deg + 180) % 360);
    }


    public void loopFace(List<Line> eList, ref List<bool> ck, DataTree<int> eNE, int n, int init, ref DataTree<int> fList, ref DataTree<Point3d> f, ref List<int> efList, ref int ct)
    {
      if (n != init)
      {
        f.Add(eList[n].pointAt(0), new GH_Path(ct));
        fList.Add(n, new GH_Path(ct));
        efList[n] = ct;
        ck[n] = false;
        loopFace(eList, ref ck, eNE, eNE[new GH_Path(n), 0], init, ref fList, ref f, ref efList, ref ct);
      }
    }
  }*/
# ---------- end c_script_6 ----------

# ---- group: FIND THE BOUNDARY FACE AND EXCLUDE IT
boundary_face = Slider(1, range=0..10)
path = DataPath(boundary_face)
branch = TreeBranch(Tree=c_script_6.f, Path=path, MaintainPaths=True)

# ---- group: DISPLAY HEM EDGES / CULL TWINNED EDGES
cull_2 = CullPattern(List=c_script_6.e, CullPattern=[True, False])

# ---- group: DISPLAY HEM EDGES
Z_3 = UnitZ(Factor=1)
extr = Extrude(Base=cull_2, Direction=Z_3)

# ----
pline_16 = PolyLine(Vertices=move.Geometry, Closed=False)  # disabled
reconstruct_3 = ReconstructCurve(CurvesIn=cut_3)  # disabled
cull_3 = CullPattern(List=linetopo, CullPattern=expression)  # disabled
c_script_7 = CSharpScript(
    e=c_script_6.e,
    eOV=c_script_6.eOV,
    ePE=c_script_6.ePE,
    eNE=c_script_6.eNE,
    v=c_script_6.v,
    vIE=c_script_6.vIE,
    f=c_script_6.f,
    fIE=c_script_6.fIE,
    thr=threshold_3,
    stp=threshold,
    bnd=boundary_face)  # -> out, A, B, C, D; inputs e: list of Line, eOV: list of Int32, ePE: list of Int32, eNE: list of Int32, v: list of Point3d, vIE: tree of Int32, f: tree of Point3d, fIE: tree of Int32, thr: Int32, stp: Int32, bnd: Int32
# ---------- c_script_7: C# ----------
    // Definition originally written For
    // codeQuotidien.wordpress.org
    // Trevor Patt
    // trpatt@gmail.com

    // Creative Commons:  Attribution/NonCommercial/ShareAlike

    var skelAll = new DataTree<Line>();

    var vActive = new List<Point3d>();
    var bisecActive = new List<Vector3d>();
    var eActive = new List<Line>();

    for( int i = 0; i <= fIE.BranchCount - 1; ++i )
    {

      if (i != bnd)
      {

        bisecActive.Clear();
        vActive.Clear();
        eActive.Clear();
        var intxActive = new List<Interval>();

        int e0 = fIE.Branch(i)[0];
        int eCurr = e0;

        int ct = 0;
        do
        {
          var iCtPth = new GH_Path(i, ct);
          // FIND THE INITIAL BISECTING RAYS
          bisecActive.Add(FindBisect(e[ePE[eCurr]], e[eCurr]));
          vActive.Add(v[eOV[eCurr]]);
          eActive.Add(e[ePE[eCurr]]);
          eCurr = eNE[eCurr];
          ct += 1;
        }
        while (eCurr != e0);


        eCurr = e0;

        // CREATE ALL INTERVALS SO THAT THEY CAN BE EDITED ONE VALUE AT A TIME
        for( int j = 0; j <= bisecActive.Count - 1; ++j )

          intxActive.Add(new Interval(thr, thr));

        int bisecCount = bisecActive.Count;

        // FIND INTERSECTION PARAMETERS
        for( int j = 0; j <= bisecCount - 1; ++j )
        {

          var ijPth = new GH_Path(i, j);
          int jPrev = (j + bisecCount - 1) % bisecCount;
          //int jPlus = (j + bisecCount    ) % bisecCount;

          var uu = new Interval(thr, thr);
          LineLineIntx(vActive[j], vActive[j] + bisecActive[j], vActive[jPrev], vActive[jPrev] + bisecActive[jPrev], ref uu);
          /*var vv = new Interval(thr, thr);
          LineLineIntx(vActive[jPlus], vActive[jPlus] + bisecActive[jPlus], vActive[j], vActive[j] + bisecActive[j], ref vv);
          intxActive[jPlus] = new Interval(intxActive[jPlus][0], vv[1]);*/
          intxActive[j] = new Interval(uu[0], intxActive[j][1]);
          intxActive[jPrev] = new Interval(intxActive[jPrev][0], uu[1]);
          //Print( intxActive[jPlus].ToString() + " jPlus" );
          Print(intxActive[j].ToString() + " j");
          Print(intxActive[jPrev].ToString() + " jPrev");

          eCurr = eNE[eCurr];

        }

        eCurr = e0;


        int k = 0;
        int safety = 0;
        bool tri = false;
        int skelCt = 0;
        while( safety < stp && !tri )
        {

          int kPrev = (k + intxActive.Count - 1) % intxActive.Count;
          int kPlus = (k + intxActive.Count ) % intxActive.Count;
          var ikPth = new GH_Path(i, k);
          var iPrevPth = new GH_Path(i, kPrev);

          if( Math.Abs(intxActive[k][0]) <= Math.Abs(intxActive[k][1]) && Math.Abs(intxActive[kPrev][1]) <= Math.Abs(intxActive[kPrev][0]) )
          {

            var skelPth = new GH_Path(skelCt);
            skelAll.Add(new Line(vActive[k], vActive[k] + intxActive[k][0] * bisecActive[k]), fIE.Path(i));
            skelAll.Add(new Line(vActive[kPrev], vActive[k] + intxActive[k][0] * bisecActive[k]), fIE.Path(i));

            // IF THERE IS AN INTERSECTION REMOVE PREVIOUS VERTEX, RAYS, REPLACE WITH NEW
            vActive[kPrev] = vActive[kPrev] + intxActive[kPrev][1] * bisecActive[kPrev];
            vActive.RemoveAt(k);
            bisecActive.RemoveAt(k);
            intxActive.RemoveAt(k);
            eActive.RemoveAt(k);

            if( k >= vActive.Count )
            {

              k = 0;

            }

            if (kPrev >= vActive.Count)
            {

              kPrev = vActive.Count - 1;

            }

            /*if( kPlus >= vActive.Count )

              kPrev = ( kPlus + vActive.Count ) % vActive.Count;*/

            int kPrevX2 = (kPrev + vActive.Count - 1 ) % vActive.Count;

            bisecActive[kPrev] = FindBisect(eActive[kPrev], eActive[k]);

            // AND RECALCULATE INTERSECTIONS
            var uu = new Interval(thr, thr);
            LineLineIntx(vActive[kPrev], vActive[kPrev] + bisecActive[kPrev], vActive[kPrevX2], vActive[kPrevX2] + bisecActive[kPrevX2], ref uu);
            intxActive[kPrev] = new Interval(uu[0], intxActive[kPrev][1]);
            intxActive[kPrevX2] = new Interval(intxActive[kPrevX2][0], uu[1]);

            uu = new Interval(thr, thr);
            LineLineIntx(vActive[k], vActive[k] + bisecActive[k], vActive[kPrev], vActive[kPrev] + bisecActive[kPrev], ref uu);
            intxActive[k] = new Interval(uu[0], intxActive[k][1]);
            intxActive[kPrev] = new Interval(intxActive[kPrev][0], uu[1]);

            /*if( vActive.Count >= kPlus - 1 )
            {

              kPlus = ( kPrev-1 ) % vActive.Count;
              uu = new Interval(thr, thr);
              LineLineIntx(vActive[kPlus], vActive[kPlus] + bisecActive[kPlus], vActive[k], vActive[k] + bisecActive[k], ref uu);
              intxActive[kPlus] = new Interval(uu[0], intxActive[kPlus][1]);
              intxActive[k] = new Interval(intxActive[k][0], uu[1]);

            }*/

            skelCt += 1;
            //Print(skelCt.ToString());

          }

          k = (k + 1) % intxActive.Count;
          safety += 1;

          if( vActive.Count <= 3 )
          {

            tri = true;

          }

        }

        if( tri )
        {

          for( int m = 0; m <= vActive.Count - 1; ++m )
          {

            var skelPth = new GH_Path(skelCt);
            int mPrev = (m + vActive.Count - 1) % vActive.Count;

            skelAll.Add(new Line(vActive[m], vActive[m] + intxActive[m][0] * bisecActive[m]), fIE.Path(i));

            skelCt += 1;

          }

          bisecActive.Clear();
          vActive.Clear();
          eActive.Clear();

        }

      }

    }

    A = skelAll;
    B = vActive;
    C = bisecActive;
    D = eActive;
# ---------- c_script_7: C# additional code ----------
  public Vector3d FindBisect(Line edgeIn, Line edgeOut)
  {

    var vctIn = new Vector3d(-edgeIn.Direction);
    var vctOut = new Vector3d(edgeOut.Direction);
    vctIn.Unitize();
    vctOut.Unitize();

    double degIn = 0.0;
    double degOut = 0.0;
    EdgeDirection(ref vctIn, ref degIn);
    EdgeDirection(ref vctOut, ref degOut);

    if( degOut < degIn )
    {

      degOut += 2 * Math.PI;

    }

    double amp = 1;
    double ang = degOut - degIn;

    if( ang > Math.PI )
    {

      amp *= -1;

    }

    var bsctVct = new Vector3d(vctIn.X + vctOut.X, vctIn.Y + vctOut.Y, 0);

    if( bsctVct.Length > 0 )
    {

      bsctVct *= amp / bsctVct.Length;

    }

    else
    {

      bsctVct = Vector3d.CrossProduct(vctIn, Vector3d.ZAxis);
      bsctVct.Unitize();

    }

    return bsctVct;

  }

  public void EdgeDirection(ref Vector3d eCurr, ref double degList)
  {
    // FIND DIRECTION OF EDGE
    double deg;
    if (eCurr.X == 0)
    {
      deg = 90 * (eCurr.Y / Math.Abs(eCurr.Y)) + 360;
      deg = (360 + deg) % 360;
    }
    else
    {
      deg = Math.Atan(eCurr.Y / eCurr.X) * 180 / Math.PI;

      if( eCurr.X < 0 )
      {

        deg = 180 + deg;

      }

      if( eCurr.X > 0 )
      {

        deg = (360 + deg) % 360;

      }

    }

    degList = Math.PI * deg / 180;

  }

  public void LineLineIntx(Point3d pt1, Point3d pt2, Point3d pt3, Point3d pt4, ref Interval interval) {
    // via Paul Bourke: http://www-cs.ccny.cuny.edu/~wolberg/capstone/intersection/Intersection%20point%20of%20two%20lines.html
    double denom = ( pt4.Y - pt3.Y ) * ( pt2.X - pt1.X ) - ( pt4.X - pt3.X ) * ( pt2.Y - pt1.Y );

    if( denom != 0 )
    {
      double u1 = ( ( pt4.X - pt3.X ) * ( pt1.Y - pt3.Y ) - ( pt4.Y - pt3.Y ) * ( pt1.X - pt3.X ) ) / denom;
      double u2 = ( ( pt2.X - pt1.X ) * ( pt1.Y - pt3.Y ) - ( pt2.Y - pt1.Y ) * ( pt1.X - pt3.X ) ) / denom;

      interval = new Interval(u1, u2);

    }

  }
# ---------- end c_script_7 ----------
join_2 = JoinCurves(Curves=c_script_7.A, Preserve=False)
polyoffset_3 = PolylineOffset(
    Polylines=c_script_7.A,
    Distance=Slider(0.46, range=0..10),
    Plane=Plane(origin=(0, 0, 0), x=(0, 0, 0), y=(0, 0, 0)),
    Tolerance=0.01,
    ClosedFillet=Slider(0, range=0..2),
    OpenFillet=Slider(0, range=0..2),
    Miter=2)  # -> Contour, Holes

hem_to_straight_skeleton = VBScript(
    e=c_script_6.e,
    eOV=c_script_6.eOV,
    ePE=c_script_6.ePE,
    eNE=c_script_6.eNE,
    v=c_script_6.v,
    vIE=c_script_6.vIE,
    f=c_script_6.f,
    fIE=c_script_6.fIE,
    thr=threshold_3,
    stp=threshold,
    bnd=boundary_face)  # -> out, A, B, C, D; inputs e: list of Line, eOV: list, ePE: list, eNE: list, v: list of Point3d, vIE: tree, f: tree, fIE: tree
# ---------- hem_to_straight_skeleton: VB ----------
    'Definition originally written For
    '  codeQuotidien.wordpress.org
    '  Trevor Patt
    '  trpatt@gmail.com

    '  Creative Commons:  Attribution/NonCommercial/ShareAlike

    Dim skelAll As New datatree(Of line)
    'Dim bisecAll As New datatree(Of vector3d)
    'Dim vtxAll As New datatree(Of point3d)
    'Dim intAll As New datatree (Of point3d)
    
    Dim vActive As New list (Of point3d)
    Dim bisecActive As New list(Of vector3d)
    Dim eActive As New list (Of line)

    For i As int32=0 To fIE.BranchCount - 1
      If i <> bnd Then
        'Dim bisecActive As New list(Of vector3d)
        'Dim vActive As New list (Of point3d)
        bisecActive.clear
        vActive.clear
        eActive.clear
        Dim intxActive As New list (Of interval)



        Dim e0 As int32 = fIE.Branch(i)(0)
        Dim eCurr As int32 = e0


        Dim ct As int32 = 0
        Do
          Dim iCtPth As New gh_path(i, ct)
          'bisecAll.ensurepath(iCtPth)
          'FIND THE INITIAL BISECTING RAYS
          biSecActive.add(FindBisect(e(ePE(eCurr)), e(eCurr)))
          'biSecAll.add(biSecActive(ct), iCtPth)
          vActive.add(v(eOV(eCurr)))
          eActive.add(e(ePE(eCurr)))

          eCurr = eNE(eCurr)
          ct += 1
        Loop While eCurr <> e0


        eCurr = e0

        'CREATE ALL INTERVALS SO THAT THEY CAN BE EDITED ONE VALUE AT A TIME
        For j As int32=0 To biSecActive.count - 1
          intxActive.add(New interval(thr, thr))
        Next

        'FIND INTERSECTION PARAMETERS
        For j As int32=0 To biSecActive.count - 1
          Dim ijPth As New gh_path(i, j)
          Dim jPrev As int32 = (j + biSecActive.count - 1) Mod biSecActive.count

          Dim uu As New interval(thr, thr)
          LineLineIntx(vActive(j), vActive(j) + biSecActive(j), vActive(jPrev), vActive(jPrev) + biSecActive(jPrev), uu)

          intxActive(j) = New interval(uu(0), intxActive(j)(1))
          intxActive(jPrev) = New interval(intxActive(jPrev)(0), uu(1))

          eCurr = eNE(eCurr)
        Next

        eCurr = e0


        Dim k As int32 = 0
        Dim safety As Int32 = 0
        Dim tri As Boolean = False
        Dim skelCt As int32 = 0
        Do While safety < stp AndAlso Not tri'AndAlso k < intxActive.count - 1

          Dim kPrev As int32 = (k + intxActive.count - 1) Mod intxActive.count
          Dim ikPth As New gh_path(i, k)
          Dim iPrevPth As New gh_path(i, kPrev)



          If math.Abs(intxActive(k)(0)) <= math.Abs(intxActive(k)(1)) AndAlso math.Abs(intxActive(kPrev)(1)) <= math.Abs(intxActive(kPrev)(0)) Then
            Dim skelPth As New gh_path(skelCt)
            'intAll.add(vActive(k) + (intxActive(k)(0) * biSecActive(k)), skelPth)
            'vtxAll.add(vActive(k), skelPth)
            'vtxAll.add(vActive(kPrev), skelPth)
            skelAll.add(New line(vActive(k), vActive(k) + (intxActive(k)(0) * biSecActive(k))), fIE.Path(i))
            skelAll.add(New line(vActive(kPrev), vActive(k) + (intxActive(k)(0) * biSecActive(k))), fIE.Path(i))

            'IF THERE IS AN INTERSECTION REMOVE PREVIOUS VERTEX, RAYS, REPLACE WITH NEW
            vActive(kPrev) = vActive(kPrev) + (intxActive(kPrev)(1) * biSecActive(kPRev))
            vActive.removeat(k)
            biSecActive.removeat(k)
            intxActive.removeat(k)
            eActive.removeat(k)

            If k >= vActive.count Then k = 0
            If kPrev >= vActive.count Then kPrev = vActive.count - 1
            Dim kPrevX2 As int32 = (kPrev + vActive.count - 1) Mod vActive.count

            biSecActive(kPrev) = FindBisect(eActive(kPrev), eActive(k))

            'AND RECALCULATE INTERSECTIONS
            Dim uu As New interval(thr, thr)
            LineLineIntx(vActive(kPrev), vActive(kPrev) + biSecActive(kPrev), vActive(kPrevX2), vActive(kPrevX2) + biSecActive(kPrevX2), uu)
            intxActive(kPrev) = New interval (uu(0), intxActive(kPrev)(1))
            intxActive(kPrevX2) = New interval (intxActive(kPrevX2)(0), uu(1))

            uu = New interval(thr, thr)
            LineLineIntx(vActive(k), vActive(k) + biSecActive(k), vActive(kPrev), vActive(kPrev) + biSecActive(kPrev), uu)
            intxActive(k) = New interval (uu(0), intxActive(k)(1))
            intxActive(kPrev) = New interval (intxActive(kPrev)(0), uu(1))

            skelCt += 1
          End If



          k = (k + 1) Mod intxActive.count
          safety += 1

          If vActive.count <= 3 Then tri = True
        Loop

        If tri Then
          For m As int32=0 To vActive.count - 1
            Dim skelPth As New gh_path(skelCt)
            Dim mPrev As int32 = (m + vActive.count - 1) Mod vActive.count

            'intAll.add(vActive(m) + (intxActive(m)(0) * biSecActive(m)), skelPth)
            'vtxAll.add(vActive(m), skelPth)
            skelAll.add(New line(vActive(m), vActive(m) + (intxActive(m)(0) * biSecActive(m))), fIE.Path(i))

            skelCt += 1
          Next
          bisecActive.clear
          vActive.clear
          eActive.clear
        End If

      End If
    Next





    A = skelAll
    B = vActive
    C = bisecActive
    D = eActive
# ---------- hem_to_straight_skeleton: VB additional code ----------
  Function FindBisect(ByRef edgeIn As line, ByRef edgeOut As line) As vector3d

    Dim vctIn As New vector3d(-edgeIn.Direction)
    Dim vctOut As New vector3d(edgeOut.Direction)
    vctIn.Unitize
    vctOut.Unitize

    Dim degIn As Double
    Dim degOut As Double
    EdgeDirection(vctIn, degIn)
    EdgeDirection(vctOut, degOut)

    If degOut < degIn Then degOut += (2 * math.PI)

    Dim amp As Double = 1'distOff / math.Sin(ang / 2)
    Dim ang As Double = degOut - degIn
    If ang > math.PI Then amp *= -1 'print("!!!") '

    Dim bsctVct As New vector3d(vctIn.X + vctOut.X, vctIn.Y + vctOut.Y, 0)
    If bsctVct.length > 0 Then
      bsctVct *= amp / bsctVct.length
    Else
      bsctVct = vector3d.CrossProduct(vctIn, vector3d.ZAxis)
      bsctVct.unitize
    End If


    Return bsctVct 'bsctPt

  End Function

  Sub EdgeDirection(ByRef eCurr As vector3d, ByRef degList As Double)
    'FIND DIRECTION OF EDGE
    Dim deg As Double
    If eCurr.x = 0 Then
      deg = (90 * (eCurr.Y / math.abs(eCurr.Y))) + 360
      deg = (360 + deg) Mod 360
    Else
      deg = ((math.atan(eCurr.Y / eCurr.x)) * 180 / math.PI)
      If eCurr.X < 0 Then deg = 180 + deg
      If eCurr.X > 0  Then deg = (360 + deg) Mod 360
    End If
    'print(deg)
    degList = (math.PI * deg / 180)
  End Sub

  Sub LineLineIntx(ByRef pt1 As point3d, ByRef pt2 As point3d, ByRef pt3 As point3d, pt4 As point3d, ByRef int As interval)
    'via Paul Bourke: http://www-cs.ccny.cuny.edu/~wolberg/capstone/intersection/Intersection%20point%20of%20two%20lines.html

    Dim denom As Double = ((pt4.y - pt3.Y) * (pt2.X - pt1.X)) - ((pt4.X - pt3.X) * (pt2.Y - pt1.Y))
    If denom <> 0 Then
      Dim u1 As Double = (((pt4.X - pt3.X) * (pt1.Y - pt3.Y)) - ((pt4.Y - pt3.Y) * (pt1.X - pt3.X))) / denom
      Dim u2 As Double = (((pt2.X - pt1.X) * (pt1.Y - pt3.Y)) - ((pt2.Y - pt1.Y) * (pt1.X - pt3.X))) / denom

      'If u1 < 0 Then u1 = int(0)
      'If u2 < 0 Then u2 = int(1)

      int = New interval(u1, u2)
    End If
  End Sub
# ---------- end hem_to_straight_skeleton ----------

panel_3 = Panel(c_script_7.out)
points_7 = PointList(Points=c_script_7.B, Tags=True, Lines=True, Size=2)

# ---- group: IN PROGRESS DISPLAYS ONLY LAST FACE
curvepoint = PointOnCurve(hem_to_straight_skeleton.D, parameter=0.5)
amp = Amplitude(Vector=hem_to_straight_skeleton.C, Amplitude=3)
points_8 = PointList(Points=hem_to_straight_skeleton.B, Tags=True, Lines=True, Size=2)
vdis_2 = VectorDisplay(Anchor=hem_to_straight_skeleton.B, Vector=amp)
points_9 = PointList(Points=curvepoint, Tags=True, Lines=False, Size=1)

# ----
crv_9 = Curve(hem_to_straight_skeleton.A)
shift_2 = ShiftList(List=c_script_7.B, Shift=1, Wrap=False)
data = Data(c_script_7.A)
ln_2 = Line(StartPoint=c_script_7.B, EndPoint=shift_2)
spctopo_2 = SpaceTopology(Curves=c_script_7.A)
merge = Merge(Data1=data, Data2=ln_2)  # -> flatten(Result)
cut_4 = CutCorners(CurvesToSplit=c_script_7.A)
eval = EvaluateCurve(Curve=c_script_7.A, Parameter=Slider(0.5, range=0..1))  # -> Point, Tangent, Angle
reconstruct_4 = ReconstructCurve(CurvesIn=cut_4)
linetopo_2 = LineTopology(PointTree=graft(eval.Point), Topology=spctopo_2)

# ---- group: SpacePartition / RandomColourSeed
number_slider_37 = Slider(40, range=0..100)  # disabled
number_slider_38 = Slider(402, range=0..1000)  # disabled
number_slider_39 = Slider(326, range=0..1000)  # disabled

# ----
inside_2 = InsideOriginal(CurvesToCull=merge, BoundaryCurve=crv_3, ParallelComputing=True)  # disabled
flatten_5 = FlattenTree(Tree=prunebranches_2.prunedTree, Path="{0}")
number_slider_40 = Slider(1, range=0..1)  # disabled
number_slider_41 = Slider(4, range=0..10)  # disabled
toggle_2 = BooleanToggle(True)  # disabled

# ---- group: AddAreaForCirculation
multiplication = Multiplication(A=flatten_5, B=0.3)
addition = Addition(A=flatten_5, B=multiplication)  # -> simplify(Result)

# ----
crv_10 = Curve(inside_2)  # disabled
number_slider_42 = Slider(5, range=0..10)  # disabled
cut_5 = CutCorners(CurvesToSplit=crv_10)  # disabled
number_slider_43 = Slider(70, range=0..100)  # disabled
multiplication_2 = Multiplication(A=number_slider_42, B=number_slider_43)  # disabled
number_slider_44 = Slider(-0.584, range=-10..10)  # disabled
offset_3 = OffsetCurve(Curve=crv_3, Distance=number_slider_44, Plane=PlaneXY(0, 0, 0), Corners=1)  # disabled
number_slider_45 = Slider(-0.799, range=-10..10)  # disabled
panel_4 = Panel("""0: Privado
1: Privado
2: Público
3: SemiPrivado""")
intercull_3 = IntersectionCulling(CurvesToCull=merge, BoundaryCurve=offset_3, ParallelComputing=True)  # disabled
crv_11 = Curve(c_script_7.A)
txt_4 = Text(prunebranches.prunedTree)
graft = GraftTree(Tree=panel_4, IncludeEmptyLists=True, IncludeNullItems=True)  # -> simplify(Tree)
offset_4 = OffsetCurve(Curve=crv_3, Distance=number_slider_45, Plane=PlaneXY(0, 0, 0), Corners=1)  # disabled
reconstruct_5 = ReconstructCurve(CurvesIn=intercull_3)  # disabled
graft_2 = GraftTree(Tree=txt_4, IncludeEmptyLists=True, IncludeNullItems=True)
cut_6 = CutCorners(CurvesToSplit=crv_11)
intercull_4 = IntersectionCulling(CurvesToCull=cut_5, BoundaryCurve=offset_4, ParallelComputing=True)  # disabled
addindextolabels = CSharpScript(labels=graft_2)  # -> indexedLabels; inputs labels: tree of String
# ---------- addindextolabels: C# ----------
    var newLabels = new DataTree<string>();
    
    for( int i = 0; i < labels.BranchCount; ++i )
      for( int j = 0; j < labels.Branch(i).Count; ++j )
      {
      
        newLabels.Add( i.ToString() + " " + labels.Branch(i)[j], new GH_Path(i) );
      
      }
    
    indexedLabels = newLabels;
# ---------- end addindextolabels ----------
number_slider_46 = Slider(2, range=0..2)
crv_12 = Curve(crv_2)
reconstruct_6 = ReconstructCurve(CurvesIn=intercull_4)  # disabled
crv_13 = Curve()
polyoffset_4 = PolylineOffset(
    Polylines=crv_13,
    Distance=Slider(0.75, range=0..10),
    Plane=Plane(origin=(0, 0, 0), x=(0, 0, 0), y=(0, 0, 0)),
    Tolerance=0.01,
    ClosedFillet=number_slider_46,
    OpenFillet=number_slider_46,
    Miter=2)  # -> Contour, Holes
number_slider_47 = Slider(1, range=0..1)
end_2 = EndPoints(Curve=crv_13)  # -> Start, End
lng_4 = ListLength(List=flatten(ma.Result))
dom_2 = ConstructDomain(DomainStart=0, DomainEnd=1)
galapagos = Galapagos(fitness=ma_3, gene=[seedsx, seedsy])
genemodifier = GenePoolModifier(GeneList="FirstStepO", Count=lng_4, Domain=dom_2, Randomize=Button(), PercentageOfRandomization=number_slider_47)
number_slider_48 = Slider(10, range=0..10)
genemodifier_2 = GenePoolModifier(GeneList="FirstStep", Count=lng_4, Domain=dom_2, Randomize=Button(), PercentageOfRandomization=number_slider_47)
firststep = GenePool(Decimals=2, Maximum=1, Minimum=0, Value=[0.5, 0.45, 1, 0.35])
firststepo = GenePool(Decimals=2, Maximum=1, Minimum=0, Value=[0, 0.59, 0.74, 0])
txt_5 = Text(["2 2: Público", "3 3: SemiPrivado", "1 1: Privado", "0 0: Privado"])
panel_5 = Panel(txt_5)
eval_2 = EvaluateCurve(Curve=reparameterize(crv_12), Parameter=firststep)  # -> Point, Tangent, Angle
eval_3 = EvaluateCurve(Curve=reparameterize(crv_13), Parameter=firststepo)  # -> Point, Tangent, Angle; disabled
split = TextSplit(Text=txt_5, Separators=" ")
ln_3 = Line(StartPoint=eval_2.Point, EndPoint=eval_3.Point)  # disabled
item_4 = ListItem(List=split, Index=0, Wrap=True)  # -> flatten(Item)
srfsplit = SurfaceSplit(Surface=crv_2, Curves=flatten(ln_3))  # disabled
panel_6 = Panel(item_4)
area_3 = Area(Geometry=srfsplit, UseTasks=True)  # -> Area, Centroid; disabled
number_slider_49 = Slider(0, range=0..100)  # disabled
number_slider_50 = Slider(255, range=0..1000)  # disabled
panel_7 = Panel(prunebranches.prunedTree)
lng_5 = ListLength(List=flatten(srfsplit))  # disabled
dom_3 = ConstructDomain(DomainStart=number_slider_49, DomainEnd=number_slider_50)  # disabled
number_slider_51 = Slider(40, range=0..100)  # disabled
number_slider_52 = Slider(270, range=0..1000)  # disabled
number_slider_53 = Slider(326, range=0..1000)  # disabled
bang_3 = ExplodeTree(Data=prunebranches.prunedTree)  # -> Branch0, Branch1, Branch2, Branch3
bang_4 = ExplodeTree(Data=prunebranches_2.prunedTree)  # -> Branch0, Branch1, Branch2, Branch3
galapagos_2 = Galapagos(fitness=ma_4, gene=firststep)
panel_8 = Panel(prunebranches_2.prunedTree)
num_2 = Number(bang_4.Branch1)
panel_9 = Panel(bang_4.Branch3)
panel_10 = Panel(num_2)
random = Random(Range=dom_3, Number=lng_5, Seed=[number_slider_51, number_slider_52, number_slider_53], Integers=True)  # disabled
panel_11 = Panel(ma.Result)

# ---- group: SpacePartition / OriginalSilhouette
crv_14 = Curve(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)

# ----
bbox = BoundingBox(Content=crv_14, Plane=PlaneXY(0, 0, 0))  # -> Box, Box_2
ptsrfdomnum = SurfaceDomainNumber(Surface=bbox.Box, UNumber=Slider(2, range=0..100), VNumber=Slider(10, range=0..100))
ptborders = GenerateBorders(Grid=ptsrfdomnum, PanelShape=0)  # -> simplify(Border)
crv_15 = Curve(flatten(ptborders))
item_5 = ListItem(List=crv_15, Index=0, Wrap=True)
area_4 = Area(Geometry=item_5)  # -> Area, Centroid
multiplication_3 = Multiplication(A=area_4.Area, B=Slider(0.6, range=0..1))
bang_5 = ExplodeTree(Data=random)  # -> Branch0, Branch1, Branch2; disabled
multiplication_4 = Multiplication(A=ma.Result, B=0.3)
addition_2 = Addition(A=ma.Result, B=multiplication_4)  # -> simplify(Result)
ma_2 = MassAddition(Input=flatten(addition_2))  # -> Result, PartialResults
panel_12 = Panel(addition_2)

# ---- group: SpacePartition / RandomColourSeed
number_slider_54 = Slider(40, range=0..100)
number_slider_55 = Slider(238, range=0..1000)
number_slider_56 = Slider(326, range=0..1000)

# ----
rgb_2 = ColourRGB(Alpha=255, Red=expr("x*2", bang_5.Branch0), Green=expr("x*0.5", bang_5.Branch1), Blue=0)  # disabled
secondstep = GenePool(Decimals=2, Maximum=1, Minimum=0, Value=[0.8, 0.24, 0.97, 0.58, 0.57, 0.45])
_4 = GenePool(Decimals=2, Maximum=1, Minimum=0, Value=[0.62, 0.9])
lng_6 = ListLength(List=flatten(bang_4.Branch3))
dom_4 = ConstructDomain(DomainStart=0, DomainEnd=1)
preview_2 = CustomPreview(Geometry=srfsplit, Material=rgb_2)  # disabled
txt_6 = Text(["Consultorios Odontologícos Adultos", "Consultorios Odontologícos Niños", "Entrevistas", "Sala de Juntas", "Archivo de historias clinicas", "Deposito de medicamentos e insumos"])
lng_7 = ListLength(List=flatten(num_2))
panel_13 = Panel("""0: Privado
1: Privado
2: Público
3: SemiPrivado""")
dom_5 = ConstructDomain(DomainStart=0, DomainEnd=1)
number_slider_57 = Slider(10, range=0..10)
genemodifier_3 = GenePoolModifier(GeneList="SecondStep", Count=lng_6, Domain=dom_4, Randomize=Button(), PercentageOfRandomization=Slider(1, range=0..1))
third = GenePool(Decimals=2, Maximum=1, Minimum=0, Value=[0.16, 0.69, 0.59, 0.29, 0.19, 0.72, 0.54])
txt_7 = Text(["Consultorios Odontologícos Adultos", "Consultorios Odontologícos Niños", "Entrevistas", "Sala de Juntas", "Archivo de historias clinicas", "Deposito de medicamentos e insumos"])
number_slider_58 = Slider(10, range=0..10)
genemodifier_4 = GenePoolModifier(GeneList="4", Count=lng_7, Domain=dom_5, Randomize=Button(), PercentageOfRandomization=Slider(1, range=0..1))
txt_8 = Text(flatten(["2 Sala de espera (3 M2 por consultorio)", "1 Caja ( 1 Puestos de trabajo)", """0 Recepción y Control ( 2 Puestos de trabajo y
archivo)""", "4 Unidades sanitarias hombres Público (Discapacitados)", "5 Unidades sanitarias mujeres Público (Discapacitados)", "6 Toma e interpretación de Radiografías odontológicas", "3 Oficina de Dirección con baño"]))
lng_8 = ListLength(List=flatten(bang_4.Branch2))
panel_14 = Panel(txt_6)
dom_6 = ConstructDomain(DomainStart=0, DomainEnd=1)
graft_3 = GraftTree(Tree=panel_13, IncludeEmptyLists=True, IncludeNullItems=True)  # -> simplify(Tree)
split_2 = TextSplit(Text=txt_8, Separators=" ")
txt_9 = Text(["Consultorios Odontologícos Adultos", "Consultorios Odontologícos Niños", "Entrevistas", "Sala de Juntas", "Archivo de historias clinicas", "Deposito de medicamentos e insumos"])
panel_15 = Panel(txt_7)
number_slider_59 = Slider(10, range=0..10)
genemodifier_5 = GenePoolModifier(GeneList="Third", Count=lng_8, Domain=dom_6, Randomize=Button(), PercentageOfRandomization=Slider(1, range=0..1))
txt_10 = Text(flatten(["2 Sala de espera (3 M2 por consultorio)", "1 Caja ( 1 Puestos de trabajo)", """0 Recepción y Control ( 2 Puestos de trabajo y
archivo)""", "4 Unidades sanitarias hombres Público (Discapacitados)", "5 Unidades sanitarias mujeres Público (Discapacitados)", "6 Toma e interpretación de Radiografías odontológicas", "3 Oficina de Dirección con baño"]))
end_3 = EndPoints(Curve=crv_13)  # -> Start, End
item_6 = ListItem(List=split_2, Index=0, Wrap=True)  # -> flatten(Item)
split_3 = TextSplit(Text=txt_10, Separators=" ")
addindextolabels_2 = CSharpScript(labels=graft_3)  # -> indexedLabels; inputs labels: tree of String; same code as addindextolabels
txt_11 = Text(addindextolabels_2)
panel_16 = Panel(txt_9)
panel_17 = Panel(txt_8)
end_4 = EndPoints(Curve=crv_13)  # -> Start, End
toggle_3 = GroupToggle(ToggleActive=True, ToggleVisible=False)  # disabled
item_7 = ListItem(List=split_3, Index=0, Wrap=True)  # -> flatten(Item)
toggle_4 = GroupToggle(ToggleActive=True, ToggleVisible=False)  # disabled
panel_18 = Panel(txt_10)
panel_19 = Panel(item_6)
toggle_5 = GroupToggle(ToggleActive=True, ToggleVisible=False)  # disabled
panel_20 = Panel(item_7)
addindextolabels_3 = CSharpScript(labels=graft(bang_3.Branch3))  # -> indexedLabels; inputs labels: tree of String; same code as addindextolabels
addindextolabels_4 = CSharpScript(labels=graft(bang_3.Branch1))  # -> indexedLabels; inputs labels: tree of String; same code as addindextolabels
txt_12 = Text(addindextolabels_4)
addindextolabels_5 = CSharpScript(labels=graft(bang_3.Branch2))  # -> indexedLabels; inputs labels: tree of String; same code as addindextolabels
txt_13 = Text(addindextolabels_5)
dom_7 = ConstructDomain(DomainStart=Slider(0, range=0..100), DomainEnd=Slider(255, range=0..1000))
dom_8 = ConstructDomain(DomainStart=Slider(0, range=0..100), DomainEnd=Slider(255, range=0..1000))
dom_9 = ConstructDomain(DomainStart=Slider(0, range=0..100), DomainEnd=Slider(255, range=0..1000))
panel_21 = Panel("""0: Privado
1: Privado
2: Público
3: SemiPrivado""")
number_slider_60 = Slider(241, range=0..255)
number_slider_61 = Slider(241, range=0..255)
number_slider_62 = Slider(241, range=0..255)
galapagos_3 = Galapagos(fitness=ma_5, gene=secondstep)
galapagos_4 = Galapagos(fitness=ma_6, gene=_4)
galapagos_5 = Galapagos(fitness=ma_7, gene=third)

# ---- group: Perlin
number_slider_63 = Slider(22, range=0..100)  # disabled
number_slider_64 = Slider(4, range=0..10)  # disabled
number_slider_65 = Slider(0, range=0..100)  # disabled
number_slider_66 = Slider(4, range=0..10)  # disabled
dom_10 = ConstructDomain(DomainStart=number_slider_65, DomainEnd=number_slider_64)  # disabled
number_slider_67 = Slider(4, range=0..10)  # disabled
number_slider_68 = Slider(69, range=0..1000)  # disabled
number_slider_69 = Slider(3.2, range=0..10)  # disabled
number_slider_70 = Slider(0.430667, range=0..1)  # disabled
number_slider_71 = Slider(13.910642, range=0..100)  # disabled
number_slider_72 = Slider(32.088268, range=0..100)  # disabled
knots = KnotVector(Count=expr("x+1", number_slider_63), Degree=number_slider_66, Periodic=False)  # disabled
weights = GenePool(Decimals=2, Maximum=4, Minimum=0, Value=[2, 2, 2, 2, 2, 2, 2, 2, 2, 2, 2, 2, 2, 2, 2, 2, 2, 2, 2, 2, 2, 2, 2])  # disabled
number_slider_73 = Slider(1000, range=0..1000)  # disabled
number_slider_74 = Slider(0, range=0..1000)  # disabled
number_slider_75 = Slider(0, range=0..1000)  # disabled
rgb_3 = ColourRGB(Alpha=255, Red=number_slider_73, Green=number_slider_74, Blue=number_slider_75)  # disabled
number_slider_76 = Slider(3.01, range=0..10)  # disabled

# ---- group: Voronoi
number_slider_77 = Slider(0, range=0..0.1)
subtraction = Subtraction(A=Slider(1, range=0..1), B=number_slider_77)
dom_11 = ConstructDomain(DomainStart=number_slider_77, DomainEnd=subtraction)
pt_5 = ConstructPoint(XCoordinate=seedsx, YCoordinate=seedsy, ZCoordinate=0)

# ----
genemodifier_6 = GenePoolModifier(GeneList="SeedsX", Count=lng, Domain=dom_11, Randomize=Button(), PercentageOfRandomization=Slider(1, range=0..1))
genemodifier_7 = GenePoolModifier(GeneList="SeedsY", Count=lng, Domain=dom_11, Randomize=Button(), PercentageOfRandomization=Slider(1, range=0..1))

# ---- group: Grid
dom_12 = ConstructDomain(DomainStart=expr("-x", number_slider_3), DomainEnd=number_slider_3)
dom_13 = ConstructDomain(DomainStart=expr("-x", number_slider_4), DomainEnd=number_slider_4)
pt_6 = Point(Point(-27.55069635, 0.2364199029, 0))
dedomain = DeconstructDomain(Domain=dom_12)  # -> Start, End
rectangle_2 = Rectangle(Plane=pt_6, XSize=dom_13, YSize=dom_12, Radius=0)  # -> Rectangle, Length
crv_16 = Curve(rectangle_2.Rectangle)
ptsrfdomlen = SurfaceDomainLength(Surface=crv_16, ULength=division_2, VLength=division)  # disabled

# ---- group: Perlin (continued)
range = Range(Domain=dom_12, Steps=number_slider_63)  # disabled
perlinnoise = CSharpScript(x=range, fre=number_slider_69, amp=number_slider_70, iter=number_slider_67, t=number_slider_72, seed=number_slider_68)  # -> out, A; inputs x: Double, fre: Double, amp: Double, iter: Int32, t: Double, seed: Int32; disabled
# ---------- perlinnoise: C# ----------
    //time+=1e-7;
    
    A = fbm(new vec3(x, 0, 0) + t, fre, amp, iter, seed);
# ---------- perlinnoise: C# additional code ----------
  //double time = 0;
  
  double hash(double a, int seed)
  {

    //return fract(Math.Sin(a) * 4513.15);
    var rand = new Random( seed );
    return rand.NextDouble() * ( 1.0 + 1.0 ) - 1.0;

  }

  double noise(vec3 x, int seed)
  {

    vec3 p = x.floor();
    vec3 k = x.fract();

    k *= k * k * ( 3.0 - 2.0 * k );

    double n = p.X() + p.Y() * 57.0 + p.Z() * 113.0;

    double a = hash(n, seed);
    double b = hash(n + 1.0, seed);
    double c = hash(n + 57.0, seed);
    double d = hash(n + 58.0, seed);

    double e = hash(n + 113.0, seed);
    double f = hash(n + 114.0, seed);
    double g = hash(n + 170.0, seed);
    double h = hash(n + 171.0, seed);

    double res = vec3.mix(vec3.mix(vec3.mix(a, b, k.X()), vec3.mix(c, d, k.X()), k.Y()),
      vec3.mix(vec3.mix(e, f, k.X()), vec3.mix(g, h, k.X()), k.Y()),
      k.Z()
      );

    return res;

  }

  double fbm(vec3 f, double freq, double ampl, int iter, int seed)
  {

    double amp = 1.0, fre = 1.7, res = 0.0;

    for( int i = 0; i < iter; ++i )
    {

      amp *= ampl;
      fre *= freq;

      amp += amp;

      res += amp * noise(fre * f, seed);

    }

    return res;

  }

  class vec3
  {

    double x, y, z;

    public vec3(double x, double y, double z)
    {

      this.x = x;
      this.y = y;
      this.z = z;

    }

    public vec3(Point3d point)
    {

      this.x = point.X;
      this.y = point.Y;
      this.z = point.Z;

    }

    public double X()
    {

      return x;

    }

    public double Y()
    {

      return y;

    }

    public double Z()
    {

      return z;

    }

    // Addition operator overload.
    public static vec3 operator+( vec3 x, vec3 y )
    {

      return new vec3(x.X() + y.X(), x.Y() + y.Y(), x.Z() + y.Z());

    }

    public static vec3 operator+( vec3 x, double y )
    {

      return new vec3(x.X() + y, x.Y() + y, x.Z() + y);

    }

    public static vec3 operator+( double y, vec3 x )
    {

      return new vec3(y + x.X(), y + x.Y(), y + x.Z());

    }

    // Subtraction operator overload.
    public static vec3 operator-( vec3 x, vec3 y )
    {

      return new vec3(x.X() - y.X(), x.Y() - y.Y(), x.Z() - y.Z());

    }

    public static vec3 operator-( vec3 x, double y )
    {

      return new vec3(x.X() - y, x.Y() - y, x.Z() - y);

    }

    public static vec3 operator-( double y, vec3 x )
    {

      return new vec3(y - x.X(), y - x.Y(), y - x.Z());

    }

    // Multiplication operator overload.
    public static vec3 operator*( vec3 x, vec3 y )
    {

      return new vec3(x.X() * y.X(), x.Y() * y.Y(), x.Z() * y.Z());

    }

    public static vec3 operator*( vec3 x, double y )
    {

      return new vec3(x.X() * y, x.Y() * y, x.Z() * y);

    }

    public static vec3 operator*( double y, vec3 x )
    {

      return new vec3(y * x.X(), y * x.Y(), y * x.Z());

    }

    // Fractional part of a vec3.
    public vec3 fract()
    {

      return new vec3(fract(x), fract(y), fract(y));

    }

    // Floor.
    public vec3 floor()
    {

      return new vec3(Math.Floor(x), Math.Floor(y), Math.Floor(z));

    }

    // Fractional part of a double.
    public double fract(double x)
    {

      return x - Math.Truncate(x);

    }

    // Linear interpolation of a double.
    public static double mix(double a, double b, double c)
    {

      return a - ( 1 - c ) + b * c;

    }

    // Linear interpolation of a vec3.
    public static vec3 mix(vec3 a, vec3 b, double c)
    {

      double mixX = mix(a.X(), b.X(), c);
      double mixY = mix(a.Y(), b.Y(), c);
      double mixZ = mix(a.Z(), b.Y(), c);

      return new vec3(mixX, mixY, mixZ);

    }

    public Point3d toPoint()
    {

      return new Point3d(this.X(), this.Y(), this.Z());

    }

  }

  public double fract(double x)
  {

    return x - Math.Truncate(x);

  }
# ---------- end perlinnoise ----------
pt_7 = ConstructPoint(XCoordinate=perlinnoise.A, YCoordinate=range, ZCoordinate=0)  # disabled
item_8 = ListItem(List=pt_7, Index=0, Wrap=True)  # disabled
Y = UnitY(Factor=dedomain.Start)  # disabled
move_2 = Move(Geometry=pt_6, Motion=Y)  # -> Geometry, Transform; disabled
vec2pt = Vector2Pt(PointA=item_8, PointB=move_2.Geometry, Unitize=False)  # -> Vector, Length; disabled
move_3 = Move(Geometry=pt_7, Motion=vec2pt.Vector)  # -> Geometry, Transform; disabled
nurbcrv = NurbsCurvePWK(Points=move_3.Geometry, Weights=weights, Knots=knots)  # -> Curve, Length, Domain; disabled
previewlw = CustomPreviewLineweights(Geometry=nurbcrv.Curve, Shader=rgb_3, Thickness=number_slider_76, Absolute=False)  # disabled

# ----
ptsrfdomnum_2 = SurfaceDomainNumber(Surface=crv_16, UNumber=Slider(3, range=0..100), VNumber=Slider(15, range=0..100))
closestptgrid = ClosestPointInGrid(Grid=ptsrfdomnum_2, Point=pt)  # -> ClosestPointInGrid, BranchOfGrid, LeafOfGrid; disabled
closestptgrid_2 = ClosestPointInGrid(Grid=ptsrfdomnum_2, Point=pt_2)  # -> ClosestPointInGrid, BranchOfGrid, LeafOfGrid; disabled
shortorto = ShortestPathOrthogonal(
    Grid=ptsrfdomnum_2,
    StartPointBranch=closestptgrid.BranchOfGrid,
    StartPointLeaf=closestptgrid.LeafOfGrid,
    EndPointBranch=closestptgrid_2.BranchOfGrid,
    EndPointLeaf=closestptgrid_2.LeafOfGrid)  # disabled

# ---- group: Voronoi (continued)
evalsrf = EvaluateSurface(Surface=reparameterize(crv_16), Point=pt_5)  # -> Point, Normal, UDirection, VDirection, Frame
pt_8 = Point(evalsrf.Point)
voronoi_2 = Voronoi(Points=pt_8, Boundary=rectangle_2.Rectangle, BruteForceOverride=False)

# ----
panel_24 = Panel(pt_8)  # disabled

# ---- group: Grid (continued)
ptcrvatts = CurveAttraction(Grid=ptsrfdomnum_2, CrvAtts=nurbcrv.Curve, Magnitude=number_slider_7)  # -> Grid, Weights; disabled
ptborders_2 = GenerateBorders(Grid=ptsrfdomnum_2, PanelShape=0)  # -> simplify(Border)
crv_17 = Curve(flatten(ptborders_2))
area_5 = Area(Geometry=ptborders_2, UseTasks=False)  # -> Area, Centroid

# ---- group: Circulation
colom = CollisionOneMany(Collider=nurbcrv.Curve, Obstacles=graft(crv_17))  # -> Collision, Index; disabled
cull_4 = CullPattern(List=crv_17, CullPattern=flatten(colom.Collision))  # disabled
pararunion = ParallelRegionUnion(Curves=cull_4)  # disabled
parallelregionintersection_2 = ParallelRegionIntersection(CurvesA=crv, CurvesB=pararunion)  # disabled
srf = Surface(parallelregionintersection_2)  # disabled
frgb = ColourRGBF(Alpha=1, Red=0, Green=0, Blue=0)  # disabled
preview_3 = CustomPreview(Geometry=srf, Material=frgb)  # disabled

# ----
qt = QuadTree(Points=pt_8, Plane=PlaneXY(0, 0, 0), Square=False, Group=5)  # -> Quads, Points; disabled
qt_2 = QuadTree(Points=flatten(ptsrfdomnum_2), Plane=PlaneXY(0, 0, 0), Square=False, Group=5)  # -> Quads, Points; disabled
panel_25 = Panel(qt.Points)  # disabled
previewlw_2 = CustomPreviewLineweights(Geometry=shortorto, Shader=rgb, Thickness=number_slider_25, Absolute=False)  # disabled

# ---- group: ManhattanVoronoi
number_slider_78 = Slider(10, range=0..10)  # disabled
python = GhPythonScript(r=number_slider_78, P=evalsrf.Point)  # -> out, PL; inputs P: list of Point3d; disabled
# ---------- python: Python ----------
__author__ = "Paula"
__version__ = "2019.04.23"

import rhinoscriptsyntax as rs
from Rhino.Geometry import Point3d as P3
from Rhino.Geometry import Polyline as PLine

def taxicab_midnormal ( Point_1 = P3(0,0,0), Point_2 = P3(0,0,0) , leng = 10000):
    dx = abs(Point_1.X - Point_2.X)
    dy = abs(Point_1.Y - Point_2.Y)
    
    C = P3 ( ( Point_1.X + Point_2.X ) / 2, ( Point_1.Y + Point_2.Y ) / 2, ( Point_1.Z + Point_2.Z ) / 2)
    
    """ MPQN, in which M is on the lengeft(X-) or bottom(Y-) """
    P = P3 (0,0,C.Z)
    Q = P3 (0,0,C.Z)
    M = P3 (0,0,C.Z)
    N = P3 (0,0,C.Z)
    
    if dx > dy:
        P.Y = C.Y + dy / 2
        Q.Y = C.Y - dy / 2
        M.Y = P.Y + leng
        N.Y = Q.Y - leng
        if bool(Point_1.Y > Point_2.Y) ^ bool(Point_1.X > Point_2.X):
            P.X = C.X + dy / 2
            Q.X = C.X - dy / 2
        else:
            P.X = C.X - dy / 2
            Q.X = C.X + dy / 2
        M.X = P.X
        N.X = Q.X
    else:
        if dx < dy:
            P.X = C.X + dx / 2
            Q.X = C.X - dx / 2
            M.X = P.X + leng
            N.X = Q.X - leng
            if bool(Point_1.Y > Point_2.Y) ^ bool(Point_1.X > Point_2.X):
                P.Y = C.Y + dx / 2
                Q.Y = C.Y - dx / 2
            else:
                P.Y = C.Y - dx / 2
                Q.Y = C.Y + dx / 2
            M.Y = P.Y
            N.Y = Q.Y
        else:
            if bool(Point_1.Y > Point_2.Y) ^ bool(Point_1.X > Point_2.X):
                P.Y = C.Y - dx / 2
                Q.Y = C.Y + dx / 2
                P.X = C.X - dy / 2
                Q.X = C.X + dy / 2
                M.Y = P.Y - leng
                M.X = P.X - leng
                N.Y = Q.Y + leng
                N.X = Q.X + leng
            else:
                P.Y = C.Y - dx / 2
                Q.Y = C.Y + dx / 2
                P.X = C.X + dy / 2
                Q.X = C.X - dy / 2
                M.Y = P.Y - leng
                M.X = P.X + leng
                N.Y = Q.Y + leng
                N.X = Q.X - leng

    return rs.AddPolyline( [M , P , Q , N] )

def taxicab_circle ( point = P3(0,0,0), r = 1 ):
    A = P3( point.X + r, point.Y, point.Z )
    B = P3( point.X, point.Y + r, point.Z )
    C = P3( point.X - r, point.Y, point.Z )
    D = P3( point.X, point.Y - r, point.Z )
    return rs.AddPolyline( [A, B, C, D, A] )

l = 2 * r

""" PL = taxicab_midnormal ( A, B, r ) """

pts = P

polylines = []
for i in range( len( P ) ):
    polylines.append(taxicab_circle( P[i], l ))

for i in range(len(polylines)):
    for j in range(i):
        if i == j:
            continue
        if rs.CurveBooleanUnion( [ polylines[i], polylines[j] ] ):
            MN = taxicab_midnormal( pts[i], pts[j], l )
            
            ccx = rs.CurveCurveIntersection( polylines[i], MN )
            if ccx is None:
                continue
            if ccx[0][0] == 2:
                continue
            para_a = [ ccx[0][5], ccx[1][5] ]
            para_b = [ ccx[0][7], ccx[1][7] ]
            
            if para_b[0] > para_b[1]:
                para_b = [ para_b[1], para_b[0] ]
            
            probable_dash = rs.SplitCurve(polylines[i], para_a)
            edge = rs.TrimCurve(MN, para_b, False )
            edgepts = rs.CurvePoints(edge)
            
            for crv in probable_dash:
                crvpts = rs.CurvePoints(crv)
                if rs.PointCompare( crvpts[0], edgepts[0] ):
                    crvpts.reverse()
                newpl = rs.AddPolyline( edgepts + crvpts )
                if rs.PointInPlanarClosedCurve( pts[i], newpl ):
                    polylines[i] = newpl
                    break
            
            
            ccx = rs.CurveCurveIntersection( polylines[j], MN )
            if ccx is None:
                continue
            para_a = [ ccx[0][5], ccx[1][5] ]
            para_b = [ ccx[0][7], ccx[1][7] ]
            
            if para_b[0] > para_b[1]:
                para_b = [ para_b[1], para_b[0] ]
            
            probable_dash = rs.SplitCurve(polylines[j], para_a)
            edge = rs.TrimCurve(MN, para_b, False )
            edgepts = rs.CurvePoints(edge)
            
            for crv in probable_dash:
                crvpts = rs.CurvePoints(crv)
                if rs.PointCompare( crvpts[0], edgepts[0] ):
                    crvpts.reverse()
                newpl = rs.AddPolyline( edgepts + crvpts )
                if rs.PointInPlanarClosedCurve( pts[j], newpl ):
                    polylines[j] = newpl
                    break
    

PL = polylines
# ---------- end python ----------
rint = RegionIntersection(CurvesA=python.PL)  # disabled
crv_18 = Curve(rint)  # disabled
srf_2 = Surface(crv_18)  # disabled

# ----
crv_19 = Curve(voronoi_2)
bang_6 = ExplodeTree(Data=qt.Points)  # -> Branch0, Branch1, Branch2, Branch3, Branch4, Branch5, Branch6, Branch7, Branch8, Branch9; disabled
srf_3 = Surface(crv_19)
pt_9 = Point(bang_6.Branch3)  # disabled
area_6 = Area(Geometry=crv_17, UseTasks=False)  # -> Area, Centroid
sort = SortList(Keys=area_6.Area, ValuesA=area_6.Area)  # -> Keys, ValuesA; disabled
lng_9 = ListLength(List=sort.ValuesA)  # disabled
subtraction_2 = Subtraction(A=lng_9, B=1)  # disabled
item_9 = ListItem(List=area_6.Area, Index=Slider(0, range=0..50), Wrap=True)
multiplication_5 = Multiplication(A=item_9, B=Slider(0.6, range=0..1))
pt_10 = Point(flatten(area_5.Centroid))  # disabled
pt_11 = Point(pt_8)  # disabled
pt_12 = Point(area_5.Centroid)  # disabled
relay = Relay([pt_11, pt_12])  # disabled
crv_20 = Curve([voronoi_2, crv_17])  # disabled
pt_13 = Point(flatten(relay))  # disabled
spctopo_3 = SpaceTopology(Curves=flatten(crv_20), ParallelComputing=toggle_2)  # disabled
c_script_8 = CSharpScript(VoroPoints=flatten(area_5.Centroid))  # -> out, A, B; inputs VoroPoints: list of Point3d, x: Double, y: Double, z: Double, u: Double; disabled
# ---------- c_script_8: C# ----------
    DataTree<GH_Curve> curveTree = new DataTree<GH_Curve>();
    DataTree<int> topoTree = new DataTree<int>();

    Grasshopper.Kernel.Geometry.Node2List node2List = new Grasshopper.Kernel.Geometry.Node2List(VoroPoints);
    Grasshopper.Kernel.Geometry.Node2Tree node2Tree = node2List.CreateTree(0.0, false, 5);

    var leafAction_Outline = new LeafAction_Outline(curveTree, Plane.WorldXY);
    node2Tree.PerformAction(leafAction_Outline, false);

    DataTree<GH_Point> pointTree = new DataTree<GH_Point>();
    var leafAction_Points = new LeafAction_Points(node2List, pointTree, Plane.WorldXY);
    node2Tree.PerformAction(leafAction_Points, false);

    A = pointTree;
    B = curveTree;
# ---------- c_script_8: C# additional code ----------
  public class LeafAction_Outline : Grasshopper.Kernel.Geometry.Node2Leaf.ILeafAction
  {
    private DataTree<GH_Curve> boxes;

    private Transform x_form;

    public LeafAction_Outline(DataTree<GH_Curve> box_list, Plane plane)
    {
      this.boxes = box_list;
      this.x_form = Transform.ChangeBasis(plane, Plane.WorldXY);
    }

    public Grasshopper.Kernel.Geometry.Node2Leaf.VorLeafRecursionResult LeafAction(Grasshopper.Kernel.Geometry.Node2Leaf Leaf)
    {
      Polyline polyline = new Polyline();
      polyline.Add(Leaf.x_min, Leaf.y_min, 0.0);
      polyline.Add(Leaf.x_max, Leaf.y_min, 0.0);
      polyline.Add(Leaf.x_max, Leaf.y_max, 0.0);
      polyline.Add(Leaf.x_min, Leaf.y_max, 0.0);
      polyline.Add(Leaf.x_min, Leaf.y_min, 0.0);
      PolylineCurve polylineCurve = new PolylineCurve(polyline);
      polylineCurve.Transform(this.x_form);
      GH_Curve gH_Curve = new GH_Curve(polylineCurve);
      this.boxes.Add(gH_Curve);
      return 0;
    }
  }

  public class LeafAction_Points : Grasshopper.Kernel.Geometry.Node2Leaf.ILeafAction
  {
    private DataTree<GH_Point> points;

    private Grasshopper.Kernel.Geometry.Node2List nodes;

    private GH_Path m_path;

    private Transform x_form;

    public LeafAction_Points(Grasshopper.Kernel.Geometry.Node2List nodelist, DataTree<GH_Point> point_list, Plane plane)
    {
      this.m_path = new GH_Path(-1);
      this.nodes = nodelist;
      this.points = point_list;
      this.x_form = Transform.ChangeBasis(plane, Plane.WorldXY);
    }

    public Grasshopper.Kernel.Geometry.Node2Leaf.VorLeafRecursionResult LeafAction(Grasshopper.Kernel.Geometry.Node2Leaf Leaf)
    {
      //      var path = new GH_Path();
      //      path.
      if (Leaf != null)
      {
        this.m_path = new GH_Path(checked(this.m_path.Indices[0] + 1));
        //try
        {
          List<int>.Enumerator enumerator = Leaf.Nodes.GetEnumerator();
          while (enumerator.MoveNext())
          {
            int current = enumerator.Current;
            Grasshopper.Kernel.Geometry.Node2 node = this.nodes[current];
            Point3d point3d = new Point3d(node.x, node.y, 0.0);
            point3d.Transform(this.x_form);
            this.points.Add(new GH_Point(point3d), this.m_path);
          }
        }
        //finally
        {
          //List<int>.Enumerator enumerator;
          //((IDisposable) enumerator).Dispose();
        }
      }
      return 0;
    }
  }
# ---------- end c_script_8 ----------
c_script_9 = CSharpScript(VoroPoints=flatten(pt_13))  # -> out, A; inputs VoroPoints: list of Point3d, x: Double, y: Double, z: Double, u: Double; disabled
# ---------- c_script_9: C# usings ----------
using Grasshopper.Kernel.Geometry;
# ---------- c_script_9: C# ----------
    DataTree<Point3d> pointTree = new DataTree<Point3d>();
    DataTree<int> topoTree = new DataTree<int>();

    Node2List node2List = new Node2List(VoroPoints);
    Node2Tree node2Tree = node2List.CreateTree(0.0, false, 10);

    GH_Path path = new GH_Path();

    for( int i = 0; i < node2List.Count; ++i )
    {

      path = new GH_Path(i);

      //Print(node2List[i].ToString());

      Node2Proximity node2Proximity = new Node2Proximity(node2List[i], i, 10, x, y);
      node2Tree.SolveProximity(node2Proximity);
      Print(node2Proximity.CurrentCount.ToString());

      //Print(node2Proximity.MaximumCount.ToString());

      if( node2Proximity.CurrentCount != 0 )
      {

        Print("YES");

        //List<int> enu = node2Proximity.get_IndexList().GetEnumerator();

        List<int> enu = node2Proximity.IndexList;//.GetEnumerator();

        for( int j = 0; j < enu.Count; ++j )
        {

          topoTree.Add(enu[j], path);

        }

      }

    }

    A = topoTree;
# ---------- end c_script_9 ----------
c_script_10 = CSharpScript(VoroPoints=[pt_8, pt_10], z=number_slider_41)  # -> out, A, B; inputs VoroPoints: list of Point3d, x: Double, y: Double, z: Int32, u: Double; disabled
# ---------- c_script_10: C# ----------
    DataTree<GH_Curve> curveTree = new DataTree<GH_Curve>();
    DataTree<int> topoTree = new DataTree<int>();

    Grasshopper.Kernel.Geometry.Node2List node2List = new Grasshopper.Kernel.Geometry.Node2List(VoroPoints);
    Grasshopper.Kernel.Geometry.Node2Tree node2Tree = node2List.CreateTree(0.0, false, z);

    var leafAction_Outline = new LeafAction_Outline(curveTree, Plane.WorldXY);
    node2Tree.PerformAction(leafAction_Outline, false);

    DataTree<GH_Point> pointTree = new DataTree<GH_Point>();
    var leafAction_Points = new LeafAction_Points(node2List, pointTree, Plane.WorldXY);
    node2Tree.PerformAction(leafAction_Points, false);

    A = pointTree;
    B = curveTree;
# ---------- c_script_10: C# additional code ----------
  public class LeafAction_Outline : Grasshopper.Kernel.Geometry.Node2Leaf.ILeafAction
  {
    private DataTree<GH_Curve> boxes;

    private Transform x_form;

    public LeafAction_Outline(DataTree<GH_Curve> box_list, Plane plane)
    {
      this.boxes = box_list;
      this.x_form = Transform.ChangeBasis(plane, Plane.WorldXY);
    }

    public Grasshopper.Kernel.Geometry.Node2Leaf.VorLeafRecursionResult LeafAction(Grasshopper.Kernel.Geometry.Node2Leaf Leaf)
    {
      Polyline polyline = new Polyline();
      polyline.Add(Leaf.x_min, Leaf.y_min, 0.0);
      polyline.Add(Leaf.x_max, Leaf.y_min, 0.0);
      polyline.Add(Leaf.x_max, Leaf.y_max, 0.0);
      polyline.Add(Leaf.x_min, Leaf.y_max, 0.0);
      polyline.Add(Leaf.x_min, Leaf.y_min, 0.0);
      PolylineCurve polylineCurve = new PolylineCurve(polyline);
      polylineCurve.Transform(this.x_form);
      GH_Curve gH_Curve = new GH_Curve(polylineCurve);
      this.boxes.Add(gH_Curve);
      return 0;
    }
  }

  public class LeafAction_Points : Grasshopper.Kernel.Geometry.Node2Leaf.ILeafAction
  {
    private DataTree<GH_Point> points;

    private Grasshopper.Kernel.Geometry.Node2List nodes;

    private GH_Path m_path;

    private Transform x_form;

    public LeafAction_Points(Grasshopper.Kernel.Geometry.Node2List nodelist, DataTree<GH_Point> point_list, Plane plane)
    {
      this.m_path = new GH_Path(-1);
      this.nodes = nodelist;
      this.points = point_list;
      this.x_form = Transform.ChangeBasis(plane, Plane.WorldXY);
    }

    public Grasshopper.Kernel.Geometry.Node2Leaf.VorLeafRecursionResult LeafAction(Grasshopper.Kernel.Geometry.Node2Leaf Leaf)
    {
      //      var path = new GH_Path();
      //      path.
      if (Leaf != null)
      {
        this.m_path = new GH_Path(checked(this.m_path.Indices[0] + 1));
        //try
        {
          List<int>.Enumerator enumerator = Leaf.Nodes.GetEnumerator();
          while (enumerator.MoveNext())
          {
            int current = enumerator.Current;
            Grasshopper.Kernel.Geometry.Node2 node = this.nodes[current];
            Point3d point3d = new Point3d(node.x, node.y, 0.0);
            point3d.Transform(this.x_form);
            this.points.Add(new GH_Point(point3d), this.m_path);
          }
        }
        //finally
        {
          //List<int>.Enumerator enumerator;
          //((IDisposable) enumerator).Dispose();
        }
      }
      return 0;
    }
  }
# ---------- end c_script_10 ----------
lng_10 = ListLength(List=c_script_10.A)  # disabled
linetopo_3 = LineTopology(PointTree=graft(pt_13), Topology=spctopo_3)  # disabled
panel_26 = Panel(spctopo_3)  # disabled
linetopo_4 = LineTopology(PointTree=graft(pt_13), Topology=c_script_9.A)  # disabled
panel_27 = Panel(lng_10)  # disabled
voronoi_3 = Voronoi(Points=eval_2.Point, Boundary=rectangle_2.Rectangle, BruteForceOverride=False)

# ---- group: SpacePartition
toggle_6 = GroupToggle(ToggleActive=True, ToggleVisible=False)  # disabled
number_slider_79 = Slider(0.7, range=0..1)  # disabled
number_slider_80 = Slider(0.001, range=0..0.001)  # disabled
multiplication_6 = Multiplication(A=multiplication_5, B=number_slider_79)  # disabled
number_slider_81 = Slider(0, range=0..100)  # disabled
number_slider_82 = Slider(255, range=0..1000)  # disabled
dom_14 = ConstructDomain(DomainStart=number_slider_81, DomainEnd=number_slider_82)  # disabled
number_slider_83 = Slider(10, range=0..10)  # disabled
number_slider_84 = Slider(241, range=0..255)  # disabled

# ----
spacepartition = SpacePartition(VoronoiIn=crv_19, GridIn=crv_17, AreaIn=multiplication_5, Distance=multiplication_6, Tolerance=number_slider_80)

# ---- group: SpacePartition (continued)
sortxy = SortPointsXY(Grid=flatten(spacepartition))  # disabled
pararunion_2 = ParallelRegionUnion(Curves=spacepartition)  # disabled
missing = MissingGridCells(CulledGrid=flatten(sortxy), OriginalGrid=crv_17)  # disabled
mgtree = MergeTreeMissing(CulledGrid=pararunion_2, MissingGridCells=missing)  # disabled
pararunion_3 = ParallelRegionUnion(Curves=mgtree)  # disabled
parallelregionintersection_3 = ParallelRegionIntersection(CurvesA=crv, CurvesB=pararunion_3)  # disabled
lng_11 = ListLength(List=flatten(parallelregionintersection_3))  # disabled
random_2 = Random(Range=dom_14, Number=lng_11, Seed=[number_slider_37, number_slider_38, number_slider_39], Integers=True)  # disabled
bang_7 = ExplodeTree(Data=random_2)  # -> Branch0, Branch1, Branch2; disabled
rgb_4 = ColourRGB(Alpha=number_slider_83, Red=bang_7.Branch0, Green=bang_7.Branch1, Blue=bang_7.Branch2)  # disabled
rgb_5 = ColourRGB(
    Alpha=number_slider_84,
    Red=bang_7.Branch0,
    Green=[55, 209, 59, 216, 1, 112, 142, 1, 76, 111, 92, 58, 62, 60, 197, 158, 67, 19, 183, 163, 50, 202, 112, 182, 111],
    Blue=[9, 120, 163, 36, 100, 115, 248, 253, 79, 124, 119, 250, 189, 19, 44, 159, 229, 29, 128, 139, 34, 211, 22, 234, 166])  # disabled
srf_4 = Surface(parallelregionintersection_3)  # disabled
preview_4 = CustomPreview(Geometry=graft(srf_3), Material=graft(rgb_4))  # disabled

# ----
rgb_6 = ColourRGB(Alpha=number_slider_84, Red=expr("x*2", bang_7.Branch1), Green=expr("x*0.5", bang_7.Branch1), Blue=0)

# ---- group: SpacePartition (continued)
preview_5 = CustomPreview(Geometry=srf_4, Material=graft(rgb_6))  # disabled

# ---- group: CalculateThresholdOfArea
toggle_7 = GroupToggle(ToggleActive=True, ToggleVisible=False)  # disabled
area_7 = Area(Geometry=parallelregionintersection_3, UseTasks=False)  # -> simplify(flatten(Area)), simplify(Centroid); disabled
null_3 = NullItem(Item=area_7.Area)  # -> NullFlags, InvalidFlags, Description; disabled
expression_2 = Expression(x=null_3.InvalidFlags, y=area_7.Area, Expression="If( True, y, 1000 )")  # disabled
expression_3 = Expression(x=addition, y=expression_2, Expression="Abs( x - y ) * 0.1")  # disabled

# ----
c_script_11 = CSharpScript(AreaTree=area_7.Area)  # disabled
flatten_6 = FlattenTree(Tree=area_7.Area, Path="{0}")
lng_12 = ListLength(List=flatten_6)
expression_4 = Expression(x=lng_12, y=lng, Expression="If( x ≠ y, 1000, 0 )")
tag_2 = TextTag(Location=area_7.Centroid, Text=addindextolabels)

# ---- group: CalculateThresholdOfArea (continued)
ma_3 = MassAddition(Input=flatten([expression_4, expression_3]))  # -> Result, PartialResults; disabled

# ----
screentext = ScreenOrientedText(
    Text=addindextolabels,
    Font="Interstate",
    Justification=8,
    Location=area_7.Centroid,
    SizeFactor=Slider(6.961, range=0..100),
    Color=RGB(255, 255, 255),
    Depth=0,
    Absolute=False)
panel_28 = Panel(ma_3.Result)

# ---- group: TakeScreenShotIterations
toggle_8 = GroupToggle(ToggleActive=True, ToggleVisible=False)  # disabled
toggle_9 = BooleanToggle(True)  # disabled
button = Button()  # disabled
number_slider_85 = Slider(0, range=0..1)  # disabled
number_slider_86 = Slider(20, range=0..20)  # disabled
panel_29 = Panel("C:\Users\Paula\Desktop\Felipe\GenerativeFloorPlan\Images\VideoTres\")  # disabled
panel_30 = Panel("VideoTres")  # disabled
data_2 = Data(flatten([seedsx, seedsy]))  # disabled
takescreenshot = CSharpScript(
    Run=toggle_9,
    Reset=button,
    Fitness=ma_3.Result,
    Min=number_slider_85,
    Max=number_slider_86,
    GalapagosSliders=flatten(data_2),
    Path=panel_29,
    ImageName=panel_30)  # -> out; inputs Run: Boolean, Reset: Boolean, Fitness: Double, Min: Double, Max: Double, GalapagosSliders: list of Double, Path: String, ImageName: String; disabled
# ---------- takescreenshot: C# ----------
    string pather = Path + ImageName + counter.ToString();

    GH_Document ghDocument = Component.OnPingDocument();

    if(ghDocument.IsModified && Run == true )
    {

      if( Fitness >= Min && Fitness <= Max  )
      {

        Rhino.RhinoApp.RunScript("_-ScreenCaptureToFile " + pather, true);

        counter++;

      }

    }

    if(Reset == true) counter = 0;

    Print(pather);
# ---------- takescreenshot: C# additional code ----------
  int counter = 0;
# ---------- end takescreenshot ----------
panel_31 = Panel(takescreenshot)  # disabled

# ---- group: SpacePartition
toggle_10 = GroupToggle(ToggleActive=True, ToggleVisible=False)  # disabled
number_slider_87 = Slider(0.001, range=0..0.001)
multiplication_7 = Multiplication(A=multiplication_3, B=Slider(0.7, range=0..1))
dom_15 = ConstructDomain(DomainStart=Slider(0, range=0..100), DomainEnd=Slider(255, range=0..1000))
number_slider_88 = Slider(241, range=0..255)

# ----
spacepartition_2 = SpacePartition(VoronoiIn=voronoi_3, GridIn=crv_15, AreaIn=multiplication_3, Distance=multiplication_7)

# ---- group: SpacePartition (continued)
sortxy_2 = SortPointsXY(Grid=flatten(spacepartition_2))
pararunion_4 = ParallelRegionUnion(Curves=spacepartition_2)
missing_2 = MissingGridCells(CulledGrid=flatten(sortxy_2), OriginalGrid=crv_15)
mgtree_2 = MergeTreeMissing(CulledGrid=pararunion_4, MissingGridCells=missing_2)
pararunion_5 = ParallelRegionUnion(Curves=mgtree_2)
parallelregionintersection_4 = ParallelRegionIntersection(CurvesA=crv_14, CurvesB=pararunion_5)
lng_13 = ListLength(List=flatten(parallelregionintersection_4))
random_3 = Random(Range=dom_15, Number=lng_13, Seed=[number_slider_54, number_slider_55, number_slider_56], Integers=True)
bang_8 = ExplodeTree(Data=random_3)  # -> Branch0, Branch1, Branch2
srf_5 = Surface(parallelregionintersection_4)
rgb_7 = ColourRGB(Alpha=Slider(10, range=0..10), Red=bang_8.Branch0, Green=bang_8.Branch1, Blue=bang_8.Branch2)
rgb_8 = ColourRGB(
    Alpha=number_slider_88,
    Red=bang_8.Branch0,
    Green=[55, 209, 59, 216, 1, 112, 142, 1, 76, 111, 92, 58, 62, 60, 197, 158, 67, 19, 183, 163, 50, 202, 112, 182, 111],
    Blue=[9, 120, 163, 36, 100, 115, 248, 253, 79, 124, 119, 250, 189, 19, 44, 159, 229, 29, 128, 139, 34, 211, 22, 234, 166])
preview_6 = CustomPreview(Geometry=graft(voronoi_3), Material=graft(rgb_7))

# ----
lng_14 = ListLength(List=flatten(srf_5))
expression_5 = Expression(x=lng_4, y=flatten(lng_14), Expression="Abs( x - y ) * 1000")
area_8 = Area(Geometry=srf_5)  # -> Area, Centroid
dist = Distance(PointA=area_8.Centroid, PointB=end_2.Start)
sort_2 = SortList(Keys=flatten(dist), ValuesA=flatten(srf_5))  # -> Keys, ValuesA
sort_3 = SortList(Keys=flatten(dist), ValuesA=flatten(txt_11))  # -> Keys, ValuesA
area_9 = Area(Geometry=sort_2.ValuesA, UseTasks=False)  # -> Area, Centroid
split_4 = TextSplit(Text=sort_3.ValuesA, Separators=" ")
item_10 = ListItem(List=split_4, Index=0, Wrap=True)  # -> flatten(Item)
expression_6 = Expression(x=item_10, y=flatten(item_4), Expression="Abs( x - y ) * 10")  # disabled
expression_7 = Expression(x=flatten(addition_2), y=flatten(area_8.Area), Expression="Abs( x - y ) * 0.1")
ma_4 = MassAddition(Input=flatten([expression_7, expression_5, expression_6]))  # -> Result, PartialResults
bang_9 = ExplodeTree(Data=srf_5)  # -> Branch0, Branch1, Branch2, Branch3
crv_21 = Curve(bang_9.Branch1)
crv_22 = Curve(crv_21)
crv_23 = Curve(bang_9.Branch3)
bbox_2 = BoundingBox(Content=crv_22, Plane=PlaneXY(0, 0, 0))  # -> Box, Box_2
crv_24 = Curve(bang_9.Branch2)
crv_25 = Curve(crv_23)
debrep = DeconstructBrep(Brep=bbox_2.Box)  # -> Faces, Edges, Vertices
bbox_3 = BoundingBox(Content=crv_24, Plane=PlaneXY(0, 0, 0))  # -> Box, Box_2
join_3 = JoinCurves(Curves=debrep.Edges, Preserve=False)
crv_26 = Curve(join_3)
debrep_2 = DeconstructBrep(Brep=bbox_3.Box)  # -> Faces, Edges, Vertices
ptsrfdomnum_3 = SurfaceDomainNumber(Surface=crv_25, UNumber=Slider(6, range=0..100), VNumber=Slider(2, range=0..100))
join_4 = JoinCurves(Curves=debrep_2.Edges, Preserve=False)
crv_27 = Curve(join_4)
ptsrfdomnum_4 = SurfaceDomainNumber(Surface=crv_26, UNumber=Slider(8, range=0..100), VNumber=Slider(2, range=0..100))
ptborders_3 = GenerateBorders(Grid=ptsrfdomnum_3, PanelShape=0)  # -> simplify(Border)
ptsrfdomnum_5 = SurfaceDomainNumber(Surface=crv_27, UNumber=Slider(6, range=0..100), VNumber=Slider(2, range=0..100))
ptborders_4 = GenerateBorders(Grid=ptsrfdomnum_4, PanelShape=0)  # -> simplify(Border)
crv_28 = Curve(flatten(ptborders_3))
item_11 = ListItem(List=crv_28, Index=0, Wrap=True)
ptborders_5 = GenerateBorders(Grid=ptsrfdomnum_5, PanelShape=0)  # -> simplify(Border)
crv_29 = Curve(flatten(ptborders_4))
item_12 = ListItem(List=crv_29, Index=0, Wrap=True)
area_10 = Area(Geometry=item_11)  # -> Area, Centroid
area_11 = Area(Geometry=item_12)  # -> Area, Centroid
eval_4 = EvaluateCurve(Curve=reparameterize(crv_25), Parameter=secondstep)  # -> Point, Tangent, Angle
voronoi_4 = Voronoi(Points=eval_4.Point, Boundary=crv_25, BruteForceOverride=False)
multiplication_8 = Multiplication(A=area_10.Area, B=Slider(0.6, range=0..1))
crv_30 = Curve(flatten(ptborders_5))
item_13 = ListItem(List=crv_30, Index=0, Wrap=True)
eval_5 = EvaluateCurve(Curve=reparameterize(crv_26), Parameter=_4)  # -> Point, Tangent, Angle
duppt = RemoveDuplicatePts(Points=eval_5.Point, Tolerance=0.01)
voronoi_5 = Voronoi(Points=duppt, Boundary=crv_26, BruteForceOverride=False)
multiplication_9 = Multiplication(A=area_11.Area, B=Slider(0.6, range=0..1))
area_12 = Area(Geometry=item_13)  # -> Area, Centroid
eval_6 = EvaluateCurve(Curve=reparameterize(crv_27), Parameter=third)  # -> Point, Tangent, Angle
duppt_2 = RemoveDuplicatePts(Points=eval_6.Point, Tolerance=0.01)
voronoi_6 = Voronoi(Points=duppt_2, Boundary=crv_27, BruteForceOverride=False)
multiplication_10 = Multiplication(A=area_12.Area, B=Slider(0.6, range=0..1))
rgb_9 = ColourRGB(Alpha=number_slider_88, Red=expr("x*2", bang_8.Branch1), Green=expr("x*0.5", bang_8.Branch1), Blue=0)
tag_3 = TextTag(Location=area_8.Centroid, Text=addindextolabels_2)

# ---- group: SpacePartition (continued)
preview_7 = CustomPreview(Geometry=srf_5, Material=graft(rgb_9))

# ----
multiplication_11 = Multiplication(A=multiplication_8, B=Slider(0.6, range=0..10))
multiplication_12 = Multiplication(A=multiplication_9, B=Slider(0.6, range=0..1))
spacepartition_3 = SpacePartition(
    VoronoiIn=voronoi_4,
    GridIn=crv_28,
    AreaIn=multiplication_8,
    Distance=multiplication_11,
    Tolerance=Slider(0.001, range=0..0.001))
screentext_2 = ScreenOrientedText(
    Text=addindextolabels_2,
    Font="Interstate",
    Justification=8,
    Location=area_8.Centroid,
    SizeFactor=Slider(6.961, range=0..100),
    Color=RGB(255, 255, 255),
    Depth=0,
    Absolute=False)
spctopo_4 = SpaceTopology(Curves=flatten(srf_5))  # disabled
spacepartition_4 = SpacePartition(
    VoronoiIn=voronoi_5,
    GridIn=crv_29,
    AreaIn=multiplication_9,
    Distance=multiplication_12,
    Tolerance=Slider(0.001, range=0..0.001))
multiplication_13 = Multiplication(A=multiplication_10, B=Slider(0.6, range=0..1))
sortxy_3 = SortPointsXY(Grid=flatten(crv_28))
sortxy_4 = SortPointsXY(Grid=flatten(spacepartition_3))
pararunion_6 = ParallelRegionUnion(Curves=spacepartition_3)
sortxy_5 = SortPointsXY(Grid=flatten(crv_29))
sortxy_6 = SortPointsXY(Grid=flatten(spacepartition_4))
linetopo_5 = LineTopology(PointTree=area_8.Centroid, Topology=spctopo_4)  # disabled
spacepartition_5 = SpacePartition(
    VoronoiIn=voronoi_6,
    GridIn=crv_30,
    AreaIn=multiplication_10,
    Distance=multiplication_13,
    Tolerance=Slider(0.001, range=0..0.001))
missing_3 = MissingGridCells(CulledGrid=flatten(sortxy_4), OriginalGrid=sortxy_3)
pararunion_7 = ParallelRegionUnion(Curves=spacepartition_4)
sortxy_7 = SortPointsXY(Grid=flatten(crv_30))
missing_4 = MissingGridCells(CulledGrid=flatten(sortxy_6), OriginalGrid=sortxy_5)
sortxy_8 = SortPointsXY(Grid=flatten(spacepartition_5))
mgtree_3 = MergeTreeMissing(CulledGrid=pararunion_6, MissingGridCells=missing_3)
pararunion_8 = ParallelRegionUnion(Curves=spacepartition_5)
missing_5 = MissingGridCells(CulledGrid=flatten(sortxy_8), OriginalGrid=sortxy_7)
mgtree_4 = MergeTreeMissing(CulledGrid=pararunion_7, MissingGridCells=missing_4)
pararunion_9 = ParallelRegionUnion(Curves=mgtree_3)
mgtree_5 = MergeTreeMissing(CulledGrid=pararunion_8, MissingGridCells=missing_5)
c_script_12 = CSharpScript(tree=pararunion_7, list=missing_4)  # -> out, A; inputs tree: tree of Curve, list: list of Curve
# ---------- c_script_12: C# ----------
    var topoTree = new DataTree<int>();

    List<Point3d> missing = new List<Point3d>();

    double tolerance = Rhino.RhinoDoc.ActiveDoc.ModelAbsoluteTolerance;

    int missingCount = list.Count;
    int originalCount = tree.BranchCount;

    GH_Path pathOne = new GH_Path();

    int idX = 0;

    for (int i = 0; i < missingCount; ++i)
    {

      Curve temp = list[i];

      missing.Add(AreaMassProperties.Compute(temp, tolerance).Centroid);

      pathOne = new GH_Path(i);

      for (int j = 1; j < originalCount; ++j)
      {

        if (Curve.PlanarCurveCollision(temp, tree.Branch(j)[0], Plane.WorldXY, 1e-3) && j != i)
        {

          topoTree.Add(j, pathOne);

        }

      }

    }

    DataTree<Point3d> original = new DataTree<Point3d>();

    for (int i = 0; i < tree.BranchCount; ++i)
    {

      GH_Path pathGrid = tree.Path(i);

      for (int j = 0; j < tree.Branch(i).Count; ++j)
      {

        original.Add(AreaMassProperties.Compute(tree.Branch(i)[j], tolerance).Centroid, pathGrid);

      }

    }

    DataTree<KeyValuePair<double, int>> keyValuePair = new DataTree<KeyValuePair<double, int>>();
    DataTree<int> intTree = new DataTree<int>();

    List<KeyValuePair<double, int>> tempList = new List<KeyValuePair<double, int>>();

    Point3d a = new Point3d();

    GH_Path path = new GH_Path();

    A = topoTree;

    for (int i = 0; i < missing.Count; ++i)
    {

      Point3d temp = missing[i];

      path = new GH_Path(i);

      if( i < topoTree.BranchCount )
      {
        
        for (int j = 0; j < topoTree.Branch(i).Count; ++j)
        {

          idX = topoTree.Branch(i)[j];
          
          a = original.Branch(idX)[0];

          keyValuePair.Add(new KeyValuePair<double, int>(temp.DistanceTo(a), idX), path);

        }
        
      }
      
      else
      {
      
        keyValuePair.Add(new KeyValuePair<double, int>(0, idX), path);
      
      }

    }

    for (int i = 0; i < keyValuePair.BranchCount; ++i)
    {

      keyValuePair.Branch(i).Sort(Compare1);

      intTree.Add(keyValuePair.Branch(i)[0].Value, new GH_Path(i));

    }

    for (int i = 0; i < intTree.BranchCount; ++i)
    {

      int temp = intTree.Branch(i)[0];

      for (int j = 0; j < tree.BranchCount; ++j)
      {

        if (j == temp)

          tree.Branch(j).Add(list[i]);

      }

    }

    A = tree;
# ---------- c_script_12: C# additional code ----------
  static int Compare1(KeyValuePair<double, int> a, KeyValuePair<double, int> b)
  {
    return a.Key.CompareTo(b.Key);
  }
# ---------- end c_script_12 ----------
pararunion_10 = ParallelRegionUnion(Curves=mgtree_4)
parallelregionintersection_5 = ParallelRegionIntersection(CurvesA=crv_25, CurvesB=pararunion_9)
parallelregionintersection_6 = ParallelRegionIntersection(CurvesA=crv_22, CurvesB=pararunion_10)
c_script_13 = CSharpScript(tree=pararunion_8, list=missing_5)  # -> out, A; inputs tree: tree of Curve, list: list of Curve; same code as c_script_12
lng_15 = ListLength(List=flatten(pararunion_7))
pararunion_11 = ParallelRegionUnion(Curves=mgtree_5)
panel_32 = Panel(c_script_12.out)
parallelregionintersection_7 = ParallelRegionIntersection(CurvesA=crv_24, CurvesB=pararunion_11)
lng_16 = ListLength(List=flatten(pararunion_8))
panel_33 = Panel(c_script_13.out)
lng_17 = ListLength(List=flatten(parallelregionintersection_5))
lng_18 = ListLength(List=flatten(parallelregionintersection_6))
lng_19 = ListLength(List=flatten(parallelregionintersection_7))
random_4 = Random(
    Range=dom_7,
    Number=lng_17,
    Seed=[Slider(51, range=0..100), Slider(381, range=0..1000), Slider(326, range=0..1000)],
    Integers=True)
random_5 = Random(
    Range=dom_8,
    Number=lng_18,
    Seed=[Slider(48, range=0..100), Slider(261, range=0..1000), Slider(326, range=0..1000)],
    Integers=True)
srf_6 = Surface(parallelregionintersection_5)
bang_10 = ExplodeTree(Data=random_4)  # -> Branch0, Branch1, Branch2
srf_7 = Surface(parallelregionintersection_6)
random_6 = Random(
    Range=dom_9,
    Number=lng_19,
    Seed=[Slider(48, range=0..100), Slider(261, range=0..1000), Slider(326, range=0..1000)],
    Integers=True)
bang_11 = ExplodeTree(Data=random_5)  # -> Branch0, Branch1, Branch2
lng_20 = ListLength(List=flatten(srf_6))
lng_21 = ListLength(List=flatten(srf_7))
srf_8 = Surface(parallelregionintersection_7)
rgb_10 = ColourRGB(Alpha=Slider(10, range=0..10), Red=bang_10.Branch0, Green=bang_10.Branch1, Blue=bang_10.Branch2)
bang_12 = ExplodeTree(Data=random_6)  # -> Branch0, Branch1, Branch2
rgb_11 = ColourRGB(
    Alpha=number_slider_60,
    Red=bang_10.Branch0,
    Green=[55, 209, 59, 216, 1, 112, 142, 1, 76, 111, 92, 58, 62, 60, 197, 158, 67, 19, 183, 163, 50, 202, 112, 182, 111],
    Blue=[9, 120, 163, 36, 100, 115, 248, 253, 79, 124, 119, 250, 189, 19, 44, 159, 229, 29, 128, 139, 34, 211, 22, 234, 166])
null_4 = NullItem(Item=lng_21)  # -> NullFlags, InvalidFlags, Description
rgb_12 = ColourRGB(Alpha=Slider(10, range=0..10), Red=bang_11.Branch0, Green=bang_11.Branch1, Blue=bang_11.Branch2)
rgb_13 = ColourRGB(Alpha=number_slider_60, Red=expr("x*2", bang_10.Branch1), Green=expr("x*0.5", bang_10.Branch1), Blue=0)
rgb_14 = ColourRGB(
    Alpha=number_slider_61,
    Red=bang_11.Branch0,
    Green=[55, 209, 59, 216, 1, 112, 142, 1, 76, 111, 92, 58, 62, 60, 197, 158, 67, 19, 183, 163, 50, 202, 112, 182, 111],
    Blue=[9, 120, 163, 36, 100, 115, 248, 253, 79, 124, 119, 250, 189, 19, 44, 159, 229, 29, 128, 139, 34, 211, 22, 234, 166])
lng_22 = ListLength(List=flatten(srf_8))
preview_8 = CustomPreview(Geometry=srf_6, Material=graft(rgb_13))
preview_9 = CustomPreview(Geometry=graft(voronoi_4), Material=graft(rgb_10))
expression_8 = Expression(x=null_4.NullFlags, y=lng_21, Expression="If( x = True, 10000, y )")
rgb_15 = ColourRGB(Alpha=number_slider_61, Red=expr("x*2", bang_11.Branch1), Green=expr("x*0.5", bang_11.Branch1), Blue=0)
rgb_16 = ColourRGB(Alpha=Slider(10, range=0..10), Red=bang_12.Branch0, Green=bang_12.Branch1, Blue=bang_12.Branch2)
rgb_17 = ColourRGB(
    Alpha=number_slider_62,
    Red=bang_12.Branch0,
    Green=[55, 209, 59, 216, 1, 112, 142, 1, 76, 111, 92, 58, 62, 60, 197, 158, 67, 19, 183, 163, 50, 202, 112, 182, 111],
    Blue=[9, 120, 163, 36, 100, 115, 248, 253, 79, 124, 119, 250, 189, 19, 44, 159, 229, 29, 128, 139, 34, 211, 22, 234, 166])
preview_10 = CustomPreview(Geometry=srf_7, Material=graft(rgb_15))
preview_11 = CustomPreview(Geometry=graft(voronoi_5), Material=graft(rgb_12))
rgb_18 = ColourRGB(Alpha=number_slider_62, Red=expr("x*2", bang_12.Branch1), Green=expr("x*0.5", bang_12.Branch1), Blue=0)
expression_9 = Expression(x=lng_20, y=flatten(lng_6), Expression="Abs( x - y ) * 1000")
preview_12 = CustomPreview(Geometry=srf_8, Material=graft(rgb_18))
preview_13 = CustomPreview(Geometry=graft(voronoi_6), Material=graft(rgb_16))
area_13 = Area(Geometry=srf_6)  # -> Area, Centroid
tag_4 = TextTag(Location=area_13.Centroid, Text=addindextolabels_3)
screentext_3 = ScreenOrientedText(
    Text=addindextolabels_3,
    Font="Interstate",
    Justification=8,
    Location=area_13.Centroid,
    SizeFactor=Slider(6.961, range=0..100),
    Color=RGB(255, 255, 255),
    Depth=0,
    Absolute=False)
expression_10 = Expression(x=expression_8, y=flatten(lng_7), Expression="Abs( x - y ) * 1000")
expression_11 = Expression(x=flatten(bang_4.Branch3), y=flatten(area_13.Area), Expression="Abs( x - y ) * 0.1")
area_14 = Area(Geometry=srf_7)  # -> Area, Centroid
panel_34 = Panel(area_14.Area)
dist_2 = Distance(PointA=flatten(area_14.Centroid), PointB=end_3.Start)
sort_4 = SortList(Keys=flatten(dist_2), ValuesA=flatten(srf_7))  # -> Keys, ValuesA
sort_5 = SortList(Keys=flatten(dist_2), ValuesA=flatten(txt_12))  # -> Keys, ValuesA
txt_14 = Text(flatten(sort_5.ValuesA))
panel_35 = Panel(txt_14)
split_5 = TextSplit(Text=txt_14, Separators=" ")
item_14 = ListItem(List=split_5, Index=0, Wrap=True)  # -> flatten(Item)
null_5 = NullItem(Item=item_14)  # -> NullFlags, InvalidFlags, Description
expression_12 = Expression(x=null_5.NullFlags, y=item_14, Expression="If( x = True, 1000, y )")
expression_13 = Expression(x=item_6, y=flatten(expression_12), Expression="If( x ≠ y, 10, 0 )")
expression_14 = Expression(x=item_6, y=flatten(expression_12), Expression="Abs( x - y ) * 10")
area_15 = Area(Geometry=sort_4.ValuesA, UseTasks=False)  # -> Area, Centroid
panel_36 = Panel(item_14)
panel_37 = Panel(expression_13)
tag_5 = TextTag(Location=area_14.Centroid, Text=addindextolabels_4)
screentext_4 = ScreenOrientedText(
    Text=graft(addindextolabels_4),
    Font="Interstate",
    Justification=8,
    Location=area_14.Centroid,
    SizeFactor=Slider(6.961, range=0..100),
    Color=RGB(255, 255, 255),
    Depth=0,
    Absolute=False)
expression_15 = Expression(x=flatten(num_2), y=flatten(area_14.Area), Expression="Abs( x - y ) * 0.1")
expression_16 = Expression(x=lng_22, y=flatten(lng_8), Expression="Abs( x - y ) * 1000")
area_16 = Area(Geometry=srf_8)  # -> Area, Centroid
dist_3 = Distance(PointA=flatten(area_16.Centroid), PointB=end_4.Start)
sort_6 = SortList(Keys=flatten(dist_3), ValuesA=flatten(srf_8))  # -> Keys, ValuesA
sort_7 = SortList(Keys=flatten(dist_3), ValuesA=flatten(txt_13))  # -> Keys, ValuesA
txt_15 = Text(flatten(sort_7.ValuesA))
panel_38 = Panel(txt_15)
split_6 = TextSplit(Text=txt_15, Separators=" ")
item_15 = ListItem(List=split_6, Index=0, Wrap=True)  # -> flatten(Item)
null_6 = NullItem(Item=item_15)  # -> NullFlags, InvalidFlags, Description
expression_17 = Expression(x=null_6.NullFlags, y=item_15, Expression="If( x = True, 1000, y )")
expression_18 = Expression(x=item_7, y=flatten(expression_17), Expression="If( x ≠ y, 10, 0 )")
expression_19 = Expression(x=item_7, y=flatten(expression_17), Expression="Abs( x - y ) * 10")
area_17 = Area(Geometry=sort_6.ValuesA, UseTasks=False)  # -> Area, Centroid
panel_39 = Panel(item_15)
panel_40 = Panel(expression_18)
tag_6 = TextTag(Location=area_16.Centroid, Text=addindextolabels_5)
screentext_5 = ScreenOrientedText(
    Text=graft(addindextolabels_5),
    Font="Interstate",
    Justification=8,
    Location=area_16.Centroid,
    SizeFactor=Slider(6.961, range=0..100),
    Color=RGB(255, 255, 255),
    Depth=0,
    Absolute=False)
expression_20 = Expression(x=flatten(bang_4.Branch3), y=flatten(area_16.Area), Expression="Abs( x - y ) * 0.1")
ma_5 = MassAddition(Input=flatten([expression_11, expression_9]))  # -> Result, PartialResults
ma_6 = MassAddition(Input=flatten([expression_15, expression_10, expression_13]))  # -> Result, PartialResults
ma_7 = MassAddition(Input=flatten([expression_20, expression_16, expression_18]))  # -> Result, PartialResults
