# Grasshopper definition SpineExample.gh (Grasshopper 1.0.7)
# plug-ins: SpacePartition, ClipperComponents, Kangaroo2 Components, TT Toolbox

crv = Curve(<curve referenced from the Rhino model>)
skeleton = MedialAxisSkeleton(CurveIn=crv, NumberOfSamples=Slider(200, range=0..1000), ParallelComputing=Toggle(False))
dupln = RemoveDuplicateLines(Lines=skeleton, Tolerance=0.01)
inside = InsideOriginal(CurvesToCull=dupln, BoundaryCurve=crv)
cut = CutCorners(CurvesToSplit=inside)
offset = OffsetCurve(Curve=crv, Distance=Slider(-2.761, range=-10..0), Plane=PlaneXY(0, 0, 0), Corners=1)
intercull = IntersectionCulling(CurvesToCull=cut, BoundaryCurve=offset, ParallelComputing=Toggle(True))
reconstruct = ReconstructCurve(CurvesIn=intercull, Tolerance=Slider(0, range=0..1))
readxl = ReadExcelSheet(Run=Toggle(True), FilePath="C:\Users\Paula\Desktop\Felipe\Hotel\Data\Areas.xlsx", Worksheet="1", Listen=False)  # -> UserMessages, Columns, Rows
panel = Panel(readxl.Rows)
excelintotree = CSharpScript(Data=readxl.Rows)  # -> ProcessedData; inputs Data: tree of String
# ---------- excelintotree: C# ----------
    DataTree<string> processData = new DataTree<string>(), finalTree = new DataTree<string>();

    int counter = 0, sizeJ = 0, iCounter = 0, jCounter = 0;

    for( int i = 0; i < Data.BranchCount; ++i )
    {

      sizeJ = Data.Branch(i).Count;

      for( int j = 0; j < sizeJ; ++j )
      {

        if( Data.Branch(i)[j].Length == 0 )
        {

          counter++;

        }

      }

      if( counter == sizeJ - 1 )
      {

        processData.Add(Data.Branch(i)[0], new GH_Path(iCounter, 0));
        iCounter++;
        jCounter = 0;

      }

      else if( counter != sizeJ && i != 0 )
      {

        processData.AddRange(Data.Branch(i), new GH_Path(iCounter - 1, jCounter + 1));
        jCounter++;

      }

      counter = 0;

    }

    string temp;
    
    for( int i = 0; i < processData.BranchCount; ++i )
    {
    
      var path = processData.Path(i);
      
      for( int j = 0; j < processData.Branch(i).Count; ++j )
      {
      
        temp = processData.Branch(i)[j];
        
        if( temp.Length > 0 )
          
          finalTree.Add( temp, path );
      
      }
    
    }
    
    ProcessedData = finalTree;
# ---------- end excelintotree ----------
polyoffset = PolylineOffset(
    Polylines=reconstruct,
    Distance=Slider(1, range=0..1),
    Plane=Plane(origin=(0, 0, 0), x=(0, 0, 0), y=(0, 0, 0)),
    Tolerance=0.01,
    ClosedFillet=Slider(1, range=0..1),
    OpenFillet=Slider(1, range=0..1),
    Miter=2)  # -> Contour, Holes
panel_2 = Panel(excelintotree)
