# Grasshopper definition StressTest.gh (Grasshopper 1.0.7)
# plug-ins: SpacePartition

number_slider = Slider(10, range=0..10)
construct_domain = ConstructDomain(DomainStart=expr("-x", number_slider), DomainEnd=number_slider)
construct_domain_2 = ConstructDomain(DomainStart=expr("-x", number_slider), DomainEnd=number_slider)
rectangle = Rectangle(Plane=PlaneXY(0, 0, 0), XSize=construct_domain, YSize=construct_domain_2, Radius=0)  # -> Rectangle, Length
number_slider_2 = Slider(400, range=0..500)
number_slider_3 = Slider(15, range=0..100)
divide_surface = DivideSurface(Surface=rectangle.Rectangle, UCount=number_slider_2, VCount=number_slider_2)  # -> simplify(Points), Normals, Parameters
loft = Loft(
    Curves=[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],
    Options={Adjust=True, Closed=False, LoftEnds=0, LoftSimp=0, LoftType=0, Rebuild=10, Refit=0.01})
pt = Point(Point(2.669192926, 2.501355923, 4.128433815))
pt_2 = Point(Point(-2.843818193, -5.681941182, 0))  # disabled
pt_3 = Point(Point(3.092602096, 5.765526152, -0.1771829296))  # disabled
divide_surface_2 = DivideSurface(Surface=loft, UCount=number_slider_2, VCount=number_slider_2)  # -> simplify(Points), Normals, Parameters
closestptgrid = ClosestPointInGrid(Grid=divide_surface_2.Points, Point=pt_2)  # -> ClosestPointInGrid, BranchOfGrid, LeafOfGrid; disabled
closestptgrid_2 = ClosestPointInGrid(Grid=divide_surface_2.Points, Point=pt_3)  # -> ClosestPointInGrid, BranchOfGrid, LeafOfGrid; disabled
closestptgrid_3 = ClosestPointInGrid(Grid=divide_surface_2.Points, Point=pt)  # -> ClosestPointInGrid, BranchOfGrid, LeafOfGrid
series = Series(Start=expr("-x", Slider(10, range=0..10)), Step=1, Count=Slider(20, range=0..20))
pt_4 = ConstructPoint(XCoordinate=0, YCoordinate=series, ZCoordinate=0)
shortdiagonal = ShortestPathDiagonals(
    Grid=divide_surface_2.Points,
    StartPointBranch=closestptgrid_3.BranchOfGrid,
    StartPointLeaf=closestptgrid_3.LeafOfGrid,
    EndPointBranch=[closestptgrid.BranchOfGrid, closestptgrid_2.BranchOfGrid],
    EndPointLeaf=[closestptgrid.LeafOfGrid, closestptgrid_2.LeafOfGrid])  # disabled
closestptgrid_4 = ClosestPointInGrid(Grid=divide_surface_2.Points, Point=pt_4)  # -> ClosestPointInGrid, BranchOfGrid, LeafOfGrid
shortdiagonal_2 = ShortestPathDiagonals(
    Grid=divide_surface_2.Points,
    StartPointBranch=closestptgrid_3.BranchOfGrid,
    StartPointLeaf=closestptgrid_3.LeafOfGrid,
    EndPointBranch=closestptgrid_4.BranchOfGrid,
    EndPointLeaf=closestptgrid_4.LeafOfGrid)
flatten = FlattenTree(Tree=divide_surface_2.Points, Path="{0}")
pdecon = Deconstruct(Point=flatten)  # -> XComponent, YComponent, ZComponent
sort = SortList(Keys=pdecon.ZComponent, ValuesA=flatten)  # -> Keys, ValuesA
pt_5 = Point(Point(1.157931152, 2.501355923, -0.360901995))
lng = ListLength(List=sort.Keys)
item = ListItem(List=sort.ValuesA, Index=expr("x-1", lng), Wrap=True)
closestptgrid_5 = ClosestPointInGrid(Grid=divide_surface_2.Points, Point=item)  # -> ClosestPointInGrid, BranchOfGrid, LeafOfGrid
closestptgrid_6 = ClosestPointInGrid(Grid=divide_surface_2.Points, Point=pt_5)  # -> ClosestPointInGrid, BranchOfGrid, LeafOfGrid
number_slider_4 = Slider(100, range=0..100)
shortorto = ShortestPathOrthogonal(
    Grid=divide_surface_2.Points,
    StartPointBranch=closestptgrid_6.BranchOfGrid,
    StartPointLeaf=closestptgrid_6.LeafOfGrid,
    EndPointBranch=closestptgrid_5.BranchOfGrid,
    EndPointLeaf=closestptgrid_5.LeafOfGrid)
shortdiagonal_3 = ShortestPathDiagonals(
    Grid=divide_surface_2.Points,
    StartPointBranch=closestptgrid_6.BranchOfGrid,
    StartPointLeaf=closestptgrid_6.LeafOfGrid,
    EndPointBranch=closestptgrid_5.BranchOfGrid,
    EndPointLeaf=closestptgrid_5.LeafOfGrid)
