# Grasshopper definition Tags.gh (Grasshopper 1.0.7)

pt = Point(Tree({0;0}: [Point(-25.3657036, 9.882438075, 0)], {1;0}: [Point(-27.71437445, -14.80669131, 0)], {2;0}: [Point(-28.66743087, 14.47506727, 0)], {3;0}: [Point(-27.56995678, -2.137566276, 0)]))
pt_2 = Point(Tree({0;0}: [Point(-29.48524522, 14.71414205, 0)], {1;0}: [Point(-29.48629079, 16.72658399, 0)], {1;1}: [Point(-29.48399055, 12.29926091, 0)], {2;0}: [Point(-29.47777004, 8.676131793, 0)], {3;0}: [Point(-29.46998405, 10.28436734, 0)], {4;0}: [Point(-25.86598709, 16.7982141, 0)], {4;1}: [Point(-29.4663272, 11.49767006, 0)], {5;0}: [Point(-29.48738166, 18.73897333, 0)], {5;1}: [Point(-28.45270094, 13.84178285, 0)], {5;2}: [Point(-29.48566344, 15.51910243, 0)]))
txt = Text(Tree({0}: ["PrivadoUno 26.945"], {1}: ["Publico 43.651"], {2}: ["PrivadoDos 44.592"], {3}: ["SemiPrivado 100.331"]))
txt_2 = Text(Tree({0}: ["Unidades sanitarias mujeres / privadas 2.313"], {1}: ["Unidades sanitarias hombres / privadas 4.629"], {2}: ["Cuarto de aseo  2.312"], {3}: ["Área de aseo de residuos 4.63"], {4}: ["Almacen General Insumos de Aseo  4.651"], {5}: ["Área de UPC-Rack 8.273"], {6}: ["Cuarto de compresores 2.331"], {7}: ["Área de lokers funcionarios 6.947"], {8}: ["Área de lokers personal asistencial 6.192"], {9}: ["Área de bienestar de funcionarios / Cafeteria 2.314"]))
pt_3 = Point(Tree({0;0}: [Point(-25.36709287, 12.46655663, 0)], {1;0}: [Point(-25.36456832, 7.770762169, 0)]))
txt_3 = Text(Tree({0}: ["Ambiente de Esterilización  12.117"], {1}: ["Cirujias 14.828"]))
pt_4 = Point(Tree({0;0}: [Point(-29.45346808, -14.35381116, 0)], {1;0}: [Point(-30.17447739, -19.36078179, 0)], {2;0}: [Point(-25.34627357, -17.0909817, 0)], {3;0}: [Point(-25.34600414, -11.8496413, 0)], {3;1}: [Point(-25.34465777, -14.35396244, 0)], {4;0}: [Point(-28.6333225, -12.35019407, 0)], {5;0}: [Point(-28.28789818, -16.49305224, 0)]))
txt_4 = Text(Tree({0}: ["""Recepción y Control ( 2 Puestos de trabajo y
archivo) 5.402"""], {1}: ["Caja ( 1 Puestos de trabajo) 3.488"], {2}: ["Sala de espera (3 M2 por consultorio) 3.142"], {3}: ["Oficina de Dirección con baño 5.399"], {4}: ["Unidades sanitarias hombres Público (Discapacitados) 5.402"], {5}: ["Unidades sanitarias mujeres Público (Discapacitados) 9.007"], {6}: ["Toma e interpretación de Radiografías odontológicas 11.811"]))
pt_5 = Point(Tree({0;0}: [Point(-29.46877422, 2.237539533, 0)], {1;0}: [Point(-29.46243108, -9.97124891, 0)], {2;0}: [Point(-25.35420469, -9.032510124, 0)], {3;0}: [Point(-27.38302201, 4.596216115, 0)], {4;0}: [Point(-28.28824729, -6.549696496, 0)], {5;0}: [Point(-27.06974367, -1.989155747, 0)]))
txt_5 = Text(Tree({0}: ["Consultorios Odontologícos Adultos 10.814"], {1}: ["Consultorios Odontologícos Niños 5.391"], {2}: ["Entrevistas 10.824"], {3}: ["Sala de Juntas 21.995"], {4}: ["Archivo de historias clinicas 18.896"], {5}: ["Deposito de medicamentos e insumos 32.411"]))
tag = TextTag(Location=pt, Text=txt)
tag_2 = TextTag(Location=pt_2, Text=txt_2)
tag_3 = TextTag(Location=pt_3, Text=txt_3)
tag_4 = TextTag(Location=pt_4, Text=txt_4)
tag_5 = TextTag(Location=pt_5, Text=txt_5)
